# Grasshopper definition Mellow_Networkx_230117.gh (Grasshopper 1.0.7)
# plug-ins: Heteroptera, Human, Tundra, eleFront, Hops, Telepathy, Wombat, jSwan, LunchBox, treesloth01, Kangaroo2 Components, Pufferfish, Kangaroo Components, Ivy, MeshEdit Components, MetaHopper

standard_height = Slider(3, range=2..4)
floor_count = Slider(4, range=0..10)
series = Series(Start=standard_height, Step=standard_height, Count=floor_count)
ins = InsertItems(List=series, Item="0", Indices="0", Wrap=True)

yx_grid = Slider(3, range=2..6)
yx_grid_2 = Slider(3, range=2..6)
number_slider = Slider(5, range=0..10)
number_slider_2 = Slider(5, range=0..10)
multiplication = Multiplication(A=number_slider_2, B=yx_grid)
multiplication_2 = Multiplication(A=yx_grid_2, B=number_slider)
xy_size = RemoteSender(yx_grid)
vec = VectorXYZ(XComponent=yx_grid, YComponent=yx_grid_2, ZComponent=standard_height)  # -> Vector, Length
range = Range(Domain=multiplication, Steps=number_slider_2)
range_2 = Range(Domain=multiplication_2, Steps=number_slider)
grid_vector = RemoteSender(vec.Vector)

crossref = CrossReference(ListA=range, ListB=range_2, ListC=ins, CrossMode=1)  # -> ListA, ListB, ListC
lng = ListLength(List=range)
pt = ConstructPoint(XCoordinate=crossref.ListA, YCoordinate=crossref.ListB, ZCoordinate=crossref.ListC)
mindex = MemberIndex(Set=crossref.ListC, Member=ins)  # -> Index, Count
item = ListItem(List=pt, Index=mindex.Index, Wrap=True)
partition = PartitionList(List=item, Size=lng)  # -> simplify(graft(Chunks))

# ---- group: Works but very suspicious
xy_size_2 = RemoteReceiver(xy_size)
merge = Merge(Data1=xy_size_2, Data2=standard_height, Data3=standard_height)
ma = MassAddition(Input=merge)  # -> Result, PartialResults
lng_2 = ListLength(List=merge)
division = Division(A=ma.Result, B=lng_2)
sqrt = SquareRoot(Value=division)
suspicious_value = RemoteSender(sqrt)

# ----
simplexperlin = SimplexPerlin(Seed=1, Quality=2, gradient="tundraGradient")
number_slider_3 = Slider(0.05, range=0..1)
multiplication_3 = Multiplication(A=Slider(0, range=0..1), B="2*pi")
sin = Sine(Value=multiplication_3)
cos = Cosine(Value=multiplication_3)
scale = Scale(Module=simplexperlin, XScale=number_slider_3, YScale=number_slider_3, ZScale=1, gradient="tundraGradient")
translate = Translate(Module=scale, X=sin, Y=cos, Z=0, gradient="tundraGradient")

relitem = RelativeItem(Tree=partition, Offset="{0;0;1}", WrapPaths=False, WrapItems=False)  # -> ItemA, ItemB
relitem_2 = RelativeItem(Tree=partition, Offset="{0;1;0}", WrapPaths=False, WrapItems=False)  # -> ItemA, ItemB
ln = Line(StartPoint=relitem.ItemA, EndPoint=relitem.ItemB)
ln_2 = Line(StartPoint=relitem_2.ItemA, EndPoint=relitem_2.ItemB)

relitem_3 = RelativeItem(Tree=partition, Offset="{1;1;1}", WrapPaths=False, WrapItems=False)  # -> ItemA, ItemB
merge_2 = Merge(Data1=relitem_3.ItemA, Data2=relitem_3.ItemB)
box = Box2Pt(PointA=relitem_3.ItemA, PointB=relitem_3.ItemB, Plane=PlaneXY(0, 0, 0))
avr = Average(Input=merge_2)

relitem_4 = RelativeItem(Tree=partition, Offset="{1;0;0}", WrapPaths=False, WrapItems=False)  # -> ItemA, ItemB
ln_3 = Line(StartPoint=relitem_4.ItemA, EndPoint=relitem_4.ItemB)

flatten = FlattenTree(Tree=partition, Path="{0}")
item_2 = ListItem(List=flatten, Index=0, Wrap=True)  # -> Item1, Item
box_2 = Box2Pt(PointA=item_2.Item1, PointB=item_2.Item, Plane=PlaneXY(0, 0, 0))

split = SplitTree(Data=avr, Masks=flatten("{0;?;?}"))  # -> simplify(Positive), Negative
getvalue = GetValue(Module=translate, Point=flatten(split.Positive))

bnd = Bounds(Numbers=getvalue)
dom = ConstructDomain(DomainStart=Slider(2, range=0..3), DomainEnd=floor_count)
remap = RemapNumbers(Value=getvalue, Source=bnd, Target=dom)  # -> Mapped, Clipped
round = Round(Number=remap.Mapped)  # -> graft(Nearest), Floor, Ceiling
unflatten = UnflattenTree(Tree=round.Nearest, Guide=split.Positive)

geo = Geometry([<brep referenced from the Rhino model> x100])
volume = Volume(Geometry=geo)  # -> Volume, Centroid
sort_pt = SortPoints(Points=volume.Centroid)  # -> Points, Indices
pdecon = Deconstruct(Point=sort_pt.Points)  # -> XComponent, YComponent, ZComponent
item_3 = ListItem(List=geo, Index=sort_pt.Indices, Wrap=True)
entwine = Entwine(Branch00=pdecon.XComponent, Branch01=pdecon.YComponent, Branch02=pdecon.ZComponent, FlattenInputs=True)

series_2 = Series(Start=0, Step=1, Count=unflatten)  # -> simplify(Series)
clean = CleanTree(RemoveNulls=True, RemoveInvalid=True, RemoveEmpty=invert(False), Tree=series_2)
tstat = TreeStatistics(Tree=clean)  # -> Paths, Length, Count
branch = TreeBranch(Tree=split.Positive, Path=tstat.Paths, MaintainPaths=True)
tstat_2 = TreeStatistics(Tree=branch)  # -> Paths, Length, Count
lng_3 = ListLength(List=clean)
unflatten_2 = UnflattenTree(Tree=tstat_2.Paths, Guide=branch)
dup = DuplicateData(Data=unflatten_2, Number=lng_3, Order=True)
pshift = ShiftPaths(Data=dup, Offset=-1)
clean_2 = CleanTree(RemoveNulls=True, RemoveInvalid=True, RemoveEmpty=invert(False), Tree=pshift)
tstat_3 = TreeStatistics(Tree=clean_2)  # -> Paths, Length, Count
branch_2 = TreeBranch(Tree=clean, Path=tstat_3.Paths, MaintainPaths=True)  # -> simplify(graft(Branch))
dpath = DeconstructPath(Branch=clean_2)  # -> simplify(Indices)
ins_2 = InsertItems(List=dpath, Item=branch_2, Indices="0", Wrap=True)
path = ConstructPath(Indices=ins_2)
split_2 = SplitTree(Data=box, Masks=flatten(path))  # -> Positive, Negative
split_3 = SplitTree(Data=avr, Masks=flatten(path))  # -> Positive, Negative
reduced_centers = RemoteSender(split_3.Positive)
reduced_cells = RemoteSender(split_2.Positive)

cset = CreateSet(List=entwine)  # -> Set, Map
sort = SortList(Keys=cset.Set)  # -> Keys, ValuesA
lng_4 = ListLength(List=cset.Set)
bang = ExplodeTree(Data=sort.Keys)  # -> Branch0, Branch1, Branch2
series_3 = Series(Start=0, Step=1, Count=lng_4)  # -> simplify(Series)
crossref_2 = CrossReference(ListA=bang.Branch0, ListB=bang.Branch1, ListC=bang.Branch2, CrossMode=1)  # -> ListA, ListB, ListC
pdecon_2 = Deconstruct(Point=sort_pt.Points)  # -> XComponent, YComponent, ZComponent
pt_2 = ConstructPoint(XCoordinate=pdecon_2.XComponent, YCoordinate=pdecon_2.YComponent, ZCoordinate=pdecon_2.ZComponent)
bnd_2 = Bounds(Numbers=series_3)
pdecon_3 = Deconstruct(Point=volume.Centroid)  # -> XComponent, YComponent, ZComponent
entwine_2 = Entwine(Branch00=crossref_2.ListA, Branch01=crossref_2.ListB, Branch02=crossref_2.ListC, FlattenInputs=True)
pt_3 = ConstructPoint(XCoordinate=crossref_2.ListA, YCoordinate=crossref_2.ListB, ZCoordinate=crossref_2.ListC)
bnd_3 = Bounds(Numbers=sort.Keys)
entwine_3 = Entwine(Branch00=pdecon_3.XComponent, Branch01=pdecon_3.YComponent, Branch02=pdecon_3.ZComponent, FlattenInputs=True)
remap_2 = RemapNumbers(Value=entwine_2, Source=bnd_3, Target=bnd_2)  # -> Mapped, Clipped
cset_2 = CreateSet(List=pdecon_3.XComponent)  # -> Set, Map
mindex_2 = MemberIndex(Set=pt_3, Member=pt_2)  # -> Index, Count
flip = FlipMatrix(Data=remap_2.Mapped)
mindex_3 = MemberIndex(Set=pdecon_3.XComponent, Member=cset_2.Set)  # -> simplify(Index), Count
path_2 = ConstructPath(Indices=flip)  # -> flatten(Branch)
item_4 = ListItem(List=path_2, Index=mindex_2.Index, Wrap=True)  # -> flatten(Item)
panel = Panel(mindex_3.Index)

munion = MeshUnion(Meshes=flatten(reduced_cells))
mshedge = MeshEdgesWithTolerance(Mesh=munion, AngleThreshold=45)  # -> InteriorEdges, NakedEdges
previewlw = CustomPreviewLineweights(Geometry=mshedge.InteriorEdges, Shader=ColourSwatch(SwatchColor=RGB(0, 0, 0)), Absolute=False)

merge_3 = Merge(Data1=Slider(0, range=0..4), Data2=Slider(0, range=0..4), Data3=Slider(0, range=0..3))
tag = TextTag(Location=pt_3, Text=path_2, Colour=ColourSwatch(SwatchColor=RGB(0, 0, 0)))
tag_2 = TextTag(Location=pt_2, Text=item_4, Colour=ColourSwatch(SwatchColor=RGB(0, 0, 0)))
tree = CreateTree(Data=item_3, Path=item_4)
path_3 = ConstructPath(Indices=merge_3)
branch_3 = TreeBranch(Tree=tree, Path=path_3, MaintainPaths=True)

reduced_centers_2 = RemoteReceiver(reduced_centers)
relitem_5 = RelativeItem(Tree=reduced_centers_2, Offset="{1;0;0}", WrapPaths=False, WrapItems=False)  # -> ItemA, ItemB
relitem_6 = RelativeItem(Tree=reduced_centers_2, Offset="{0;0;1}", WrapPaths=False, WrapItems=False)  # -> ItemA, ItemB
relitem_7 = RelativeItem(Tree=reduced_centers_2, Offset="{0;1;0}", WrapPaths=False, WrapItems=False)  # -> ItemA, ItemB
ln_4 = Line(StartPoint=relitem_5.ItemA, EndPoint=relitem_5.ItemB)
ln_5 = Line(StartPoint=relitem_6.ItemA, EndPoint=relitem_6.ItemB)
ln_6 = Line(StartPoint=relitem_7.ItemA, EndPoint=relitem_7.ItemB)

suspicious_value_2 = RemoteReceiver(suspicious_value)

relay = Relay([ln_5, ln_6])
previewlw_2 = CustomPreviewLineweights(Geometry=relay, Shader=ColourSwatch(SwatchColor=RGB(255, 0, 0)), Thickness=Slider(6, range=0..10), Absolute=False)
previewlw_3 = CustomPreviewLineweights(Geometry=ln_4, Shader=ColourSwatch(SwatchColor=RGB(0, 17, 255)), Thickness=Slider(6, range=0..10), Absolute=False)

merge_4 = Merge(Data1=ln_4, Data2=ln_6, Data3=ln_5)  # -> flatten(Result)
l_net = NetworkFromLines(Lines=flatten(merge_4))  # -> simplify(PointPointTopology), simplify(ConnectionPointTopology), flatten(Points), flatten(Lines)
connexion_lines = RemoteSender(l_net.Lines)

connexion_indexes = RemoteSender(l_net.ConnectionPointTopology)
adjacency_tree = RemoteSender(l_net.PointPointTopology)
node_points = RemoteSender(l_net.Points)

reduced_cells_2 = RemoteReceiver(reduced_cells)
edges = BrepEdges(Brep=reduced_cells_2)  # -> Naked, Interior, NonManifold
node_points_2 = RemoteReceiver(node_points)
points = PointList(Points=node_points_2, Size=".8")
previewlw_4 = CustomPreviewLineweights(Geometry=edges.Interior, Shader=ColourSwatch(SwatchColor=RGB(196, 196, 196)), Absolute=False)

connexion_lines_2 = RemoteReceiver(connexion_lines)
flip_2 = FlipCurve(Curve=connexion_lines_2)  # -> Curve, Flag
merge_5 = Merge(Data1=flatten(connexion_lines_2), Data2=flatten(flip_2.Curve))
connexion_lines_bidirectional = RemoteSender(merge_5)

connexion_indexes_2 = RemoteReceiver(connexion_indexes)
tstat_4 = TreeStatistics(Tree=connexion_indexes_2)  # -> Paths, Length, Count
rev = ReverseList(List=connexion_indexes_2)
dpath_2 = DeconstructPath(Branch=tstat_4.Paths)  # -> flatten(Indices)
item_5 = ListItem(List=reverse(dpath_2), Index=0, Wrap=True)
addition = Addition(A=dpath_2, B="1", C=item_5)  # -> graft(Result)
path_4 = ConstructPath(Indices=addition)
dup_2 = DuplicateData(Data=path_4, Number=2, Order=True)
tree_2 = CreateTree(Data=rev, Path=dup_2)
merge_6 = Merge(Data1=simplify(connexion_indexes_2), Data2=simplify(tree_2))
connexion_indexes_bidirectional = RemoteSender(merge_6)

# ---- group: ordering the center points and celles based on heteroptera point node order
reduced_centers_3 = RemoteReceiver(reduced_centers)
node_points_3 = RemoteReceiver(node_points)
reduced_cells_3 = RemoteReceiver(reduced_cells)
mindex_4 = MemberIndex(Set=flatten(reduced_centers_3), Member=node_points_3)  # -> Index, Count
flatten_2 = FlattenTree(Tree=mindex_4.Index, Path="{0}")
item_6 = ListItem(List=flatten(reduced_cells_3), Index=mindex_4.Index, Wrap=True)
item_7 = ListItem(List=flatten(reduced_centers_3), Index=flatten_2, Wrap=True)
centers_ordered = RemoteSender(item_7)
cells_ordered = RemoteSender(item_6)
ordering_idx = RemoteSender(flatten_2)

# ----
xy_size_3 = RemoteReceiver(xy_size)
multiplication_4 = Multiplication(A=Slider(2, range=0..4), B=xy_size_3)
multiplication_5 = Multiplication(A=Slider(1, range=0..4), B=xy_size_3)
Y = UnitY(Factor=multiplication_4)
Z = UnitZ(Factor=multiplication_5)
addition_2 = Addition(A=Y, B=Z)
crv = Curve(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)
move = Move(Geometry=crv, Motion=addition_2)  # -> Geometry, Transform

dpipeline = DynamicGeometryPipeline(
    LayerFilter="Default",
    TypeFilter="curve",
    NameFilter="*",
    GroupByLayer=False,
    GroupByType=False,
    IncludeHidden=True,
    IncludeLocked=True,
    enableFullPath=True,
    listenToAttributes=True)
circulation_curves = RemoteSender(dpipeline)

reduced_cells_4 = RemoteReceiver(reduced_cells)
node_points_4 = RemoteReceiver(node_points)
circulation_curves_2 = RemoteReceiver(circulation_curves)
xy_size_4 = RemoteReceiver(xy_size)
crv_cp = CurveClosestPoint(Point=node_points_4, Curve=graft(circulation_curves_2))  # -> Point, Parameter, Distance
lng_5 = ListLength(List=circulation_curves_2)
lng_6 = ListLength(List=node_points_4)
division_2 = Division(A=xy_size_4, B="2")
dup_3 = DuplicateData(Data=node_points_4, Number=lng_5, Order=True)
smaller = SmallerThan(FirstNumber=crv_cp.Distance, SecondNumber=division_2)  # -> SmallerThan, OrEqualTo
partition_2 = PartitionList(List=dup_3, Size=lng_6)
cull = CullPattern(List=partition_2, CullPattern=smaller.SmallerThan)  # -> simplify(List)

# ---- group: terasses?
north_east_south_west = Panel("""{-1;1;0}
{-1;0;1}
{-1;-1;0}
{-1;0;-1}""")
reduced_centers_4 = RemoteReceiver(reduced_centers)
ordering_idx_2 = RemoteReceiver(ordering_idx)
tstat_5 = TreeStatistics(Tree=simplify(reduced_centers_4))  # -> Paths, Length, Count
python = GhPythonScript(D=north_east_south_west, O="{1;0;0}")  # -> simplify(P), simplify(B); inputs D: list, S: list, O: list
# ---------- python: Python ----------
"""Provides a scripting component.
    Inputs:
        D: Paths to offset
        S: (optional) Path to test for inclusion. If None, paths in D
        O: Offsets
    Output:
        P: New paths"""

__author__ = "Antoine Maes"
__version__ = "2022.05.10"

import Grasshopper.DataTree as ghdt
from ghpythonlib import treehelpers as th

def path_to_list(paths_list):
    list_paths_list = []
    for path in paths_list:
        temp_element = str(path)[1:-1]
        list_paths_list.append(temp_element.split(";"))
        
    return [[int(i) for i in j] for j in list_paths_list]


def offset_paths(list_of_path_as_list, offsets):

    off_nested_list = path_to_list(offsets)

    super_path = []
    for path in list_of_path_as_list:
        for offset in off_nested_list:
            new_path = []
            for int_idx in range(len(offset)):
                new_path.append(path[int_idx] + offset[int_idx])
                if len(new_path) == len(off_nested_list[0]):
                    super_path.append(new_path)
    return super_path


def list_to_paths(paths_as_list):
    paths = []
    for path in paths_as_list:
        paths.append("{" + ";".join([str(i) for i in path]) + "}")
    return paths


def reorder_path_list(list_to_reorder, offset_count):
    ordered = [[] for _ in range(offset_count)]

    for list_idx in range(len(list_to_reorder)):
        ordered[list_idx % offset_count].append(list_to_reorder[list_idx])
        
    return ordered


def bool_inclusion(new_paths, old_paths):
    bool_list = [[] for _ in new_paths]
    for path_list_idx in range(len(new_paths)):
        for path in new_paths[path_list_idx]:
            if path in [str(i) for i in old_paths]:
                bool_list[path_list_idx].append(True)
            else:
                bool_list[path_list_idx].append(False)
    return bool_list


if len(S) > 0:
    D = [str(i) for i in S]
else:
    D = [str(i) for i in D]


list_of_path_list = path_to_list(D)
offseted_path_list = offset_paths(list_of_path_list, O)

one_list_paths = list_to_paths(offseted_path_list)
ordered_list_paths = reorder_path_list(one_list_paths, len(O))

bools = bool_inclusion(ordered_list_paths, D)

B = th.list_to_tree(bools)
P = th.list_to_tree(ordered_list_paths)
# ---------- end python ----------
item_8 = ListItem(List=tstat_5.Paths, Index=ordering_idx_2, Wrap=True)
python_2 = GhPythonScript(D=item_8, O=north_east_south_west)  # -> simplify(P), simplify(B); inputs D: list, S: list, O: list; same code as python
python_3 = GhPythonScript(D=item_8, O=python.P)  # -> simplify(P), simplify(B); inputs D: list, S: list, O: list; same code as python
not = GateNot(A=python_3.B)
and = GateAnd(A=python_2.B, B=not)  # -> simplify(Result)

# ----
clean_3 = CleanTree(RemoveNulls=True, RemoveInvalid=True, RemoveEmpty=invert(False), Tree=cull)

# ---- group: get general direction of the edge
connexion_lines_bidirectional_2 = RemoteReceiver(connexion_lines_bidirectional)
devec = DeconstructVector(Vector=connexion_lines_bidirectional_2)  # -> XComponent, YComponent, ZComponent
devec_2 = DeconstructVector(Vector=connexion_lines_bidirectional_2)  # -> XComponent, YComponent, ZComponent
devec_3 = DeconstructVector(Vector=connexion_lines_bidirectional_2)  # -> XComponent, YComponent, ZComponent
abs = Absolute(Value=devec.XComponent)
abs_2 = Absolute(Value=devec_2.YComponent)
abs_3 = Absolute(Value=devec_3.ZComponent)
larger = LargerThan(FirstNumber=abs, SecondNumber="0")  # -> LargerThan, OrEqualTo
larger_2 = LargerThan(FirstNumber=abs_2, SecondNumber="0")  # -> LargerThan, OrEqualTo
larger_3 = LargerThan(FirstNumber=abs_3, SecondNumber="0")  # -> LargerThan, OrEqualTo
cull_2 = CullPattern(List=devec.XComponent, CullPattern=larger.LargerThan)
cull_3 = CullPattern(List=devec_2.YComponent, CullPattern=larger_2.LargerThan)
cull_4 = CullPattern(List=devec_3.ZComponent, CullPattern=larger_3.LargerThan)
clean_4 = CleanTree(RemoveNulls=True, RemoveInvalid=True, RemoveEmpty=invert(False), Tree=cull_2)  # -> simplify(Tree)
clean_5 = CleanTree(RemoveNulls=True, RemoveInvalid=True, RemoveEmpty=invert(False), Tree=cull_3)  # -> simplify(Tree)
clean_6 = CleanTree(RemoveNulls=True, RemoveInvalid=True, RemoveEmpty=invert(False), Tree=cull_4)  # -> simplify(Tree)

# ---- group: build tree branch attributes
reduced_centers_5 = RemoteReceiver(reduced_centers)
ordering_idx_3 = RemoteReceiver(ordering_idx)
tstat_6 = TreeStatistics(Tree=reduced_centers_5)  # -> Paths, Length, Count
item_9 = ListItem(List=tstat_6.Paths, Index=ordering_idx_3, Wrap=True)
dpath_3 = DeconstructPath(Branch=item_9)
flip_3 = FlipMatrix(Data=dpath_3)

# ----
connexion_lines_bidirectional_3 = RemoteReceiver(connexion_lines_bidirectional)
eval = EvaluateCurve(Curve=reparameterize(graft(connexion_lines_bidirectional_3)), Parameter=".5")  # -> Point, Tangent, Angle
devec_4 = DeconstructVector(Vector=eval.Tangent)  # -> XComponent, YComponent, simplify(ZComponent)
abs_4 = Absolute(Value=devec_4.ZComponent)
smaller_2 = SmallerThan(FirstNumber=abs_4, SecondNumber=".5")  # -> simplify(SmallerThan), OrEqualTo
larger_4 = LargerThan(FirstNumber=devec_4.ZComponent, SecondNumber="0")  # -> LargerThan, OrEqualTo
smaller_3 = SmallerThan(FirstNumber=devec_4.ZComponent, SecondNumber="0")  # -> SmallerThan, OrEqualTo
att_is_horizontal = RemoteSender(smaller_2.SmallerThan)
attr_goes_down = RemoteSender(smaller_3.SmallerThan)
attr_goes_up = RemoteSender(larger_4.LargerThan)

# ---- group: terasses?
branch_4 = TreeBranch(Tree=and, Path=Slider(1, range=0..3), MaintainPaths=True)
tag_3 = TextTag(Location=reduced_centers_4, Text=graft(branch_4), Colour=ColourSwatch(SwatchColor=RGB(0, 0, 0)))

# ---- group: get general direction of the edge
long = LongestList(ListA=clean_4, ListB="East-West", PaddingMode=2)  # -> ListA, ListB
long_2 = LongestList(ListA=clean_5, ListB="North-South", PaddingMode=2)  # -> ListA, ListB
long_3 = LongestList(ListA=clean_6, ListB="Up-Down", PaddingMode=2)  # -> ListA, ListB
merge_7 = Merge(Data1=long.ListB, Data2=long_2.ListB, Data3=long_3.ListB)  # -> simplify(graft(Result))
attr_direction = RemoteSender(merge_7)

# ----
attr_window_count = RemoteReceiver()
attr_direction_2 = RemoteReceiver(attr_direction)
attr_goes_down_2 = RemoteReceiver(attr_goes_down)
attr_goes_up_2 = RemoteReceiver(attr_goes_up)
att_is_horizontal_2 = RemoteReceiver(att_is_horizontal)
edge_attr_labels = Panel("""goes_up
goes_down
is_horizontal""")
merge_8 = Merge(Data1=simplify(attr_goes_up_2), Data2=attr_goes_down_2, Data3=simplify(att_is_horizontal_2))  # -> simplify(Result)
edge_attributes_values = RemoteSender(merge_8)
edge_attribute_keys = RemoteSender(edge_attr_labels)

node_attr_labels = Panel("""has_window
window_count
has_terrace_North
has_terrace_East
has_terrace_South
has_terrace_West
branch_A
branch_B
branch_C""")
node_attribute_keys = RemoteSender(node_attr_labels)

cells_ordered_2 = RemoteReceiver(cells_ordered)
max_targets = Slider(10, range=-1..25)
max_paths = Slider(10, range=-1..25)
ratio = Slider(0.3, range=0..1)
ratio_2 = Slider(0.7, range=0..1)
concat = Concatenate(FragmentA="http://127.0.0.1:5000/", FragmentB="generation_settings")
concat_2 = Concatenate(FragmentA="http://127.0.0.1:5000/", FragmentB="ranking_settings")
hops = Hops(
    _Path=concat_2,
    Compacity=Slider(0.3, range=0..1),
    Circulation=Slider(0.6, range=0..1),
    Windows=Slider(0, range=0..1),
    CacheResultsInMemory=False,
    CacheSolveResults=False,
    RemoteDefinitionLocation="http://127.0.0.1:5000/ranking_settings",
    RemoteSolveVersion=(0, 1, 0),
    ShowInput_Enabled=False,
    ShowInput_Path=True,
    SynchronousSolve=True)
hops_2 = Hops(
    _Path=concat,
    MaxTargets=max_targets,
    MaxPaths=max_paths,
    Fill=Toggle(True),
    FastCirculation=Toggle(True),
    CacheResultsInMemory=False,
    CacheSolveResults=False,
    RemoteDefinitionLocation="http://127.0.0.1:5000/generation_settings",
    RemoteSolveVersion=(0, 1, 0),
    ShowInput_Enabled=False,
    ShowInput_Path=True,
    SynchronousSolve=True)
rejson = SerializeJson(_4=ratio, _8=ratio_2, IncludeNullAndEmptyProperties=False)
python_4 = GhPythonScript()  # -> out, a
# ---------- python_4: Python ----------
__author__ = "Antoine"
__version__ = "2022.12.06"

def hello(message):
    print("hello " + message)

def question(message):
    print(message + " !")

function_dict = {
    hello:["world"],
    question:["ah"]
}

for key, values in function_dict.items():
    key(*values)
# ---------- end python_4 ----------
panel_2 = Panel(python_4.out)
concat_3 = Concatenate(FragmentA="http://127.0.0.1:5000/", FragmentB="generate_v3")
panel_3 = Panel(hops)
cells_ordered_3 = RemoteReceiver(cells_ordered)
centers_ordered_2 = RemoteReceiver(centers_ordered)
scale_2 = Scale(Geometry=cells_ordered_3, Center=graft(centers_ordered_2), Factor=".9")  # -> Geometry, Transform
desired_proportions = Panel(rejson)
edges_2 = BrepEdges(Brep=scale_2.Geometry)  # -> Naked, Interior, NonManifold

dejson = DeserializeJson(OutputsLocked=False)  # -> Directed, Multigraph, Graph, Nodes, Edges
dejsonkv = DeserializeKeysAndValues(Keys=Slider(4, range=0..9))  # -> Key, Value
dejson_2 = DeserializeJson(JSON=dejson.Edges, OutputsLocked=False)  # -> Goes_up, Goes_down, Is_horizontal, From, To

concat_4 = Concatenate(FragmentA="http://127.0.0.1:5000/", FragmentB="explode_graph")
panel_4 = Panel("""branch_A
branch_B
branch_C""")
concat_5 = Concatenate(FragmentA="http://127.0.0.1:5000/", FragmentB="read_nodes_attr_value")
pt_4 = Point(Point(12.89365895, 4.280026587, 1.179514757))
dim_apart_slab_strct = Slider(0.15, range=0.05..0.5)
dim_interior_wall = Slider(0.11, range=0.03..0.2)
dim_interior_finish_wall = Slider(0.03, range=0.03..0.1)
dim_column_width = Slider(0.25, range=0.2..0.5)
dim_exterior_finish_wall = Slider(0.03, range=0.03..0.1)
dim_beam_height = Slider(0.33, range=0.2..0.5)
dim_beam_width = Slider(0.13, range=0.1..0.3)

dim_ongroud_foundations = Slider(0.35, range=0.05..0.5)
dim_insulation_air_slab = Slider(0.2, range=0.05..0.5)
dim_insulation_ground = Slider(0.2, range=0.05..0.5)
dim_insulation_roof = Slider(0.18, range=0.05..0.5)
dim_accoustic_slab = Slider(0.03, range=0.03..0.1)
dim_greenery_roof = Slider(0.1, range=0.05..0.5)
dim_interior_floor = Slider(0.07, range=0.05..0.5)
dim_apart_ceiling = Slider(0.05, range=0.05..0.5)
dim_exterior_insulation_wall = Slider(0.3, range=0.1..0.4)
dim_outside_slab = Slider(0.25, range=0.05..0.5)
min = Minimum(A=dim_column_width, B=dim_beam_width)
color_apartment_slab_strct = RemoteSender(ColourSwatch(SwatchColor=RGB(255, 61, 61)))
dim_ongroud_foundations_2 = RemoteSender(dim_ongroud_foundations)
color_circulation_ceiling = RemoteSender(ColourSwatch(SwatchColor=RGB(0, 30, 255)))
color_apartment_ceiling = RemoteSender(ColourSwatch(SwatchColor=RGB(54, 127, 255)))
dim_insulation_air_slab_2 = RemoteSender(dim_insulation_air_slab)
dim_insulation_ground_2 = RemoteSender(dim_insulation_ground)
color_circulation_floor = RemoteSender(ColourSwatch(SwatchColor=RGB(255, 255, 255)))
color_apartment_floor = RemoteSender(ColourSwatch(SwatchColor=RGB(255, 145, 145)))
color_circulation_wall = RemoteSender(ColourSwatch(SwatchColor=RGB(255, 255, 255)))
color_accoustic_panel = RemoteSender(ColourSwatch(SwatchColor=RGB(255, 225, 0)))
color_apartment_wall = RemoteSender(ColourSwatch(SwatchColor=RGB(255, 122, 122)))
color_exterior_finish_wall = RemoteSender(ColourSwatch(SwatchColor=RGB(255, 255, 255)))
dim_exterior_insulation_wall_2 = RemoteSender(dim_exterior_insulation_wall)
dim_insulation_roof_2 = RemoteSender(dim_insulation_roof)
dim_interior_finish_wall_2 = RemoteSender(dim_interior_finish_wall)
dim_greenery_roof_2 = RemoteSender(dim_greenery_roof)
dim_accoustic_slab_2 = RemoteSender(dim_accoustic_slab)
dim_interior_floor_2 = RemoteSender(dim_interior_floor)
dim_apart_ceiling_2 = RemoteSender(dim_apart_ceiling)
dim_outside_slab_2 = RemoteSender(dim_outside_slab)
beam_width = RemoteSender(min)
column_width = RemoteSender(dim_column_width)
beam_height = RemoteSender(dim_beam_height)

beam_width_2 = RemoteReceiver(beam_width)
beam_width_3 = RemoteReceiver(beam_width)
beam_height_2 = RemoteReceiver(beam_height)

# ---- group: lower_beam_to_floor_level
beam_height_3 = RemoteReceiver(beam_height)
neg = Negative(Value=beam_height_3)

# ----
dim_accoustic_slab_3 = RemoteReceiver(dim_accoustic_slab_2)
dim_interior_floor_3 = RemoteReceiver(dim_interior_floor_2)
addition_3 = Addition(A=dim_accoustic_slab_3, B=dim_interior_floor_3)
neg_2 = Negative(Value=addition_3)
division_3 = Division(A=neg, B="2")
addition_4 = Addition(A=division_3, B=neg_2)
Z_2 = UnitZ(Factor=addition_4)
dim_frame_width = Slider(0.09, range=0.03..0.1)
dim_frame_thickness = Slider(0.07, range=0.05..0.1)
null = NullObject()
color_apartment_interior_finish_wall = RemoteSender(ColourSwatch(SwatchColor=RGB(0, 255, 174)))
color_apartment_exterior_finish_wall = RemoteSender(ColourSwatch(SwatchColor=RGB(0, 47, 255)))
color_circulation_finish_wall = RemoteSender(ColourSwatch(SwatchColor=RGB(105, 105, 105)))
dim_frame_width_2 = RemoteSender(dim_frame_width)
color_exterior_finish_slab = RemoteSender(ColourSwatch(SwatchColor=RGB(102, 102, 102)))
dim_apart_slab_strct_2 = RemoteSender(dim_apart_slab_strct)
dim_exterior_finish_wall_2 = RemoteSender(dim_exterior_finish_wall)
dim_frame_thickness_2 = RemoteSender(dim_frame_thickness)
dim_interior_wall_2 = RemoteSender(dim_interior_wall)
color_onground = RemoteSender(ColourSwatch(SwatchColor=RGB(51, 51, 51)))
color_insulation = RemoteSender(ColourSwatch(SwatchColor=RGB(247, 255, 0)))
color_air_layer = RemoteSender(null)
color_greenery = RemoteSender(ColourSwatch(SwatchColor=RGB(153, 186, 74)))
beam_width_4 = Panel(min)

# ---- group: Set the accoustic panel as a dynamic layer. Set minimum value in panel
column_width_2 = RemoteReceiver(column_width)
dim_interior_wall_3 = RemoteReceiver(dim_interior_wall_2)
multiplication_6 = Multiplication(A=dim_interior_wall_3, B="2")
minimum_thickness = Panel(".03")
ma_2 = MassAddition(Input=multiplication_6)  # -> Result, PartialResults
subtraction = Subtraction(A=column_width_2, B=ma_2.Result)
max = Maximum(A=subtraction, B=minimum_thickness)
dim_accoustic_wall = RemoteSender(max)

# ----
grid_vector_2 = RemoteReceiver(grid_vector)
devec_5 = DeconstructVector(Vector=grid_vector_2)  # -> XComponent, YComponent, ZComponent
merge_9 = Merge(Data1=devec_5.XComponent, Data2=devec_5.YComponent)  # -> flatten(Result)

dim_interior_finish_wall_3 = RemoteReceiver(dim_interior_finish_wall_2)
dim_accoustic_wall_2 = RemoteReceiver(dim_accoustic_wall)
dim_interior_wall_4 = RemoteReceiver(dim_interior_wall_2)
merge_10 = Merge(Data1=dim_accoustic_wall_2, Data2=dim_interior_wall_4, Data3=dim_interior_finish_wall_3)
division_4 = Division(A=merge_10, B="2")
relitem_8 = RelativeItem(Tree=simplify(graft(division_4)), Offset="{1}", WrapPaths=False, WrapItems=False)  # -> ItemA, ItemB
addition_5 = Addition(A=relitem_8.ItemA, B=relitem_8.ItemB)  # -> flatten(Result)
ma_3 = MassAddition(Input=addition_5)  # -> Result, PartialResults

dim_interior_finish_wall_4 = RemoteReceiver(dim_interior_finish_wall_2)
dim_accoustic_wall_3 = RemoteReceiver(dim_accoustic_wall)
dim_interior_wall_5 = RemoteReceiver(dim_interior_wall_2)
merge_11 = Merge(Data1=dim_accoustic_wall_3, Data2=dim_interior_wall_5, Data3=dim_interior_finish_wall_4)
division_5 = Division(A=merge_11, B="2")
relitem_9 = RelativeItem(Tree=simplify(graft(division_5)), Offset="{1}", WrapPaths=False, WrapItems=False)  # -> ItemA, ItemB
addition_6 = Addition(A=relitem_9.ItemA, B=relitem_9.ItemB)  # -> flatten(Result)
ma_4 = MassAddition(Input=addition_6)  # -> Result, PartialResults

pshift_2 = ShiftPaths(Offset=-1)  # -> simplify(Data)

dim_apart_slab_strct_3 = RemoteReceiver(dim_apart_slab_strct_2)
dim_apart_ceiling_3 = RemoteReceiver(dim_apart_ceiling_2)
beam_height_4 = RemoteReceiver(beam_height)
merge_12 = Merge(Data1=dim_apart_slab_strct_3, Data2=dim_apart_ceiling_3)
ma_5 = MassAddition(Input=merge_12)  # -> Result, PartialResults
minimum_thickness_2 = Panel("0")
subtraction_2 = Subtraction(A=beam_height_4, B=ma_5.Result)
max_2 = Maximum(A=subtraction_2, B=minimum_thickness_2)
dim_air_layer = RemoteSender(max_2)

panel_5 = Panel("1")
dim_air_layer_2 = RemoteReceiver(dim_air_layer)
dim_ongroud_foundations_3 = RemoteReceiver(dim_ongroud_foundations_2)
dim_air_layer_3 = RemoteReceiver(dim_air_layer)
dim_insulation_ground_3 = RemoteReceiver(dim_insulation_ground_2)
dim_exterior_finish_wall_3 = RemoteReceiver(dim_exterior_finish_wall_2)
dim_insulation_air_slab_3 = RemoteReceiver(dim_insulation_air_slab_2)
dim_insulation_air_slab_4 = RemoteReceiver(dim_insulation_air_slab_2)
dim_ongroud_foundations_4 = RemoteReceiver(dim_ongroud_foundations_2)
dim_insulation_ground_4 = RemoteReceiver(dim_insulation_ground_2)
dim_apart_slab_strct_4 = RemoteReceiver(dim_apart_slab_strct_2)
dim_apart_slab_strct_5 = RemoteReceiver(dim_apart_slab_strct_2)
dim_interior_floor_4 = RemoteReceiver(dim_interior_floor_2)
dim_accoustic_slab_4 = RemoteReceiver(dim_accoustic_slab_2)
dim_interior_floor_5 = RemoteReceiver(dim_interior_floor_2)
dim_accoustic_slab_5 = RemoteReceiver(dim_accoustic_slab_2)
dim_interior_floor_6 = RemoteReceiver(dim_interior_floor_2)
dim_air_layer_4 = RemoteReceiver(dim_air_layer)
dim_interior_floor_7 = RemoteReceiver(dim_interior_floor_2)

dim_accoustic_wall_4 = RemoteReceiver(dim_accoustic_wall)

dim_interior_finish_wall_5 = RemoteReceiver(dim_interior_finish_wall_2)
dim_interior_wall_6 = RemoteReceiver(dim_interior_wall_2)
merge_13 = Merge(
    Data1=dim_interior_finish_wall_5,
    Data2=dim_interior_wall_6,
    Data3=dim_accoustic_wall_4,
    Data4=dim_interior_wall_6,
    Data5=dim_interior_finish_wall_5)
division_6 = Division(A=merge_13, B="2")

grid_vector_3 = RemoteReceiver(grid_vector)
devec_6 = DeconstructVector(Vector=grid_vector_3)  # -> XComponent, YComponent, ZComponent
merge_14 = Merge(Data1=devec_6.XComponent, Data2=devec_6.YComponent)
cset_3 = CreateSet(List=merge_14)  # -> Set, Map
column_width_3 = RemoteReceiver(column_width)
subtraction_3 = Subtraction(A=cset_3.Set, B=column_width_3)

color_apartment_slab_strct_2 = RemoteReceiver(color_apartment_slab_strct)
color_apartment_ceiling_2 = RemoteReceiver(color_apartment_ceiling)
color_apartment_slab_strct_3 = RemoteReceiver(color_apartment_slab_strct)
color_circulation_ceiling_2 = RemoteReceiver(color_circulation_ceiling)
color_onground_2 = RemoteReceiver(color_onground)
color_apartment_slab_strct_4 = RemoteReceiver(color_apartment_slab_strct)
color_air_layer_2 = RemoteReceiver(color_air_layer)
color_onground_3 = RemoteReceiver(color_onground)
color_air_layer_3 = RemoteReceiver(color_air_layer)

# ---- group: adjust height by removing some layer's thickness
dim_accoustic_slab_6 = RemoteReceiver(dim_accoustic_slab_2)
dim_interior_floor_8 = RemoteReceiver(dim_interior_floor_2)
beam_height_5 = RemoteReceiver(beam_height)
addition_7 = Addition(A=dim_interior_floor_8, B=dim_accoustic_slab_6, C=beam_height_5)
division_7 = Division(A=addition_7, B="2")
Z_3 = UnitZ(Factor=division_7)
rev_2 = Reverse(Vector=Z_3)

# ----
dim_interior_finish_wall_6 = RemoteReceiver(dim_interior_finish_wall_2)
dim_interior_wall_7 = RemoteReceiver(dim_interior_wall_2)
dim_exterior_insulation_wall_3 = RemoteReceiver(dim_exterior_insulation_wall_2)
dim_exterior_finish_wall_4 = RemoteReceiver(dim_exterior_finish_wall_2)
merge_15 = Merge(
    Data1=dim_interior_finish_wall_6,
    Data2=dim_interior_wall_7,
    Data3=dim_exterior_insulation_wall_3,
    Data4=dim_exterior_finish_wall_4)

lng_7 = ListLength(List=cset_3.Set)
column_width_4 = RemoteReceiver(column_width)
subtraction_4 = Subtraction(A=cset_3.Set, B=column_width_4)  # -> reverse(Result)
division_8 = Division(A=subtraction_4, B="2")  # -> graft(Result)

reduced_cells_5 = RemoteReceiver(reduced_cells)

# ---- group: I challenge you to find faster than me
debrep = DeconstructBrep(Brep=reduced_cells_5)  # -> reparameterize(Faces), Edges, Vertices

# ----
evalsrf = EvaluateSurface(Surface=debrep.Faces, Point="0.5,0.5,0")  # -> Point, Normal, UDirection, VDirection, Frame
avr_2 = Average(Input=debrep.Vertices)  # -> simplify(ArithmeticMean)
addition_8 = Addition(A=evalsrf.Point, B=evalsrf.Normal)
cp = ClosestPoint(Point=addition_8, Cloud=flatten(avr_2))  # -> ClosestPoint, CPIndex, simplify(Distance)
smaller_4 = SmallerThan(FirstNumber=simplify(cp.Distance), SecondNumber=suspicious_value_2)  # -> SmallerThan, OrEqualTo

dispatch = Dispatch(List=evalsrf.Frame, DispatchPattern=smaller_4.SmallerThan)  # -> graft(ListA), graft(ListB)
dispatch_2 = Dispatch(List=debrep.Faces, DispatchPattern=smaller_4.SmallerThan)  # -> graft(ListA), graft(ListB)

deplane = DeconstructPlane(Plane=dispatch.ListB)  # -> Origin, XAxis, YAxis, ZAxis
devec_7 = DeconstructVector(Vector=deplane.ZAxis)  # -> XComponent, YComponent, ZComponent
abs_5 = Absolute(Value=devec_7.ZComponent)
larger_5 = LargerThan(FirstNumber=abs_5, SecondNumber="0")  # -> LargerThan, OrEqualTo
larger_6 = LargerThan(FirstNumber=devec_7.ZComponent, SecondNumber="0")  # -> LargerThan, OrEqualTo
dispatch_3 = Dispatch(List=dispatch.ListB, DispatchPattern=larger_5.LargerThan)  # -> ListA, ListB
dispatch_4 = Dispatch(List=larger_6.LargerThan, DispatchPattern=larger_5.LargerThan)  # -> ListA, ListB
dispatch_5 = Dispatch(List=dispatch_3.ListA, DispatchPattern=dispatch_4.ListA)  # -> ListA, ListB

deplane_2 = DeconstructPlane(Plane=dispatch.ListA)  # -> Origin, XAxis, YAxis, ZAxis
devec_8 = DeconstructVector(Vector=deplane_2.ZAxis)  # -> XComponent, YComponent, ZComponent
abs_6 = Absolute(Value=devec_8.ZComponent)
larger_7 = LargerThan(FirstNumber=abs_6, SecondNumber="0")  # -> LargerThan, OrEqualTo
dispatch_6 = Dispatch(List=dispatch_2.ListA, DispatchPattern=larger_7.LargerThan)  # -> ListA, ListB

clean_7 = CleanTree(RemoveNulls=True, RemoveInvalid=True, RemoveEmpty=invert(False), Tree=simplify(dispatch_3.ListB))
tstat_7 = TreeStatistics(Tree=clean_7)  # -> Paths, Length, Count
split_4 = SplitTree(Data=simplify(dispatch_2.ListB), Masks=flatten(tstat_7.Paths))  # -> Positive, Negative
outside_walls = RemoteSender(split_4.Positive)

clean_8 = CleanTree(RemoveNulls=True, RemoveInvalid=True, RemoveEmpty=invert(False), Tree=simplify(dispatch_5.ListA))
tstat_8 = TreeStatistics(Tree=clean_8)  # -> Paths, Length, Count
split_5 = SplitTree(Data=simplify(dispatch_2.ListB), Masks=flatten(tstat_8.Paths))  # -> Positive, Negative

clean_9 = CleanTree(RemoveNulls=True, RemoveInvalid=True, RemoveEmpty=invert(False), Tree=simplify(dispatch_5.ListB))
tstat_9 = TreeStatistics(Tree=clean_9)  # -> Paths, Length, Count
split_6 = SplitTree(Data=simplify(dispatch_2.ListB), Masks=flatten(tstat_9.Paths))  # -> Positive, Negative

preview = CustomPreview(Geometry=[split_4.Positive, split_5.Positive, split_6.Positive], Material=ColourSwatch(SwatchColor=RGBA(0, 0, 0, 33)))  # disabled

outside_walls_2 = RemoteReceiver(outside_walls)
pshift_3 = ShiftPaths(Data=outside_walls_2, Offset=-1)

preview_2 = CustomPreview(Geometry=split_4.Positive, Material=ColourSwatch(SwatchColor=RGBA(0, 255, 229, 150)))  # disabled
preview_3 = CustomPreview(Geometry=split_5.Positive, Material=ColourSwatch(SwatchColor=RGBA(255, 0, 119, 150)))  # disabled
preview_4 = CustomPreview(Geometry=split_6.Positive, Material=ColourSwatch(SwatchColor=RGBA(255, 183, 0, 150)))  # disabled
preview_5 = CustomPreview(Geometry=dispatch_6.ListA, Material=ColourSwatch(SwatchColor=RGBA(115, 255, 0, 150)))  # disabled

tstat_10 = TreeStatistics(Tree=pshift_3)  # -> Paths, Length, Count
branch_5 = TreeBranch(Tree=reduced_cells_4, Path=tstat_10.Paths, MaintainPaths=True)
preview_6 = CustomPreview(Geometry=dispatch_6.ListB, Material=ColourSwatch(SwatchColor=RGBA(255, 0, 0, 150)))  # disabled

reduced_cells_6 = RemoteReceiver(reduced_cells)
outside_walls_3 = RemoteReceiver(outside_walls)
pshift_4 = ShiftPaths(Data=outside_walls_3, Offset=-1)
tstat_11 = TreeStatistics(Tree=reduced_cells_6)  # -> Paths, Length, Count
tstat_12 = TreeStatistics(Tree=pshift_4)  # -> Paths, Length, Count
python_5 = GhPythonScript(x=tstat_11.Paths, y=tstat_12.Paths)  # -> a, b; inputs x: list, y: list
# ---------- python_5: Python ----------
__author__ = "Win"
__version__ = "2022.05.03"

# associate the right inputs
if len(x) < len(y):
    smaller = x
    larger = y
else:
    smaller = y
    larger = x

# create the empty lists
a = []
b = []

# append to each lists
for i in larger:
    if i in smaller:
        a.append(i)
    else:
        b.append(i)
# ---------- end python_5 ----------

ordering_idx_4 = RemoteReceiver(ordering_idx)
long_4 = LongestList(ListA=python_5.a, ListB="True", PaddingMode=2)  # -> ListA, ListB
long_5 = LongestList(ListA=python_5.b, ListB="False", PaddingMode=2)  # -> ListA, ListB
tree_3 = CreateTree(Data=long_4.ListB, Path=python_5.a)
tree_4 = CreateTree(Data=long_5.ListB, Path=python_5.b)
merge_16 = Merge(Data1=tree_3, Data2=tree_4)
item_10 = ListItem(List=flatten(merge_16), Index=ordering_idx_4, Wrap=True)  # -> graft(Item)

ordering_idx_5 = RemoteReceiver(ordering_idx)
int = Integer("0")
long_6 = LongestList(ListA=python_5.b, ListB=int, PaddingMode=2)  # -> ListA, ListB
tree_5 = CreateTree(Data=long_6.ListB, Path=python_5.b)
lng_8 = ListLength(List=pshift_4)
merge_17 = Merge(Data1=lng_8, Data2=tree_5)
item_11 = ListItem(List=flatten(merge_17), Index=ordering_idx_5, Wrap=True)  # -> graft(Item)

bang_2 = ExplodeTree(Data=simplify(flip_3))  # -> graft(Branch0), graft(Branch1), graft(Branch2)
bang_3 = ExplodeTree(Data=and)  # -> graft(Branch0), graft(Branch1), graft(Branch2), graft(Branch3)
merge_18 = Merge(
    Data1=simplify(item_10),
    Data2=simplify(item_11),
    Data3=simplify(bang_3.Branch0),
    Data4=simplify(bang_3.Branch1),
    Data5=simplify(bang_3.Branch2),
    Data6=simplify(bang_3.Branch3),
    Data7=simplify(bang_2.Branch0),
    Data8=simplify(bang_2.Branch1),
    Data9=simplify(bang_2.Branch2))  # -> simplify(Result)
node_attribute_values = RemoteSender(merge_18)

node_attribute_values_2 = RemoteReceiver(node_attribute_values)
node_attribute_keys_2 = RemoteReceiver(node_attribute_keys)
node_points_5 = RemoteReceiver(node_points)
concat_6 = Concatenate(FragmentA="http://127.0.0.1:5000/", FragmentB="node_to_graph")
graft = GraftTree(Tree=node_points_5, IncludeEmptyLists=True, IncludeNullItems=True)  # -> simplify(Tree)
hops_3 = Hops(
    _Path=concat_6,
    NodeIndices=graft,
    Attributes=node_attribute_values_2,
    Labels=node_attribute_keys_2,
    CacheResultsInMemory=False,
    CacheSolveResults=False,
    RemoteDefinitionLocation="http://127.0.0.1:5000/node_to_graph",
    RemoteSolveVersion=(0, 1, 0),
    ShowInput_Enabled=False,
    ShowInput_Path=True,
    SynchronousSolve=True)

connexion_indexes_bidirectional_2 = RemoteReceiver(connexion_indexes_bidirectional)
edge_attributes_values_2 = RemoteReceiver(edge_attributes_values)
edge_attribute_keys_2 = RemoteReceiver(edge_attribute_keys)
concat_7 = Concatenate(FragmentA="http://127.0.0.1:5000/", FragmentB="add_edge_graph")
hops_4 = Hops(
    _Path=concat_7,
    Graph=hops_3,
    NodeIndexes=connexion_indexes_bidirectional_2,
    Attributes=edge_attributes_values_2,
    Labels=edge_attribute_keys_2,
    CacheResultsInMemory=False,
    CacheSolveResults=False,
    RemoteDefinitionLocation="http://127.0.0.1:5000/add_edge_graph",
    RemoteSolveVersion=(0, 1, 0),
    ShowInput_Enabled=False,
    ShowInput_Path=True,
    SynchronousSolve=True)

node_points_6 = RemoteReceiver(node_points)
circulation_curves_3 = RemoteReceiver(circulation_curves)
xy_size_5 = RemoteReceiver(xy_size)
crv_cp_2 = CurveClosestPoint(Point=graft(node_points_6), Curve=circulation_curves_3)  # -> Point, Parameter, Distance
division_9 = Division(A=xy_size_5, B="2")
smaller_5 = SmallerThan(FirstNumber=crv_cp_2.Distance, SecondNumber=division_9)  # -> SmallerThan, OrEqualTo
cull_5 = CullPattern(List=crv_cp_2.Point, CullPattern=smaller_5.SmallerThan)  # -> simplify(List)
clean_10 = CleanTree(RemoveNulls=True, RemoveInvalid=True, RemoveEmpty=invert(False), Tree=cull_5)
tstat_13 = TreeStatistics(Tree=clean_10)  # -> Paths, Length, Count
dpath_4 = DeconstructPath(Branch=tstat_13.Paths)  # -> flatten(Indices)

item_12 = ListItem(List=node_points_6, Index=dpath_4, Wrap=True)  # -> simplify(Item)
mindex_5 = MemberIndex(Set=clean_3, Member=item_12)  # -> Index, Count
clean_11 = CleanTree(RemoveNulls=True, RemoveInvalid=True, RemoveEmpty=invert(False), Tree=mindex_5.Index)
tstat_14 = TreeStatistics(Tree=clean_11)  # -> Paths, Length, Count
trim = TrimTree(Tree=mindex_5.Index, Depth=1)
dpath_5 = DeconstructPath(Branch=tstat_14.Paths)
item_13 = ListItem(List=reverse(dpath_5), Index=0, Wrap=True)
unflatten_3 = UnflattenTree(Tree=item_13, Guide=trim)
item_14 = ListItem(List=flatten(dpath_4), Index=unflatten_3, Wrap=True)  # -> simplify(Item)

circulation_indices = RemoteSender(item_14)

circulation_indices_2 = RemoteReceiver(flatten(circulation_indices))
concat_8 = Concatenate(FragmentA="http://127.0.0.1:5000/", FragmentB="graph_set_circulation")

hops_5 = Hops(
    _Path=concat_8,
    Graph=hops_4,
    Indices=circulation_indices_2,
    CacheResultsInMemory=False,
    CacheSolveResults=False,
    RemoteDefinitionLocation="http://127.0.0.1:5000/graph_set_circulation",
    RemoteSolveVersion=(0, 1, 0),
    ShowInput_Enabled=False,
    ShowInput_Path=True,
    SynchronousSolve=True)

concat_9 = Concatenate(FragmentA="http://127.0.0.1:5000/", FragmentB="read_nodes_attr_value")
hops_6 = Hops(
    _Path=concat_9,
    Graph=hops_5,
    Attributes="CIRCULATION_DISTANCE",
    Index=-1,
    CacheResultsInMemory=False,
    CacheSolveResults=False,
    RemoteDefinitionLocation="http://127.0.0.1:5000/read_nodes_attr_value",
    RemoteSolveVersion=(0, 1, 0),
    ShowInput_Enabled=False,
    ShowInput_Path=True,
    SynchronousSolve=True)  # -> Values, ListPartitioner
partition_3 = PartitionList(List=hops_6.Values, Size=hops_6.ListPartitioner)

panel_6 = Panel("""0
1""")
panel_7 = Panel("""0
2""")
entwine_4 = Entwine(Branch00=panel_6, Branch01=panel_7, FlattenInputs=True)  # -> simplify(Result)
concat_10 = Concatenate(FragmentA="http://127.0.0.1:5000/", FragmentB="read_edges_attr_values")
hops_7 = Hops(
    _Path=concat_10,
    Graph=hops_5,
    Attributes="is_horizontal",
    Edges=-1,
    CacheResultsInMemory=False,
    CacheSolveResults=False,
    RemoteDefinitionLocation="http://127.0.0.1:5000/read_edges_attr_values",
    RemoteSolveVersion=(0, 1, 0),
    ShowInput_Enabled=False,
    ShowInput_Path=True,
    SynchronousSolve=True)  # -> Values, ListPartitioner
partition_4 = PartitionList(List=hops_7.Values, Size=hops_7.ListPartitioner)
flip_4 = FlipMatrix(Data=partition_4)
panel_8 = Panel(flip_4)

circulation_indices_3 = RemoteReceiver(circulation_indices)

# ---- group: circulations
circulation_indices_4 = RemoteReceiver(circulation_indices)
cells_ordered_4 = RemoteReceiver(cells_ordered)
item_15 = ListItem(List=flatten(cells_ordered_4), Index=circulation_indices_4, Wrap=True)  # -> simplify(Item)
alpha = AdjustAlpha(Color=ColourSwatch(SwatchColor=RGB(0, 0, 0)), Alpha=Slider(0.5, range=0..1))
preview_7 = CustomPreview(Geometry=item_15, Material=alpha)

# ----
lng_9 = ListLength(List=item_15)  # disabled
series_4 = Series(Start=0, Step=1, Count=lng_9)  # disabled
shift = ShiftList(List=item_15, Shift=series_4, Wrap=True)  # disabled
area = Area(Geometry=shift, UseTasks=True)  # -> Area, Centroid; disabled
group = Group(Objects=shift)  # disabled
panel_9 = Panel("1")  # disabled
panel_10 = Panel("1")  # disabled
split_7 = SplitList(List=shift, Index=panel_9)  # -> ListA, ListB; disabled
split_8 = SplitList(List=area.Centroid, Index=panel_10)  # -> ListA, ListB; disabled
lng_10 = ListLength(List=split_8.ListB)  # disabled
cps = ClosestPoints(Point=split_8.ListA, Cloud=split_8.ListB, Count=lng_10)  # -> ClosestPoint, CPIndex, Distance; disabled
pline = PolyLine(Vertices=cps.ClosestPoint, Closed=False)  # disabled
len = Length(Curve=pline)  # disabled
sort_2 = SortList(Keys=flatten(len), ValuesB=flatten(group), ValuesA=flatten(pline))  # -> Keys, ValuesB, ValuesA; disabled
item_16 = ListItem(List=sort_2.ValuesB, Index=0, Wrap=True)  # disabled
item_17 = ListItem(List=sort_2.ValuesA, Index=0, Wrap=True)  # disabled
ungroup = Ungroup(Group=item_16)  # disabled
munion_2 = MeshUnion(Meshes=ungroup)  # disabled

item_18 = ListItem(List=flatten(cells_ordered_2), Index=dpath_4, Wrap=True)  # -> simplify(Item)
panel_11 = Panel(circulation_indices_4)

panel_12 = Panel("""goes_down
goes_up""")
panel_13 = Panel("""True
True""")
concat_11 = Concatenate(FragmentA="http://127.0.0.1:5000/", FragmentB="remove_edges")
hops_8 = Hops(
    _Path=concat_11,
    Graph=hops_5,
    EdgeAttribute=panel_12,
    EdgeValue=panel_13,
    CacheResultsInMemory=False,
    CacheSolveResults=False,
    RemoteDefinitionLocation="http://127.0.0.1:5000/remove_edges",
    RemoteSolveVersion=(0, 1, 0),
    ShowInput_Enabled=False,
    ShowInput_Path=True,
    SynchronousSolve=True)

bnd_4 = Bounds(Numbers=partition_3)
dedomain = DeconstructDomain(Domain=bnd_4)  # -> Start, End
gradient = Gradient(
    LowerLimit=dedomain.Start,
    UpperLimit=dedomain.End,
    Parameter=partition_3,
    stops=[0: RGB(234, 38, 0), 0.25: RGB(234, 126, 0), 0.5: RGB(254, 244, 84), 0.75: RGB(173, 203, 249), 1: RGB(75, 107, 169)])

# ---- group: avoiding invalid meshes
munion_3 = MeshUnion(Meshes=item_15)  # -> flatten(Result)
munion_4 = MeshUnion(Meshes=munion_3)  # -> flatten(Result)

# ----
clean_12 = CombineClean(Meshes=item_15)
clean_13 = CombineClean(Meshes=graft(item_15))
clean_14 = CombineClean(Meshes=munion_4)
circulation_cleaned_per_line = RemoteSender(clean_12)
circulation_cleaned_per_bloc = RemoteSender(clean_13)
circulation_solids = RemoteSender(clean_14)

hops_9 = Hops(
    _Path=concat_3,
    Graph=hops_5,
    ApartmentProportions=rejson,
    GenerationSettings=hops_2,
    RankingSettings=hops,
    FloorCount=Slider(2, range=1..3),
    Iterations=Slider(1, range=1..10),
    CacheResultsInMemory=False,
    CacheSolveResults=False,
    RemoteDefinitionLocation="http://127.0.0.1:5000/generate_v3",
    RemoteSolveVersion=(0, 1, 0),
    ShowInput_Enabled=False,
    ShowInput_Path=True,
    SynchronousSolve=True)  # -> NewGraph, AllRankings, ApartIndexes, ListPartitioner, Proportions
cset_4 = CreateSet(List=hops_9.ListPartitioner)  # -> Set, Map
partition_5 = PartitionList(List=hops_9.ApartIndexes, Size=hops_9.ListPartitioner)
lng_11 = ListLength(List=hops_9.ListPartitioner)
mindex_6 = MemberIndex(Set=hops_9.ListPartitioner, Member=cset_4.Set)  # -> Index, Count
alpha_2 = AdjustAlpha(Color=gradient, Alpha=Slider(0.55, range=0..1))
lng_12 = ListLength(List=mindex_6.Index)
division_10 = Division(A=lng_12, B=lng_11)
panel_14 = Panel(division_10)
preview_8 = CustomPreview(Geometry=cells_ordered_3, Material=graft(alpha_2))  # disabled
previewlw_5 = CustomPreviewLineweights(Geometry=edges_2.Interior, Shader=graft(alpha_2), Thickness=Slider(3, range=0..10), Absolute=False)
circulation_solids_2 = RemoteReceiver(circulation_solids)
hops_10 = Hops(
    _Path=concat_4,
    Graph=hops_8,
    CacheResultsInMemory=False,
    CacheSolveResults=False,
    RemoteDefinitionLocation="http://127.0.0.1:5000/explode_graph",
    RemoteSolveVersion=(0, 1, 0),
    ShowInput_Enabled=False,
    ShowInput_Path=True,
    SynchronousSolve=True)  # -> Nodes, Edges, ListPartitioner
partition_6 = PartitionList(List=hops_10.Edges, Size=hops_10.ListPartitioner)
panel_15 = Panel(hops_10.Nodes)
hops_11 = Hops(
    _Path=concat_5,
    Graph=hops_9.NewGraph,
    Attributes=panel_4,
    Index=hops_9.ApartIndexes,
    CacheResultsInMemory=False,
    CacheSolveResults=False,
    RemoteDefinitionLocation="http://127.0.0.1:5000/read_nodes_attr_value",
    RemoteSolveVersion=(0, 1, 0),
    ShowInput_Enabled=False,
    ShowInput_Path=True,
    SynchronousSolve=True)  # -> Values, ListPartitioner
panel_16 = Panel(partition_6)
partition_7 = PartitionList(List=hops_11.Values, Size=hops_11.ListPartitioner)
flip_5 = FlipMatrix(Data=partition_7)
path_5 = ConstructPath(Indices=flip_5)  # -> flatten(Branch)

# ---- group: is manifold?
python_6 = GhPythonScript(M=circulation_solids)  # -> M; inputs M: Mesh
# ---------- python_6: Python ----------
"""Provides a scripting component.
    Inputs:
        M: Mesh
    Output:
        M: is Manifold?"""

__author__ = "Antoine"
__version__ = "2023.01.18"

import Rhino.Geometry as rg

M = rg.Mesh.IsManifold(M)
# ---------- end python_6 ----------

# ----
panel_17 = Panel(python_6)

circulation_cleaned_per_line_2 = RemoteReceiver(circulation_cleaned_per_line)  # disabled
clean_15 = CombineClean(Meshes=flatten(circulation_cleaned_per_line_2))  # disabled
facen = FaceNormals(Mesh=clean_15)  # -> Centers, Normals; disabled
addition_9 = Addition(A=facen.Centers, B=facen.Normals)  # disabled
minc = MeshInclusion(Mesh=flatten(item_15), Point=graft(addition_9), Strict=False)  # disabled
ma_6 = MassAddition(Input=minc)  # -> Result, PartialResults; disabled
demesh = DeconstructMesh(Mesh=clean_15)  # -> Vertices, Faces, Colours, Normals; disabled
bool = Boolean(flatten(ma_6.Result))  # disabled
cull_6 = CullPattern(List=demesh.Faces, CullPattern=bool)  # disabled
conmesh = ConstructMesh(Vertices=demesh.Vertices, Faces=cull_6)  # disabled
demesh_2 = DeconstructMesh(Mesh=conmesh)  # -> Vertices, Faces, Colours, Normals; disabled
facen_2 = FaceNormals(Mesh=conmesh)  # -> Centers, Normals; disabled
devec_9 = DeconstructVector(Vector=facen_2.Normals)  # -> XComponent, YComponent, ZComponent; disabled
panel_18 = Panel("0")  # disabled
abs_7 = Absolute(Value=devec_9.ZComponent)  # disabled
swatch = ColourSwatch(SwatchColor=RGB(122, 28, 91))  # disabled
larger_8 = LargerThan(FirstNumber=abs_7, SecondNumber=panel_18)  # -> LargerThan, OrEqualTo; disabled
cull_7 = CullPattern(List=demesh_2.Faces, CullPattern=larger_8.LargerThan)  # disabled
conmesh_2 = ConstructMesh(Vertices=demesh_2.Vertices, Faces=cull_7, Colours=swatch)  # disabled

cells_ordered_5 = RemoteReceiver(cells_ordered)
item_19 = ListItem(List=flatten(cells_ordered_5), Index=partition_5, Wrap=True)  # -> simplify(Item)

mesh = Mesh(item_19)

merge_19 = Merge(Data1=flatten(mesh), Data2=flatten(item_15))  # -> simplify(flatten(Result))
medges = MeshEdges(Mesh=merge_19)  # -> NakedEdges, flatten(InteriorEdges), NonManifoldEdges
dupln = RemoveDuplicateLines(Lines=medges.InteriorEdges, Tolerance=0.01)
dupln_2 = RemoveDuplicateLines(Lines=medges.InteriorEdges, Tolerance=0.01)
eval_2 = EvaluateCurve(Curve=reparameterize(dupln_2), Parameter=".5")  # -> Point, Tangent, Angle
pdecon_4 = Deconstruct(Point=eval_2.Point)  # -> XComponent, YComponent, ZComponent
larger_9 = LargerThan(FirstNumber=pdecon_4.ZComponent, SecondNumber="0")  # -> LargerThan, OrEqualTo
cull_8 = CullPattern(List=dupln_2, CullPattern=larger_9.LargerThan)
all_edges = RemoteSender(cull_8)

munion_5 = MeshUnion(Meshes=mesh)
clean_16 = CombineClean(Meshes=munion_5)
merge_20 = Merge(Data1=circulation_solids_2, Data2=flatten(clean_16))  # -> simplify(graft(Result))
apart_circulation_solids = RemoteSender(merge_20)
apart_individual_blocs = RemoteSender(mesh)
apart_solids = RemoteSender(clean_16)

# ---- group: visualise different rankings
dejsonkv_2 = DeserializeKeysAndValues(JSON=hops_9.AllRankings)  # -> Key, Value
list = ItemSelector(
    dejsonkv_2.Key,
    {"circulation_rankings", "compacity_rankings", "window_rankings_before", "window_rankings_after", "floors_rankings"}, selected="circulation_rankings")
dejsonkv_3 = DeserializeKeysAndValues(JSON=hops_9.AllRankings, Keys=list)  # -> Key, Value
dejson_3 = DeserializeJson(JSON=dejsonkv_3.Value, OutputsLocked=False)
bnd_5 = Bounds(Numbers=dejson_3)
dedomain_2 = DeconstructDomain(Domain=bnd_5)  # -> Start, End
gradient_2 = Gradient(
    LowerLimit=dedomain_2.Start,
    UpperLimit=dedomain_2.End,
    Parameter=dejson_3,
    stops=[0: RGB(234, 38, 0), 0.25: RGB(234, 126, 0), 0.5: RGB(254, 244, 84), 0.75: RGB(173, 203, 249), 1: RGB(75, 107, 169)])
apart_individual_blocs_2 = RemoteReceiver(apart_individual_blocs)
alpha_3 = AdjustAlpha(Color=gradient_2, Alpha=Slider(0.4, range=0..1))
preview_9 = CustomPreview(Geometry=apart_individual_blocs_2, Material=graft(alpha_3))  # disabled

# ----
apart_individual_blocs_3 = RemoteReceiver(apart_individual_blocs)
tstat_15 = TreeStatistics(Tree=apart_individual_blocs_3)  # -> Paths, Length, Count
subtraction_5 = Subtraction(A=tstat_15.Count, B="1")
range_3 = Range(Domain=Domain(0, 1), Steps=subtraction_5)
gradient_3 = Gradient(
    LowerLimit="0",
    UpperLimit="1",
    Parameter=range_3,
    stops=[0: RGB(243, 57, 0), 0.118: RGB(236, 27, 60), 0.234: RGB(210, 0, 118), 0.336: RGB(103, 0, 120), 0.452: RGB(39, 72, 161), 0.559: RGB(1, 192, 229), 0.67: RGB(18, 178, 90), 0.775: RGB(79, 186, 8), 0.889: RGB(220, 237, 32), 1: RGB(247, 159, 20)])
apart_individual_blocs_4 = RemoteReceiver(apart_individual_blocs)
alpha_4 = AdjustAlpha(Color=gradient_3, Alpha=Slider(0.4, range=0..1))
preview_10 = CustomPreview(Geometry=apart_individual_blocs_4, Material=graft(alpha_4))

apart_individual_blocs_5 = RemoteReceiver(apart_individual_blocs)
tree_6 = CreateTree(Data=flatten(apart_individual_blocs_5), Path=path_5)

merge_21 = Merge(Data1=Slider(2, range=0..3), Data2=Slider(3, range=0..4), Data3=Slider(3, range=0..9))
path_6 = ConstructPath(Indices=merge_21)
branch_6 = TreeBranch(Tree=tree_6, Path=path_6, MaintainPaths=True)

merge_22 = Merge(Data1=flatten(item_15), Data2=flatten(item_19))
tstat_16 = TreeStatistics(Tree=tree_6)  # -> Paths, Length, Count
panel_19 = Panel(tstat_16.Paths)
all_edges_2 = RemoteReceiver(simplify(graft(all_edges)))

pt_5 = Point([Point(11, -12, 0), Point(17, -15, 0), Point(19.54022258, -8, 0), Point(24, -11, 0), Point(31, -7, 0)])
pt_6 = Point([Point(11, -12, 4), Point(18, -22, 0), Point(19, -12, 0), Point(24, -11, 5), Point(28, -10, 0)])
ln_7 = Line(StartPoint=pt_5, EndPoint=pt_6)  # -> simplify(graft(Line))
vec_2 = Vector(all_edges_2)
devec_10 = DeconstructVector(Vector=vec_2)  # -> XComponent, YComponent, ZComponent
abs_8 = Absolute(Value=devec_10.ZComponent)
larger_10 = LargerThan(FirstNumber=abs_8, SecondNumber="0")  # -> LargerThan, OrEqualTo
dispatch_7 = Dispatch(List=all_edges_2, DispatchPattern=larger_10.LargerThan)  # -> ListA, ListB
clean_17 = CleanTree(RemoveNulls=True, RemoveInvalid=True, RemoveEmpty=invert(False), Tree=dispatch_7.ListA)
clean_18 = CleanTree(RemoveNulls=True, RemoveInvalid=True, RemoveEmpty=invert(False), Tree=dispatch_7.ListB)

apart_circulation_solids_2 = RemoteReceiver(apart_circulation_solids)  # disabled
demesh_3 = DeconstructMesh(Mesh=apart_circulation_solids_2)  # -> flatten(Vertices), Faces, Colours, Normals; disabled
pdecon_5 = Deconstruct(Point=demesh_3.Vertices)  # -> XComponent, YComponent, ZComponent; disabled
sort_3 = SortList(Keys=pdecon_5.ZComponent)  # -> Keys, ValuesA; disabled
item_20 = ListItem(List=sort_3.Keys, Index=0, Wrap=True)  # disabled
pdecon_6 = Deconstruct(Point=addition_9)  # -> XComponent, YComponent, ZComponent; disabled
smaller_6 = SmallerThan(FirstNumber=pdecon_6.ZComponent, SecondNumber=item_20)  # -> SmallerThan, OrEqualTo; disabled
swatch_2 = ColourSwatch(SwatchColor=RGB(31, 31, 31))  # disabled
cull_9 = CullPattern(List=demesh.Faces, CullPattern=smaller_6.SmallerThan)  # disabled
conmesh_3 = ConstructMesh(Vertices=demesh.Vertices, Faces=cull_9, Colours=swatch_2)  # disabled

# ---- group: lines always pointing up
vec_3 = Vector(clean_17)
devec_11 = DeconstructVector(Vector=vec_3)  # -> XComponent, YComponent, ZComponent
smaller_7 = SmallerThan(FirstNumber=devec_11.ZComponent, SecondNumber="0")  # -> SmallerThan, OrEqualTo
sift = SiftPattern(List=clean_17, SiftPattern=smaller_7.SmallerThan)  # -> Output0, Output1
flip_6 = FlipCurve(Curve=sift.Output1)  # -> Curve, Flag
combine = CombineData(Input0=sift.Output0, Input1=flip_6.Curve)  # -> Result, Index

# ----
item_21 = ListItem(List=flatten(combine.Result), Index=0, Wrap=True)
dim_accoustic_slab_7 = RemoteReceiver(dim_accoustic_slab_2)
dim_interior_floor_9 = RemoteReceiver(dim_interior_floor_2)
beam_height_6 = RemoteReceiver(beam_height)
addition_10 = Addition(A=dim_interior_floor_9, B=dim_accoustic_slab_7, C=beam_height_6)
len_2 = Length(Curve=item_21)
subtraction_6 = Subtraction(A=len_2, B=addition_10)
eval_3 = EvaluateLength(Curve=reparameterize(item_21), Length=subtraction_6, Normalized=invert(True))  # -> Point, Tangent, Parameter
shatter = Shatter(Curve=reparameterize(item_21), Parameters=eval_3.Parameter)
item_22 = ListItem(List=shatter, Index=0, Wrap=True)  # -> Item, Item1

dim_accoustic_slab_8 = RemoteReceiver(dim_accoustic_slab_2)
dim_interior_floor_10 = RemoteReceiver(dim_interior_floor_2)
addition_11 = Addition(A=dim_interior_floor_10, B=dim_accoustic_slab_8)
len_3 = Length(Curve=item_22.Item1)  # disabled
subtraction_7 = Subtraction(A=len_3, B=addition_11)  # disabled
eval_4 = EvaluateLength(Curve=reparameterize(item_22.Item1), Length=subtraction_7, Normalized=invert(True))  # -> Point, Tangent, Parameter; disabled
shatter_2 = Shatter(Curve=reparameterize(item_22.Item1), Parameters=eval_4.Parameter)  # disabled
item_23 = ListItem(List=shatter_2, Index=0, Wrap=True)  # disabled

# ---- group: model
eval_5 = EvaluateLength(Curve=reparameterize(item_22.Item), Length=".5", Normalized=True)  # -> Point, Tangent, Parameter
len_4 = Length(Curve=item_22.Item)
pdecon_7 = Deconstruct(Point=eval_5.Point)  # -> XComponent, YComponent, ZComponent
crv_cp_3 = CurveClosestPoint(Point=eval_5.Point, Curve=item_21)  # -> Point, Parameter, Distance
column_width_5 = RemoteReceiver(column_width)
sort_4 = SortList(Keys=pdecon_7.ZComponent, ValuesA=eval_5.Point)  # -> Keys, ValuesA
xy = XYPlane(Origin=Point(0, 0, 0))
item_24 = ListItem(List=sort_4.ValuesA, Index=0, Wrap=True)
division_11 = Division(A=column_width_5, B="2")
division_12 = Division(A=len_4, B="2")
pl_origin = PlaneOrigin(Base=xy, Origin=item_24)
parameter_column = RemoteSender(crv_cp_3.Parameter)
neg_3 = Negative(Value=division_11)
dom_2 = ConstructDomain(DomainStart=neg_3, DomainEnd=division_11)
box_3 = CenterBox(Base=pl_origin, X=division_11, Y=division_11, Z=division_12)

eval_6 = EvaluateLength(Curve=reparameterize(item_22.Item1), Length=".5", Normalized=True)  # -> Point, Tangent, Parameter
len_5 = Length(Curve=item_22.Item1)
pdecon_8 = Deconstruct(Point=eval_6.Point)  # -> XComponent, YComponent, ZComponent
crv_cp_4 = CurveClosestPoint(Point=eval_6.Point, Curve=item_21)  # -> Point, Parameter, Distance
sort_5 = SortList(Keys=pdecon_8.ZComponent, ValuesA=eval_6.Point)  # -> Keys, ValuesA
xy_2 = XYPlane(Origin=Point(0, 0, 0))
item_25 = ListItem(List=sort_5.ValuesA, Index=0, Wrap=True)
division_13 = Division(A=beam_width_2, B="2")
division_14 = Division(A=len_5, B="2")
pl_origin_2 = PlaneOrigin(Base=xy_2, Origin=item_25)
neg_4 = Negative(Value=division_13)
dom_3 = ConstructDomain(DomainStart=neg_4, DomainEnd=division_13)
box_4 = CenterBox(Base=pl_origin_2, X=division_13, Y=division_13, Z=division_14)

# ----
parameter_column_2 = RemoteReceiver(parameter_column)
eval_7 = EvaluateCurve(Curve=reparameterize(combine.Result), Parameter=parameter_column_2)  # -> Point, Tangent, Angle
pdecon_9 = Deconstruct(Point=eval_7.Point)  # -> XComponent, YComponent, ZComponent
sort_6 = SortList(Keys=pdecon_9.ZComponent, ValuesA=eval_7.Point)  # -> Keys, ValuesA
xy_3 = XYPlane(Origin=Point(0, 0, 0))
item_26 = ListItem(List=sort_6.ValuesA, Index=0, Wrap=True)
pl_origin_3 = PlaneOrigin(Base=xy_3, Origin=item_26)

orient = Orient(Geometry=box_4, Source=pl_origin, Target=pl_origin_3)  # -> Geometry, Transform
orient_2 = Orient(Geometry=box_3, Source=pl_origin, Target=pl_origin_3)  # -> Geometry, Transform

preview_11 = CustomPreview(Geometry=[orient.Geometry, orient_2.Geometry], Material=ColourSwatch(SwatchColor=RGB(179, 0, 255)))

# ---- group: CUBE SEQUENCE !
panel_20 = Panel("cubes_sequence")  # disabled
panel_21 = Panel("all")  # disabled
dpipeline_2 = DynamicGeometryPipeline(
    LayerFilter=panel_20,
    TypeFilter=panel_21,
    NameFilter="*",
    GroupByLayer=False,
    GroupByType=False,
    IncludeHidden=True,
    IncludeLocked=True,
    enableFullPath=False,
    listenToAttributes=True)  # disabled
volume_2 = Volume(Geometry=dpipeline_2, UseTasks=True)  # -> Volume, Centroid; disabled
sort_pt_2 = SortPoints(Points=volume_2.Centroid)  # -> Points, Indices; disabled
pdecon_10 = Deconstruct(Point=sort_pt_2.Points)  # -> XComponent, YComponent, ZComponent; disabled
entwine_5 = Entwine(Branch00=pdecon_10.XComponent, Branch01=pdecon_10.YComponent, Branch02=pdecon_10.ZComponent, FlattenInputs=True)  # disabled
cset_5 = CreateSet(List=entwine_5)  # -> Set, Map; disabled
sort_7 = SortList(Keys=cset_5.Set)  # -> Keys, ValuesA; disabled
lng_13 = ListLength(List=cset_5.Set)  # disabled
bang_4 = ExplodeTree(Data=sort_7.Keys)  # -> Branch0, Branch1, Branch2; disabled
series_5 = Series(Start=0, Step=1, Count=lng_13)  # -> simplify(Series); disabled
crossref_3 = CrossReference(ListA=bang_4.Branch0, ListB=bang_4.Branch1, ListC=bang_4.Branch2, CrossMode=1)  # -> ListA, ListB, ListC; disabled
pdecon_11 = Deconstruct(Point=sort_pt_2.Points)  # -> XComponent, YComponent, ZComponent; disabled
pt_7 = ConstructPoint(XCoordinate=pdecon_11.XComponent, YCoordinate=pdecon_11.YComponent, ZCoordinate=pdecon_11.ZComponent)  # disabled
bnd_6 = Bounds(Numbers=series_5)  # disabled
entwine_6 = Entwine(Branch00=crossref_3.ListA, Branch01=crossref_3.ListB, Branch02=crossref_3.ListC, FlattenInputs=True)  # disabled
pt_8 = ConstructPoint(XCoordinate=crossref_3.ListA, YCoordinate=crossref_3.ListB, ZCoordinate=crossref_3.ListC)  # disabled
bnd_7 = Bounds(Numbers=sort_7.Keys)  # disabled
remap_3 = RemapNumbers(Value=entwine_6, Source=bnd_7, Target=bnd_6)  # -> Mapped, Clipped; disabled
mindex_7 = MemberIndex(Set=pt_8, Member=pt_7)  # -> Index, Count; disabled
flip_7 = FlipMatrix(Data=remap_3.Mapped)  # disabled
path_7 = ConstructPath(Indices=flip_7)  # -> flatten(Branch); disabled
item_27 = ListItem(List=path_7, Index=mindex_7.Index, Wrap=True)  # -> flatten(Item); disabled
swatch_3 = ColourSwatch(SwatchColor=RGB(0, 0, 0))  # disabled
swatch_4 = ColourSwatch(SwatchColor=RGB(0, 0, 0))  # disabled
tree_7 = CreateTree(Data=pt_7, Path=item_27)  # disabled
tag_4 = TextTag(Location=pt_8, Text=path_7, Colour=swatch_3)  # disabled
tag_5 = TextTag(Location=pt_7, Text=item_27, Colour=swatch_4)  # disabled

number_slider_4 = Slider(0, range=0..4)  # disabled
number_slider_5 = Slider(2, range=0..4)  # disabled
number_slider_6 = Slider(1, range=0..4)  # disabled
panel_22 = Panel("{{{0};{1};{2}}}")  # disabled
format = Format(Format=panel_22, Culture=127, Data0=number_slider_4, Data1=number_slider_5, Data2=number_slider_6)  # disabled
branch_7 = TreeBranch(Tree=tree_7, Path=format, MaintainPaths=True)  # disabled
sph = Sphere(Base=branch_7, Radius=1)  # disabled
preview_12 = CustomPreview(
    Geometry=sph,
    Material={diffuse=RGB(221, 160, 221), emission=RGB(66, 48, 66), shine=0.5, specular=RGB(255, 255, 255), transparency=0})  # disabled

panel_23 = Panel("{1;0;0}")  # disabled
panel_24 = Panel("{0;1;0}")  # disabled
panel_25 = Panel("{0;0;1}")  # disabled
relitem_10 = RelativeItem(Tree=tree_7, Offset=panel_23, WrapPaths=False, WrapItems=False)  # -> ItemA, ItemB; disabled
relitem_11 = RelativeItem(Tree=tree_7, Offset=panel_24, WrapPaths=False, WrapItems=False)  # -> ItemA, ItemB; disabled
relitem_12 = RelativeItem(Tree=tree_7, Offset=panel_25, WrapPaths=False, WrapItems=False)  # -> ItemA, ItemB; disabled
ln_8 = Line(StartPoint=relitem_11.ItemA, EndPoint=relitem_11.ItemB)  # disabled
ln_9 = Line(StartPoint=relitem_10.ItemA, EndPoint=relitem_10.ItemB)  # disabled
ln_10 = Line(StartPoint=relitem_12.ItemA, EndPoint=relitem_12.ItemB)  # disabled

merge_23 = Merge(Data1=ln_9, Data2=ln_8, Data3=ln_10)  # -> flatten(Result); disabled
lng_14 = ListLength(List=merge_23)  # disabled
panel_26 = Panel(lng_14)  # disabled

swatch_5 = ColourSwatch(SwatchColor=RGB(8, 255, 0))  # disabled
number_slider_7 = Slider(12, range=0..40)  # disabled
swatch_6 = ColourSwatch(SwatchColor=RGB(255, 0, 0))  # disabled
swatch_7 = ColourSwatch(SwatchColor=RGB(8, 0, 255))  # disabled
previewlw_6 = CustomPreviewLineweights(Geometry=ln_9, Shader=swatch_6, Thickness=number_slider_7, Absolute=False)  # disabled
previewlw_7 = CustomPreviewLineweights(Geometry=ln_8, Shader=swatch_5, Thickness=number_slider_7, Absolute=False)  # disabled
previewlw_8 = CustomPreviewLineweights(Geometry=ln_10, Shader=swatch_7, Thickness=number_slider_7, Absolute=False)  # disabled

# ----
apart_circulation_solids_3 = RemoteReceiver(apart_circulation_solids)
mshedge_2 = MeshEdgesWithTolerance(Mesh=apart_circulation_solids_3, AngleThreshold=45)  # -> InteriorEdges, NakedEdges

msh2psrf = MeshToPolysurface(Mesh=apart_circulation_solids_3, Triangles=False, FaceMerge=False)
fmerge = MergeFaces(Brep=msh2psrf)  # -> Breps, Before, After
edges_3 = BrepEdges(Brep=fmerge.Breps)  # -> Naked, Interior, NonManifold

previewlw_9 = CustomPreviewLineweights(
    Geometry=edges_3.Interior,
    Shader=ColourSwatch(SwatchColor=RGB(0, 0, 0)),
    Thickness=Slider(10, range=0..10),
    Absolute=False)

apart_circulation_solids_4 = RemoteReceiver(apart_circulation_solids)
circulation_solids_3 = RemoteReceiver(circulation_solids)
apart_solids_2 = RemoteReceiver(apart_solids)
merge_24 = Merge(Data1=flatten(circulation_solids_3), Data2=flatten(apart_solids_2))
facen_3 = FaceNormals(Mesh=apart_circulation_solids_4)  # -> Centers, Normals
addition_12 = Addition(A=facen_3.Centers, B=facen_3.Normals)  # -> graft(Result)
mesh_2 = Mesh(merge_24)

minc_2 = MeshInclusion(Mesh=flatten(merge_22), Point=addition_12, Strict=False)

ma_7 = MassAddition(Input=minc_2)  # -> Result, PartialResults
bool_2 = Boolean(ma_7.Result)

# ---- group: separate meshes between outside and meshes between aparts
apart_circulation_solids_5 = RemoteReceiver(apart_circulation_solids)
demesh_4 = DeconstructMesh(Mesh=apart_circulation_solids_5)  # -> Vertices, Faces, Colours, Normals
unflatten_4 = UnflattenTree(Tree=bool_2, Guide=demesh_4.Faces)
cullf = CullFaces(Mesh=apart_circulation_solids_5, Pattern=invert(unflatten_4))
cullf_2 = CullFaces(Mesh=apart_circulation_solids_5, Pattern=unflatten_4)

# ----
lng_15 = ListLength(List=mesh_2)
subtraction_8 = Subtraction(A=lng_15, B="1")
multiplication_7 = Multiplication(A=subtraction_8, B=Slider(0.546, range=0..1))
item_28 = ListItem(List=mesh_2, Index=multiplication_7, Wrap=True)
mshclsd = IsMeshClosed(Mesh=item_28)
minc_3 = MeshInclusion(Mesh=flatten(item_28), Point=pt_4, Strict=False)
msh2psrf_2 = MeshToPolysurface(Mesh=item_28, Triangles=False, FaceMerge=False)
panel_27 = Panel(mshclsd)
panel_28 = Panel(minc_3)

clean_19 = CombineClean(Meshes=flatten(cullf))  # disabled
disjoint = DisjointMesh(Mesh=flatten(clean_19))  # -> graft(Meshes); disabled
demesh_5 = DeconstructMesh(Mesh=disjoint)  # -> Vertices, Faces, Colours, Normals; disabled
facen_4 = FaceNormals(Mesh=disjoint)  # -> Centers, Normals; disabled
devec_12 = DeconstructVector(Vector=facen_4.Normals)  # -> XComponent, YComponent, ZComponent; disabled
abs_9 = Absolute(Value=devec_12.ZComponent)  # disabled
unweave = Unweave(List=demesh_5.Faces, UnweavePattern=abs_9)  # -> Data0, Data1
clean_20 = CleanTree(RemoveNulls=True, RemoveInvalid=True, RemoveEmpty=False)  # disabled
clean_21 = CleanTree(RemoveNulls=True, RemoveInvalid=True, RemoveEmpty=False)  # disabled
swatch_8 = ColourSwatch(SwatchColor=RGB(255, 0, 0))  # disabled
swatch_9 = ColourSwatch(SwatchColor=RGB(47, 0, 255))  # disabled
conmesh_4 = ConstructMesh(Vertices=simplify(demesh_5.Vertices), Faces=simplify(clean_20), Colours=swatch_9)  # disabled
conmesh_5 = ConstructMesh(Vertices=simplify(demesh_5.Vertices), Faces=simplify(clean_21), Colours=swatch_8)  # disabled
disjoint_2 = DisjointMesh(Mesh=conmesh_4)  # disabled
disjoint_3 = DisjointMesh(Mesh=conmesh_5)  # disabled

demesh_6 = DeconstructMesh(Mesh=cullf_2)  # -> Vertices, Faces, Colours, Normals; disabled
facen_5 = FaceNormals(Mesh=cullf_2)  # -> Centers, Normals; disabled
devec_13 = DeconstructVector(Vector=facen_5.Normals)  # -> XComponent, YComponent, ZComponent; disabled
swatch_10 = ColourSwatch(SwatchColor=RGB(176, 206, 255))  # disabled
panel_29 = Panel("1")  # disabled
addition_13 = Addition(A=devec_13.ZComponent, B=panel_29)  # disabled
unweave_2 = Unweave(List=demesh_6.Faces, UnweavePattern=addition_13)  # -> Data0, Data1, Data2
clean_22 = CleanTree(RemoveNulls=True, RemoveInvalid=True, RemoveEmpty=False)  # disabled
clean_23 = CleanTree(RemoveNulls=True, RemoveInvalid=True, RemoveEmpty=False)  # disabled
clean_24 = CleanTree(RemoveNulls=True, RemoveInvalid=True, RemoveEmpty=False)  # disabled

apart_individual_blocs_6 = RemoteReceiver(apart_individual_blocs)  # disabled
merge_25 = Merge(Data1=facen_5.Centers, Data2=facen_4.Centers)  # -> flatten(Result); disabled
facen_6 = FaceNormals(Mesh=apart_individual_blocs_6)  # -> Centers, Normals; disabled
demesh_7 = DeconstructMesh(Mesh=apart_individual_blocs_6)  # -> Vertices, Faces, Colours, Normals; disabled
mindex_8 = MemberIndex(Set=facen_6.Centers, Member=merge_25)  # -> Index, Count; disabled
trim_2 = TrimTree(Tree=mindex_8.Index, Depth=1)  # disabled
cull_i = CullIndex(List=demesh_7.Faces, Indices=trim_2, Wrap=True)  # disabled
conmesh_6 = ConstructMesh(Vertices=demesh_7.Vertices, Faces=cull_i)  # -> simplify(Mesh); disabled
trim_3 = TrimTree(Tree=conmesh_6, Depth=1)  # disabled

# ---- group: me too
conmesh_7 = ConstructMesh(Vertices=simplify(demesh_6.Vertices), Faces=simplify(clean_23), Colours=swatch_10)  # disabled

# ---- group: I might be grumpy, but I should be fine
conmesh_8 = ConstructMesh(Vertices=simplify(demesh_6.Vertices), Faces=simplify(clean_22))  # disabled
conmesh_9 = ConstructMesh(Vertices=simplify(demesh_6.Vertices), Faces=simplify(clean_24))  # disabled

# ----
circulation_solids_4 = RemoteReceiver(circulation_solids)  # disabled
lng_16 = ListLength(List=flatten(circulation_solids_4))  # disabled
series_6 = Series(Start=0, Step=1, Count=lng_16)  # disabled
path_8 = ConstructPath(Indices=graft(series_6))  # -> flatten(Branch); disabled
split_9 = SplitTree(Data=conmesh_7, Masks=flatten(path_8))  # -> Positive, Negative; disabled
swatch_11 = ColourSwatch(SwatchColor=RGB(102, 120, 148))  # disabled
renumber = RenumberPaths(Data=split_9.Negative)

apart_circulation_solids_6 = RemoteReceiver(apart_circulation_solids)  # disabled
facen_7 = FaceNormals(Mesh=apart_circulation_solids_6)  # -> flatten(Centers), Normals; disabled
clean_25 = CombineClean(Meshes=flatten(conmesh_8))  # disabled
pdecon_12 = Deconstruct(Point=facen_7.Centers)  # -> XComponent, YComponent, ZComponent; disabled
facen_8 = FaceNormals(Mesh=clean_25)  # -> flatten(Centers), Normals; disabled
cset_6 = CreateSet(List=pdecon_12.ZComponent)  # -> Set, Map; disabled
demesh_8 = DeconstructMesh(Mesh=clean_25)  # -> Vertices, Faces, Colours, Normals; disabled
sort_8 = SortList(Keys=cset_6.Map)  # -> Keys, ValuesA; disabled
pdecon_13 = Deconstruct(Point=facen_8.Centers)  # -> XComponent, YComponent, ZComponent; disabled
item_29 = ListItem(List=sort_8.Keys, Index=0, Wrap=True)  # disabled
mindex_9 = MemberIndex(Set=pdecon_13.ZComponent, Member=item_29)  # -> Index, Count; disabled
cull_i_2 = CullIndex(List=demesh_8.Faces, Indices=mindex_9.Index, Wrap=True)  # disabled
swatch_12 = ColourSwatch(SwatchColor=RGB(153, 153, 153))  # disabled
swatch_13 = ColourSwatch(SwatchColor=RGB(82, 82, 82))  # disabled
item_30 = ListItem(List=demesh_8.Faces, Index=mindex_9.Index, Wrap=True)  # disabled
conmesh_10 = ConstructMesh(Vertices=demesh_8.Vertices, Faces=item_30, Colours=swatch_13)  # disabled
conmesh_11 = ConstructMesh(Vertices=demesh_8.Vertices, Faces=cull_i_2, Colours=swatch_12)  # disabled

circulation_solids_5 = RemoteReceiver(circulation_solids)  # disabled
clean_26 = CombineClean(Meshes=flatten(disjoint_2))  # disabled
clean_27 = CombineClean(Meshes=flatten(circulation_solids_5))  # disabled
facen_9 = FaceNormals(Mesh=clean_26)  # -> Centers, Normals; disabled
facen_10 = FaceNormals(Mesh=clean_27)  # -> Centers, Normals; disabled
demesh_9 = DeconstructMesh(Mesh=clean_26)  # -> Vertices, Faces, Colours, Normals; disabled
mindex_10 = MemberIndex(Set=facen_9.Centers, Member=facen_10.Centers)  # -> Index, Count; disabled
cull_i_3 = CullIndex(List=demesh_9.Faces, Indices=flatten(mindex_10.Index), Wrap=True)  # disabled
item_31 = ListItem(List=demesh_9.Faces, Index=flatten(mindex_10.Index), Wrap=True)  # disabled
swatch_14 = ColourSwatch(SwatchColor=RGB(255, 144, 0))  # disabled

circulation_solids_6 = RemoteReceiver(circulation_solids)  # disabled
clean_28 = CombineClean(Meshes=flatten(conmesh_9))  # disabled
clean_29 = CombineClean(Meshes=flatten(circulation_solids_6))  # disabled
facen_11 = FaceNormals(Mesh=clean_28)  # -> Centers, Normals; disabled
facen_12 = FaceNormals(Mesh=clean_29)  # -> Centers, Normals; disabled
demesh_10 = DeconstructMesh(Mesh=clean_28)  # -> Vertices, Faces, Colours, Normals; disabled
mindex_11 = MemberIndex(Set=facen_11.Centers, Member=facen_12.Centers)  # -> Index, Count; disabled
cull_i_4 = CullIndex(List=demesh_10.Faces, Indices=flatten(mindex_11.Index), Wrap=True)  # disabled
item_32 = ListItem(List=demesh_10.Faces, Index=flatten(mindex_11.Index), Wrap=True)  # disabled
swatch_15 = ColourSwatch(SwatchColor=RGB(78, 120, 0))  # disabled
swatch_16 = ColourSwatch(SwatchColor=RGB(143, 219, 0))  # disabled

mcol = MeshColours(Mesh=split_9.Positive, Colours=swatch_11)  # disabled
mesh_3 = Mesh(renumber)  # disabled

# ---- group: I might be grumpy, but I should be fine
conmesh_12 = ConstructMesh(Vertices=demesh_9.Vertices, Faces=item_31, Colours=swatch_14)  # disabled
conmesh_13 = ConstructMesh(Vertices=demesh_9.Vertices, Faces=cull_i_3, Colours=swatch_9)  # disabled

conmesh_14 = ConstructMesh(Vertices=demesh_10.Vertices, Faces=item_32, Colours=swatch_15)  # disabled
conmesh_15 = ConstructMesh(Vertices=demesh_10.Vertices, Faces=cull_i_4, Colours=swatch_16)  # disabled

# ----
circulation_solids_7 = RemoteReceiver(circulation_solids)  # disabled
clean_30 = CombineClean(Meshes=flatten(conmesh_11))  # disabled
clean_31 = CombineClean(Meshes=flatten(circulation_solids_7))  # disabled
facen_13 = FaceNormals(Mesh=clean_30)  # -> Centers, Normals; disabled
facen_14 = FaceNormals(Mesh=clean_31)  # -> Centers, Normals; disabled
demesh_11 = DeconstructMesh(Mesh=clean_30)  # -> Vertices, Faces, Colours, Normals; disabled
mindex_12 = MemberIndex(Set=facen_13.Centers, Member=facen_14.Centers)  # -> Index, Count; disabled
item_33 = ListItem(List=demesh_11.Faces, Index=flatten(mindex_12.Index), Wrap=True)  # disabled
cull_i_5 = CullIndex(List=demesh_11.Faces, Indices=flatten(mindex_12.Index), Wrap=True)  # disabled
swatch_17 = ColourSwatch(SwatchColor=RGB(150, 150, 150))  # disabled
swatch_18 = ColourSwatch(SwatchColor=RGB(222, 222, 222))  # disabled

circulation_solids_8 = RemoteReceiver(circulation_solids)  # disabled
clean_32 = CombineClean(Meshes=flatten(conmesh_10))  # disabled
clean_33 = CombineClean(Meshes=flatten(conmesh_3))  # disabled
facen_15 = FaceNormals(Mesh=clean_32)  # -> Centers, Normals; disabled
facen_16 = FaceNormals(Mesh=clean_33)  # -> Centers, Normals; disabled
demesh_12 = DeconstructMesh(Mesh=clean_32)  # -> Vertices, Faces, Colours, Normals; disabled
mindex_13 = MemberIndex(Set=facen_15.Centers, Member=facen_16.Centers)  # -> Index, Count; disabled
item_34 = ListItem(List=demesh_12.Faces, Index=flatten(mindex_13.Index), Wrap=True)  # disabled
cull_i_6 = CullIndex(List=demesh_12.Faces, Indices=flatten(mindex_13.Index), Wrap=True)  # disabled
swatch_19 = ColourSwatch(SwatchColor=RGB(31, 31, 31))  # disabled
swatch_20 = ColourSwatch(SwatchColor=RGB(82, 82, 82))  # disabled

# ---- group: I might be grumpy, but I should be fine
conmesh_16 = ConstructMesh(Vertices=demesh_11.Vertices, Faces=item_33, Colours=swatch_17)  # disabled
conmesh_17 = ConstructMesh(Vertices=demesh_11.Vertices, Faces=cull_i_5, Colours=swatch_18)  # disabled

conmesh_18 = ConstructMesh(Vertices=demesh_12.Vertices, Faces=item_34, Colours=swatch_19)  # disabled
conmesh_19 = ConstructMesh(Vertices=demesh_12.Vertices, Faces=cull_i_6, Colours=swatch_20)  # disabled

# ----
circulation_cleaned_per_bloc_2 = RemoteReceiver(circulation_cleaned_per_bloc)
facen_17 = FaceNormals(Mesh=conmesh_12)  # -> graft(Centers), graft(Normals)
addition_14 = Addition(A=facen_17.Centers, B=facen_17.Normals)
minc_4 = MeshInclusion(Mesh=flatten(circulation_cleaned_per_bloc_2), Point=addition_14, Strict=False)
ma_8 = MassAddition(Input=minc_4)  # -> Result, PartialResults
dispatch_8 = Dispatch(List=facen_17.Normals, DispatchPattern=ma_8.Result)  # -> ListA, ListB
dispatch_9 = Dispatch(List=facen_17.Centers, DispatchPattern=ma_8.Result)  # -> ListA, ListB
Z_4 = UnitZ(Factor=1)
vdis = VectorDisplay(Anchor=dispatch_9.ListA, Vector=dispatch_8.ListA)
pl = ConstructPlane(Origin=dispatch_9.ListA, XAxis=dispatch_8.ListA, YAxis=Z_4)

clean_34 = CombineClean(Meshes=mesh_3)
merge_26 = Merge(Data1=mcol, Data2=mesh_3)
facen_18 = FaceNormals(Mesh=clean_34)  # -> Centers, Normals
disjoint_4 = DisjointMesh(Mesh=clean_34)  # -> simplify(graft(Meshes))

demesh_13 = DeconstructMesh(Mesh=conmesh_12)  # -> Vertices, Faces, Colours, Normals
item_35 = ListItem(List=demesh_13.Faces, Index=0, Wrap=True)
deface = DeconstructFace(Face=demesh_13.Faces)  # -> CornerA, CornerB, CornerC, CornerD
entwine_7 = Entwine(Branch00=deface.CornerA, Branch01=deface.CornerB, Branch02=deface.CornerC, Branch03=deface.CornerD, FlattenInputs=True)
item_36 = ListItem(List=demesh_13.Vertices, Index=entwine_7, Wrap=True)
bang_5 = ExplodeTree(Data=item_36)  # -> Branch0, Branch1, Branch2, Branch3
dist = Distance(PointA=bang_5.Branch0, PointB=bang_5.Branch1)
dist_2 = Distance(PointA=bang_5.Branch1, PointB=bang_5.Branch2)

demesh_14 = DeconstructMesh(Mesh=conmesh_13)  # -> Vertices, Faces, Colours, Normals
item_37 = ListItem(List=demesh_14.Faces, Index=0, Wrap=True)
deface_2 = DeconstructFace(Face=demesh_14.Faces)  # -> CornerA, CornerB, CornerC, CornerD
entwine_8 = Entwine(
    Branch00=deface_2.CornerA,
    Branch01=deface_2.CornerB,
    Branch02=deface_2.CornerC,
    Branch03=deface_2.CornerD,
    FlattenInputs=True)
item_38 = ListItem(List=demesh_14.Vertices, Index=entwine_8, Wrap=True)
bang_6 = ExplodeTree(Data=item_38)  # -> Branch0, Branch1, Branch2, Branch3
dist_3 = Distance(PointA=bang_6.Branch0, PointB=bang_6.Branch1)
dist_4 = Distance(PointA=bang_6.Branch1, PointB=bang_6.Branch2)

clean_35 = CombineClean(Meshes=flatten(merge_26))
vdis_2 = VectorDisplay(Anchor=facen_18.Centers, Vector=facen_18.Normals)
grphmsh = GraphFromMesh(InputMesh=disjoint_4)
disjoint_5 = DisjointMesh(Mesh=clean_35)  # -> simplify(graft(Meshes))
explode = MeshExplode(Mesh=disjoint_4, Interpolate=False)
edges_4 = GraphEdges(MeshGraph=grphmsh)  # -> MeshId, GraphEdge, TopoEdge, Weight, Nodes, Angle, Bend
nodes = GraphNodes(MeshGraph=grphmsh)  # -> MeshId, Point, Weight, Edges, Neighbors, Depth, NodeObject
edges_5 = GraphEdges(MeshGraph=disjoint_5)  # -> MeshId, GraphEdge, TopoEdge, Weight, Nodes, Angle, Bend
mesh_4 = Mesh(simplify(explode))
tag_6 = TextTag(Location=nodes.Point, Text=nodes.MeshId)
data = Data(edges_5.TopoEdge)
data_2 = Data(edges_4.GraphEdge)
medges_2 = MeshEdges(Mesh=mesh_4)  # -> NakedEdges, InteriorEdges, NonManifoldEdges
demesh_15 = DeconstructMesh(Mesh=mesh_4)  # -> Vertices, Faces, Colours, Normals

# ---- group: should always select bottom horizontal
item_39 = ListItem(List=medges_2.NakedEdges, Index=0, Wrap=True)

# ----
medges_3 = MeshEdges(Mesh=disjoint_4)  # -> NakedEdges, InteriorEdges, NonManifoldEdges
len_6 = Length(Curve=item_39)
mindex_14 = MemberIndex(Set=merge_9, Member=len_6)  # -> simplify(Index), Count
pshift_5 = ShiftPaths(Data=mindex_14.Index, Offset=-1)

parameter_column_3 = RemoteReceiver(parameter_column)
ln_11 = Line(StartPoint=bang_5.Branch1, EndPoint=bang_5.Branch2)
end = EndPoints(Curve=ln_11)  # -> Start, End
eval_8 = EvaluateCurve(Curve=ln_11, Parameter=parameter_column_3)  # -> Point, Tangent, Angle
pdecon_14 = Deconstruct(Point=graft(eval_8.Point))  # -> XComponent, YComponent, ZComponent
dist_5 = Distance(PointA=end.Start, PointB=eval_8.Point)  # -> simplify(graft(Distance))
deplane_3 = DeconstructPlane(Plane=pl)  # -> Origin, XAxis, YAxis, ZAxis
pdecon_15 = Deconstruct(Point=deplane_3.Origin)  # -> XComponent, YComponent, ZComponent
pt_9 = ConstructPoint(XCoordinate=pdecon_15.XComponent, YCoordinate=pdecon_15.YComponent, ZCoordinate=pdecon_14.ZComponent)
pl_2 = ConstructPlane(Origin=pt_9, XAxis=deplane_3.YAxis, YAxis=deplane_3.ZAxis)

previewlw_10 = CustomPreviewLineweights(
    Geometry=medges_3.NakedEdges,
    Shader=ColourSwatch(SwatchColor=RGB(0, 0, 0)),
    Thickness=Slider(6, range=0..10),
    Absolute=False)
previewlw_11 = CustomPreviewLineweights(Geometry=medges_3.InteriorEdges, Shader=ColourSwatch(SwatchColor=RGB(0, 178, 255)), Absolute=False)
ma_9 = MassAddition(Input=pshift_5)  # -> Result, PartialResults
lng_17 = ListLength(List=pshift_5)
not_2 = GateNot(A=pshift_5)
subtraction_9 = Subtraction(A=lng_17, B=ma_9.Result)
dispatch_10 = Dispatch(List=mesh_4, DispatchPattern=not_2)  # -> ListA, ListB
# {A;B;C}: A = width of facade
# B = apartment index
# C = facade cluster
entwine_9 = Entwine(Branch0X=dispatch_10.ListA, Branch1X=dispatch_10.ListB, FlattenInputs=False)

facen_19 = FaceNormals(Mesh=conmesh_19)  # -> Centers, Normals
xy_4 = XYPlane(Origin=Point(0, 0, 0))
cset_7 = CreateSet(List=facen_19.Centers)  # -> Set, Map
pl_origin_4 = PlaneOrigin(Base=xy_4, Origin=cset_7.Set)

number_slider_8 = Slider(0, range=0..2)
number_slider_9 = Slider(2, range=0..8)
merge_27 = Merge(Data1=Slider(0, range=0..2), Data2="?", Data3="?")
conmask = ConstructPathMask(IndexCharacters=merge_27)
split_10 = SplitTree(Data=entwine_9, Masks=flatten(conmask))  # -> Positive, Negative

deplane_4 = DeconstructPlane(Plane=pl_2)  # -> Origin, XAxis, YAxis, ZAxis
multiplication_8 = Multiplication(A=deplane_4.ZAxis, B=ma_3.PartialResults)

# ----
# SOMETHIMES THERE ARE NO CLUSTERS !!!!
pshift_6 = ShiftPaths(Data=entwine_9, Offset=-1)
path_mapper = PathMapper(pshift_6, source="{A;B}", target="{B;A}")

# ---- group: order, direction and intensities of the layer's thicknesses (amplitudes will position the planes at each middle of each middle's thickness
neg_5 = Negative(Value=reverse(multiplication_8))
item_40 = ListItem(List=multiplication_8, Index=0, Wrap=True)
long_7 = LongestList(ListA="{0,0,0}", ListB=item_40, PaddingMode=2)  # -> ListA, ListB
merge_28 = Merge(Data1=neg_5, Data2=long_7.ListA, Data3=multiplication_8)  # -> simplify(Result)

# ----
clean_36 = CleanTree(RemoveNulls=True, RemoveInvalid=True, RemoveEmpty=invert(False), Tree=pl_2)  # -> simplify(Tree)
tstat_17 = TreeStatistics(Tree=clean_36)  # -> Paths, Length, Count
branch_8 = TreeBranch(Tree=merge_28, Path=tstat_17.Paths, MaintainPaths=True)
move_2 = Move(Geometry=clean_36, Motion=branch_8)  # -> Geometry, Transform

column_width_6 = RemoteReceiver(column_width)
subtraction_10 = Subtraction(A=dist, B=column_width_6)
division_15 = Division(A=subtraction_10, B="2")  # -> simplify(graft(Result))
branch_9 = TreeBranch(Tree=division_15, Path=tstat_17.Paths, MaintainPaths=True)
branch_10 = TreeBranch(Tree=dist_5, Path=tstat_17.Paths, MaintainPaths=True)

# ---- group: column overlap for the first and last layers
column_width_7 = RemoteReceiver(column_width)
division_16 = Division(A=column_width_7, B="2")
addition_15 = Addition(A=division_16, B=branch_9)
merge_29 = Merge(Data1=addition_15, Data2=branch_9, Data3=branch_9, Data4=branch_9, Data5=addition_15)

# ----
clean_37 = CombineClean(Meshes=flatten(mesh_3))
disjoint_6 = DisjointMesh(Mesh=clean_37)  # -> simplify(graft(Meshes))

edges_6 = GraphEdges(MeshGraph=disjoint_6)  # -> MeshId, GraphEdge, TopoEdge, Weight, Nodes, Angle, Bend
int_2 = Integer("1")
int_3 = Integer("3")
mindex_15 = MemberIndex(Set=edges_6.Bend, Member=int_2)  # -> Index, Count
mindex_16 = MemberIndex(Set=edges_6.Bend, Member=int_3)  # -> Index, Count
item_41 = ListItem(List=edges_6.TopoEdge, Index=mindex_15.Index, Wrap=True)  # -> simplify(Item)
item_42 = ListItem(List=edges_6.TopoEdge, Index=mindex_16.Index, Wrap=True)  # -> simplify(Item)

box_5 = CenterBox(Base=simplify(move_2.Geometry), X=branch_10, Y=merge_29, Z=division_6)
clean_38 = CleanTree(RemoveNulls=True, RemoveInvalid=True, RemoveEmpty=invert(False), Tree=box_5)  # -> simplify(Tree)
renumber_2 = RenumberPaths(Data=clean_38)

devec_14 = DeconstructVector(Vector=item_41)  # -> XComponent, YComponent, ZComponent
abs_10 = Absolute(Value=devec_14.ZComponent)
larger_11 = LargerThan(FirstNumber=abs_10, SecondNumber="0")  # -> LargerThan, OrEqualTo

color_apartment_interior_finish_wall_2 = RemoteReceiver(color_apartment_interior_finish_wall)
color_apartment_wall_2 = RemoteReceiver(color_apartment_wall)
color_circulation_finish_wall_2 = RemoteReceiver(color_circulation_finish_wall)
color_accoustic_panel_2 = RemoteReceiver(color_accoustic_panel)
merge_30 = Merge(
    Data1=color_apartment_interior_finish_wall_2,
    Data2=color_apartment_wall_2,
    Data3=color_accoustic_panel_2,
    Data4=color_apartment_wall_2,
    Data5=color_circulation_finish_wall_2)
preview_13 = CustomPreview(Geometry=renumber_2, Material=merge_30)

dispatch_11 = Dispatch(List=item_41, DispatchPattern=larger_11.LargerThan)  # -> ListA, ListB

facen_20 = FaceNormals(Mesh=disjoint_6)  # -> Centers, Normals
eval_9 = EvaluateLength(Curve=item_42, Length=".5", Normalized=True)  # -> Point, Tangent, Parameter
cps_2 = ClosestPoints(Point=eval_9.Point, Cloud=facen_20.Centers, Count="2")  # -> ClosestPoint, CPIndex, Distance
item_43 = ListItem(List=facen_20.Normals, Index=cps_2.CPIndex, Wrap=True)
ma_10 = MassAddition(Input=item_43)  # -> Result, PartialResults
vdis_3 = VectorDisplay(Anchor=eval_9.Point, Vector=ma_10.Result)

eval_10 = EvaluateLength(Curve=dispatch_11.ListA, Length=".5", Normalized=True)  # -> Point, Tangent, Parameter
facen_21 = FaceNormals(Mesh=disjoint_6)  # -> Centers, Normals
cp_2 = ClosestPoint(Point=eval_10.Point, Cloud=facen_21.Centers)  # -> ClosestPoint, CPIndex, Distance
item_44 = ListItem(List=facen_21.Normals, Index=cp_2.CPIndex, Wrap=True)
vdis_4 = VectorDisplay(Anchor=eval_10.Point, Vector=item_44)

eval_11 = EvaluateLength(Curve=dispatch_11.ListB, Length=".5", Normalized=True)  # -> Point, Tangent, Parameter
facen_22 = FaceNormals(Mesh=disjoint_6)  # -> Centers, Normals
cp_3 = ClosestPoint(Point=eval_11.Point, Cloud=facen_22.Centers)  # -> ClosestPoint, CPIndex, Distance
item_45 = ListItem(List=facen_22.Normals, Index=cp_3.CPIndex, Wrap=True)
vdis_5 = VectorDisplay(Anchor=eval_11.Point, Vector=item_45)

Z_5 = UnitZ(Factor=1)
pl_3 = ConstructPlane(Origin=eval_10.Point, XAxis=item_44, YAxis=Z_5)
deplane_5 = DeconstructPlane(Plane=pl_3)  # -> Origin, XAxis, YAxis, ZAxis
neg_6 = Negative(Value=deplane_5.ZAxis)
pl_4 = ConstructPlane(Origin=deplane_5.Origin, XAxis=neg_6, YAxis=deplane_5.YAxis)

Z_6 = UnitZ(Factor=1)
pl_5 = ConstructPlane(Origin=eval_11.Point, XAxis=item_45, YAxis=Z_6)
deplane_6 = DeconstructPlane(Plane=pl_5)  # -> Origin, XAxis, YAxis, ZAxis
pl_6 = ConstructPlane(Origin=deplane_6.Origin, XAxis=deplane_6.YAxis, YAxis=deplane_6.ZAxis)  # -> flatten(Plane)

deplane_7 = DeconstructPlane(Plane=pl_6)  # -> Origin, XAxis, YAxis, ZAxis
devec_15 = DeconstructVector(Vector=deplane_7.ZAxis)  # -> XComponent, YComponent, ZComponent
abs_11 = Absolute(Value=devec_15.XComponent)
abs_12 = Absolute(Value=devec_15.YComponent)
dispatch_12 = Dispatch(List=pl_6, DispatchPattern=abs_11)  # -> ListA, ListB
entwine_10 = Entwine(Branch00=dispatch_12.ListA, Branch01=dispatch_12.ListB, FlattenInputs=True)

move_3 = Move(Geometry=pl_4, Motion=rev_2)  # -> Geometry, Transform
move_4 = Move(Geometry=entwine_10, Motion=rev_2)  # -> Geometry, Transform

circulation_solids_9 = RemoteReceiver(circulation_solids)  # disabled
clean_39 = CombineClean(Meshes=flatten(circulation_solids_9))  # disabled
clean_40 = CombineClean(Meshes=flatten(disjoint_3))  # disabled
demesh_16 = DeconstructMesh(Mesh=clean_39)  # -> Vertices, Faces, Colours, Normals; disabled
facen_23 = FaceNormals(Mesh=clean_39)  # -> Centers, Normals; disabled
facen_24 = FaceNormals(Mesh=clean_40)  # -> Centers, Normals; disabled
mindex_17 = MemberIndex(Set=facen_23.Centers, Member=facen_24.Centers)  # -> Index, Count; disabled
item_46 = ListItem(List=demesh_16.Faces, Index=flatten(mindex_17.Index), Wrap=True)  # disabled
item_47 = ListItem(List=facen_23.Normals, Index=flatten(mindex_17.Index), Wrap=True)  # disabled
devec_16 = DeconstructVector(Vector=item_47)  # -> XComponent, YComponent, ZComponent; disabled
panel_30 = Panel("0")  # disabled
larger_12 = LargerThan(FirstNumber=devec_16.ZComponent, SecondNumber=panel_30)  # -> LargerThan, OrEqualTo; disabled
swatch_21 = ColourSwatch(SwatchColor=RGB(180, 0, 186))  # disabled
swatch_22 = ColourSwatch(SwatchColor=RGB(250, 117, 255))  # disabled
dispatch_13 = Dispatch(List=item_46, DispatchPattern=larger_12.LargerThan)  # -> ListA, ListB; disabled

# ---- group: remove faces from inside_common_slabs_TEMP
demesh_17 = DeconstructMesh(Mesh=clean_40)  # -> Vertices, Faces, Colours, Normals; disabled
mindex_18 = MemberIndex(Set=facen_24.Centers, Member=facen_23.Centers)  # -> Index, Count; disabled
cull_i_7 = CullIndex(List=demesh_17.Faces, Indices=flatten(mindex_18.Index), Wrap=True)  # disabled

# ---- group: I might be grumpy, but I should be fine
conmesh_20 = ConstructMesh(Vertices=demesh_16.Vertices, Faces=dispatch_13.ListA, Colours=swatch_22)  # disabled
conmesh_21 = ConstructMesh(Vertices=demesh_16.Vertices, Faces=dispatch_13.ListB, Colours=swatch_21)  # disabled
conmesh_22 = ConstructMesh(Vertices=demesh_17.Vertices, Faces=cull_i_7, Colours=swatch_8)  # disabled

# ----
clean_41 = CombineClean(Meshes=flatten(conmesh_22))  # disabled

clean_42 = CombineClean(Meshes=flatten(conmesh_20))  # disabled
clean_43 = CombineClean(Meshes=flatten(conmesh_21))  # disabled

merge_31 = Merge(Data1=clean_41, Data2=conmesh_15)  # -> flatten(Result)
null_2 = NullItem(Item=merge_31)  # -> NullFlags, InvalidFlags, Description
cull_10 = CullPattern(List=merge_31, CullPattern=invert(null_2.NullFlags))
item_48 = ListItem(List=cull_10, Index=0, Wrap=True)

facen_25 = FaceNormals(Mesh=clean_42)  # -> Centers, Normals
xy_5 = XYPlane(Origin=Point(0, 0, 0))
cset_8 = CreateSet(List=facen_25.Centers)  # -> Set, Map
pl_origin_5 = PlaneOrigin(Base=xy_5, Origin=cset_8.Set)

clean_44 = CombineClean(Meshes=flatten(trim_3))  # disabled
disjoint_7 = DisjointMesh(Mesh=flatten(clean_44))  # -> graft(Meshes); disabled
demesh_18 = DeconstructMesh(Mesh=disjoint_7)  # -> Vertices, Faces, Colours, Normals; disabled
facen_26 = FaceNormals(Mesh=disjoint_7)  # -> Centers, Normals; disabled
devec_17 = DeconstructVector(Vector=facen_26.Normals)  # -> XComponent, YComponent, ZComponent; disabled
abs_13 = Absolute(Value=devec_17.ZComponent)  # disabled
unweave_3 = Unweave(List=demesh_18.Faces, UnweavePattern=abs_13)  # -> Data0, Data1
number_slider_10 = Slider(0.16, range=0..1)  # disabled
alpha_5 = AdjustAlpha(Color=swatch_9, Alpha=number_slider_10)  # disabled
alpha_6 = AdjustAlpha(Color=swatch_8, Alpha=number_slider_10)  # disabled

# ---- group: I might be grumpy, but I should be fine
conmesh_23 = ConstructMesh(Vertices=simplify(demesh_18.Vertices), Faces=simplify({A=0, B=1, C=2, D=3}), Colours=alpha_5)  # disabled
conmesh_24 = ConstructMesh(Vertices=simplify(demesh_18.Vertices), Faces=simplify({A=0, B=1, C=2, D=3}), Colours=alpha_6)  # disabled

# ----
clean_45 = CleanTree(RemoveNulls=True, RemoveInvalid=True, RemoveEmpty=invert(False), Tree=conmesh_24)  # disabled

clean_46 = CombineClean(Meshes=flatten(conmesh_9))  # disabled
disjoint_8 = DisjointMesh(Mesh=clean_46)  # -> graft(Meshes); disabled
medges_4 = MeshEdges(Mesh=disjoint_8)  # -> NakedEdges, InteriorEdges, NonManifoldEdges; disabled
number_slider_11 = Slider(0.5, range=0.1..0.8)  # disabled
join = JoinCurves(Curves=medges_4.NakedEdges, Preserve=False)  # disabled
neg_7 = Negative(Value=number_slider_11)  # disabled
merge_32 = Merge(Data1=neg_7, Data2=number_slider_11)  # disabled
offset = OffsetCurve(Curve=join, Distance=merge_32, Corners=1)  # -> simplify(Curve); disabled
trim_4 = TrimTree(Tree=offset, Depth=1)  # disabled
len_7 = Length(Curve=trim_4)  # disabled
sort_9 = SortList(Keys=len_7, ValuesA=trim_4)  # -> Keys, ValuesA; disabled
simplify = SimplifyCurve(Curve=join)  # -> reparameterize(Curve), Simplified; disabled
item_49 = ListItem(List=sort_9.ValuesA, Index=0, Wrap=True)  # disabled
explode_2 = Explode(Curve=simplify.Curve, Recursive=True)  # -> Segments, Vertices; disabled
panel_31 = Panel(".5")  # disabled
eval_12 = EvaluateCurve(Curve=reparameterize(explode_2.Segments), Parameter=panel_31)  # -> Point, Tangent, Angle; disabled
number_slider_12 = Slider(0.5, range=0.1..1)  # disabled
Z_7 = UnitZ(Factor=number_slider_12)  # disabled

# ---- group: leave me alone, I know what I'm doing
explode_3 = Explode(Curve=item_49, Recursive=True)  # -> Segments, Vertices; disabled
join_2 = JoinCurves(Curves=explode_3.Segments, Preserve=False)  # disabled
simplify_2 = SimplifyCurve(Curve=join_2)  # -> reparameterize(Curve), Simplified; disabled
explode_4 = Explode(Curve=simplify_2.Curve, Recursive=True)  # -> Segments, Vertices; disabled

# ----
alongcrv = SortAlongCurve(Points=eval_12.Point, Curve=simplify_2.Curve)  # -> Points, Indices; disabled
item_50 = ListItem(List=explode_2.Segments, Index=alongcrv.Indices, Wrap=True)  # disabled
rulesrf = RuledSurface(CurveA=item_50, CurveB=explode_4.Segments)  # disabled
extr = Extrude(Base=rulesrf, Direction=Z_7)  # disabled
preview_14 = CustomPreview(Geometry=extr, Material=swatch_16)  # disabled

item_51 = ListItem(List=flatten(clean_18), Index=0, Wrap=True)
eval_13 = EvaluateCurve(Curve=reparameterize(clean_18), Parameter=".5")  # -> Point, Tangent, Angle
pdecon_16 = Deconstruct(Point=eval_13.Point)  # -> XComponent, YComponent, ZComponent
sort_10 = SortList(Keys=pdecon_16.ZComponent, ValuesA=eval_13.Point)  # -> Keys, ValuesA
len_8 = Length(Curve=clean_18)
xy_6 = XYPlane(Origin=Point(0, 0, 0))
item_52 = ListItem(List=sort_10.ValuesA, Index=0, Wrap=True)
pl_origin_6 = PlaneOrigin(Base=xy_6, Origin=item_52)
division_17 = Division(A=beam_height_2, B="2")
division_18 = Division(A=len_8, B="2")
division_19 = Division(A=beam_width_3, B="2")
deplane_8 = DeconstructPlane(Plane=pl_origin_6)  # -> Origin, XAxis, YAxis, ZAxis
vec_4 = Vector(clean_18)
pl_7 = ConstructPlane(Origin=deplane_8.Origin, XAxis=deplane_8.ZAxis, YAxis=vec_4)
deplane_9 = DeconstructPlane(Plane=pl_7)  # -> Origin, XAxis, YAxis, ZAxis
pl_8 = ConstructPlane(Origin=deplane_9.Origin, XAxis=deplane_9.XAxis, YAxis=deplane_9.ZAxis)

# ---- group: reduce_length
beam_width_5 = RemoteReceiver(beam_width)
division_20 = Division(A=beam_width_5, B="2")
subtraction_11 = Subtraction(A=division_18, B=division_20)

# ----
box_6 = CenterBox(Base=pl_8, X=division_17, Y=division_19, Z=subtraction_11)

move_5 = Move(Geometry=box_6, Motion=Z_2)  # -> Geometry, Transform

preview_15 = CustomPreview(Geometry=move_5.Geometry, Material=ColourSwatch(SwatchColor=RGB(0, 166, 255)))

facen_27 = FaceNormals(Mesh=conmesh_13)  # -> Centers, Normals
Z_8 = UnitZ(Factor=1)

cset_9 = CreateSet(List=facen_27.Centers)  # -> Set, Map
dim_accoustic_wall_5 = RemoteReceiver(dim_accoustic_wall)

dim_interior_finish_wall_7 = RemoteReceiver(dim_interior_finish_wall_2)
dim_interior_wall_8 = RemoteReceiver(dim_interior_wall_2)
merge_33 = Merge(
    Data1=dim_interior_finish_wall_7,
    Data2=dim_interior_wall_8,
    Data3=dim_accoustic_wall_5,
    Data4=dim_interior_wall_8,
    Data5=dim_interior_finish_wall_7)
division_21 = Division(A=merge_33, B="2")

mindex_19 = MemberIndex(Set=facen_27.Centers, Member=cset_9.Set)  # -> Index, Count

item_53 = ListItem(List=mindex_19.Index, Index=0, Wrap=True)
item_54 = ListItem(List=flatten(facen_27.Centers), Index=item_53, Wrap=True)
item_55 = ListItem(List=flatten(facen_27.Normals), Index=item_53, Wrap=True)

pl_9 = ConstructPlane(Origin=item_54, XAxis=item_55, YAxis=Z_8)  # -> simplify(Plane)

parameter_column_4 = RemoteReceiver(parameter_column)
ln_12 = Line(StartPoint=bang_6.Branch1, EndPoint=bang_6.Branch2)
end_2 = EndPoints(Curve=ln_12)  # -> Start, End
eval_14 = EvaluateCurve(Curve=ln_12, Parameter=parameter_column_4)  # -> Point, Tangent, Angle
item_56 = ListItem(List=eval_14.Point, Index=item_53, Wrap=True)
dist_6 = Distance(PointA=end_2.Start, PointB=eval_14.Point)  # -> simplify(graft(Distance))
deplane_10 = DeconstructPlane(Plane=pl_9)  # -> Origin, XAxis, YAxis, ZAxis
pdecon_17 = Deconstruct(Point=item_56)  # -> XComponent, YComponent, ZComponent
pdecon_18 = Deconstruct(Point=deplane_10.Origin)  # -> XComponent, YComponent, ZComponent
pt_10 = ConstructPoint(XCoordinate=pdecon_18.XComponent, YCoordinate=pdecon_18.YComponent, ZCoordinate=pdecon_17.ZComponent)
pl_10 = ConstructPlane(Origin=pt_10, XAxis=deplane_10.YAxis, YAxis=deplane_10.ZAxis)

deplane_11 = DeconstructPlane(Plane=pl_10)  # -> Origin, XAxis, YAxis, ZAxis
multiplication_9 = Multiplication(A=deplane_11.ZAxis, B=ma_4.PartialResults)

# ---- group: order, direction and intensities of the layer's thicknesses (amplitudes will position the planes at each middle of each middle's thickness
neg_8 = Negative(Value=reverse(multiplication_9))
item_57 = ListItem(List=multiplication_9, Index=0, Wrap=True)
long_8 = LongestList(ListA="{0,0,0}", ListB=item_57, PaddingMode=2)  # -> ListA, ListB
merge_34 = Merge(Data1=neg_8, Data2=long_8.ListA, Data3=multiplication_9)  # -> simplify(Result)

# ----
column_width_8 = RemoteReceiver(column_width)
subtraction_12 = Subtraction(A=dist_3, B=column_width_8)
division_22 = Division(A=subtraction_12, B="2")  # -> simplify(graft(Result))
branch_11 = TreeBranch(Tree=division_22, Path=flatten(item_53), MaintainPaths=True)
branch_12 = TreeBranch(Tree=dist_6, Path=flatten(item_53), MaintainPaths=True)

move_6 = Move(Geometry=pl_10, Motion=merge_34)  # -> Geometry, Transform

# ---- group: column overlap for the first and last layers
column_width_9 = RemoteReceiver(column_width)
division_23 = Division(A=column_width_9, B="2")
addition_16 = Addition(A=division_23, B=branch_11)
merge_35 = Merge(Data1=addition_16, Data2=branch_11, Data3=branch_11, Data4=branch_11, Data5=addition_16)

# ----
box_7 = CenterBox(Base=simplify(move_6.Geometry), X=branch_12, Y=merge_35, Z=division_21)
clean_47 = CleanTree(RemoveNulls=True, RemoveInvalid=True, RemoveEmpty=invert(False), Tree=box_7)  # -> simplify(Tree)
renumber_3 = RenumberPaths(Data=clean_47)

color_apartment_interior_finish_wall_3 = RemoteReceiver(color_apartment_interior_finish_wall)
color_apartment_wall_3 = RemoteReceiver(color_apartment_wall)
color_accoustic_panel_3 = RemoteReceiver(color_accoustic_panel)
merge_36 = Merge(
    Data1=color_apartment_interior_finish_wall_3,
    Data2=color_apartment_wall_3,
    Data3=color_accoustic_panel_3,
    Data4=color_apartment_wall_3,
    Data5=color_apartment_interior_finish_wall_3)
preview_16 = CustomPreview(Geometry=renumber_3, Material=merge_36)

# ---- group: should flip the origin plane depending on the orientation of the face (longest side towards one same axis all the time)
demesh_19 = DeconstructMesh(Mesh=item_48)  # -> Vertices, Faces, Colours, Normals
item_58 = ListItem(List=demesh_19.Faces, Index=0, Wrap=True)
deface_3 = DeconstructFace(Face=item_58)  # -> CornerA, CornerB, CornerC, CornerD
entwine_11 = Entwine(
    Branch00=deface_3.CornerA,
    Branch01=deface_3.CornerB,
    Branch02=deface_3.CornerC,
    Branch03=deface_3.CornerD,
    FlattenInputs=True)
item_59 = ListItem(List=demesh_19.Vertices, Index=entwine_11, Wrap=True)
bang_7 = ExplodeTree(Data=item_59)  # -> Branch0, Branch1, Branch2, Branch3
dist_7 = Distance(PointA=bang_7.Branch0, PointB=bang_7.Branch1)
dist_8 = Distance(PointA=bang_7.Branch1, PointB=bang_7.Branch2)

# ----
min_2 = Minimum(A=dist_7, B=dist_8)
max_3 = Maximum(A=dist_7, B=dist_8)

# ---- group: should flip the origin plane depending on the orientation of the face (longest side towards one same axis all the time) (continued)
floort_dim_2 = RemoteSender(min_2)
floor_dim_1 = RemoteSender(max_3)

# ----
dim_accoustic_slab_9 = RemoteReceiver(dim_accoustic_slab_2)
dim_apart_slab_strct_6 = RemoteReceiver(dim_apart_slab_strct_2)
dim_apart_ceiling_4 = RemoteReceiver(dim_apart_ceiling_2)
dim_interior_floor_11 = RemoteReceiver(dim_interior_floor_2)
merge_37 = Merge(
    Data1=dim_interior_floor_11,
    Data2=dim_accoustic_slab_9,
    Data3=dim_apart_slab_strct_6,
    Data4=dim_air_layer_2,
    Data5=dim_apart_ceiling_4)
item_60 = ListItem(List=pl_origin_5, Index=0, Wrap=True)
ma_11 = MassAddition(Input=merge_37)  # -> Result, PartialResults
division_24 = Division(A=merge_37, B="2")
division_25 = Division(A=merge_37, B="2")
subtraction_13 = Subtraction(A=ma_11.PartialResults, B=division_25)
neg_9 = Negative(Value=subtraction_13)
Z_9 = UnitZ(Factor=neg_9)
beam_width_6 = RemoteReceiver(beam_width)
floort_dim_2_2 = RemoteReceiver(floort_dim_2)
floor_dim_1_2 = RemoteReceiver(floor_dim_1)
move_7 = Move(Geometry=item_60, Motion=Z_9)  # -> Geometry, Transform
division_26 = Division(A=floor_dim_1_2, B="2")
division_27 = Division(A=floort_dim_2_2, B="2")
division_28 = Division(A=beam_width_6, B="2")
subtraction_14 = Subtraction(A=division_27, B=division_28)
subtraction_15 = Subtraction(A=division_26, B=division_28)
merge_38 = Merge(Data1=division_26, Data2=division_26, Data3=subtraction_15, Data4=subtraction_15)
merge_39 = Merge(Data1=division_27, Data2=division_27, Data3=subtraction_14, Data4=subtraction_14)
box_8 = CenterBox(Base=move_7.Geometry, X=merge_38, Y=merge_39, Z=division_24)
group_2 = Group(Objects=box_8)
orient_3 = Orient(Geometry=group_2, Source=item_60, Target=pl_origin_5)  # -> Geometry, Transform

merge_40 = Merge(Data1=dim_interior_floor_4, Data2=dim_insulation_ground_3, Data3=dim_ongroud_foundations_3)
item_61 = ListItem(List=pl_origin_4, Index=0, Wrap=True)
ma_12 = MassAddition(Input=merge_40)  # -> Result, PartialResults
division_29 = Division(A=merge_40, B="2")
division_30 = Division(A=merge_40, B="2")
subtraction_16 = Subtraction(A=ma_12.PartialResults, B=division_30)
neg_10 = Negative(Value=subtraction_16)
Z_10 = UnitZ(Factor=neg_10)
floort_dim_2_3 = RemoteReceiver(floort_dim_2)
floor_dim_1_3 = RemoteReceiver(floor_dim_1)
move_8 = Move(Geometry=item_61, Motion=Z_10)  # -> Geometry, Transform
division_31 = Division(A=floor_dim_1_3, B="2")
division_32 = Division(A=floort_dim_2_3, B="2")
panel_32 = Panel("slighlty different")
box_9 = CenterBox(Base=move_8.Geometry, X=division_31, Y=division_32, Z=division_29)
group_3 = Group(Objects=box_9)
orient_4 = Orient(Geometry=group_3, Source=item_61, Target=pl_origin_4)  # -> Geometry, Transform

# ---- group: APART TO CIRCULATION SLABS (TOP TO BOTTOM)
color_apartment_slab_strct_5 = RemoteReceiver(color_apartment_slab_strct)
color_circulation_ceiling_3 = RemoteReceiver(color_circulation_ceiling)
color_apartment_floor_2 = RemoteReceiver(color_apartment_floor)
color_accoustic_panel_4 = RemoteReceiver(color_accoustic_panel)
ungroup_2 = Ungroup(Group=orient_3.Geometry)
merge_41 = Merge(
    Data1=color_apartment_floor_2,
    Data2=color_accoustic_panel_4,
    Data3=color_apartment_slab_strct_5,
    Data4=color_air_layer_2,
    Data5=color_circulation_ceiling_3)
preview_17 = CustomPreview(Geometry=ungroup_2, Material=merge_41)

# ---- group: APART TO GROUND SLABS (TOP TO BOTTOM)
color_apartment_floor_3 = RemoteReceiver(color_apartment_floor)
color_insulation_2 = RemoteReceiver(color_insulation)
ungroup_3 = Ungroup(Group=orient_4.Geometry)
merge_42 = Merge(Data1=color_apartment_floor_3, Data2=color_insulation_2, Data3=color_onground_2)
preview_18 = CustomPreview(Geometry=ungroup_3, Material=merge_42)

# ----
facen_28 = FaceNormals(Mesh=conmesh_15)  # -> Centers, Normals
xy_7 = XYPlane(Origin=Point(0, 0, 0))

cset_10 = CreateSet(List=facen_28.Centers)  # -> Set, Map

pl_origin_7 = PlaneOrigin(Base=xy_7, Origin=cset_10.Set)

facen_29 = FaceNormals(Mesh=conmesh_14)  # -> Centers, Normals
xy_8 = XYPlane(Origin=Point(0, 0, 0))

cset_11 = CreateSet(List=facen_29.Centers)  # -> Set, Map

pl_origin_8 = PlaneOrigin(Base=xy_8, Origin=cset_11.Set)

facen_30 = FaceNormals(Mesh=conmesh_16)  # -> Centers, Normals
xy_9 = XYPlane(Origin=Point(0, 0, 0))

cset_12 = CreateSet(List=facen_30.Centers)  # -> Set, Map

pl_origin_9 = PlaneOrigin(Base=xy_9, Origin=cset_12.Set)

merge_43 = Merge(Data1=dim_interior_floor_5, Data2=dim_accoustic_slab_4, Data3=dim_apart_slab_strct_4, Data4=dim_insulation_air_slab_3)
item_62 = ListItem(List=pl_origin_9, Index=0, Wrap=True)
ma_13 = MassAddition(Input=merge_43)  # -> Result, PartialResults
division_33 = Division(A=merge_43, B="2")
division_34 = Division(A=merge_43, B="2")
subtraction_17 = Subtraction(A=ma_13.PartialResults, B=division_34)
neg_11 = Negative(Value=subtraction_17)
Z_11 = UnitZ(Factor=neg_11)
beam_width_7 = RemoteReceiver(beam_width)
floort_dim_2_4 = RemoteReceiver(floort_dim_2)
floor_dim_1_4 = RemoteReceiver(floor_dim_1)
move_9 = Move(Geometry=item_62, Motion=Z_11)  # -> Geometry, Transform
division_35 = Division(A=floor_dim_1_4, B="2")
division_36 = Division(A=floort_dim_2_4, B="2")
division_37 = Division(A=beam_width_7, B="2")
subtraction_18 = Subtraction(A=division_35, B=division_37)
subtraction_19 = Subtraction(A=division_36, B=division_37)
merge_44 = Merge(Data1=division_35, Data2=division_35, Data3=subtraction_18, Data4=subtraction_18)
merge_45 = Merge(Data1=division_36, Data2=division_36, Data3=subtraction_19, Data4=subtraction_19)
box_10 = CenterBox(Base=move_9.Geometry, X=merge_44, Y=merge_45, Z=division_33)
group_4 = Group(Objects=box_10)
orient_5 = Orient(Geometry=group_4, Source=item_62, Target=pl_origin_9)  # -> Geometry, Transform

# ---- group: CIRCULATION TO AIR SLABS (TOP TO BOTTOM)
color_circulation_floor_2 = RemoteReceiver(color_circulation_floor)
color_apartment_slab_strct_6 = RemoteReceiver(color_apartment_slab_strct)
color_accoustic_panel_5 = RemoteReceiver(color_accoustic_panel)
color_insulation_3 = RemoteReceiver(color_insulation)
ungroup_4 = Ungroup(Group=orient_5.Geometry)
merge_46 = Merge(
    Data1=color_circulation_floor_2,
    Data2=color_accoustic_panel_5,
    Data3=color_apartment_slab_strct_6,
    Data4=color_insulation_3)
preview_19 = CustomPreview(Geometry=ungroup_4, Material=merge_46)

# ----
facen_31 = FaceNormals(Mesh=conmesh_17)  # -> Centers, Normals
xy_10 = XYPlane(Origin=Point(0, 0, 0))

cset_13 = CreateSet(List=facen_31.Centers)  # -> Set, Map

pl_origin_10 = PlaneOrigin(Base=xy_10, Origin=cset_13.Set)

facen_32 = FaceNormals(Mesh=conmesh_18)  # -> Centers, Normals
xy_11 = XYPlane(Origin=Point(0, 0, 0))

cset_14 = CreateSet(List=facen_32.Centers)  # -> Set, Map

pl_origin_11 = PlaneOrigin(Base=xy_11, Origin=cset_14.Set)

merge_47 = Merge(Data1=dim_interior_floor_7, Data2=dim_insulation_ground_4, Data3=dim_ongroud_foundations_4)
item_63 = ListItem(List=pl_origin_11, Index=0, Wrap=True)
ma_14 = MassAddition(Input=merge_47)  # -> Result, PartialResults
division_38 = Division(A=merge_47, B="2")
division_39 = Division(A=merge_47, B="2")
subtraction_20 = Subtraction(A=ma_14.PartialResults, B=division_39)
neg_12 = Negative(Value=subtraction_20)
Z_12 = UnitZ(Factor=neg_12)
floort_dim_2_5 = RemoteReceiver(floort_dim_2)
floor_dim_1_5 = RemoteReceiver(floor_dim_1)
move_10 = Move(Geometry=item_63, Motion=Z_12)  # -> Geometry, Transform
division_40 = Division(A=floor_dim_1_5, B="2")
division_41 = Division(A=floort_dim_2_5, B="2")
box_11 = CenterBox(Base=move_10.Geometry, X=division_40, Y=division_41, Z=division_38)
group_5 = Group(Objects=box_11)
orient_6 = Orient(Geometry=group_5, Source=item_63, Target=pl_origin_11)  # -> Geometry, Transform

# ---- group: CIRCULATION TO GROUND SLABS (TOP TO BOTTOM)
color_circulation_floor_3 = RemoteReceiver(color_circulation_floor)
color_insulation_4 = RemoteReceiver(color_insulation)
ungroup_5 = Ungroup(Group=orient_6.Geometry)
merge_48 = Merge(Data1=color_circulation_floor_3, Data2=color_insulation_4, Data3=color_onground_3)
preview_20 = CustomPreview(Geometry=ungroup_5, Material=merge_48)

# ----
facen_33 = FaceNormals(Mesh=clean_43)  # -> Centers, Normals
xy_12 = XYPlane(Origin=Point(0, 0, 0))

cset_15 = CreateSet(List=facen_33.Centers)  # -> Set, Map

pl_origin_12 = PlaneOrigin(Base=xy_12, Origin=cset_15.Set)

dim_accoustic_slab_10 = RemoteReceiver(dim_accoustic_slab_2)
dim_apart_slab_strct_7 = RemoteReceiver(dim_apart_slab_strct_2)
dim_apart_ceiling_5 = RemoteReceiver(dim_apart_ceiling_2)
dim_interior_floor_12 = RemoteReceiver(dim_interior_floor_2)
merge_49 = Merge(
    Data1=dim_interior_floor_12,
    Data2=dim_accoustic_slab_10,
    Data3=dim_apart_slab_strct_7,
    Data4=dim_air_layer_3,
    Data5=dim_apart_ceiling_5)
item_64 = ListItem(List=pl_origin_12, Index=0, Wrap=True)
ma_15 = MassAddition(Input=merge_49)  # -> Result, PartialResults
division_42 = Division(A=merge_49, B="2")
division_43 = Division(A=merge_49, B="2")
subtraction_21 = Subtraction(A=ma_15.PartialResults, B=division_43)
neg_13 = Negative(Value=subtraction_21)
Z_13 = UnitZ(Factor=neg_13)
beam_width_8 = RemoteReceiver(beam_width)
floort_dim_2_6 = RemoteReceiver(floort_dim_2)
floor_dim_1_6 = RemoteReceiver(floor_dim_1)
move_11 = Move(Geometry=item_64, Motion=Z_13)  # -> Geometry, Transform
division_44 = Division(A=floor_dim_1_6, B="2")
division_45 = Division(A=floort_dim_2_6, B="2")
division_46 = Division(A=beam_width_8, B="2")
subtraction_22 = Subtraction(A=division_45, B=division_46)
subtraction_23 = Subtraction(A=division_44, B=division_46)
merge_50 = Merge(Data1=division_44, Data2=division_44, Data3=subtraction_23, Data4=subtraction_23)
merge_51 = Merge(Data1=division_45, Data2=division_45, Data3=subtraction_22, Data4=subtraction_22)
box_12 = CenterBox(Base=move_11.Geometry, X=merge_50, Y=merge_51, Z=division_42)
group_6 = Group(Objects=box_12)
orient_7 = Orient(Geometry=group_6, Source=item_64, Target=pl_origin_12)  # -> Geometry, Transform

# ---- group: CIRCULATION TO APART SLABS (TOP TO BOTTOM)
color_apartment_ceiling_3 = RemoteReceiver(color_apartment_ceiling)
color_circulation_floor_4 = RemoteReceiver(color_circulation_floor)
color_accoustic_panel_6 = RemoteReceiver(color_accoustic_panel)
ungroup_6 = Ungroup(Group=orient_7.Geometry)
merge_52 = Merge(
    Data1=color_circulation_floor_4,
    Data2=color_accoustic_panel_6,
    Data3=color_apartment_slab_strct_4,
    Data4=color_air_layer_3,
    Data5=color_apartment_ceiling_3)
preview_21 = CustomPreview(Geometry=ungroup_6, Material=merge_52)

# ----
facen_34 = FaceNormals(Mesh=clean_41)  # -> Centers, Normals
xy_13 = XYPlane(Origin=Point(0, 0, 0))

cset_16 = CreateSet(List=facen_34.Centers)  # -> Set, Map

pl_origin_13 = PlaneOrigin(Base=xy_13, Origin=cset_16.Set)

dim_apart_slab_strct_8 = RemoteReceiver(dim_apart_slab_strct_2)
dim_accoustic_slab_11 = RemoteReceiver(dim_accoustic_slab_2)
dim_apart_ceiling_6 = RemoteReceiver(dim_apart_ceiling_2)
dim_interior_floor_13 = RemoteReceiver(dim_interior_floor_2)
merge_53 = Merge(
    Data1=dim_interior_floor_13,
    Data2=dim_accoustic_slab_11,
    Data3=dim_apart_slab_strct_8,
    Data4=dim_air_layer_4,
    Data5=dim_apart_ceiling_6)
item_65 = ListItem(List=pl_origin_13, Index=0, Wrap=True)
ma_16 = MassAddition(Input=merge_53)  # -> Result, PartialResults
division_47 = Division(A=merge_53, B="2")
division_48 = Division(A=merge_53, B="2")
subtraction_24 = Subtraction(A=ma_16.PartialResults, B=division_48)
neg_14 = Negative(Value=subtraction_24)
Z_14 = UnitZ(Factor=neg_14)
floort_dim_2_7 = RemoteReceiver(floort_dim_2)
beam_width_9 = RemoteReceiver(beam_width)
floor_dim_1_7 = RemoteReceiver(floor_dim_1)
move_12 = Move(Geometry=item_65, Motion=Z_14)  # -> Geometry, Transform
division_49 = Division(A=floor_dim_1_7, B="2")
division_50 = Division(A=floort_dim_2_7, B="2")
division_51 = Division(A=beam_width_9, B="2")
subtraction_25 = Subtraction(A=division_50, B=division_51)
subtraction_26 = Subtraction(A=division_49, B=division_51)
merge_54 = Merge(Data1=division_49, Data2=division_49, Data3=subtraction_26, Data4=subtraction_26)
merge_55 = Merge(Data1=division_50, Data2=division_50, Data3=subtraction_25, Data4=subtraction_25)
box_13 = CenterBox(Base=move_12.Geometry, X=merge_54, Y=merge_55, Z=division_47)
group_7 = Group(Objects=box_13)
orient_8 = Orient(Geometry=group_7, Source=item_65, Target=pl_origin_13)  # -> Geometry, Transform

# ---- group: SLABS BETWEEN APARTS
color_apartment_slab_strct_7 = RemoteReceiver(color_apartment_slab_strct)
color_apartment_ceiling_4 = RemoteReceiver(color_apartment_ceiling)
color_apartment_floor_4 = RemoteReceiver(color_apartment_floor)
color_accoustic_panel_7 = RemoteReceiver(color_accoustic_panel)
color_air_layer_4 = RemoteReceiver(color_air_layer)
ungroup_7 = Ungroup(Group=orient_8.Geometry)
merge_56 = Merge(
    Data1=color_apartment_floor_4,
    Data2=color_accoustic_panel_7,
    Data3=color_apartment_slab_strct_7,
    Data4=color_air_layer_4,
    Data5=color_apartment_ceiling_4)
preview_22 = CustomPreview(Geometry=ungroup_7, Material=merge_56)

# ----
dim_apart_slab_strct_9 = RemoteReceiver(dim_apart_slab_strct_2)
dim_apart_ceiling_7 = RemoteReceiver(dim_apart_ceiling_2)
dim_insulation_roof_3 = RemoteReceiver(dim_insulation_roof_2)
dim_greenery_roof_3 = RemoteReceiver(dim_greenery_roof_2)
merge_57 = Merge(Data1=dim_greenery_roof_3, Data2=dim_insulation_roof_3, Data3=dim_apart_slab_strct_9, Data4=dim_apart_ceiling_7)
item_66 = ListItem(List=pl_origin_7, Index=0, Wrap=True)
ma_17 = MassAddition(Input=merge_57)  # -> Result, PartialResults
division_52 = Division(A=merge_57, B="2")
division_53 = Division(A=merge_57, B="2")
subtraction_27 = Subtraction(A=ma_17.PartialResults, B=division_53)
neg_15 = Negative(Value=subtraction_27)
Z_15 = UnitZ(Factor=neg_15)
beam_width_10 = RemoteReceiver(beam_width)
floort_dim_2_8 = RemoteReceiver(floort_dim_2)
floor_dim_1_8 = RemoteReceiver(floor_dim_1)
move_13 = Move(Geometry=item_66, Motion=Z_15)  # -> Geometry, Transform
division_54 = Division(A=beam_width_10, B="2")
division_55 = Division(A=floor_dim_1_8, B="2")
division_56 = Division(A=floort_dim_2_8, B="2")
subtraction_28 = Subtraction(A=division_55, B=division_54)
subtraction_29 = Subtraction(A=division_56, B=division_54)
merge_58 = Merge(Data1=division_56, Data2=division_56, Data3=subtraction_29, Data4=subtraction_29)
merge_59 = Merge(Data1=division_55, Data2=division_55, Data3=subtraction_28, Data4=subtraction_28)
item_67 = ListItem(List=merge_57, Index=0, Wrap=True)
box_14 = CenterBox(Base=move_13.Geometry, X=merge_59, Y=merge_58, Z=division_52)
group_8 = Group(Objects=box_14)

# ---- group: ensure same ceiling levels
subtraction_30 = Subtraction(A=ma_17.Result, B=ma_16.Result)

# ----
Z_16 = UnitZ(Factor=subtraction_30)
move_14 = Move(Geometry=group_8, Motion=Z_16)  # -> Geometry, Transform
orient_9 = Orient(Geometry=move_14.Geometry, Source=item_66, Target=pl_origin_7)  # -> Geometry, Transform

color_accoustic_panel_8 = RemoteReceiver(color_accoustic_panel)
color_greenery_2 = RemoteReceiver(color_greenery)
ungroup_8 = Ungroup(Group=orient_9.Geometry)
merge_60 = Merge(
    Data1=color_greenery_2,
    Data2=color_accoustic_panel_8,
    Data3=color_apartment_slab_strct_2,
    Data4=color_apartment_ceiling_2)
preview_23 = CustomPreview(Geometry=ungroup_8, Material=merge_60)

dim_apart_slab_strct_10 = RemoteReceiver(dim_apart_slab_strct_2)
dim_apart_ceiling_8 = RemoteReceiver(dim_apart_ceiling_2)
dim_insulation_roof_4 = RemoteReceiver(dim_insulation_roof_2)
dim_greenery_roof_4 = RemoteReceiver(dim_greenery_roof_2)
merge_61 = Merge(Data1=dim_greenery_roof_4, Data2=dim_insulation_roof_4, Data3=dim_apart_slab_strct_10, Data4=dim_apart_ceiling_8)
item_68 = ListItem(List=pl_origin_8, Index=0, Wrap=True)
ma_18 = MassAddition(Input=merge_61)  # -> Result, PartialResults
division_57 = Division(A=merge_61, B="2")
division_58 = Division(A=merge_61, B="2")
subtraction_31 = Subtraction(A=ma_18.PartialResults, B=division_58)
neg_16 = Negative(Value=subtraction_31)
Z_17 = UnitZ(Factor=neg_16)
beam_width_11 = RemoteReceiver(beam_width)
floort_dim_2_9 = RemoteReceiver(floort_dim_2)
floor_dim_1_9 = RemoteReceiver(floor_dim_1)
move_15 = Move(Geometry=item_68, Motion=Z_17)  # -> Geometry, Transform
division_59 = Division(A=beam_width_11, B="2")
division_60 = Division(A=floor_dim_1_9, B="2")
division_61 = Division(A=floort_dim_2_9, B="2")
subtraction_32 = Subtraction(A=division_60, B=division_59)
subtraction_33 = Subtraction(A=division_61, B=division_59)
merge_62 = Merge(Data1=division_61, Data2=division_61, Data3=subtraction_33, Data4=subtraction_33)
merge_63 = Merge(Data1=division_60, Data2=division_60, Data3=subtraction_32, Data4=subtraction_32)
item_69 = ListItem(List=merge_61, Index=0, Wrap=True)
box_15 = CenterBox(Base=move_15.Geometry, X=merge_63, Y=merge_62, Z=division_57)
group_9 = Group(Objects=box_15)

# ---- group: ensure same ceiling levels
subtraction_34 = Subtraction(A=ma_18.Result, B=ma_16.Result)

# ----
Z_18 = UnitZ(Factor=subtraction_34)
move_16 = Move(Geometry=group_9, Motion=Z_18)  # -> Geometry, Transform
orient_10 = Orient(Geometry=move_16.Geometry, Source=item_68, Target=pl_origin_8)  # -> Geometry, Transform

color_insulation_5 = RemoteReceiver(color_insulation)
color_greenery_3 = RemoteReceiver(color_greenery)
ungroup_9 = Ungroup(Group=orient_10.Geometry)
merge_64 = Merge(Data1=color_greenery_3, Data2=color_insulation_5, Data3=color_apartment_slab_strct_3, Data4=color_circulation_ceiling_2)
preview_24 = CustomPreview(Geometry=ungroup_9, Material=merge_64)

merge_65 = Merge(
    Data1=dim_interior_floor_6,
    Data2=dim_accoustic_slab_5,
    Data3=dim_apart_slab_strct_5,
    Data4=dim_insulation_air_slab_4,
    Data5=dim_exterior_finish_wall_3)
item_70 = ListItem(List=pl_origin_10, Index=0, Wrap=True)
ma_19 = MassAddition(Input=merge_65)  # -> Result, PartialResults
division_62 = Division(A=merge_65, B="2")
division_63 = Division(A=merge_65, B="2")
subtraction_35 = Subtraction(A=ma_19.PartialResults, B=division_63)
neg_17 = Negative(Value=subtraction_35)
Z_19 = UnitZ(Factor=neg_17)
beam_width_12 = RemoteReceiver(beam_width)
floort_dim_2_10 = RemoteReceiver(floort_dim_2)
floor_dim_1_10 = RemoteReceiver(floor_dim_1)
move_17 = Move(Geometry=item_70, Motion=Z_19)  # -> Geometry, Transform
division_64 = Division(A=floor_dim_1_10, B="2")
division_65 = Division(A=floort_dim_2_10, B="2")
division_66 = Division(A=beam_width_12, B="2")
subtraction_36 = Subtraction(A=division_64, B=division_66)
subtraction_37 = Subtraction(A=division_65, B=division_66)

# ---- group: reduced width or not (per layer)
merge_66 = Merge(Data1=division_64, Data2=division_64, Data3=subtraction_36, Data4=subtraction_36, Data5=division_64)
merge_67 = Merge(Data1=division_65, Data2=division_65, Data3=subtraction_37, Data4=subtraction_37, Data5=division_65)

# ----
box_16 = CenterBox(Base=move_17.Geometry, X=merge_66, Y=merge_67, Z=division_62)
group_10 = Group(Objects=box_16)
orient_11 = Orient(Geometry=group_10, Source=item_70, Target=pl_origin_10)  # -> Geometry, Transform

# ---- group: APART TO AIR SLABS (TOP TO BOTTOM)
color_apartment_floor_5 = RemoteReceiver(color_apartment_floor)
color_apartment_slab_strct_8 = RemoteReceiver(color_apartment_slab_strct)
color_exterior_finish_slab_2 = RemoteReceiver(color_exterior_finish_slab)
color_accoustic_panel_9 = RemoteReceiver(color_accoustic_panel)
color_insulation_6 = RemoteReceiver(color_insulation)
ungroup_10 = Ungroup(Group=orient_11.Geometry)
merge_68 = Merge(
    Data1=color_apartment_floor_5,
    Data2=color_accoustic_panel_9,
    Data3=color_apartment_slab_strct_8,
    Data4=color_insulation_6,
    Data5=color_exterior_finish_slab_2)
preview_25 = CustomPreview(Geometry=ungroup_10, Material=merge_68)

# ----
dim_accoustic_slab_12 = RemoteReceiver(dim_accoustic_slab_2)
dim_interior_floor_14 = RemoteReceiver(dim_interior_floor_2)
beam_height_7 = RemoteReceiver(beam_height)
addition_17 = Addition(A=dim_interior_floor_14, B=dim_accoustic_slab_12, C=beam_height_7)
subtraction_38 = Subtraction(A=devec_6.ZComponent, B=addition_17)
number_slider_13 = Slider(30, range=0..100)
genes = GenePool(Decimals=0, Maximum=10, Minimum=2, Value=4)
number_slider_14 = Slider(5, range=0..10)
lng_18 = ListLength(List=subtraction_3)
addition_18 = Addition(A=number_slider_13, B=number_slider_14)
series_7 = Series(Start=0, Step=number_slider_14, Count=genes)
subtraction_39 = Subtraction(A=lng_18, B="1")
merge_69 = Merge(Data1=number_slider_13, Data2=addition_18)
dom_4 = ConstructDomain(DomainStart="2", DomainEnd=Slider(10, range=0..10))
filter = StreamFilter(Gate=subtraction_39, Stream0=number_slider_13, Stream1=merge_69)
gnc = PoolController(GenePool=genes, Count=lng_18, Range=dom_4, Randomness=0.1)
pt_11 = ConstructPoint(XCoordinate=graft(filter), YCoordinate=series_7, ZCoordinate=0)
xy_14 = XYPlane(Origin=pt_11)
lng_19 = ListLength(List=series_7)
subtraction_40 = Subtraction(A=lng_19, B=1)
division_67 = Division(A="1", B=subtraction_40)
dup_4 = DuplicateData(Data=division_67, Number=subtraction_40, Order=True)
ins_3 = InsertItems(List=dup_4, Item="0", Indices="0", Wrap=True)
ma_20 = MassAddition(Input=ins_3)  # -> Result, PartialResults
null_3 = NullItem(Item=ins_3)  # -> NullFlags, InvalidFlags, Description
multiplication_10 = Multiplication(A=ma_20.PartialResults, B=graft(subtraction_3))
dom_5 = ConstructDomain(DomainStart=0, DomainEnd=multiplication_10)
panel_36 = Panel(multiplication_10)
neg_18 = Negative(Value=multiplication_10)
dom_6 = ConstructDomain(DomainStart=0, DomainEnd=neg_18)
division_68 = Division(A=merge_15, B="2")
ma_21 = MassAddition(Input=merge_15)  # -> Result, PartialResults
relitem_13 = RelativeItem(Tree=simplify(graft(division_68)), Offset="{1}", WrapPaths=False, WrapItems=False)  # -> ItemA, ItemB
division_69 = Division(A=ma_21.Result, B=2)
addition_19 = Addition(A=relitem_13.ItemA, B=relitem_13.ItemB)  # -> flatten(Result)
neg_19 = Negative(Value=division_69)
ma_22 = MassAddition(Input=addition_19)  # -> Result, PartialResults
Z_20 = UnitZ(Factor=neg_19)
ins_4 = InsertItems(List=ma_22.PartialResults, Item="0", Indices="0", Wrap=True)
division_70 = Division(A=multiplication_10, B="2")
Z_21 = UnitZ(Factor=ins_4)
glass_layers_in_milimeters = Panel("""6
13.2
6
13.2
6""")
division_71 = Division(A=glass_layers_in_milimeters, B="1000")
color_apartment_exterior_finish_wall_2 = RemoteReceiver(color_apartment_exterior_finish_wall)
color_apartment_interior_finish_wall_4 = RemoteReceiver(color_apartment_interior_finish_wall)
color_apartment_wall_4 = RemoteReceiver(color_apartment_wall)
ma_23 = MassAddition(Input=division_71)  # -> Result, PartialResults
color_insulation_7 = RemoteReceiver(color_insulation)
division_72 = Division(A=division_71, B="2")
division_73 = Division(A=ma_23.Result, B="2")
relitem_14 = RelativeItem(Tree=simplify(graft(division_72)), Offset="{1}", WrapPaths=False, WrapItems=False)  # -> ItemA, ItemB
merge_70 = Merge(
    Data1=color_apartment_interior_finish_wall_4,
    Data2=color_apartment_wall_4,
    Data3=color_insulation_7,
    Data4=color_apartment_exterior_finish_wall_2)
neg_20 = Negative(Value=division_73)
addition_20 = Addition(A=relitem_14.ItemA, B=relitem_14.ItemB)  # -> flatten(Result)
Z_22 = UnitZ(Factor=neg_20)
ma_24 = MassAddition(Input=addition_20)  # -> Result, PartialResults
ins_5 = InsertItems(List=ma_24.PartialResults, Item="0", Indices="0", Wrap=True)
Z_23 = UnitZ(Factor=ins_5)
dim_frame_width_3 = RemoteReceiver(dim_frame_width_2)
panel_37 = Panel("""True
False""")
dim_frame_width_4 = RemoteReceiver(dim_frame_width_2)
division_74 = Division(A=multiplication_10, B="2")
cull_11 = CullPattern(List=division_72, CullPattern=panel_37)
subtraction_41 = Subtraction(A=division_74, B=dim_frame_width_4)  # -> reverse(Result)
unwrap = UnwrapList()
number_slider_15 = Slider(20, range=1..20)
division_75 = Division(A="1", B=number_slider_15)
pshift_7 = ShiftPaths(Data=pshift_6, Offset=-1)
lng_20 = ListLength(List=pshift_7)
split_11 = SplitTree(Data=simplify(pshift_6), Masks=flatten("{0;?}"))  # -> Positive, Negative
pshift_8 = ShiftPaths(Data=pshift_6, Offset=-1)
facen_35 = FaceNormals(Mesh=pshift_8)  # -> Centers, Normals
Z_24 = UnitZ(Factor=1)
pl_11 = ConstructPlane(Origin=facen_35.Centers, XAxis=Z_24, YAxis=facen_35.Normals)
deplane_12 = DeconstructPlane(Plane=pl_11)  # -> Origin, XAxis, YAxis, ZAxis
pl_12 = ConstructPlane(Origin=deplane_12.Origin, XAxis=deplane_12.ZAxis, YAxis=deplane_12.XAxis)
pshift_9 = ShiftPaths(Data=pl_12, Offset=-1)
pshift_10 = ShiftPaths(Data=pl_11, Offset=-1)

division_76 = Division(A=subtraction_38, B="2")
division_77 = Division(A=addition_17, B="2")
Y_2 = UnitY(Factor=division_77)
division_78 = Division(A=subtraction_3, B="2")
rev_3 = Reverse(Vector=Y_2)
neg_21 = Negative(Value=division_78)
neg_22 = Negative(Value=division_76)
move_18 = Move(Geometry=xy_14, Motion=rev_3)  # -> Geometry, Transform
dom_7 = ConstructDomain(DomainStart=neg_21, DomainEnd=division_78)
dom_8 = ConstructDomain(DomainStart=neg_22, DomainEnd=division_76)
rectangle = Rectangle(Plane=move_18.Geometry, XSize=graft(dom_7), YSize=dom_8, Radius=0)  # -> Rectangle, Length

xy_15 = XYPlane(Origin=Point(0, 0, 0))
move_19 = Move(Geometry=xy_15, Motion=Z_20)  # -> Geometry, Transform
move_20 = Move(Geometry=move_19.Geometry, Motion=Z_21)  # -> Geometry, Transform
overlap_visual_margin = Slider(0.001, range=-0.01..0.01)
column_width_10 = RemoteReceiver(column_width)
division_79 = Division(A=column_width_10, B="2")
addition_21 = Addition(A=division_79, B=overlap_visual_margin)
box_17 = CenterBox(Base=move_20.Geometry, X=addition_21, Y=division_76, Z=division_68)  # -> simplify(Box)
group_11 = Group(Objects=box_17)
orient_12 = Orient(Geometry=group_11, Source=xy_15, Target=move_3.Geometry)  # -> Geometry, Transform
ungroup_11 = Ungroup(Group=orient_12.Geometry)

evalsrf_2 = EvaluateSurface(Surface=reparameterize(rectangle.Rectangle), Point="0,0,0")  # -> Point, Normal, UDirection, VDirection, Frame
evalsrf_3 = EvaluateSurface(Surface=reparameterize(rectangle.Rectangle), Point="1,0,0")  # -> Point, Normal, UDirection, VDirection, Frame
rectangle_2 = Rectangle(Plane=evalsrf_2.Point, XSize=dom_5, YSize=subtraction_38, Radius=0)  # -> reverse(Rectangle), Length
rectangle_3 = Rectangle(Plane=evalsrf_3.Point, XSize=reverse(dom_6), YSize=subtraction_38, Radius=0)  # -> reverse(Rectangle), Length
item_71 = ListItem(List=rectangle_3.Rectangle, Index=Slider(4, range=0..10), Wrap=True)
subtraction_42 = Subtraction(A=division_76, B=dim_frame_width_3)

area_2 = Area(Geometry=rectangle_3.Rectangle)  # -> Area, Centroid
larger_13 = LargerThan(FirstNumber=area_2.Area, SecondNumber="0")  # -> LargerThan, OrEqualTo
cull_12 = CullPattern(List=graft(rectangle_3.Rectangle), CullPattern=graft(larger_13.LargerThan))  # -> simplify(List)

area_3 = Area(Geometry=rectangle_2.Rectangle)  # -> Area, Centroid
larger_14 = LargerThan(FirstNumber=area_3.Area, SecondNumber="0")  # -> LargerThan, OrEqualTo
cull_13 = CullPattern(List=graft(rectangle_2.Rectangle), CullPattern=graft(larger_14.LargerThan))

dim_frame_thickness_3 = RemoteReceiver(dim_frame_thickness_2)
dim_frame_width_5 = RemoteReceiver(dim_frame_width_2)
neg_23 = Negative(Value=dim_frame_width_5)
offset_2 = OffsetCurve(Curve=cull_13, Distance=neg_23, Corners=1)
explode_5 = Explode(Curve=cull_13, Recursive=True)  # -> Segments, Vertices
explode_6 = Explode(Curve=offset_2, Recursive=True)  # -> Segments, Vertices
rulesrf_2 = RuledSurface(CurveA=explode_5.Segments, CurveB=explode_6.Segments)
Z_25 = UnitZ(Factor=dim_frame_thickness_3)
join_3 = BrepJoin(Breps=rulesrf_2)  # -> simplify(Breps), Closed
division_80 = Division(A=Z_25, B="2")
rev_4 = Reverse(Vector=division_80)
fmerge_2 = MergeFaces(Brep=join_3.Breps)  # -> Breps, Before, After
preview_26 = CustomPreview(Material=ColourSwatch(SwatchColor=RGBA(107, 216, 255, 46)))
move_21 = Move(Geometry=fmerge_2.Breps, Motion=rev_4)  # -> Geometry, Transform
extr_2 = Extrude(Base=move_21.Geometry, Direction=Z_25)

xy_16 = XYPlane(Origin=Point(0, 0, 0))
overlap_visual_margin_2 = Slider(0.001, range=-0.01..0.01)
column_width_11 = RemoteReceiver(column_width)
division_81 = Division(A=column_width_11, B="2")
addition_22 = Addition(A=division_81, B=overlap_visual_margin_2)

dup_5 = DuplicateData(Data=xy_16, Number=lng_7, Order=True)  # -> graft(Data)

move_22 = Move(Geometry=dup_5, Motion=Z_20)  # -> Geometry, Transform
move_23 = Move(Geometry=move_22.Geometry, Motion=Z_21)  # -> Geometry, Transform
box_18 = CenterBox(Base=move_23.Geometry, X=division_7, Y=division_8, Z=division_68)  # -> simplify(Box)
group_12 = Group(Objects=box_18)
orient_13 = Orient(Geometry=group_12, Source=dup_5, Target=move_4.Geometry)  # -> Geometry, Transform
ungroup_12 = Ungroup(Group=orient_13.Geometry)

preview_27 = CustomPreview(Geometry=ungroup_11, Material=merge_70)
preview_28 = CustomPreview(Geometry=ungroup_12, Material=merge_70)

evalsrf_4 = EvaluateSurface(Surface=reparameterize(cull_12), Point=".5,.5,0")  # -> Point, Normal, UDirection, VDirection, Frame
evalsrf_5 = EvaluateSurface(Surface=reparameterize(cull_13), Point=".5,.5,0")  # -> Point, Normal, UDirection, VDirection, Frame
move_24 = Move(Geometry=evalsrf_4.Point, Motion=Z_20)  # -> Geometry, Transform
move_25 = Move(Geometry=move_24.Geometry, Motion=Z_21)  # -> Geometry, Transform
box_19 = CenterBox(Base=move_25.Geometry, X=graft(division_70), Y=division_76, Z=division_68)
group_13 = Group(Objects=box_19)
preview_29 = CustomPreview(Geometry=box_19, Material=merge_70)  # disabled
move_26 = Move(Geometry=evalsrf_5.Point, Motion=Z_22)  # -> Geometry, Transform
move_27 = Move(Geometry=move_26.Geometry, Motion=Z_23)  # -> Geometry, Transform
cull_14 = CullPattern(List=move_27.Geometry, CullPattern=panel_37)
box_20 = CenterBox(Base=cull_14, X=graft(subtraction_41), Y=subtraction_42, Z=cull_11)  # -> simplify(Box)
group_14 = Group(Objects=extr_2)
group_15 = Group(Objects=box_20)
merge_71 = Merge(Data1=simplify(group_14), Data2=simplify(group_15))
group_16 = Group(Objects=merge_71)
merge_72 = Merge(Data1=simplify(group_16), Data2=simplify(group_13))
preview_30 = CustomPreview(Geometry=box_20, Material=ColourSwatch(SwatchColor=RGBA(110, 209, 255, 49)))  # disabled
group_17 = Group(Objects=merge_72)

# ---- group: DATATREE manual check
merge_73 = Merge(Data1=Slider(1, range=0..10), Data2="?")
conmask_2 = ConstructPathMask(IndexCharacters=merge_73)
split_12 = SplitTree(Data=group_17, Masks=flatten(conmask_2))  # -> simplify(Positive), Negative
branch_13 = TreeBranch(Tree=split_12.Positive, Path=Slider(0, range=0..10), MaintainPaths=True)

# ---- group: PREVIEW
pshift_11 = ShiftPaths(Data=group_17, Offset=-1)  # -> reverse(Data)

# ----
flatten_3 = FlattenTree(Tree=group_17, Path="{0}")  # -> reverse(Tree)
null_4 = NullItem(Item=pshift_11)  # -> NullFlags, InvalidFlags, Description
filter_2 = StreamFilter(Gate=null_4.NullFlags, Stream0=pshift_11, Stream1=flatten_3)

lng_21 = ListLength(List=filter_2)
subtraction_43 = Subtraction(A=lng_21, B="1")
range_4 = Range(Domain=Domain(0, 1), Steps=subtraction_43)
subtraction_44 = Subtraction(A=".5", B=range_4)
abs_14 = Absolute(Value=subtraction_44)
series_8 = Series(Start=0, Step=1, Count=lng_21)
subtraction_45 = Subtraction(A=abs_14, B=".5")
abs_15 = Absolute(Value=subtraction_45)
addition_23 = Addition(A=abs_15, B=division_75)
multiplication_11 = Multiplication(A=addition_23, B=number_slider_15)
panel_38 = Panel(abs_15)
dup_6 = DuplicateData(Data=graft(series_8), Number=graft(multiplication_11), Order=True)  # -> simplify(Data)
ma_25 = MassAddition(Input=multiplication_11)  # -> Result, PartialResults
panel_39 = Panel(multiplication_11)
pshift_12 = ShiftPaths(Data=dup_6, Offset=-1)
random = Random(Range=simplify(ma_25.Result), Number=lng_20, Seed=Slider(2, range=0..10))
round_2 = Round(Number=random)  # -> Nearest, Floor, Ceiling

flatten_4 = FlattenTree(Tree=dup_6, Path="{0}")
null_5 = NullItem(Item=pshift_12)  # -> NullFlags, InvalidFlags, Description
filter_3 = StreamFilter(Gate=null_5.NullFlags, Stream0=pshift_12, Stream1=flatten_4)

item_72 = ListItem(List=filter_3, Index=round_2.Nearest, Wrap=True)
pie = PieChart(item_72)

item_73 = ListItem(List=filter_2, Index=item_72, Wrap=True)
item_74 = ListItem(List=xy_14, Index=item_72, Wrap=True)

orient_14 = Orient(Geometry=item_73, Source=item_74, Target=pshift_9)  # -> Geometry, Transform

# ---- group: random flip ?
lng_22 = ListLength(List=orient_14.Geometry)
mirror = Mirror(Geometry=orient_14.Geometry, Plane=pshift_10)  # -> Geometry, Transform
random_2 = Random(Range=Domain(0, 1), Number=lng_22, Seed=2)
round_3 = Round(Number=random_2)  # -> Nearest, Floor, Ceiling
p_n_c = PickNChoose(Pattern=round_3.Nearest, Stream0=orient_14.Geometry, Stream1=mirror.Geometry)

# ----
unflatten_5 = UnflattenTree(Tree=p_n_c, Guide=pshift_6)
ungroup_13 = Ungroup(Group=unflatten_5)
item_75 = ListItem(List=ungroup_13, Index=0, Wrap=True)  # -> Item, Item1
ungroup_14 = Ungroup(Group=item_75.Item)
ungroup_15 = Ungroup(Group=item_75.Item1)
item_76 = ListItem(List=ungroup_14, Index=0, Wrap=True)  # -> Item, Item1
ungroup_16 = Ungroup(Group=item_76.Item)
ungroup_17 = Ungroup(Group=item_76.Item1)
preview_31 = CustomPreview(Geometry=ungroup_16, Material=ColourSwatch(SwatchColor=RGB(255, 64, 0)))
preview_32 = CustomPreview(Geometry=ungroup_17, Material=ColourSwatch(SwatchColor=RGBA(43, 202, 255, 53)))
preview_33 = CustomPreview(Geometry=ungroup_15, Material=merge_70)
