# Grasshopper definition Mellow_Networkx_220628.gh (Grasshopper 1.0.7)
# plug-ins: Heteroptera, Human, Tundra, Hops, eleFront, Wombat, Telepathy

standard_height = Slider(3, range=2..4)
floor_count = Slider(3, range=0..10)
first_height = Slider(4, range=3..5)
series = Series(Start=standard_height, Step=standard_height, Count=floor_count)
ins = InsertItems(List=series, Item="0", Indices="0", Wrap=True)

yx_grid = Slider(3, range=2..4)
number_slider = Slider(4, range=0..10)
number_slider_2 = Slider(4, range=0..10)
multiplication = Multiplication(A=number_slider_2, B=yx_grid)
multiplication_2 = Multiplication(A=yx_grid, B=number_slider)
range = Range(Domain=multiplication, Steps=number_slider_2)
range_2 = Range(Domain=multiplication_2, Steps=number_slider)

crossref = CrossReference(ListA=range, ListB=range_2, ListC=ins, CrossMode=1)  # -> ListA, ListB, ListC
lng = ListLength(List=range)
pt = ConstructPoint(XCoordinate=crossref.ListA, YCoordinate=crossref.ListB, ZCoordinate=crossref.ListC)
mindex = MemberIndex(Set=crossref.ListC, Member=ins)  # -> Index, Count
item = ListItem(List=pt, Index=mindex.Index, Wrap=True)
partition = PartitionList(List=item, Size=lng)  # -> simplify(graft(Chunks))

# ---- group: Works but very suspicious
merge = Merge(Data1=yx_grid, Data2=standard_height, Data3=standard_height)
ma = MassAddition(Input=merge)  # -> Result, PartialResults
lng_2 = ListLength(List=merge)
division = Division(A=ma.Result, B=lng_2)
sqrt = SquareRoot(Value=division)

# ----
simplexperlin = SimplexPerlin(Seed=1, Quality=2, gradient="tundraGradient")
translate = Translate(Module=simplexperlin, X=Slider(0.468, range=0..1), Y=Slider(1, range=0..1), Z=0, gradient="tundraGradient")
number_slider_3 = Slider(0.05, range=0..1)
scale = Scale(Module=translate, XScale=number_slider_3, YScale=number_slider_3, ZScale=1, gradient="tundraGradient")

relitem = RelativeItem(Tree=partition, Offset="{0;0;1}", WrapPaths=False, WrapItems=False)  # -> ItemA, ItemB
relitem_2 = RelativeItem(Tree=partition, Offset="{0;1;0}", WrapPaths=False, WrapItems=False)  # -> ItemA, ItemB
ln = Line(StartPoint=relitem.ItemA, EndPoint=relitem.ItemB)
ln_2 = Line(StartPoint=relitem_2.ItemA, EndPoint=relitem_2.ItemB)

relitem_3 = RelativeItem(Tree=partition, Offset="{1;0;0}", WrapPaths=False, WrapItems=False)  # -> ItemA, ItemB
ln_3 = Line(StartPoint=relitem_3.ItemA, EndPoint=relitem_3.ItemB)

relitem_4 = RelativeItem(Tree=partition, Offset="{1;1;1}", WrapPaths=False, WrapItems=False)  # -> ItemA, ItemB
merge_2 = Merge(Data1=relitem_4.ItemA, Data2=relitem_4.ItemB)
box = Box2Pt(PointA=relitem_4.ItemA, PointB=relitem_4.ItemB, Plane=PlaneXY(0, 0, 0))
avr = Average(Input=merge_2)

flatten = FlattenTree(Tree=partition, Path="{0}")
item_2 = ListItem(List=flatten, Index=0, Wrap=True)  # -> Item1, Item
box_2 = Box2Pt(PointA=item_2.Item1, PointB=item_2.Item, Plane=PlaneXY(0, 0, 0))

split = SplitTree(Data=avr, Masks=flatten("{0;?;?}"))  # -> simplify(Positive), Negative
getvalue = GetValue(Module=scale, Point=flatten(split.Positive))

subtraction = Subtraction(A=floor_count, B="0")
bnd = Bounds(Numbers=getvalue)
dom = ConstructDomain(DomainStart="0", DomainEnd=subtraction)
remap = RemapNumbers(Value=getvalue, Source=bnd, Target=dom)  # -> Mapped, Clipped
round = Round(Number=remap.Mapped)  # -> graft(Nearest), Floor, Ceiling
unflatten = UnflattenTree(Tree=round.Nearest, Guide=split.Positive)

series_2 = Series(Start=0, Step=1, Count=unflatten)  # -> simplify(Series)
clean = CleanTree(RemoveNulls=True, RemoveInvalid=True, RemoveEmpty=invert(False), Tree=series_2)
tstat = TreeStatistics(Tree=clean)  # -> Paths, Length, Count
branch = TreeBranch(Tree=split.Positive, Path=tstat.Paths, MaintainPaths=True)
tstat_2 = TreeStatistics(Tree=branch)  # -> Paths, Length, Count
lng_3 = ListLength(List=clean)
unflatten_2 = UnflattenTree(Tree=tstat_2.Paths, Guide=branch)
dup = DuplicateData(Data=unflatten_2, Number=lng_3, Order=True)
pshift = ShiftPaths(Data=dup, Offset=-1)
clean_2 = CleanTree(RemoveNulls=True, RemoveInvalid=True, RemoveEmpty=invert(False), Tree=pshift)
tstat_3 = TreeStatistics(Tree=clean_2)  # -> Paths, Length, Count
branch_2 = TreeBranch(Tree=clean, Path=tstat_3.Paths, MaintainPaths=True)  # -> simplify(graft(Branch))
dpath = DeconstructPath(Branch=clean_2)  # -> simplify(Indices)
ins_2 = InsertItems(List=dpath, Item=branch_2, Indices="0", Wrap=True)
path = ConstructPath(Indices=ins_2)
split_2 = SplitTree(Data=box, Masks=flatten(path))  # -> Positive, Negative
split_3 = SplitTree(Data=avr, Masks=flatten(path))  # -> Positive, Negative

# ---- group: I challenge you to find faster than me
debrep = DeconstructBrep(Brep=split_2.Positive)  # -> reparameterize(Faces), Edges, Vertices

# ----
edges = BrepEdges(Brep=split_2.Positive)  # -> Naked, Interior, NonManifold
previewlw = CustomPreviewLineweights(Geometry=edges.Interior, Shader=ColourSwatch(SwatchColor=RGB(0, 0, 0)), Absolute=False)

evalsrf = EvaluateSurface(Surface=debrep.Faces, Point="0.5,0.5,0")  # -> Point, Normal, UDirection, VDirection, Frame
avr_2 = Average(Input=debrep.Vertices)  # -> simplify(ArithmeticMean)
addition = Addition(A=evalsrf.Point, B=evalsrf.Normal)
cp = ClosestPoint(Point=addition, Cloud=flatten(avr_2))  # -> ClosestPoint, CPIndex, simplify(Distance)
smaller = SmallerThan(FirstNumber=simplify(cp.Distance), SecondNumber=sqrt)  # -> SmallerThan, OrEqualTo

path_2 = FilePath()
file = ReadFile(File=path_2, PerLineParse=False)

relitem_5 = RelativeItem(Tree=split_3.Positive, Offset="{0;0;1}", WrapPaths=False, WrapItems=False)  # -> ItemA, ItemB
relitem_6 = RelativeItem(Tree=split_3.Positive, Offset="{0;1;0}", WrapPaths=False, WrapItems=False)  # -> ItemA, ItemB
ln_4 = Line(StartPoint=relitem_5.ItemA, EndPoint=relitem_5.ItemB)
ln_5 = Line(StartPoint=relitem_6.ItemA, EndPoint=relitem_6.ItemB)

relitem_7 = RelativeItem(Tree=split_3.Positive, Offset="{1;0;0}", WrapPaths=False, WrapItems=False)  # -> ItemA, ItemB
ln_6 = Line(StartPoint=relitem_7.ItemA, EndPoint=relitem_7.ItemB)

python = GhPythonScript(Code=file)  # -> Out, A

relay = Relay([ln_4, ln_5])
previewlw_2 = CustomPreviewLineweights(Geometry=relay, Shader=ColourSwatch(SwatchColor=RGB(255, 0, 0)), Thickness=Slider(6, range=0..10), Absolute=False)
previewlw_3 = CustomPreviewLineweights(Geometry=ln_6, Shader=ColourSwatch(SwatchColor=RGB(0, 17, 255)), Thickness=Slider(6, range=0..10), Absolute=False)

merge_3 = Merge(Data1=ln_6, Data2=ln_5, Data3=ln_4)  # -> flatten(Result)
l_net = NetworkFromLines(Lines=flatten(merge_3))  # -> simplify(PointPointTopology), simplify(ConnectionPointTopology), Points, Lines
points = PointList(Points=l_net.Points, Size=".8")

dispatch = Dispatch(List=evalsrf.Frame, DispatchPattern=smaller.SmallerThan)  # -> graft(ListA), graft(ListB)
dispatch_2 = Dispatch(List=debrep.Faces, DispatchPattern=smaller.SmallerThan)  # -> graft(ListA), graft(ListB)

deplane = DeconstructPlane(Plane=dispatch.ListB)  # -> Origin, XAxis, YAxis, ZAxis
devec = DeconstructVector(Vector=deplane.ZAxis)  # -> XComponent, YComponent, ZComponent
abs = Absolute(Value=devec.ZComponent)
larger = LargerThan(FirstNumber=abs, SecondNumber="0")  # -> LargerThan, OrEqualTo
larger_2 = LargerThan(FirstNumber=devec.ZComponent, SecondNumber="0")  # -> LargerThan, OrEqualTo
dispatch_3 = Dispatch(List=dispatch.ListB, DispatchPattern=larger.LargerThan)  # -> ListA, ListB
dispatch_4 = Dispatch(List=larger_2.LargerThan, DispatchPattern=larger.LargerThan)  # -> ListA, ListB
dispatch_5 = Dispatch(List=dispatch_3.ListA, DispatchPattern=dispatch_4.ListA)  # -> ListA, ListB

flip = FlipCurve(Curve=l_net.Lines)  # -> Curve, Flag
tstat_4 = TreeStatistics(Tree=l_net.ConnectionPointTopology)  # -> Paths, Length, Count
merge_4 = Merge(Data1=flatten(l_net.Lines), Data2=flatten(flip.Curve))
dpath_2 = DeconstructPath(Branch=tstat_4.Paths)  # -> flatten(Indices)
item_3 = ListItem(List=reverse(dpath_2), Index=0, Wrap=True)
rev = ReverseList(List=l_net.ConnectionPointTopology)
addition_2 = Addition(A=dpath_2, B="1", C=item_3)  # -> graft(Result)
path_3 = ConstructPath(Indices=addition_2)
dup_2 = DuplicateData(Data=path_3, Number=2, Order=True)
tree = CreateTree(Data=rev, Path=dup_2)
merge_5 = Merge(Data1=simplify(l_net.ConnectionPointTopology), Data2=simplify(tree))

deplane_2 = DeconstructPlane(Plane=dispatch.ListA)  # -> Origin, XAxis, YAxis, ZAxis
devec_2 = DeconstructVector(Vector=deplane_2.ZAxis)  # -> XComponent, YComponent, ZComponent
abs_2 = Absolute(Value=devec_2.ZComponent)
larger_3 = LargerThan(FirstNumber=abs_2, SecondNumber="0")  # -> LargerThan, OrEqualTo
dispatch_6 = Dispatch(List=dispatch_2.ListA, DispatchPattern=larger_3.LargerThan)  # -> ListA, ListB

# ---- group: ordering the center points and celles based on heteroptera point node order
mindex_2 = MemberIndex(Set=flatten(split_3.Positive), Member=l_net.Points)  # -> Index, Count
flatten_2 = FlattenTree(Tree=mindex_2.Index, Path="{0}")
item_4 = ListItem(List=flatten(split_2.Positive), Index=mindex_2.Index, Wrap=True)
item_5 = ListItem(List=flatten(split_3.Positive), Index=flatten_2, Wrap=True)

# ----
clean_3 = CleanTree(RemoveNulls=True, RemoveInvalid=True, RemoveEmpty=invert(False), Tree=simplify(dispatch_3.ListB))
tstat_5 = TreeStatistics(Tree=clean_3)  # -> Paths, Length, Count
split_4 = SplitTree(Data=simplify(dispatch_2.ListB), Masks=flatten(tstat_5.Paths))  # -> Positive, Negative

clean_4 = CleanTree(RemoveNulls=True, RemoveInvalid=True, RemoveEmpty=invert(False), Tree=simplify(dispatch_5.ListA))
tstat_6 = TreeStatistics(Tree=clean_4)  # -> Paths, Length, Count
split_5 = SplitTree(Data=simplify(dispatch_2.ListB), Masks=flatten(tstat_6.Paths))  # -> Positive, Negative

clean_5 = CleanTree(RemoveNulls=True, RemoveInvalid=True, RemoveEmpty=invert(False), Tree=simplify(dispatch_5.ListB))
tstat_7 = TreeStatistics(Tree=clean_5)  # -> Paths, Length, Count
split_6 = SplitTree(Data=simplify(dispatch_2.ListB), Masks=flatten(tstat_7.Paths))  # -> Positive, Negative

preview = CustomPreview(Geometry=split_4.Positive, Material=ColourSwatch(SwatchColor=RGBA(0, 255, 229, 150)))  # disabled
preview_2 = CustomPreview(Geometry=dispatch_6.ListA, Material=ColourSwatch(SwatchColor=RGBA(115, 255, 0, 150)))  # disabled
preview_3 = CustomPreview(Geometry=split_5.Positive, Material=ColourSwatch(SwatchColor=RGBA(255, 0, 119, 150)))  # disabled
preview_4 = CustomPreview(Geometry=split_6.Positive, Material=ColourSwatch(SwatchColor=RGBA(255, 183, 0, 150)))  # disabled

pshift_2 = ShiftPaths(Data=split_4.Positive, Offset=-1)
tstat_8 = TreeStatistics(Tree=pshift_2)  # -> Paths, Length, Count
branch_3 = TreeBranch(Tree=split_2.Positive, Path=tstat_8.Paths, MaintainPaths=True)
preview_5 = CustomPreview(Geometry=[split_4.Positive, split_5.Positive, split_6.Positive], Material=ColourSwatch(SwatchColor=RGBA(0, 0, 0, 33)))
preview_6 = CustomPreview(Geometry=dispatch_6.ListB, Material=ColourSwatch(SwatchColor=RGBA(255, 0, 0, 150)))  # disabled

tstat_9 = TreeStatistics(Tree=l_net.PointPointTopology)  # -> Paths, Length, Count
dpath_3 = DeconstructPath(Branch=tstat_9.Paths)
item_6 = ListItem(List=l_net.Points, Index=l_net.PointPointTopology, Wrap=True)
item_7 = ListItem(List=l_net.Points, Index=dpath_3, Wrap=True)
ln_7 = Line(StartPoint=item_6, EndPoint=item_7)
eval = EvaluateCurve(Curve=reparameterize(ln_7), Parameter=".5")  # -> Point, Tangent, Angle
devec_3 = DeconstructVector(Vector=eval.Tangent)  # -> XComponent, YComponent, ZComponent
abs_3 = Absolute(Value=devec_3.ZComponent)
smaller_2 = SmallerThan(FirstNumber=abs_3, SecondNumber=".5")  # -> simplify(SmallerThan), OrEqualTo

# ---- group: terasses?
north_east_south_west = Panel("""{-1;1;0}
{-1;0;1}
{-1;-1;0}
{-1;0;-1}""")
tstat_10 = TreeStatistics(Tree=simplify(split_3.Positive))  # -> Paths, Length, Count
python_2 = GhPythonScript(D=north_east_south_west, O="{1;0;0}")  # -> simplify(P), simplify(B); inputs D: list, S: list, O: list
# ---------- python_2: Python ----------
"""Provides a scripting component.
    Inputs:
        D: Paths to offset
        S: (optional) Path to test for inclusion. If None, paths in D
        O: Offsets
    Output:
        P: New paths"""

__author__ = "Antoine Maes"
__version__ = "2022.05.10"

import Grasshopper.DataTree as ghdt
from ghpythonlib import treehelpers as th

def path_to_list(paths_list):
    list_paths_list = []
    for path in paths_list:
        temp_element = str(path)[1:-1]
        list_paths_list.append(temp_element.split(";"))
        
    return [[int(i) for i in j] for j in list_paths_list]


def offset_paths(list_of_path_as_list, offsets):

    off_nested_list = path_to_list(offsets)

    super_path = []
    for path in list_of_path_as_list:
        for offset in off_nested_list:
            new_path = []
            for int_idx in range(len(offset)):
                new_path.append(path[int_idx] + offset[int_idx])
                if len(new_path) == len(off_nested_list[0]):
                    super_path.append(new_path)
    return super_path


def list_to_paths(paths_as_list):
    paths = []
    for path in paths_as_list:
        paths.append("{" + ";".join([str(i) for i in path]) + "}")
    return paths


def reorder_path_list(list_to_reorder, offset_count):
    ordered = [[] for _ in range(offset_count)]

    for list_idx in range(len(list_to_reorder)):
        ordered[list_idx % offset_count].append(list_to_reorder[list_idx])
        
    return ordered


def bool_inclusion(new_paths, old_paths):
    bool_list = [[] for _ in new_paths]
    for path_list_idx in range(len(new_paths)):
        for path in new_paths[path_list_idx]:
            if path in [str(i) for i in old_paths]:
                bool_list[path_list_idx].append(True)
            else:
                bool_list[path_list_idx].append(False)
    return bool_list


if len(S) > 0:
    D = [str(i) for i in S]
else:
    D = [str(i) for i in D]


list_of_path_list = path_to_list(D)
offseted_path_list = offset_paths(list_of_path_list, O)

one_list_paths = list_to_paths(offseted_path_list)
ordered_list_paths = reorder_path_list(one_list_paths, len(O))

bools = bool_inclusion(ordered_list_paths, D)

B = th.list_to_tree(bools)
P = th.list_to_tree(ordered_list_paths)
# ---------- end python_2 ----------
item_8 = ListItem(List=tstat_10.Paths, Index=flatten_2, Wrap=True)
python_3 = GhPythonScript(D=item_8, O=north_east_south_west)  # -> simplify(P), simplify(B); inputs D: list, S: list, O: list; same code as python_2
python_4 = GhPythonScript(D=item_8, O=python_2.P)  # -> simplify(P), simplify(B); inputs D: list, S: list, O: list; same code as python_2
not = GateNot(A=python_4.B)
and = GateAnd(A=python_3.B, B=not)  # -> simplify(Result)

# ----
pshift_3 = ShiftPaths(Data=split_4.Positive, Offset=-1)
tstat_11 = TreeStatistics(Tree=split_2.Positive)  # -> Paths, Length, Count
tstat_12 = TreeStatistics(Tree=pshift_3)  # -> Paths, Length, Count
python_5 = GhPythonScript(x=tstat_11.Paths, y=tstat_12.Paths)  # -> a, b; inputs x: list, y: list
# ---------- python_5: Python ----------
__author__ = "Win"
__version__ = "2022.05.03"

# associate the right inputs
if len(x) < len(y):
    smaller = x
    larger = y
else:
    smaller = y
    larger = x

# create the empty lists
a = []
b = []

# append to each lists
for i in larger:
    if i in smaller:
        a.append(i)
    else:
        b.append(i)
# ---------- end python_5 ----------

long = LongestList(ListA=python_5.a, ListB="True", PaddingMode=2)  # -> ListA, ListB
long_2 = LongestList(ListA=python_5.b, ListB="False", PaddingMode=2)  # -> ListA, ListB
tree_2 = CreateTree(Data=long.ListB, Path=python_5.a)
tree_3 = CreateTree(Data=long_2.ListB, Path=python_5.b)
merge_6 = Merge(Data1=tree_2, Data2=tree_3)
item_9 = ListItem(List=flatten(merge_6), Index=flatten_2, Wrap=True)  # -> graft(Item)

int = Integer("0")
long_3 = LongestList(ListA=python_5.b, ListB=int, PaddingMode=2)  # -> ListA, ListB
tree_4 = CreateTree(Data=long_3.ListB, Path=python_5.b)
lng_4 = ListLength(List=pshift_3)
merge_7 = Merge(Data1=lng_4, Data2=tree_4)
item_10 = ListItem(List=flatten(merge_7), Index=flatten_2, Wrap=True)  # -> graft(Item)

item_11 = ListItem(List=flatten(item_10), Index=merge_5, Wrap=True)
avr_3 = Average(Input=item_11)  # -> simplify(ArithmeticMean)
attr_window_count = RemoteSender(avr_3)

# ---- group: terasses?
branch_4 = TreeBranch(Tree=and, Path=Slider(1, range=0..3), MaintainPaths=True)
tag = TextTag(Location=split_3.Positive, Text=graft(branch_4), Colour=ColourSwatch(SwatchColor=RGB(0, 0, 0)))

# ----
concat = Concatenate(FragmentA="http://127.0.0.1:5000/", FragmentB="ajd_to_net")
hops = Hops(
    _Path=concat,
    Adjacency=l_net.PointPointTopology,
    Type=smaller_2.SmallerThan,
    WriteGmlFile=False,
    CacheResultsInMemory=False,
    CacheSolveResults=False,
    RemoteDefinitionLocation="http://127.0.0.1:5000/ajd_to_net",
    RemoteSolveVersion=(0, 1, 0),
    ShowInput_Enabled=False,
    ShowInput_Path=True,
    SynchronousSolve=True)

concat_2 = Concatenate(FragmentA="http://127.0.0.1:5000/", FragmentB="path_index")
hops_2 = Hops(
    _Path=concat_2,
    Graph=hops,
    Source=Slider(26, range=0..173),
    Target=Slider(11, range=0..193),
    MaxPaths=Slider(-1, range=-1..15000),
    CacheResultsInMemory=False,
    CacheSolveResults=False,
    RemoteDefinitionLocation="http://127.0.0.1:5000/path_index",
    RemoteSolveVersion=(0, 1, 0),
    ShowInput_Enabled=False,
    ShowInput_Path=True,
    SynchronousSolve=True)  # -> SingleShortestPathsIndexes, AllPathsIndexes, ListPartitioner
partition_2 = PartitionList(List=hops_2.AllPathsIndexes, Size=hops_2.ListPartitioner)  # -> simplify(Chunks)

eval_2 = EvaluateCurve(Curve=reparameterize(graft(merge_4)), Parameter=".5")  # -> Point, Tangent, Angle
devec_4 = DeconstructVector(Vector=eval_2.Tangent)  # -> XComponent, YComponent, simplify(ZComponent)
abs_4 = Absolute(Value=devec_4.ZComponent)
smaller_3 = SmallerThan(FirstNumber=abs_4, SecondNumber=".5")  # -> simplify(SmallerThan), OrEqualTo
larger_4 = LargerThan(FirstNumber=devec_4.ZComponent, SecondNumber="0")  # -> LargerThan, OrEqualTo
smaller_4 = SmallerThan(FirstNumber=devec_4.ZComponent, SecondNumber="0")  # -> SmallerThan, OrEqualTo
att_is_horizontal = RemoteSender(smaller_3.SmallerThan)
attr_goes_down = RemoteSender(smaller_4.SmallerThan)
attr_goes_up = RemoteSender(larger_4.LargerThan)

# ---- group: get general direction of the edge
devec_5 = DeconstructVector(Vector=merge_4)  # -> XComponent, YComponent, ZComponent
devec_6 = DeconstructVector(Vector=merge_4)  # -> XComponent, YComponent, ZComponent
devec_7 = DeconstructVector(Vector=merge_4)  # -> XComponent, YComponent, ZComponent
abs_5 = Absolute(Value=devec_5.XComponent)
abs_6 = Absolute(Value=devec_6.YComponent)
abs_7 = Absolute(Value=devec_7.ZComponent)
larger_5 = LargerThan(FirstNumber=abs_5, SecondNumber="0")  # -> LargerThan, OrEqualTo
larger_6 = LargerThan(FirstNumber=abs_6, SecondNumber="0")  # -> LargerThan, OrEqualTo
larger_7 = LargerThan(FirstNumber=abs_7, SecondNumber="0")  # -> LargerThan, OrEqualTo
cull = CullPattern(List=devec_5.XComponent, CullPattern=larger_5.LargerThan)
cull_2 = CullPattern(List=devec_6.YComponent, CullPattern=larger_6.LargerThan)
cull_3 = CullPattern(List=devec_7.ZComponent, CullPattern=larger_7.LargerThan)
clean_6 = CleanTree(RemoveNulls=True, RemoveInvalid=True, RemoveEmpty=invert(False), Tree=cull)  # -> simplify(Tree)
clean_7 = CleanTree(RemoveNulls=True, RemoveInvalid=True, RemoveEmpty=invert(False), Tree=cull_2)  # -> simplify(Tree)
clean_8 = CleanTree(RemoveNulls=True, RemoveInvalid=True, RemoveEmpty=invert(False), Tree=cull_3)  # -> simplify(Tree)

# ----
pdecon = Deconstruct(Point=flatten(l_net.Points))  # -> graft(XComponent), graft(YComponent), graft(ZComponent)
bang = ExplodeTree(Data=and)  # -> graft(Branch0), graft(Branch1), graft(Branch2), graft(Branch3)
merge_8 = Merge(
    Data1=simplify(item_9),
    Data2=simplify(item_10),
    Data3=simplify(bang.Branch0),
    Data4=simplify(bang.Branch1),
    Data5=simplify(bang.Branch2),
    Data6=simplify(bang.Branch3),
    Data7=simplify(pdecon.XComponent),
    Data8=simplify(pdecon.YComponent),
    Data9=simplify(pdecon.ZComponent))  # -> simplify(Result)

item_12 = ListItem(List=flatten(item_4), Index=partition_2, Wrap=True)
item_13 = ListItem(List=l_net.Points, Index=partition_2, Wrap=True)
pline = PolyLine(Vertices=item_13, Closed=False)  # -> simplify(Polyline)

graft = GraftTree(Tree=l_net.Points, IncludeEmptyLists=True, IncludeNullItems=True)  # -> simplify(Tree)
node_attr_labels = Panel("""has_window
window_count
has_terrace_North
has_terrace_East
has_terrace_South
has_terrace_West
x_position
y_position
z_position""")

# ---- group: get general direction of the edge
long_4 = LongestList(ListA=clean_6, ListB="East-West", PaddingMode=2)  # -> ListA, ListB
long_5 = LongestList(ListA=clean_7, ListB="North-South", PaddingMode=2)  # -> ListA, ListB
long_6 = LongestList(ListA=clean_8, ListB="Up-Down", PaddingMode=2)  # -> ListA, ListB
merge_9 = Merge(Data1=long_4.ListB, Data2=long_5.ListB, Data3=long_6.ListB)  # -> simplify(graft(Result))
attr_direction = RemoteSender(merge_9)

# ----
tstat_13 = TreeStatistics(Tree=pline)  # -> Paths, Length, Count
subtraction_2 = Subtraction(A=tstat_13.Count, B="1")
max = Maximum(A=subtraction_2, B="1")
range_3 = Range(Domain=Domain(0, 1), Steps=max)  # -> graft(Range)
gradient = Gradient(
    LowerLimit=0,
    UpperLimit=1,
    Parameter=simplify(range_3),
    stops=[0: RGB(243, 57, 0), 0.118: RGB(236, 27, 60), 0.234: RGB(210, 0, 118), 0.336: RGB(103, 0, 120), 0.452: RGB(39, 72, 161), 0.559: RGB(1, 192, 229), 0.67: RGB(18, 178, 90), 0.775: RGB(79, 186, 8), 0.889: RGB(220, 237, 32), 1: RGB(247, 159, 20)])

concat_3 = Concatenate(FragmentA="http://127.0.0.1:5000/", FragmentB="node_to_graph")

attr_window_count_2 = RemoteReceiver(attr_window_count)
attr_goes_up_2 = RemoteReceiver(attr_goes_up)
attr_goes_down_2 = RemoteReceiver(attr_goes_down)
att_is_horizontal_2 = RemoteReceiver(att_is_horizontal)
attr_direction_2 = RemoteReceiver(attr_direction)
edge_attr_labels = Panel("""goes_up
goes_down
window_count
is_horizontal
direcition""")
merge_10 = Merge(
    Data1=simplify(attr_goes_up_2),
    Data2=attr_goes_down_2,
    Data3=attr_window_count_2,
    Data4=simplify(att_is_horizontal_2),
    Data5=attr_direction_2)  # -> simplify(Result)

hops_3 = Hops(
    _Path=concat_3,
    NodeIndexes=graft,
    Attributes=merge_8,
    Labels=node_attr_labels,
    CacheResultsInMemory=True,
    CacheSolveResults=True,
    RemoteDefinitionLocation="http://127.0.0.1:5000/node_to_graph",
    RemoteSolveVersion=(0, 1, 0),
    ShowInput_Enabled=False,
    ShowInput_Path=True,
    SynchronousSolve=True)
number_slider_4 = Slider(1, range=0..4)

number_slider_5 = Slider(10, range=0..10)
branch_5 = TreeBranch(Tree=gradient, Path=number_slider_5, MaintainPaths=True)
branch_6 = TreeBranch(Tree=pline, Path=number_slider_5, MaintainPaths=True)
branch_7 = TreeBranch(Tree=item_12, Path=number_slider_5, MaintainPaths=True)

concat_4 = Concatenate(FragmentA="http://127.0.0.1:5000/", FragmentB="add_edge_graph")
hops_4 = Hops(
    _Path=concat_4,
    Graph=hops_3,
    NodeIndexes=merge_5,
    Attributes=merge_10,
    Labels=edge_attr_labels,
    CacheResultsInMemory=False,
    CacheSolveResults=False,
    RemoteDefinitionLocation="http://127.0.0.1:5000/add_edge_graph",
    RemoteSolveVersion=(0, 1, 0),
    ShowInput_Enabled=False,
    ShowInput_Path=True,
    SynchronousSolve=True)
full_graph = RemoteSender(hops_4)

node_attr_labels_2 = Panel("""has_window
window_count
has_terrace_North
z_position""")
full_graph_2 = RemoteReceiver(full_graph)
concat_5 = Concatenate(FragmentA="http://127.0.0.1:5000/", FragmentB="read_nodes")
hops_5 = Hops(
    _Path=concat_5,
    Graph=full_graph_2,
    Attributes=node_attr_labels_2,
    Index=-1,
    CacheResultsInMemory=False,
    CacheSolveResults=False,
    RemoteDefinitionLocation="http://127.0.0.1:5000/read_nodes",
    RemoteSolveVersion=(0, 1, 0),
    ShowInput_Enabled=False,
    ShowInput_Path=True,
    SynchronousSolve=True)  # -> Values, ListPartitioner
partition_3 = PartitionList(List=hops_5.Values, Size=hops_5.ListPartitioner)  # -> simplify(Chunks)
flip_2 = FlipMatrix(Data=partition_3)
panel = Panel(flip_2)

number_slider_6 = Slider(10, range=0..10)
edges_2 = BrepEdges(Brep=branch_7)  # -> Naked, Interior, NonManifold
previewlw_4 = CustomPreviewLineweights(Geometry=edges_2.Interior, Shader=ColourSwatch(SwatchColor=RGB(255, 255, 255)), Absolute=False)
previewlw_5 = CustomPreviewLineweights(Geometry=pline, Shader=gradient, Thickness=number_slider_6, Absolute=False)

concat_6 = Concatenate(FragmentA="http://127.0.0.1:5000/", FragmentB="random_apartment_AB")
full_graph_3 = RemoteReceiver(full_graph)
hops_6 = Hops(
    _Path=concat_6,
    Graph=full_graph_3,
    Start=Slider(9, range=0..55),
    Target=Slider(15, range=0..55),
    Length=Slider(6, range=0..10),
    Filter=Toggle(False),
    CacheResultsInMemory=False,
    CacheSolveResults=False,
    RemoteDefinitionLocation="http://127.0.0.1:5000/random_apartment_AB",
    RemoteSolveVersion=(0, 1, 0),
    ShowInput_Enabled=False,
    ShowInput_Path=True,
    SynchronousSolve=True)  # -> ApartIndexes, ListPartitioner

preview_7 = CustomPreview(Geometry=branch_7, Material=branch_5)
previewlw_6 = CustomPreviewLineweights(Geometry=branch_6, Shader=branch_5, Thickness=number_slider_6, Absolute=False)

panel_2 = Panel("""0
2""")
panel_3 = Panel("""0
1""")
node_attr_labels_3 = Panel("""is_horizontal
goes_down
window_count""")
entwine = Entwine(Branch00=panel_2, Branch01=panel_3, FlattenInputs=True)
panel_4 = Panel("""0
1""")
full_graph_4 = RemoteReceiver(full_graph)
panel_5 = Panel("-1")
concat_7 = Concatenate(FragmentA="http://127.0.0.1:5000/", FragmentB="read_edges")
hops_7 = Hops(
    _Path=concat_7,
    Graph=full_graph_4,
    Attributes=node_attr_labels_3,
    Edges=panel_4,
    CacheResultsInMemory=False,
    CacheSolveResults=False,
    RemoteDefinitionLocation="http://127.0.0.1:5000/read_edges",
    RemoteSolveVersion=(0, 1, 0),
    ShowInput_Enabled=False,
    ShowInput_Path=True,
    SynchronousSolve=True)  # -> Values, ListPartitioner
partition_4 = PartitionList(List=hops_7.Values, Size=hops_7.ListPartitioner)  # -> simplify(Chunks)
flip_3 = FlipMatrix(Data=partition_4)
panel_6 = Panel(partition_4)

full_graph_5 = RemoteReceiver(full_graph)

concat_8 = Concatenate(FragmentA="http://127.0.0.1:5000/", FragmentB="remove_edges")
hops_8 = Hops(
    _Path=concat_8,
    Graph=full_graph_5,
    EdgeAttribute="is_horizontal",
    EdgeValue="False",
    CacheResultsInMemory=False,
    CacheSolveResults=False,
    RemoteDefinitionLocation="http://127.0.0.1:5000/remove_edges",
    RemoteSolveVersion=(0, 1, 0),
    ShowInput_Enabled=False,
    ShowInput_Path=True,
    SynchronousSolve=True)

circulation_indexes = Panel("""10
11""")
full_graph_6 = RemoteReceiver(full_graph)
concat_9 = Concatenate(FragmentA="http://127.0.0.1:5000/", FragmentB="many_apartments")
hops_9 = Hops(
    _Path=concat_9,
    Graph=full_graph_6,
    CirculationIndexes=circulation_indexes,
    Length=Slider(3, range=0..12),
    Compacity=Slider(0.59, range=0..1),
    Seed=Slider(6, range=0..10),
    Filter=Toggle(False),
    CacheResultsInMemory=False,
    CacheSolveResults=False,
    RemoteDefinitionLocation="http://127.0.0.1:5000/many_apartments",
    RemoteSolveVersion=(0, 1, 0),
    ShowInput_Enabled=False,
    ShowInput_Path=True,
    SynchronousSolve=True)  # -> Message, ApartIndexes, ListPartitioner

number_slider_7 = Slider(13, range=0..55)
panel_7 = Panel()
full_graph_7 = RemoteReceiver(full_graph)
concat_10 = Concatenate(FragmentA="http://127.0.0.1:5000/", FragmentB="one_apartment")
hops_10 = Hops(
    _Path=concat_10,
    Graph=full_graph_7,
    Index=number_slider_7,
    Length=Slider(4, range=1..10),
    Attributes=panel_7,
    CacheResultsInMemory=False,
    CacheSolveResults=False,
    RemoteDefinitionLocation="http://127.0.0.1:5000/one_apartment",
    RemoteSolveVersion=(0, 1, 0),
    ShowInput_Enabled=False,
    ShowInput_Path=True,
    SynchronousSolve=True)  # -> FurthestReachableIndexes, AllReachableIndexes, Values

# ---- group: Furthest reachable blocs for apart length
item_14 = ListItem(List=flatten(item_4), Index=hops_10.FurthestReachableIndexes, Wrap=True)

# ----
lng_5 = ListLength(List=flatten(hops_10.FurthestReachableIndexes))
subtraction_3 = Subtraction(A=lng_5, B="1")
multiplication_3 = Multiplication(A=subtraction_3, B=Slider(0.9043, range=0..1))
item_15 = ListItem(List=hops_10.FurthestReachableIndexes, Index=multiplication_3, Wrap=True)

num = Number(yx_grid)
crv = Curve(<curve referenced from the Rhino model>)
crv_cp = CurveClosestPoint(Point=graft(l_net.Points), Curve=crv)  # -> Point, Parameter, Distance
division_2 = Division(A=num, B="2")
smaller_5 = SmallerThan(FirstNumber=crv_cp.Distance, SecondNumber=division_2)  # -> SmallerThan, OrEqualTo
cull_4 = CullPattern(List=crv_cp.Point, CullPattern=smaller_5.SmallerThan)  # -> simplify(List)
clean_9 = CleanTree(RemoveNulls=True, RemoveInvalid=True, RemoveEmpty=invert(False), Tree=cull_4)
tstat_14 = TreeStatistics(Tree=clean_9)  # -> Paths, Length, Count
dpath_4 = DeconstructPath(Branch=tstat_14.Paths)  # -> flatten(Indices)
circulation_idx = RemoteSender(dpath_4)

full_graph_8 = RemoteReceiver(full_graph)
concat_11 = Concatenate(FragmentA="http://127.0.0.1:5000/", FragmentB="path_index")
hops_11 = Hops(
    _Path=concat_11,
    Graph=full_graph_8,
    Source=number_slider_7,
    Target=item_15,
    MaxPaths=Slider(-1, range=-1..15000),
    CacheResultsInMemory=False,
    CacheSolveResults=False,
    RemoteDefinitionLocation="http://127.0.0.1:5000/path_index",
    RemoteSolveVersion=(0, 1, 0),
    ShowInput_Enabled=False,
    ShowInput_Path=True,
    SynchronousSolve=True)  # -> SingleShortestPathsIndexes, AllPathsIndexes, ListPartitioner

circulation_idx_2 = RemoteReceiver(circulation_idx)
circulation_indexes_2 = Panel(circulation_idx_2)
number_slider_8 = Slider(1, range=0..1)
number_slider_9 = Slider(13, range=0..200)
full_graph_9 = RemoteReceiver(full_graph)
concat_12 = Concatenate(FragmentA="http://127.0.0.1:5000/", FragmentB="apartment_builder")
hops_12 = Hops(
    _Path=concat_12,
    Graph=full_graph_9,
    CirculationIndexes=circulation_idx_2,
    MaxLength=Slider(3, range=2..10),
    MinLength=Slider(2, range=2..10),
    Compacity=number_slider_8,
    Seed=number_slider_9,
    CacheResultsInMemory=False,
    CacheSolveResults=False,
    RemoteDefinitionLocation="http://127.0.0.1:5000/apartment_builder",
    RemoteSolveVersion=(0, 1, 0),
    ShowInput_Enabled=False,
    ShowInput_Path=True,
    SynchronousSolve=True)  # -> NewGraph, ApartIndexes, ListPartitioner
partition_5 = PartitionList(List=hops_12.ApartIndexes, Size=hops_12.ListPartitioner)  # -> simplify(Chunks)
cset = CreateSet(List=hops_12.ListPartitioner)  # -> Set, Map
panel_8 = Panel(cset.Set)

partition_6 = PartitionList(List=hops_11.AllPathsIndexes, Size=hops_11.ListPartitioner)  # -> simplify(Chunks)
item_16 = ListItem(List=flatten(item_4), Index=partition_6, Wrap=True)
item_17 = ListItem(List=l_net.Points, Index=partition_6, Wrap=True)
pline_2 = PolyLine(Vertices=item_17, Closed=False)  # -> simplify(Polyline)
tstat_15 = TreeStatistics(Tree=pline_2)  # -> Paths, Length, Count
subtraction_4 = Subtraction(A=tstat_15.Count, B="1")
max_2 = Maximum(A=subtraction_4, B="1")
range_4 = Range(Domain=Domain(0, 1), Steps=max_2)  # -> graft(Range)
gradient_2 = Gradient(
    LowerLimit=0,
    UpperLimit=1,
    Parameter=simplify(range_4),
    stops=[0: RGB(243, 57, 0), 0.118: RGB(236, 27, 60), 0.234: RGB(210, 0, 118), 0.336: RGB(103, 0, 120), 0.452: RGB(39, 72, 161), 0.559: RGB(1, 192, 229), 0.67: RGB(18, 178, 90), 0.775: RGB(79, 186, 8), 0.889: RGB(220, 237, 32), 1: RGB(247, 159, 20)])
number_slider_10 = Slider(2, range=0..12)
branch_8 = TreeBranch(Tree=item_16, Path=number_slider_10, MaintainPaths=True)
branch_9 = TreeBranch(Tree=gradient_2, Path=number_slider_10, MaintainPaths=True)
edges_3 = BrepEdges(Brep=branch_8)  # -> Naked, Interior, NonManifold
preview_8 = CustomPreview(Geometry=branch_8, Material=branch_9)
previewlw_7 = CustomPreviewLineweights(Geometry=pline_2, Shader=gradient_2, Thickness=Slider(10, range=0..10), Absolute=False)
previewlw_8 = CustomPreviewLineweights(Geometry=edges_3.Interior, Shader=ColourSwatch(SwatchColor=RGB(255, 255, 255)), Absolute=False)

full_graph_10 = RemoteReceiver(full_graph)
circulation_idx_3 = RemoteReceiver(circulation_idx)
concat_13 = Concatenate(FragmentA="http://127.0.0.1:5000/", FragmentB="apartments_directedGraph")
hops_13 = Hops(
    _Path=concat_13,
    Graph=full_graph_10,
    CirculationIndexes=circulation_idx_3,
    MaxLength=Slider(4, range=2..10),
    MinLength=Slider(3, range=2..10),
    Compacity=Slider(0.7, range=0..1),
    Seed=Slider(26, range=0..100),
    CacheResultsInMemory=False,
    CacheSolveResults=False,
    RemoteDefinitionLocation="http://127.0.0.1:5000/apartments_directedGraph",
    RemoteSolveVersion=(0, 1, 0),
    ShowInput_Enabled=False,
    ShowInput_Path=True,
    SynchronousSolve=True)  # -> NewGraph, ApartIndexes, ListPartitioner
partition_7 = PartitionList(List=hops_13.ApartIndexes, Size=hops_13.ListPartitioner)  # -> simplify(Chunks)
cset_2 = CreateSet(List=hops_13.ListPartitioner)  # -> Set, Map
panel_9 = Panel(cset_2.Set)
panel_10 = Panel(partition_7)

circulation_idx_4 = RemoteReceiver(circulation_idx)
item_18 = ListItem(List=flatten(item_4), Index=partition_5, Wrap=True)
item_19 = ListItem(List=flatten(item_4), Index=circulation_idx_4, Wrap=True)
lng_6 = ListLength(List=item_18)
lng_7 = ListLength(List=flatten(lng_6))
subtraction_5 = Subtraction(A=lng_7, B="1")
edges_4 = BrepEdges(Brep=item_18)  # -> Naked, Interior, NonManifold
range_5 = Range(Domain=Domain(0, 1), Steps=subtraction_5)
gradient_3 = Gradient(
    LowerLimit=0,
    UpperLimit=1,
    Parameter=range_5,
    stops=[0: RGB(243, 57, 0), 0.114: RGB(236, 27, 60), 0.221: RGB(210, 0, 118), 0.336: RGB(103, 0, 120), 0.447: RGB(39, 72, 161), 0.555: RGB(1, 192, 229), 0.668: RGB(18, 178, 90), 0.781: RGB(79, 186, 8), 0.888: RGB(220, 237, 32), 1: RGB(247, 159, 20)])
pshift_4 = ShiftPaths(Data=simplify(edges_4.Interior), Offset=-1)
number_slider_11 = Slider(0.3, range=0..1)
alpha = AdjustAlpha(Color=gradient_3, Alpha=number_slider_11)
alpha_2 = AdjustAlpha(Color=ColourSwatch(SwatchColor=RGB(110, 110, 110)), Alpha=number_slider_11)
preview_9 = CustomPreview(Geometry=item_18, Material=graft(alpha))
previewlw_9 = CustomPreviewLineweights(Geometry=pshift_4, Shader=graft(alpha), Thickness=Slider(2, range=0..10), Absolute=False)
preview_10 = CustomPreview(Geometry=item_19, Material=alpha_2)

all_apartments = Slider(1, range=0..1)
concat_14 = Concatenate(FragmentA="http://127.0.0.1:5000/", FragmentB="random_apartment")
full_graph_11 = RemoteReceiver(full_graph)
hops_14 = Hops(
    _Path=concat_14,
    Graph=full_graph_11,
    Start=Slider(12, range=0..55),
    Length=Slider(7, range=0..12),
    Compacity=Slider(0.42, range=0..1),
    Targets=Slider(0, range=0..1),
    Filter=Toggle(True),
    CacheResultsInMemory=False,
    CacheSolveResults=False,
    RemoteDefinitionLocation="http://127.0.0.1:5000/random_apartment",
    RemoteSolveVersion=(0, 1, 0),
    ShowInput_Enabled=False,
    ShowInput_Path=True,
    SynchronousSolve=True)  # -> Message, ApartIndexes, ListPartitioner
partition_8 = PartitionList(List=hops_14.ApartIndexes, Size=hops_14.ListPartitioner)  # -> simplify(Chunks)

full_graph_12 = RemoteReceiver(full_graph)
concat_15 = Concatenate(FragmentA="http://127.0.0.1:5000/", FragmentB="graph_attributes")
hops_15 = Hops(
    _Path=concat_15,
    Graph=full_graph_12,
    CacheResultsInMemory=False,
    CacheSolveResults=False,
    RemoteDefinitionLocation="http://127.0.0.1:5000/graph_attributes",
    RemoteSolveVersion=(0, 1, 0),
    ShowInput_Enabled=False,
    ShowInput_Path=True,
    SynchronousSolve=True)  # -> NodeAttributeList, EdgeAttributeList
item_20 = ListItem(List=hops_15.EdgeAttributeList, Index=Slider(0, range=0..8), Wrap=True)

tstat_16 = TreeStatistics(Tree=partition_8)  # -> Paths, Length, Count
subtraction_6 = Subtraction(A=tstat_16.Count, B="1")
multiplication_4 = Multiplication(A=subtraction_6, B=all_apartments)
item_21 = ListItem(List=tstat_16.Paths, Index=multiplication_4, Wrap=True)
branch_10 = TreeBranch(Tree=partition_8, Path=item_21, MaintainPaths=True)
item_22 = ListItem(List=flatten(item_4), Index=branch_10, Wrap=True)

full_graph_13 = RemoteReceiver(full_graph)
concat_16 = Concatenate(FragmentA="http://127.0.0.1:5000/", FragmentB="evaluate_apartments")
hops_16 = Hops(
    _Path=concat_16,
    Graph=full_graph_13,
    ApartmentsIndexes=partition_5,
    Attribute=item_20,
    CacheResultsInMemory=False,
    CacheSolveResults=False,
    RemoteDefinitionLocation="http://127.0.0.1:5000/evaluate_apartments",
    RemoteSolveVersion=(0, 1, 0),
    ShowInput_Enabled=False,
    ShowInput_Path=True,
    SynchronousSolve=True)  # -> Values, ValueListPartitioner
partition_9 = PartitionList(List=hops_16.Values, Size=hops_16.ValueListPartitioner)  # -> simplify(Chunks)

panel_11 = Panel(item_20)

lng_8 = ListLength(List=item_22)
subtraction_7 = Subtraction(A=lng_8, B="1")
range_6 = Range(Domain=Domain(0, 1), Steps=subtraction_7)
edges_5 = BrepEdges(Brep=item_22)  # -> Naked, Interior, NonManifold
hsl = ColourHSL(Alpha=Slider(0.6, range=0..1), Hue=ColourSwatch(SwatchColor=RGB(255, 0, 0)), Saturation=1, Luminance=range_6)
previewlw_10 = CustomPreviewLineweights(
    Geometry=edges_5.Interior,
    Shader=ColourSwatch(SwatchColor=RGB(255, 255, 255)),
    Thickness=Slider(2, range=0..10),
    Absolute=False)
preview_11 = CustomPreview(Geometry=item_22, Material=hsl)

num_2 = Number(partition_9)
ma_2 = MassAddition(Input=num_2)  # -> Result, PartialResults
bnd_2 = Bounds(Numbers=flatten(ma_2.Result))
remap_2 = RemapNumbers(Value=ma_2.Result, Source=bnd_2, Target=Domain(0, 1))  # -> Mapped, Clipped
gradient_4 = Gradient(
    LowerLimit=0,
    UpperLimit=1,
    Parameter=remap_2.Mapped,
    stops=[0: RGB(234, 38, 0), 0.25: RGB(234, 126, 0), 0.5: RGB(254, 244, 84), 0.75: RGB(173, 203, 249), 1: RGB(75, 107, 169)])
avr_4 = Average(Input=flatten(ma_2.Result))
alpha_3 = AdjustAlpha(Color=gradient_4, Alpha=Slider(0.5, range=0..1))

galapagos = Galapagos(fitness=avr_4, gene=[number_slider_8, number_slider_9])

item_23 = ListItem(List=flatten(item_4), Index=partition_5, Wrap=True)
item_24 = ListItem(List=flatten(l_net.Points), Index=partition_5, Wrap=True)
scale_2 = Scale(Geometry=item_23, Center=item_24, Factor=".9")  # -> Geometry, Transform
edges_6 = BrepEdges(Brep=scale_2.Geometry)  # -> Naked, Interior, NonManifold
pshift_5 = ShiftPaths(Data=edges_6.Interior, Offset=-1)
previewlw_11 = CustomPreviewLineweights(Geometry=pshift_5, Shader=graft(alpha), Thickness=Slider(8, range=0..10), Absolute=False)
preview_12 = CustomPreview(Geometry=scale_2.Geometry, Material=alpha_3)

concat_17 = Concatenate(FragmentA="average", FragmentB=item_20, JoinSeparator=" ")
concat_18 = Concatenate(FragmentA=concat_17, FragmentB=avr_4, JoinSeparator=": ")
merge_11 = Merge(Data1=flatten(item_20), Data2=flatten(bnd_2), Data3=flatten(concat_18))
pt_2 = Point(Point(-5.870514314, 1.331740401, 0))
neg = Negative(Value=Slider(1.5, range=1..2))
lng_9 = ListLength(List=merge_11)
series_3 = Series(Start=0, Step=neg, Count=lng_9)
Z = UnitZ(Factor=series_3)
move = Move(Geometry=pt_2, Motion=Z)  # -> Geometry, Transform
tag_2 = TextTag(Location=move.Geometry, Text=merge_11)
