# Grasshopper definition Mellow_Networkx_220907.gh (Grasshopper 1.0.7)
# plug-ins: Heteroptera, Human, Tundra, eleFront, Hops, Telepathy

standard_height = Slider(3, range=2..4)
floor_count = Slider(3, range=0..10)
first_height = Slider(4, range=3..5)
series = Series(Start=standard_height, Step=standard_height, Count=floor_count)
ins = InsertItems(List=series, Item="0", Indices="0", Wrap=True)

yx_grid = Slider(3, range=2..4)
number_slider = Slider(4, range=0..10)
number_slider_2 = Slider(4, range=0..10)
multiplication = Multiplication(A=number_slider_2, B=yx_grid)
multiplication_2 = Multiplication(A=yx_grid, B=number_slider)
range = Range(Domain=multiplication, Steps=number_slider_2)
range_2 = Range(Domain=multiplication_2, Steps=number_slider)

crossref = CrossReference(ListA=range, ListB=range_2, ListC=ins, CrossMode=1)  # -> ListA, ListB, ListC
lng = ListLength(List=range)
pt = ConstructPoint(XCoordinate=crossref.ListA, YCoordinate=crossref.ListB, ZCoordinate=crossref.ListC)
mindex = MemberIndex(Set=crossref.ListC, Member=ins)  # -> Index, Count
item = ListItem(List=pt, Index=mindex.Index, Wrap=True)
partition = PartitionList(List=item, Size=lng)  # -> simplify(graft(Chunks))

# ---- group: Works but very suspicious
merge = Merge(Data1=yx_grid, Data2=standard_height, Data3=standard_height)
ma = MassAddition(Input=merge)  # -> Result, PartialResults
lng_2 = ListLength(List=merge)
division = Division(A=ma.Result, B=lng_2)
sqrt = SquareRoot(Value=division)

# ----
simplexperlin = SimplexPerlin(Seed=1, Quality=2, gradient="tundraGradient")
translate = Translate(Module=simplexperlin, X=Slider(0.468, range=0..1), Y=Slider(1, range=0..1), Z=0, gradient="tundraGradient")
number_slider_3 = Slider(0.05, range=0..1)
scale = Scale(Module=translate, XScale=number_slider_3, YScale=number_slider_3, ZScale=1, gradient="tundraGradient")

relitem = RelativeItem(Tree=partition, Offset="{0;0;1}", WrapPaths=False, WrapItems=False)  # -> ItemA, ItemB
relitem_2 = RelativeItem(Tree=partition, Offset="{0;1;0}", WrapPaths=False, WrapItems=False)  # -> ItemA, ItemB
ln = Line(StartPoint=relitem.ItemA, EndPoint=relitem.ItemB)
ln_2 = Line(StartPoint=relitem_2.ItemA, EndPoint=relitem_2.ItemB)

relitem_3 = RelativeItem(Tree=partition, Offset="{1;0;0}", WrapPaths=False, WrapItems=False)  # -> ItemA, ItemB
ln_3 = Line(StartPoint=relitem_3.ItemA, EndPoint=relitem_3.ItemB)

relitem_4 = RelativeItem(Tree=partition, Offset="{1;1;1}", WrapPaths=False, WrapItems=False)  # -> ItemA, ItemB
merge_2 = Merge(Data1=relitem_4.ItemA, Data2=relitem_4.ItemB)
box = Box2Pt(PointA=relitem_4.ItemA, PointB=relitem_4.ItemB, Plane=PlaneXY(0, 0, 0))
avr = Average(Input=merge_2)

flatten = FlattenTree(Tree=partition, Path="{0}")
item_2 = ListItem(List=flatten, Index=0, Wrap=True)  # -> Item1, Item
box_2 = Box2Pt(PointA=item_2.Item1, PointB=item_2.Item, Plane=PlaneXY(0, 0, 0))

split = SplitTree(Data=avr, Masks=flatten("{0;?;?}"))  # -> simplify(Positive), Negative
getvalue = GetValue(Module=scale, Point=flatten(split.Positive))

subtraction = Subtraction(A=floor_count, B="0")
bnd = Bounds(Numbers=getvalue)
dom = ConstructDomain(DomainStart="0", DomainEnd=subtraction)
remap = RemapNumbers(Value=getvalue, Source=bnd, Target=dom)  # -> Mapped, Clipped
round = Round(Number=remap.Mapped)  # -> graft(Nearest), Floor, Ceiling
unflatten = UnflattenTree(Tree=round.Nearest, Guide=split.Positive)

series_2 = Series(Start=0, Step=1, Count=unflatten)  # -> simplify(Series)
clean = CleanTree(RemoveNulls=True, RemoveInvalid=True, RemoveEmpty=invert(False), Tree=series_2)
tstat = TreeStatistics(Tree=clean)  # -> Paths, Length, Count
branch = TreeBranch(Tree=split.Positive, Path=tstat.Paths, MaintainPaths=True)
tstat_2 = TreeStatistics(Tree=branch)  # -> Paths, Length, Count
lng_3 = ListLength(List=clean)
unflatten_2 = UnflattenTree(Tree=tstat_2.Paths, Guide=branch)
dup = DuplicateData(Data=unflatten_2, Number=lng_3, Order=True)
pshift = ShiftPaths(Data=dup, Offset=-1)
clean_2 = CleanTree(RemoveNulls=True, RemoveInvalid=True, RemoveEmpty=invert(False), Tree=pshift)
tstat_3 = TreeStatistics(Tree=clean_2)  # -> Paths, Length, Count
branch_2 = TreeBranch(Tree=clean, Path=tstat_3.Paths, MaintainPaths=True)  # -> simplify(graft(Branch))
dpath = DeconstructPath(Branch=clean_2)  # -> simplify(Indices)
ins_2 = InsertItems(List=dpath, Item=branch_2, Indices="0", Wrap=True)
path = ConstructPath(Indices=ins_2)
split_2 = SplitTree(Data=box, Masks=flatten(path))  # -> Positive, Negative
split_3 = SplitTree(Data=avr, Masks=flatten(path))  # -> Positive, Negative

# ---- group: I challenge you to find faster than me
debrep = DeconstructBrep(Brep=split_2.Positive)  # -> reparameterize(Faces), Edges, Vertices

# ----
edges = BrepEdges(Brep=split_2.Positive)  # -> Naked, Interior, NonManifold
previewlw = CustomPreviewLineweights(Geometry=edges.Interior, Shader=ColourSwatch(SwatchColor=RGB(0, 0, 0)), Absolute=False)

evalsrf = EvaluateSurface(Surface=debrep.Faces, Point="0.5,0.5,0")  # -> Point, Normal, UDirection, VDirection, Frame
avr_2 = Average(Input=debrep.Vertices)  # -> simplify(ArithmeticMean)
addition = Addition(A=evalsrf.Point, B=evalsrf.Normal)
cp = ClosestPoint(Point=addition, Cloud=flatten(avr_2))  # -> ClosestPoint, CPIndex, simplify(Distance)
smaller = SmallerThan(FirstNumber=simplify(cp.Distance), SecondNumber=sqrt)  # -> SmallerThan, OrEqualTo

path_2 = FilePath()
file = ReadFile(File=path_2, PerLineParse=False)

relitem_5 = RelativeItem(Tree=split_3.Positive, Offset="{0;0;1}", WrapPaths=False, WrapItems=False)  # -> ItemA, ItemB
relitem_6 = RelativeItem(Tree=split_3.Positive, Offset="{0;1;0}", WrapPaths=False, WrapItems=False)  # -> ItemA, ItemB
ln_4 = Line(StartPoint=relitem_5.ItemA, EndPoint=relitem_5.ItemB)
ln_5 = Line(StartPoint=relitem_6.ItemA, EndPoint=relitem_6.ItemB)

relitem_7 = RelativeItem(Tree=split_3.Positive, Offset="{1;0;0}", WrapPaths=False, WrapItems=False)  # -> ItemA, ItemB
ln_6 = Line(StartPoint=relitem_7.ItemA, EndPoint=relitem_7.ItemB)

python = GhPythonScript(Code=file)  # -> Out, A

relay = Relay([ln_4, ln_5])
previewlw_2 = CustomPreviewLineweights(Geometry=relay, Shader=ColourSwatch(SwatchColor=RGB(255, 0, 0)), Thickness=Slider(6, range=0..10), Absolute=False)
previewlw_3 = CustomPreviewLineweights(Geometry=ln_6, Shader=ColourSwatch(SwatchColor=RGB(0, 17, 255)), Thickness=Slider(6, range=0..10), Absolute=False)

merge_3 = Merge(Data1=ln_6, Data2=ln_5, Data3=ln_4)  # -> flatten(Result)
l_net = NetworkFromLines(Lines=flatten(merge_3))  # -> simplify(PointPointTopology), simplify(ConnectionPointTopology), Points, Lines
points = PointList(Points=l_net.Points, Size=".8")

dispatch = Dispatch(List=evalsrf.Frame, DispatchPattern=smaller.SmallerThan)  # -> graft(ListA), graft(ListB)
dispatch_2 = Dispatch(List=debrep.Faces, DispatchPattern=smaller.SmallerThan)  # -> graft(ListA), graft(ListB)

deplane = DeconstructPlane(Plane=dispatch.ListB)  # -> Origin, XAxis, YAxis, ZAxis
devec = DeconstructVector(Vector=deplane.ZAxis)  # -> XComponent, YComponent, ZComponent
abs = Absolute(Value=devec.ZComponent)
larger = LargerThan(FirstNumber=abs, SecondNumber="0")  # -> LargerThan, OrEqualTo
larger_2 = LargerThan(FirstNumber=devec.ZComponent, SecondNumber="0")  # -> LargerThan, OrEqualTo
dispatch_3 = Dispatch(List=dispatch.ListB, DispatchPattern=larger.LargerThan)  # -> ListA, ListB
dispatch_4 = Dispatch(List=larger_2.LargerThan, DispatchPattern=larger.LargerThan)  # -> ListA, ListB
dispatch_5 = Dispatch(List=dispatch_3.ListA, DispatchPattern=dispatch_4.ListA)  # -> ListA, ListB

flip = FlipCurve(Curve=l_net.Lines)  # -> Curve, Flag
tstat_4 = TreeStatistics(Tree=l_net.ConnectionPointTopology)  # -> Paths, Length, Count
merge_4 = Merge(Data1=flatten(l_net.Lines), Data2=flatten(flip.Curve))
dpath_2 = DeconstructPath(Branch=tstat_4.Paths)  # -> flatten(Indices)
item_3 = ListItem(List=reverse(dpath_2), Index=0, Wrap=True)
rev = ReverseList(List=l_net.ConnectionPointTopology)
addition_2 = Addition(A=dpath_2, B="1", C=item_3)  # -> graft(Result)
path_3 = ConstructPath(Indices=addition_2)
dup_2 = DuplicateData(Data=path_3, Number=2, Order=True)
tree = CreateTree(Data=rev, Path=dup_2)
merge_5 = Merge(Data1=simplify(l_net.ConnectionPointTopology), Data2=simplify(tree))

deplane_2 = DeconstructPlane(Plane=dispatch.ListA)  # -> Origin, XAxis, YAxis, ZAxis
devec_2 = DeconstructVector(Vector=deplane_2.ZAxis)  # -> XComponent, YComponent, ZComponent
abs_2 = Absolute(Value=devec_2.ZComponent)
larger_3 = LargerThan(FirstNumber=abs_2, SecondNumber="0")  # -> LargerThan, OrEqualTo
dispatch_6 = Dispatch(List=dispatch_2.ListA, DispatchPattern=larger_3.LargerThan)  # -> ListA, ListB

# ---- group: ordering the center points and celles based on heteroptera point node order
mindex_2 = MemberIndex(Set=flatten(split_3.Positive), Member=l_net.Points)  # -> Index, Count
flatten_2 = FlattenTree(Tree=mindex_2.Index, Path="{0}")
item_4 = ListItem(List=flatten(split_2.Positive), Index=mindex_2.Index, Wrap=True)
item_5 = ListItem(List=flatten(split_3.Positive), Index=flatten_2, Wrap=True)

# ----
clean_3 = CleanTree(RemoveNulls=True, RemoveInvalid=True, RemoveEmpty=invert(False), Tree=simplify(dispatch_3.ListB))
tstat_5 = TreeStatistics(Tree=clean_3)  # -> Paths, Length, Count
split_4 = SplitTree(Data=simplify(dispatch_2.ListB), Masks=flatten(tstat_5.Paths))  # -> Positive, Negative

clean_4 = CleanTree(RemoveNulls=True, RemoveInvalid=True, RemoveEmpty=invert(False), Tree=simplify(dispatch_5.ListA))
tstat_6 = TreeStatistics(Tree=clean_4)  # -> Paths, Length, Count
split_5 = SplitTree(Data=simplify(dispatch_2.ListB), Masks=flatten(tstat_6.Paths))  # -> Positive, Negative

clean_5 = CleanTree(RemoveNulls=True, RemoveInvalid=True, RemoveEmpty=invert(False), Tree=simplify(dispatch_5.ListB))
tstat_7 = TreeStatistics(Tree=clean_5)  # -> Paths, Length, Count
split_6 = SplitTree(Data=simplify(dispatch_2.ListB), Masks=flatten(tstat_7.Paths))  # -> Positive, Negative

preview = CustomPreview(Geometry=split_4.Positive, Material=ColourSwatch(SwatchColor=RGBA(0, 255, 229, 150)))  # disabled
preview_2 = CustomPreview(Geometry=dispatch_6.ListA, Material=ColourSwatch(SwatchColor=RGBA(115, 255, 0, 150)))  # disabled
preview_3 = CustomPreview(Geometry=split_5.Positive, Material=ColourSwatch(SwatchColor=RGBA(255, 0, 119, 150)))  # disabled
preview_4 = CustomPreview(Geometry=split_6.Positive, Material=ColourSwatch(SwatchColor=RGBA(255, 183, 0, 150)))  # disabled

pshift_2 = ShiftPaths(Data=split_4.Positive, Offset=-1)
tstat_8 = TreeStatistics(Tree=pshift_2)  # -> Paths, Length, Count
branch_3 = TreeBranch(Tree=split_2.Positive, Path=tstat_8.Paths, MaintainPaths=True)
preview_5 = CustomPreview(Geometry=[split_4.Positive, split_5.Positive, split_6.Positive], Material=ColourSwatch(SwatchColor=RGBA(0, 0, 0, 33)))
preview_6 = CustomPreview(Geometry=dispatch_6.ListB, Material=ColourSwatch(SwatchColor=RGBA(255, 0, 0, 150)))  # disabled
graft = GraftTree(Tree=l_net.Points, IncludeEmptyLists=True, IncludeNullItems=True)  # -> simplify(Tree)
node_points = RemoteSender(graft)

node_points_2 = RemoteReceiver(node_points)
crv = Curve(<curve referenced from the Rhino model>)
num = Number(yx_grid)
crv_cp = CurveClosestPoint(Point=node_points_2, Curve=crv)  # -> Point, Parameter, Distance
division_2 = Division(A=num, B="2")
smaller_2 = SmallerThan(FirstNumber=crv_cp.Distance, SecondNumber=division_2)  # -> SmallerThan, OrEqualTo
long = LongestList(ListA="yo", ListB=node_points_2, PaddingMode=2)  # -> flatten(ListA), ListB
cull = CullPattern(List=crv_cp.Point, CullPattern=smaller_2.SmallerThan)  # -> simplify(List)
clean_6 = CleanTree(RemoveNulls=True, RemoveInvalid=True, RemoveEmpty=invert(False), Tree=cull)
tstat_9 = TreeStatistics(Tree=clean_6)  # -> Paths, Length, Count
dpath_3 = DeconstructPath(Branch=tstat_9.Paths)  # -> flatten(Indices)
replace = ReplaceItems(List=long.ListA, Item="OY", Indices=dpath_3, Wrap=False)  # -> simplify(graft(List))
node_type = RemoteSender(replace)

node_attr_labels = Panel("""has_window
window_count
has_terrace_North
has_terrace_East
has_terrace_South
has_terrace_West
x_position
y_position
z_position""")

eval = EvaluateCurve(Curve=reparameterize(graft(merge_4)), Parameter=".5")  # -> Point, Tangent, Angle
devec_3 = DeconstructVector(Vector=eval.Tangent)  # -> XComponent, YComponent, simplify(ZComponent)
abs_3 = Absolute(Value=devec_3.ZComponent)
smaller_3 = SmallerThan(FirstNumber=abs_3, SecondNumber=".5")  # -> simplify(SmallerThan), OrEqualTo
larger_4 = LargerThan(FirstNumber=devec_3.ZComponent, SecondNumber="0")  # -> LargerThan, OrEqualTo
smaller_4 = SmallerThan(FirstNumber=devec_3.ZComponent, SecondNumber="0")  # -> SmallerThan, OrEqualTo
att_is_horizontal = RemoteSender(smaller_3.SmallerThan)
attr_goes_down = RemoteSender(smaller_4.SmallerThan)
attr_goes_up = RemoteSender(larger_4.LargerThan)

node_points_3 = RemoteReceiver(node_points)
node_type_2 = RemoteReceiver(node_type)

# ---- group: get general direction of the edge
devec_4 = DeconstructVector(Vector=merge_4)  # -> XComponent, YComponent, ZComponent
devec_5 = DeconstructVector(Vector=merge_4)  # -> XComponent, YComponent, ZComponent
devec_6 = DeconstructVector(Vector=merge_4)  # -> XComponent, YComponent, ZComponent
abs_4 = Absolute(Value=devec_4.XComponent)
abs_5 = Absolute(Value=devec_5.YComponent)
abs_6 = Absolute(Value=devec_6.ZComponent)
larger_5 = LargerThan(FirstNumber=abs_4, SecondNumber="0")  # -> LargerThan, OrEqualTo
larger_6 = LargerThan(FirstNumber=abs_5, SecondNumber="0")  # -> LargerThan, OrEqualTo
larger_7 = LargerThan(FirstNumber=abs_6, SecondNumber="0")  # -> LargerThan, OrEqualTo
cull_2 = CullPattern(List=devec_4.XComponent, CullPattern=larger_5.LargerThan)
cull_3 = CullPattern(List=devec_5.YComponent, CullPattern=larger_6.LargerThan)
cull_4 = CullPattern(List=devec_6.ZComponent, CullPattern=larger_7.LargerThan)
clean_7 = CleanTree(RemoveNulls=True, RemoveInvalid=True, RemoveEmpty=invert(False), Tree=cull_2)  # -> simplify(Tree)
clean_8 = CleanTree(RemoveNulls=True, RemoveInvalid=True, RemoveEmpty=invert(False), Tree=cull_3)  # -> simplify(Tree)
clean_9 = CleanTree(RemoveNulls=True, RemoveInvalid=True, RemoveEmpty=invert(False), Tree=cull_4)  # -> simplify(Tree)

# ----
concat = Concatenate(FragmentA="http://127.0.0.1:5000/", FragmentB="graph_set_circulation")
concat_2 = Concatenate(FragmentA="http://127.0.0.1:5000/", FragmentB="node_to_graph")
hops = Hops(
    _Path=concat_2,
    NodeIndices=node_points_3,
    Attributes=node_type_2,
    Labels="ads",
    CacheResultsInMemory=False,
    CacheSolveResults=False,
    RemoteDefinitionLocation="http://127.0.0.1:5000/node_to_graph",
    RemoteSolveVersion=(0, 1, 0),
    ShowInput_Enabled=False,
    ShowInput_Path=True,
    SynchronousSolve=True)
panel = Panel("""6
8
17""")
hops_2 = Hops(
    _Path=concat,
    Graph=hops,
    Indices=panel,
    CacheResultsInMemory=False,
    CacheSolveResults=False,
    RemoteDefinitionLocation="http://127.0.0.1:5000/graph_set_circulation",
    RemoteSolveVersion=(0, 1, 0),
    ShowInput_Enabled=False,
    ShowInput_Path=True,
    SynchronousSolve=True)

# ---- group: get general direction of the edge
long_2 = LongestList(ListA=clean_7, ListB="East-West", PaddingMode=2)  # -> ListA, ListB
long_3 = LongestList(ListA=clean_8, ListB="North-South", PaddingMode=2)  # -> ListA, ListB
long_4 = LongestList(ListA=clean_9, ListB="Up-Down", PaddingMode=2)  # -> ListA, ListB
merge_6 = Merge(Data1=long_2.ListB, Data2=long_3.ListB, Data3=long_4.ListB)  # -> simplify(graft(Result))
attr_direction = RemoteSender(merge_6)

# ----
panel_2 = Panel(hops_2)

attr_goes_up_2 = RemoteReceiver(attr_goes_up)
attr_window_count = RemoteReceiver()
att_is_horizontal_2 = RemoteReceiver(att_is_horizontal)
attr_goes_down_2 = RemoteReceiver(attr_goes_down)
attr_direction_2 = RemoteReceiver(attr_direction)
edge_attr_labels = Panel("""goes_up
goes_down
window_count
is_horizontal
direcition""")
merge_7 = Merge(
    Data1=simplify(attr_goes_up_2),
    Data2=attr_goes_down_2,
    Data3=attr_window_count,
    Data4=simplify(att_is_horizontal_2),
    Data5=attr_direction_2)  # -> simplify(Result)

concat_3 = Concatenate(FragmentA="http://127.0.0.1:5000/", FragmentB="add_edge_graph")
hops_3 = Hops(
    _Path=concat_3,
    Graph=hops_2,
    NodeIndexes=merge_5,
    Attributes=merge_7,
    Labels=edge_attr_labels,
    CacheResultsInMemory=False,
    CacheSolveResults=False,
    RemoteDefinitionLocation="http://127.0.0.1:5000/add_edge_graph",
    RemoteSolveVersion=(0, 1, 0),
    ShowInput_Enabled=False,
    ShowInput_Path=True,
    SynchronousSolve=True)
