# Grasshopper definition Mellow_Networkx_221012.gh (Grasshopper 1.0.7)
# plug-ins: Heteroptera, Human, Tundra, eleFront, Hops, Telepathy, jSwan, Wombat, LunchBox

standard_height = Slider(3, range=2..4)
floor_count = Slider(3, range=0..10)
first_height = Slider(4, range=3..5)
series = Series(Start=standard_height, Step=standard_height, Count=floor_count)
ins = InsertItems(List=series, Item="0", Indices="0", Wrap=True)

yx_grid = Slider(3, range=2..4)
number_slider = Slider(7, range=0..10)
number_slider_2 = Slider(7, range=0..10)
multiplication = Multiplication(A=number_slider_2, B=yx_grid)
multiplication_2 = Multiplication(A=yx_grid, B=number_slider)
xy_size = RemoteSender(yx_grid)
range = Range(Domain=multiplication, Steps=number_slider_2)
range_2 = Range(Domain=multiplication_2, Steps=number_slider)

crossref = CrossReference(ListA=range, ListB=range_2, ListC=ins, CrossMode=1)  # -> ListA, ListB, ListC
lng = ListLength(List=range)
pt = ConstructPoint(XCoordinate=crossref.ListA, YCoordinate=crossref.ListB, ZCoordinate=crossref.ListC)
mindex = MemberIndex(Set=crossref.ListC, Member=ins)  # -> Index, Count
item = ListItem(List=pt, Index=mindex.Index, Wrap=True)
partition = PartitionList(List=item, Size=lng)  # -> simplify(graft(Chunks))

# ---- group: Works but very suspicious
xy_size_2 = RemoteReceiver(xy_size)
merge = Merge(Data1=xy_size_2, Data2=standard_height, Data3=standard_height)
ma = MassAddition(Input=merge)  # -> Result, PartialResults
lng_2 = ListLength(List=merge)
division = Division(A=ma.Result, B=lng_2)
sqrt = SquareRoot(Value=division)
suspicious_value = RemoteSender(sqrt)

# ----
relitem = RelativeItem(Tree=partition, Offset="{0;0;1}", WrapPaths=False, WrapItems=False)  # -> ItemA, ItemB
relitem_2 = RelativeItem(Tree=partition, Offset="{0;1;0}", WrapPaths=False, WrapItems=False)  # -> ItemA, ItemB
ln = Line(StartPoint=relitem.ItemA, EndPoint=relitem.ItemB)
ln_2 = Line(StartPoint=relitem_2.ItemA, EndPoint=relitem_2.ItemB)

relitem_3 = RelativeItem(Tree=partition, Offset="{1;0;0}", WrapPaths=False, WrapItems=False)  # -> ItemA, ItemB
ln_3 = Line(StartPoint=relitem_3.ItemA, EndPoint=relitem_3.ItemB)

relitem_4 = RelativeItem(Tree=partition, Offset="{1;1;1}", WrapPaths=False, WrapItems=False)  # -> ItemA, ItemB
merge_2 = Merge(Data1=relitem_4.ItemA, Data2=relitem_4.ItemB)
box = Box2Pt(PointA=relitem_4.ItemA, PointB=relitem_4.ItemB, Plane=PlaneXY(0, 0, 0))
avr = Average(Input=merge_2)

flatten = FlattenTree(Tree=partition, Path="{0}")
item_2 = ListItem(List=flatten, Index=0, Wrap=True)  # -> Item1, Item
box_2 = Box2Pt(PointA=item_2.Item1, PointB=item_2.Item, Plane=PlaneXY(0, 0, 0))

number_slider_3 = Slider(10, range=0..10)
range_3 = Range(Domain=Domain(0, 1), Steps=Slider(50, range=0..100))
graph = GraphMapper(
    range_3,
    x0=0,
    x1=1,
    y0=0,
    y1=1,
    container_name="Sine",
    Equation_px=[0.1997530311, 0.6714733839],
    Equation_py=[0.4992038608, 0.8819172978])
graph_2 = GraphMapper(range_3, x0=0, x1=1, y0=0, y1=1, container_name="Sine", Equation_px=[0, 0.594677031], Equation_py=[0, 0.8452714682])
graph_3 = GraphMapper(
    range_3,
    x0=0,
    x1=1,
    y0=0,
    y1=1,
    container_name="Sine",
    Equation_px=[0, 0.2136159688],
    Equation_py=[0.2002130151, 0.8391361237])
graph_4 = GraphMapper(
    range_3,
    x0=0,
    x1=1,
    y0=0,
    y1=1,
    container_name="Sine",
    Equation_px=[0.3847709298, 0.6775185466],
    Equation_py=[0.3729407191, 0.7097097635])
addition = Addition(A=graph_2, B=graph_3, C=graph, D=graph_4)
division_2 = Division(A=addition, B=Slider(4, range=0..10))
cull_i = CullIndex(List=division_2, Indices="-1", Wrap=True)
number_slider_4 = Slider(4, range=0..10)
brep = Brep([<brep referenced from the Rhino model> x375])
mjoin = MeshJoin(Meshes=brep)
medges = MeshEdges(Mesh=mjoin)  # -> NakedEdges, InteriorEdges, NonManifoldEdges
munion = MeshUnion(Meshes=flatten(mjoin))
previewlw = CustomPreviewLineweights(Geometry=medges.NonManifoldEdges, Shader=ColourSwatch(SwatchColor=RGB(196, 196, 196)), Absolute=False)
mshedge = MeshEdgesWithTolerance(Mesh=mjoin, AngleThreshold=45)  # -> InteriorEdges, NakedEdges
preview = CustomPreview(Geometry=munion, Material=ColourSwatch(SwatchColor=RGB(255, 128, 138)))
previewlw_2 = CustomPreviewLineweights(Geometry=mshedge.InteriorEdges, Shader=ColourSwatch(SwatchColor=RGB(0, 0, 0)), Absolute=False)
suspicious_value_2 = RemoteReceiver(suspicious_value)

number_slider_5 = Slider(2, range=0..4)
number_slider_6 = Slider(0, range=0..4)
xy_size_3 = RemoteReceiver(xy_size)
multiplication_3 = Multiplication(A=number_slider_5, B=xy_size_3)
multiplication_4 = Multiplication(A=number_slider_6, B=xy_size_3)
Y = UnitY(Factor=multiplication_3)
Z = UnitZ(Factor=multiplication_4)
addition_2 = Addition(A=Y, B=Z)
crv = Curve(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)
move = Move(Geometry=crv, Motion=addition_2)  # -> Geometry, Transform

dpipeline = DynamicGeometryPipeline(
    LayerFilter="Default",
    TypeFilter="curve",
    NameFilter="*",
    GroupByLayer=False,
    GroupByType=False,
    IncludeHidden=True,
    IncludeLocked=True,
    enableFullPath=True,
    listenToAttributes=True)
circulation_curves = RemoteSender(dpipeline)

node_attr_labels = Panel("""has_window
window_count
has_terrace_North
has_terrace_East
has_terrace_South
has_terrace_West
branch_A
branch_B
branch_C""")
node_attribute_keys = RemoteSender(node_attr_labels)

apart_length_ratio = Panel("""{
"4": 0.3,
"3": 0.3,
"5": 0.4
}""")
apart_length_ratio_2 = Panel("""{
"4": 0.6,
"5": 0.4
}""")
apart_settings = Panel("""{
"8": 1
}""")
generation_settings = Panel("""{
"compacity": 1
}""")
rejson = SerializeJson(Compacity=Slider(1, range=0..1), IncludeNullAndEmptyProperties=False)
concat = Concatenate(FragmentA="http://127.0.0.1:5000/", FragmentB="generate_v2")
hops = Hops(
    CacheResultsInMemory=False,
    CacheSolveResults=False,
    RemoteSolveVersion=(0, 1, 0),
    ShowInput_Enabled=False,
    ShowInput_Path=True,
    SynchronousSolve=True)
desired_proportions = Panel(apart_length_ratio_2)
lng_3 = ListLength()
galapagos = Galapagos(fitness=num, gene=[number_slider_5, number_slider_6])
num = Number(lng_3)
concat_2 = Concatenate(FragmentA="http://127.0.0.1:5000/", FragmentB="explode_graph")

simplexperlin = SimplexPerlin(Seed=1, Quality=2, gradient="tundraGradient")
number_slider_7 = Slider(0, range=0..1)
number_slider_8 = Slider(0.05, range=0..1)
multiplication_5 = Multiplication(A=number_slider_7, B="2*pi")
sin = Sine(Value=multiplication_5)
cos = Cosine(Value=multiplication_5)
scale = Scale(Module=simplexperlin, XScale=number_slider_8, YScale=number_slider_8, ZScale=1, gradient="tundraGradient")

multiplication_6 = Multiplication(A=number_slider_7, B="pi")
sin_2 = Sine(Value=multiplication_6)
multiplication_7 = Multiplication(A=sin, B=number_slider_3)
multiplication_8 = Multiplication(A=cos, B=number_slider_3)

translate = Translate(Module=scale, X=multiplication_7, Y=multiplication_8, Z=0, gradient="tundraGradient")

split = SplitTree(Data=avr, Masks=flatten("{0;?;?}"))  # -> simplify(Positive), Negative
getvalue = GetValue(Module=translate, Point=flatten(split.Positive))

bnd = Bounds(Numbers=getvalue)
dom = ConstructDomain(DomainStart=Slider(0, range=0..3), DomainEnd=floor_count)
remap = RemapNumbers(Value=getvalue, Source=bnd, Target=dom)  # -> Mapped, Clipped
round = Round(Number=remap.Mapped)  # -> graft(Nearest), Floor, Ceiling
unflatten = UnflattenTree(Tree=round.Nearest, Guide=split.Positive)

series_2 = Series(Start=0, Step=1, Count=unflatten)  # -> simplify(Series)
clean = CleanTree(RemoveNulls=True, RemoveInvalid=True, RemoveEmpty=invert(False), Tree=series_2)
tstat = TreeStatistics(Tree=clean)  # -> Paths, Length, Count
branch = TreeBranch(Tree=split.Positive, Path=tstat.Paths, MaintainPaths=True)
tstat_2 = TreeStatistics(Tree=branch)  # -> Paths, Length, Count
lng_4 = ListLength(List=clean)
unflatten_2 = UnflattenTree(Tree=tstat_2.Paths, Guide=branch)
dup = DuplicateData(Data=unflatten_2, Number=lng_4, Order=True)
pshift = ShiftPaths(Data=dup, Offset=-1)
clean_2 = CleanTree(RemoveNulls=True, RemoveInvalid=True, RemoveEmpty=invert(False), Tree=pshift)
tstat_3 = TreeStatistics(Tree=clean_2)  # -> Paths, Length, Count
branch_2 = TreeBranch(Tree=clean, Path=tstat_3.Paths, MaintainPaths=True)  # -> simplify(graft(Branch))
dpath = DeconstructPath(Branch=clean_2)  # -> simplify(Indices)
ins_2 = InsertItems(List=dpath, Item=branch_2, Indices="0", Wrap=True)
path = ConstructPath(Indices=ins_2)
split_2 = SplitTree(Data=box, Masks=flatten(path))  # -> Positive, Negative
split_3 = SplitTree(Data=avr, Masks=flatten(path))  # -> Positive, Negative
reduced_centers = RemoteSender(split_3.Positive)
reduced_cells = RemoteSender(split_2.Positive)

munion_2 = MeshUnion(Meshes=flatten(reduced_cells))
mshedge_2 = MeshEdgesWithTolerance(Mesh=munion_2, AngleThreshold=45)  # -> InteriorEdges, NakedEdges
previewlw_3 = CustomPreviewLineweights(Geometry=mshedge_2.InteriorEdges, Shader=ColourSwatch(SwatchColor=RGB(0, 0, 0)), Absolute=False)

reduced_centers_2 = RemoteReceiver(reduced_centers)
relitem_5 = RelativeItem(Tree=reduced_centers_2, Offset="{1;0;0}", WrapPaths=False, WrapItems=False)  # -> ItemA, ItemB
relitem_6 = RelativeItem(Tree=reduced_centers_2, Offset="{0;0;1}", WrapPaths=False, WrapItems=False)  # -> ItemA, ItemB
relitem_7 = RelativeItem(Tree=reduced_centers_2, Offset="{0;1;0}", WrapPaths=False, WrapItems=False)  # -> ItemA, ItemB
ln_4 = Line(StartPoint=relitem_5.ItemA, EndPoint=relitem_5.ItemB)
ln_5 = Line(StartPoint=relitem_6.ItemA, EndPoint=relitem_6.ItemB)
ln_6 = Line(StartPoint=relitem_7.ItemA, EndPoint=relitem_7.ItemB)

relay = Relay([ln_5, ln_6])
previewlw_4 = CustomPreviewLineweights(Geometry=relay, Shader=ColourSwatch(SwatchColor=RGB(255, 0, 0)), Thickness=Slider(6, range=0..10), Absolute=False)
previewlw_5 = CustomPreviewLineweights(Geometry=ln_4, Shader=ColourSwatch(SwatchColor=RGB(0, 17, 255)), Thickness=Slider(6, range=0..10), Absolute=False)

merge_3 = Merge(Data1=ln_4, Data2=ln_6, Data3=ln_5)  # -> flatten(Result)
l_net = NetworkFromLines(Lines=flatten(merge_3))  # -> simplify(PointPointTopology), simplify(ConnectionPointTopology), flatten(Points), flatten(Lines)
connexion_lines = RemoteSender(l_net.Lines)

connexion_indexes = RemoteSender(l_net.ConnectionPointTopology)
adjacency_tree = RemoteSender(l_net.PointPointTopology)
node_points = RemoteSender(l_net.Points)

reduced_cells_2 = RemoteReceiver(reduced_cells)
edges = BrepEdges(Brep=reduced_cells_2)  # -> Naked, Interior, NonManifold
node_points_2 = RemoteReceiver(node_points)
points = PointList(Points=node_points_2, Size=".8")
previewlw_6 = CustomPreviewLineweights(Geometry=edges.Interior, Shader=ColourSwatch(SwatchColor=RGB(196, 196, 196)), Absolute=False)

connexion_lines_2 = RemoteReceiver(connexion_lines)
flip = FlipCurve(Curve=connexion_lines_2)  # -> Curve, Flag
merge_4 = Merge(Data1=flatten(connexion_lines_2), Data2=flatten(flip.Curve))
connexion_lines_bidirectional = RemoteSender(merge_4)

connexion_indexes_2 = RemoteReceiver(connexion_indexes)
tstat_4 = TreeStatistics(Tree=connexion_indexes_2)  # -> Paths, Length, Count
rev = ReverseList(List=connexion_indexes_2)
dpath_2 = DeconstructPath(Branch=tstat_4.Paths)  # -> flatten(Indices)
item_3 = ListItem(List=reverse(dpath_2), Index=0, Wrap=True)
addition_3 = Addition(A=dpath_2, B="1", C=item_3)  # -> graft(Result)
path_2 = ConstructPath(Indices=addition_3)
dup_2 = DuplicateData(Data=path_2, Number=2, Order=True)
tree = CreateTree(Data=rev, Path=dup_2)
merge_5 = Merge(Data1=simplify(connexion_indexes_2), Data2=simplify(tree))
connexion_indexes_bidirectional = RemoteSender(merge_5)

# ---- group: ordering the center points and celles based on heteroptera point node order
reduced_centers_3 = RemoteReceiver(reduced_centers)
reduced_cells_3 = RemoteReceiver(reduced_cells)
node_points_3 = RemoteReceiver(node_points)
mindex_2 = MemberIndex(Set=flatten(reduced_centers_3), Member=node_points_3)  # -> Index, Count
flatten_2 = FlattenTree(Tree=mindex_2.Index, Path="{0}")
item_4 = ListItem(List=flatten(reduced_cells_3), Index=mindex_2.Index, Wrap=True)
item_5 = ListItem(List=flatten(reduced_centers_3), Index=flatten_2, Wrap=True)
centers_ordered = RemoteSender(item_5)
cells_ordered = RemoteSender(item_4)
ordering_idx = RemoteSender(flatten_2)

# ----
reduced_cells_4 = RemoteReceiver(reduced_cells)

node_points_4 = RemoteReceiver(node_points)
circulation_curves_2 = RemoteReceiver(circulation_curves)
xy_size_4 = RemoteReceiver(xy_size)
crv_cp = CurveClosestPoint(Point=graft(node_points_4), Curve=circulation_curves_2)  # -> Point, Parameter, Distance
division_3 = Division(A=xy_size_4, B="2")
smaller = SmallerThan(FirstNumber=crv_cp.Distance, SecondNumber=division_3)  # -> SmallerThan, OrEqualTo
cull = CullPattern(List=crv_cp.Point, CullPattern=smaller.SmallerThan)  # -> simplify(List)
clean_3 = CleanTree(RemoveNulls=True, RemoveInvalid=True, RemoveEmpty=invert(False), Tree=cull)
tstat_5 = TreeStatistics(Tree=clean_3)  # -> Paths, Length, Count
dpath_3 = DeconstructPath(Branch=tstat_5.Paths)  # -> flatten(Indices)
circulation_indices = RemoteSender(dpath_3)

# ---- group: terasses?
north_east_south_west = Panel("""{-1;1;0}
{-1;0;1}
{-1;-1;0}
{-1;0;-1}""")
reduced_centers_4 = RemoteReceiver(reduced_centers)
ordering_idx_2 = RemoteReceiver(ordering_idx)
tstat_6 = TreeStatistics(Tree=simplify(reduced_centers_4))  # -> Paths, Length, Count
python = GhPythonScript(D=north_east_south_west, O="{1;0;0}")  # -> simplify(P), simplify(B); inputs D: list, S: list, O: list
# ---------- python: Python ----------
"""Provides a scripting component.
    Inputs:
        D: Paths to offset
        S: (optional) Path to test for inclusion. If None, paths in D
        O: Offsets
    Output:
        P: New paths"""

__author__ = "Antoine Maes"
__version__ = "2022.05.10"

import Grasshopper.DataTree as ghdt
from ghpythonlib import treehelpers as th

def path_to_list(paths_list):
    list_paths_list = []
    for path in paths_list:
        temp_element = str(path)[1:-1]
        list_paths_list.append(temp_element.split(";"))
        
    return [[int(i) for i in j] for j in list_paths_list]


def offset_paths(list_of_path_as_list, offsets):

    off_nested_list = path_to_list(offsets)

    super_path = []
    for path in list_of_path_as_list:
        for offset in off_nested_list:
            new_path = []
            for int_idx in range(len(offset)):
                new_path.append(path[int_idx] + offset[int_idx])
                if len(new_path) == len(off_nested_list[0]):
                    super_path.append(new_path)
    return super_path


def list_to_paths(paths_as_list):
    paths = []
    for path in paths_as_list:
        paths.append("{" + ";".join([str(i) for i in path]) + "}")
    return paths


def reorder_path_list(list_to_reorder, offset_count):
    ordered = [[] for _ in range(offset_count)]

    for list_idx in range(len(list_to_reorder)):
        ordered[list_idx % offset_count].append(list_to_reorder[list_idx])
        
    return ordered


def bool_inclusion(new_paths, old_paths):
    bool_list = [[] for _ in new_paths]
    for path_list_idx in range(len(new_paths)):
        for path in new_paths[path_list_idx]:
            if path in [str(i) for i in old_paths]:
                bool_list[path_list_idx].append(True)
            else:
                bool_list[path_list_idx].append(False)
    return bool_list


if len(S) > 0:
    D = [str(i) for i in S]
else:
    D = [str(i) for i in D]


list_of_path_list = path_to_list(D)
offseted_path_list = offset_paths(list_of_path_list, O)

one_list_paths = list_to_paths(offseted_path_list)
ordered_list_paths = reorder_path_list(one_list_paths, len(O))

bools = bool_inclusion(ordered_list_paths, D)

B = th.list_to_tree(bools)
P = th.list_to_tree(ordered_list_paths)
# ---------- end python ----------
item_6 = ListItem(List=tstat_6.Paths, Index=ordering_idx_2, Wrap=True)
python_2 = GhPythonScript(D=item_6, O=north_east_south_west)  # -> simplify(P), simplify(B); inputs D: list, S: list, O: list; same code as python
python_3 = GhPythonScript(D=item_6, O=python.P)  # -> simplify(P), simplify(B); inputs D: list, S: list, O: list; same code as python
not = GateNot(A=python_3.B)
and = GateAnd(A=python_2.B, B=not)  # -> simplify(Result)

# ---- group: get general direction of the edge
connexion_lines_bidirectional_2 = RemoteReceiver(connexion_lines_bidirectional)
devec = DeconstructVector(Vector=connexion_lines_bidirectional_2)  # -> XComponent, YComponent, ZComponent
devec_2 = DeconstructVector(Vector=connexion_lines_bidirectional_2)  # -> XComponent, YComponent, ZComponent
devec_3 = DeconstructVector(Vector=connexion_lines_bidirectional_2)  # -> XComponent, YComponent, ZComponent
abs = Absolute(Value=devec.XComponent)
abs_2 = Absolute(Value=devec_2.YComponent)
abs_3 = Absolute(Value=devec_3.ZComponent)
larger = LargerThan(FirstNumber=abs, SecondNumber="0")  # -> LargerThan, OrEqualTo
larger_2 = LargerThan(FirstNumber=abs_2, SecondNumber="0")  # -> LargerThan, OrEqualTo
larger_3 = LargerThan(FirstNumber=abs_3, SecondNumber="0")  # -> LargerThan, OrEqualTo
cull_2 = CullPattern(List=devec.XComponent, CullPattern=larger.LargerThan)
cull_3 = CullPattern(List=devec_2.YComponent, CullPattern=larger_2.LargerThan)
cull_4 = CullPattern(List=devec_3.ZComponent, CullPattern=larger_3.LargerThan)
clean_4 = CleanTree(RemoveNulls=True, RemoveInvalid=True, RemoveEmpty=invert(False), Tree=cull_2)  # -> simplify(Tree)
clean_5 = CleanTree(RemoveNulls=True, RemoveInvalid=True, RemoveEmpty=invert(False), Tree=cull_3)  # -> simplify(Tree)
clean_6 = CleanTree(RemoveNulls=True, RemoveInvalid=True, RemoveEmpty=invert(False), Tree=cull_4)  # -> simplify(Tree)

# ---- group: build tree branch attributes
reduced_centers_5 = RemoteReceiver(reduced_centers)
ordering_idx_3 = RemoteReceiver(ordering_idx)
tstat_7 = TreeStatistics(Tree=reduced_centers_5)  # -> Paths, Length, Count
item_7 = ListItem(List=tstat_7.Paths, Index=ordering_idx_3, Wrap=True)
dpath_4 = DeconstructPath(Branch=item_7)
flip_2 = FlipMatrix(Data=dpath_4)

# ----
connexion_lines_bidirectional_3 = RemoteReceiver(connexion_lines_bidirectional)
eval = EvaluateCurve(Curve=reparameterize(graft(connexion_lines_bidirectional_3)), Parameter=".5")  # -> Point, Tangent, Angle
devec_4 = DeconstructVector(Vector=eval.Tangent)  # -> XComponent, YComponent, simplify(ZComponent)
abs_4 = Absolute(Value=devec_4.ZComponent)
smaller_2 = SmallerThan(FirstNumber=abs_4, SecondNumber=".5")  # -> simplify(SmallerThan), OrEqualTo
larger_4 = LargerThan(FirstNumber=devec_4.ZComponent, SecondNumber="0")  # -> LargerThan, OrEqualTo
smaller_3 = SmallerThan(FirstNumber=devec_4.ZComponent, SecondNumber="0")  # -> SmallerThan, OrEqualTo
att_is_horizontal = RemoteSender(smaller_2.SmallerThan)
attr_goes_down = RemoteSender(smaller_3.SmallerThan)
attr_goes_up = RemoteSender(larger_4.LargerThan)

# ---- group: terasses?
branch_3 = TreeBranch(Tree=and, Path=Slider(1, range=0..3), MaintainPaths=True)
tag = TextTag(Location=reduced_centers_4, Text=graft(branch_3), Colour=ColourSwatch(SwatchColor=RGB(0, 0, 0)))

# ---- group: get general direction of the edge
long = LongestList(ListA=clean_4, ListB="East-West", PaddingMode=2)  # -> ListA, ListB
long_2 = LongestList(ListA=clean_5, ListB="North-South", PaddingMode=2)  # -> ListA, ListB
long_3 = LongestList(ListA=clean_6, ListB="Up-Down", PaddingMode=2)  # -> ListA, ListB
merge_6 = Merge(Data1=long.ListB, Data2=long_2.ListB, Data3=long_3.ListB)  # -> simplify(graft(Result))
attr_direction = RemoteSender(merge_6)

# ----
attr_window_count = RemoteReceiver()
attr_direction_2 = RemoteReceiver(attr_direction)
attr_goes_up_2 = RemoteReceiver(attr_goes_up)
att_is_horizontal_2 = RemoteReceiver(att_is_horizontal)
attr_goes_down_2 = RemoteReceiver(attr_goes_down)
edge_attr_labels = Panel("""goes_up
goes_down
is_horizontal""")
merge_7 = Merge(Data1=simplify(attr_goes_up_2), Data2=attr_goes_down_2, Data3=simplify(att_is_horizontal_2))  # -> simplify(Result)
edge_attributes_values = RemoteSender(merge_7)
edge_attribute_keys = RemoteSender(edge_attr_labels)

circulation_indices_2 = RemoteReceiver(circulation_indices)
concat_3 = Concatenate(FragmentA="http://127.0.0.1:5000/", FragmentB="graph_set_circulation")

cells_ordered_2 = RemoteReceiver(cells_ordered)
centers_ordered_2 = RemoteReceiver(centers_ordered)
scale_2 = Scale(Geometry=cells_ordered_2, Center=graft(centers_ordered_2), Factor=".9")  # -> Geometry, Transform
edges_2 = BrepEdges(Brep=scale_2.Geometry)  # -> Naked, Interior, NonManifold
cells_ordered_3 = RemoteReceiver(cells_ordered)
circulation_indices_3 = RemoteReceiver(circulation_indices)
cells_ordered_4 = RemoteReceiver(cells_ordered)
item_8 = ListItem(List=flatten(cells_ordered_4), Index=circulation_indices_3, Wrap=True)  # -> simplify(Item)
preview_2 = CustomPreview(Geometry=item_8, Material=ColourSwatch(SwatchColor=RGB(0, 0, 0)))

reduced_cells_5 = RemoteReceiver(reduced_cells)

# ---- group: I challenge you to find faster than me
debrep = DeconstructBrep(Brep=reduced_cells_5)  # -> reparameterize(Faces), Edges, Vertices

# ----
evalsrf = EvaluateSurface(Surface=debrep.Faces, Point="0.5,0.5,0")  # -> Point, Normal, UDirection, VDirection, Frame
avr_2 = Average(Input=debrep.Vertices)  # -> simplify(ArithmeticMean)
addition_4 = Addition(A=evalsrf.Point, B=evalsrf.Normal)
cp = ClosestPoint(Point=addition_4, Cloud=flatten(avr_2))  # -> ClosestPoint, CPIndex, simplify(Distance)
smaller_4 = SmallerThan(FirstNumber=simplify(cp.Distance), SecondNumber=suspicious_value_2)  # -> SmallerThan, OrEqualTo

dispatch = Dispatch(List=evalsrf.Frame, DispatchPattern=smaller_4.SmallerThan)  # -> graft(ListA), graft(ListB)
dispatch_2 = Dispatch(List=debrep.Faces, DispatchPattern=smaller_4.SmallerThan)  # -> graft(ListA), graft(ListB)

deplane = DeconstructPlane(Plane=dispatch.ListB)  # -> Origin, XAxis, YAxis, ZAxis
devec_5 = DeconstructVector(Vector=deplane.ZAxis)  # -> XComponent, YComponent, ZComponent
abs_5 = Absolute(Value=devec_5.ZComponent)
larger_5 = LargerThan(FirstNumber=abs_5, SecondNumber="0")  # -> LargerThan, OrEqualTo
larger_6 = LargerThan(FirstNumber=devec_5.ZComponent, SecondNumber="0")  # -> LargerThan, OrEqualTo
dispatch_3 = Dispatch(List=dispatch.ListB, DispatchPattern=larger_5.LargerThan)  # -> ListA, ListB
dispatch_4 = Dispatch(List=larger_6.LargerThan, DispatchPattern=larger_5.LargerThan)  # -> ListA, ListB
dispatch_5 = Dispatch(List=dispatch_3.ListA, DispatchPattern=dispatch_4.ListA)  # -> ListA, ListB

deplane_2 = DeconstructPlane(Plane=dispatch.ListA)  # -> Origin, XAxis, YAxis, ZAxis
devec_6 = DeconstructVector(Vector=deplane_2.ZAxis)  # -> XComponent, YComponent, ZComponent
abs_6 = Absolute(Value=devec_6.ZComponent)
larger_7 = LargerThan(FirstNumber=abs_6, SecondNumber="0")  # -> LargerThan, OrEqualTo
dispatch_6 = Dispatch(List=dispatch_2.ListA, DispatchPattern=larger_7.LargerThan)  # -> ListA, ListB

clean_7 = CleanTree(RemoveNulls=True, RemoveInvalid=True, RemoveEmpty=invert(False), Tree=simplify(dispatch_3.ListB))
tstat_8 = TreeStatistics(Tree=clean_7)  # -> Paths, Length, Count
split_4 = SplitTree(Data=simplify(dispatch_2.ListB), Masks=flatten(tstat_8.Paths))  # -> Positive, Negative
outside_walls = RemoteSender(split_4.Positive)

clean_8 = CleanTree(RemoveNulls=True, RemoveInvalid=True, RemoveEmpty=invert(False), Tree=simplify(dispatch_5.ListA))
tstat_9 = TreeStatistics(Tree=clean_8)  # -> Paths, Length, Count
split_5 = SplitTree(Data=simplify(dispatch_2.ListB), Masks=flatten(tstat_9.Paths))  # -> Positive, Negative

clean_9 = CleanTree(RemoveNulls=True, RemoveInvalid=True, RemoveEmpty=invert(False), Tree=simplify(dispatch_5.ListB))
tstat_10 = TreeStatistics(Tree=clean_9)  # -> Paths, Length, Count
split_6 = SplitTree(Data=simplify(dispatch_2.ListB), Masks=flatten(tstat_10.Paths))  # -> Positive, Negative

preview_3 = CustomPreview(Geometry=[split_4.Positive, split_5.Positive, split_6.Positive], Material=ColourSwatch(SwatchColor=RGBA(0, 0, 0, 33)))  # disabled

outside_walls_2 = RemoteReceiver(outside_walls)
pshift_2 = ShiftPaths(Data=outside_walls_2, Offset=-1)

preview_4 = CustomPreview(Geometry=split_4.Positive, Material=ColourSwatch(SwatchColor=RGBA(0, 255, 229, 150)))  # disabled
preview_5 = CustomPreview(Geometry=split_5.Positive, Material=ColourSwatch(SwatchColor=RGBA(255, 0, 119, 150)))  # disabled
preview_6 = CustomPreview(Geometry=split_6.Positive, Material=ColourSwatch(SwatchColor=RGBA(255, 183, 0, 150)))  # disabled
preview_7 = CustomPreview(Geometry=dispatch_6.ListA, Material=ColourSwatch(SwatchColor=RGBA(115, 255, 0, 150)))  # disabled

tstat_11 = TreeStatistics(Tree=pshift_2)  # -> Paths, Length, Count
branch_4 = TreeBranch(Tree=reduced_cells_4, Path=tstat_11.Paths, MaintainPaths=True)
preview_8 = CustomPreview(Geometry=dispatch_6.ListB, Material=ColourSwatch(SwatchColor=RGBA(255, 0, 0, 150)))  # disabled

reduced_cells_6 = RemoteReceiver(reduced_cells)
outside_walls_3 = RemoteReceiver(outside_walls)
pshift_3 = ShiftPaths(Data=outside_walls_3, Offset=-1)
tstat_12 = TreeStatistics(Tree=reduced_cells_6)  # -> Paths, Length, Count
tstat_13 = TreeStatistics(Tree=pshift_3)  # -> Paths, Length, Count
python_4 = GhPythonScript(x=tstat_12.Paths, y=tstat_13.Paths)  # -> a, b; inputs x: list, y: list
# ---------- python_4: Python ----------
__author__ = "Win"
__version__ = "2022.05.03"

# associate the right inputs
if len(x) < len(y):
    smaller = x
    larger = y
else:
    smaller = y
    larger = x

# create the empty lists
a = []
b = []

# append to each lists
for i in larger:
    if i in smaller:
        a.append(i)
    else:
        b.append(i)
# ---------- end python_4 ----------

ordering_idx_4 = RemoteReceiver(ordering_idx)
long_4 = LongestList(ListA=python_4.a, ListB="True", PaddingMode=2)  # -> ListA, ListB
long_5 = LongestList(ListA=python_4.b, ListB="False", PaddingMode=2)  # -> ListA, ListB
tree_2 = CreateTree(Data=long_4.ListB, Path=python_4.a)
tree_3 = CreateTree(Data=long_5.ListB, Path=python_4.b)
merge_8 = Merge(Data1=tree_2, Data2=tree_3)
item_9 = ListItem(List=flatten(merge_8), Index=ordering_idx_4, Wrap=True)  # -> graft(Item)

ordering_idx_5 = RemoteReceiver(ordering_idx)
int = Integer("0")
long_6 = LongestList(ListA=python_4.b, ListB=int, PaddingMode=2)  # -> ListA, ListB
tree_4 = CreateTree(Data=long_6.ListB, Path=python_4.b)
lng_5 = ListLength(List=pshift_3)
merge_9 = Merge(Data1=lng_5, Data2=tree_4)
item_10 = ListItem(List=flatten(merge_9), Index=ordering_idx_5, Wrap=True)  # -> graft(Item)

bang = ExplodeTree(Data=simplify(flip_2))  # -> graft(Branch0), graft(Branch1), graft(Branch2)
bang_2 = ExplodeTree(Data=and)  # -> graft(Branch0), graft(Branch1), graft(Branch2), graft(Branch3)
merge_10 = Merge(
    Data1=simplify(item_9),
    Data2=simplify(item_10),
    Data3=simplify(bang_2.Branch0),
    Data4=simplify(bang_2.Branch1),
    Data5=simplify(bang_2.Branch2),
    Data6=simplify(bang_2.Branch3),
    Data7=simplify(bang.Branch0),
    Data8=simplify(bang.Branch1),
    Data9=simplify(bang.Branch2))  # -> simplify(Result)
node_attribute_values = RemoteSender(merge_10)

node_attribute_values_2 = RemoteReceiver(node_attribute_values)
node_attribute_keys_2 = RemoteReceiver(node_attribute_keys)
node_points_5 = RemoteReceiver(node_points)
concat_4 = Concatenate(FragmentA="http://127.0.0.1:5000/", FragmentB="node_to_graph")
graft = GraftTree(Tree=node_points_5, IncludeEmptyLists=True, IncludeNullItems=True)  # -> simplify(Tree)
hops_2 = Hops(
    _Path=concat_4,
    NodeIndices=graft,
    Attributes=node_attribute_values_2,
    Labels=node_attribute_keys_2,
    CacheResultsInMemory=False,
    CacheSolveResults=False,
    RemoteDefinitionLocation="http://127.0.0.1:5000/node_to_graph",
    RemoteSolveVersion=(0, 1, 0),
    ShowInput_Enabled=False,
    ShowInput_Path=True,
    SynchronousSolve=True)

connexion_indexes_bidirectional_2 = RemoteReceiver(connexion_indexes_bidirectional)
edge_attributes_values_2 = RemoteReceiver(edge_attributes_values)
edge_attribute_keys_2 = RemoteReceiver(edge_attribute_keys)
concat_5 = Concatenate(FragmentA="http://127.0.0.1:5000/", FragmentB="add_edge_graph")
hops_3 = Hops(
    _Path=concat_5,
    Graph=hops_2,
    NodeIndexes=connexion_indexes_bidirectional_2,
    Attributes=edge_attributes_values_2,
    Labels=edge_attribute_keys_2,
    CacheResultsInMemory=False,
    CacheSolveResults=False,
    RemoteDefinitionLocation="http://127.0.0.1:5000/add_edge_graph",
    RemoteSolveVersion=(0, 1, 0),
    ShowInput_Enabled=False,
    ShowInput_Path=True,
    SynchronousSolve=True)

dejson = DeserializeJson(JSON=hops_3, OutputsLocked=False)  # -> Directed, Multigraph, Graph, Nodes, Edges
dejson_2 = DeserializeJson(JSON=dejson.Nodes, OutputsLocked=False)  # -> Has_window, Window_count, Has_terrace_North, Has_terrace_East, Has_terrace_South, Has_terrace_West, Branch_A, Branch_B, Branch_C, Id
panel = Panel(dejson_2.Has_window)

panel_2 = Panel(dejson.Edges)
hops_4 = Hops(
    _Path=concat_3,
    Graph=hops_3,
    Indices=circulation_indices_2,
    CacheResultsInMemory=False,
    CacheSolveResults=False,
    RemoteDefinitionLocation="http://127.0.0.1:5000/graph_set_circulation",
    RemoteSolveVersion=(0, 1, 0),
    ShowInput_Enabled=False,
    ShowInput_Path=True,
    SynchronousSolve=True)

concat_6 = Concatenate(FragmentA="http://127.0.0.1:5000/", FragmentB="read_nodes_attr_value")
hops_5 = Hops(
    _Path=concat_6,
    Graph=hops_4,
    Attributes="CIRCULATION_DISTANCE",
    Index=-1,
    CacheResultsInMemory=False,
    CacheSolveResults=False,
    RemoteDefinitionLocation="http://127.0.0.1:5000/read_nodes_attr_value",
    RemoteSolveVersion=(0, 1, 0),
    ShowInput_Enabled=False,
    ShowInput_Path=True,
    SynchronousSolve=True)  # -> Values, ListPartitioner
partition_2 = PartitionList(List=hops_5.Values, Size=hops_5.ListPartitioner)

panel_3 = Panel("""0
1""")
panel_4 = Panel("""0
2""")
entwine = Entwine(Branch00=panel_3, Branch01=panel_4, FlattenInputs=True)  # -> simplify(Result)
concat_7 = Concatenate(FragmentA="http://127.0.0.1:5000/", FragmentB="read_edges_attr_values")
hops_6 = Hops(
    _Path=concat_7,
    Graph=hops_4,
    Attributes="is_horizontal",
    Edges=entwine,
    CacheResultsInMemory=False,
    CacheSolveResults=False,
    RemoteDefinitionLocation="http://127.0.0.1:5000/read_edges_attr_values",
    RemoteSolveVersion=(0, 1, 0),
    ShowInput_Enabled=False,
    ShowInput_Path=True,
    SynchronousSolve=True)  # -> Values, ListPartitioner
partition_3 = PartitionList(List=hops_6.Values, Size=hops_6.ListPartitioner)
flip_3 = FlipMatrix(Data=partition_3)
panel_5 = Panel(flip_3)

panel_6 = Panel("""goes_down
goes_up""")
panel_7 = Panel("""True
True""")
concat_8 = Concatenate(FragmentA="http://127.0.0.1:5000/", FragmentB="remove_edges")
hops_7 = Hops(
    _Path=concat_8,
    Graph=hops_4,
    EdgeAttribute=panel_6,
    EdgeValue=panel_7,
    CacheResultsInMemory=False,
    CacheSolveResults=False,
    RemoteDefinitionLocation="http://127.0.0.1:5000/remove_edges",
    RemoteSolveVersion=(0, 1, 0),
    ShowInput_Enabled=False,
    ShowInput_Path=True,
    SynchronousSolve=True)

bnd_2 = Bounds(Numbers=partition_2)
dedomain = DeconstructDomain(Domain=bnd_2)  # -> Start, End
gradient = Gradient(
    LowerLimit=dedomain.Start,
    UpperLimit=dedomain.End,
    Parameter=partition_2,
    stops=[0: RGB(234, 38, 0), 0.25: RGB(234, 126, 0), 0.5: RGB(254, 244, 84), 0.75: RGB(173, 203, 249), 1: RGB(75, 107, 169)])
hops_8 = Hops(
    _Path=concat,
    Graph=hops_4,
    ApartmentProportions=apart_length_ratio_2,
    GenerationSettings="default",
    FloorCount=Slider(2, range=1..5),
    Fill=Toggle(True),
    Iterations=Slider(10, range=1..10),
    CacheResultsInMemory=False,
    CacheSolveResults=False,
    RemoteDefinitionLocation="http://127.0.0.1:5000/generate_v2",
    RemoteSolveVersion=(0, 1, 0),
    ShowInput_Enabled=False,
    ShowInput_Path=True,
    SynchronousSolve=True)  # -> NewGraph, AllRankings, ApartIndexes, ListPartitioner, Proportions
partition_4 = PartitionList(List=hops_8.ApartIndexes, Size=hops_8.ListPartitioner)  # -> simplify(Chunks)
alpha = AdjustAlpha(Color=gradient, Alpha=Slider(0.1, range=0..1))

dejson_3 = DeserializeJson(JSON=hops_8.NewGraph, OutputsLocked=False)  # -> Directed, Multigraph, Graph, Nodes, Edges
dejsonkv = DeserializeKeysAndValues(Keys=Slider(4, range=0..9))  # -> Key, Value
dejson_4 = DeserializeJson(JSON=dejson_3.Edges, OutputsLocked=False)  # -> Goes_up, Goes_down, Is_horizontal, From, To

preview_9 = CustomPreview(Geometry=cells_ordered_2, Material=graft(alpha))  # disabled
previewlw_7 = CustomPreviewLineweights(Geometry=edges_2.Interior, Shader=graft(alpha), Thickness=Slider(3, range=0..10), Absolute=False)  # disabled
item_11 = ListItem(List=flatten(cells_ordered_3), Index=partition_4, Wrap=True)  # -> simplify(Item)
hops_9 = Hops(
    _Path=concat_2,
    Graph=hops_7,
    CacheResultsInMemory=False,
    CacheSolveResults=False,
    RemoteDefinitionLocation="http://127.0.0.1:5000/explode_graph",
    RemoteSolveVersion=(0, 1, 0),
    ShowInput_Enabled=False,
    ShowInput_Path=True,
    SynchronousSolve=True)  # -> Nodes, Edges, ListPartitioner

# ---- group: visualise different rankings
dejsonkv_2 = DeserializeKeysAndValues(JSON=hops_8.AllRankings)  # -> Key, Value
list = ItemSelector(
    dejsonkv_2.Key,
    {"circulation_rankings", "compacity_rankings", "window_rankings_before", "window_rankings_after", "floors_rankings"}, selected="circulation_rankings")
dejsonkv_3 = DeserializeKeysAndValues(JSON=hops_8.AllRankings, Keys=list)  # -> Key, Value
dejson_5 = DeserializeJson(JSON=dejsonkv_3.Value, OutputsLocked=False)
bnd_3 = Bounds(Numbers=dejson_5)
dedomain_2 = DeconstructDomain(Domain=bnd_3)  # -> Start, End
gradient_2 = Gradient(
    LowerLimit=dedomain_2.Start,
    UpperLimit=dedomain_2.End,
    Parameter=dejson_5,
    stops=[0: RGB(234, 38, 0), 0.25: RGB(234, 126, 0), 0.5: RGB(254, 244, 84), 0.75: RGB(173, 203, 249), 1: RGB(75, 107, 169)])
alpha_2 = AdjustAlpha(Color=gradient_2, Alpha=Slider(0.9, range=0..1))
preview_10 = CustomPreview(Geometry=item_11, Material=graft(alpha_2))

# ----
partition_5 = PartitionList(List=hops_9.Edges, Size=hops_9.ListPartitioner)
panel_8 = Panel(hops_9.Nodes)

tstat_14 = TreeStatistics(Tree=item_11)  # -> Paths, Length, Count
cset = CreateSet(List=tstat_14.Length)  # -> Set, Map
list_2 = ValueList({"One color per apartment": 0, "One color per size": 1}, selected="One color per apartment")
subtraction = Subtraction(A=tstat_14.Count, B="1")
bnd_4 = Bounds(Numbers=cset.Set)
range_4 = Range(Domain=Domain(0, 1), Steps=subtraction)
dedomain_3 = DeconstructDomain(Domain=bnd_4)  # -> Start, End
filter = StreamFilter(Gate=list_2, Stream0="0", Stream1=dedomain_3.Start)
filter_2 = StreamFilter(Gate=list_2, Stream0="1", Stream1=dedomain_3.End)
filter_3 = StreamFilter(Gate=list_2, Stream0=range_4, Stream1=tstat_14.Length)
gradient_3 = Gradient(
    LowerLimit=filter,
    UpperLimit=filter_2,
    Parameter=filter_3,
    stops=[0: RGB(243, 57, 0), 0.118: RGB(236, 27, 60), 0.234: RGB(210, 0, 118), 0.336: RGB(103, 0, 120), 0.452: RGB(39, 72, 161), 0.559: RGB(1, 192, 229), 0.67: RGB(18, 178, 90), 0.775: RGB(79, 186, 8), 0.889: RGB(220, 237, 32), 1: RGB(247, 159, 20)])
alpha_3 = AdjustAlpha(Color=gradient_3, Alpha=Slider(0.9, range=0..1))

panel_9 = Panel(partition_5)

munion_3 = MeshUnion(Meshes=item_11)
mshedge_3 = MeshEdgesWithTolerance(Mesh=munion_3, AngleThreshold=45)  # -> InteriorEdges, NakedEdges
previewlw_8 = CustomPreviewLineweights(
    Geometry=mshedge_3.InteriorEdges,
    Shader=ColourSwatch(SwatchColor=RGB(0, 0, 0)),
    Thickness=Slider(10, range=0..10),
    Absolute=False)

preview_11 = CustomPreview(Geometry=item_11, Material=graft(alpha_3))
