# Grasshopper definition Mellow_Networkx_221205.gh (Grasshopper 1.0.7)
# plug-ins: Heteroptera, Human, Tundra, eleFront, Hops, Telepathy, Wombat, jSwan, LunchBox, treesloth01, Kangaroo2 Components

standard_height = Slider(3, range=2..4)
floor_count = Slider(4, range=0..10)
series = Series(Start=standard_height, Step=standard_height, Count=floor_count)
ins = InsertItems(List=series, Item="0", Indices="0", Wrap=True)

yx_grid = Slider(3, range=2..6)
number_slider = Slider(5, range=0..10)
number_slider_2 = Slider(5, range=0..10)
multiplication = Multiplication(A=number_slider_2, B=yx_grid)
multiplication_2 = Multiplication(A=yx_grid, B=number_slider)
xy_size = RemoteSender(yx_grid)
range = Range(Domain=multiplication, Steps=number_slider_2)
range_2 = Range(Domain=multiplication_2, Steps=number_slider)

crossref = CrossReference(ListA=range, ListB=range_2, ListC=ins, CrossMode=1)  # -> ListA, ListB, ListC
lng = ListLength(List=range)
pt = ConstructPoint(XCoordinate=crossref.ListA, YCoordinate=crossref.ListB, ZCoordinate=crossref.ListC)
mindex = MemberIndex(Set=crossref.ListC, Member=ins)  # -> Index, Count
item = ListItem(List=pt, Index=mindex.Index, Wrap=True)
partition = PartitionList(List=item, Size=lng)  # -> simplify(graft(Chunks))

# ---- group: Works but very suspicious
xy_size_2 = RemoteReceiver(xy_size)
merge = Merge(Data1=xy_size_2, Data2=standard_height, Data3=standard_height)
ma = MassAddition(Input=merge)  # -> Result, PartialResults
lng_2 = ListLength(List=merge)
division = Division(A=ma.Result, B=lng_2)
sqrt = SquareRoot(Value=division)
suspicious_value = RemoteSender(sqrt)

# ----
simplexperlin = SimplexPerlin(Seed=1, Quality=2, gradient="tundraGradient")
number_slider_3 = Slider(0.05, range=0..1)
multiplication_3 = Multiplication(A=Slider(0, range=0..1), B="2*pi")
sin = Sine(Value=multiplication_3)
cos = Cosine(Value=multiplication_3)
scale = Scale(Module=simplexperlin, XScale=number_slider_3, YScale=number_slider_3, ZScale=1, gradient="tundraGradient")
translate = Translate(Module=scale, X=sin, Y=cos, Z=0, gradient="tundraGradient")

relitem = RelativeItem(Tree=partition, Offset="{0;0;1}", WrapPaths=False, WrapItems=False)  # -> ItemA, ItemB
relitem_2 = RelativeItem(Tree=partition, Offset="{0;1;0}", WrapPaths=False, WrapItems=False)  # -> ItemA, ItemB
ln = Line(StartPoint=relitem.ItemA, EndPoint=relitem.ItemB)
ln_2 = Line(StartPoint=relitem_2.ItemA, EndPoint=relitem_2.ItemB)

relitem_3 = RelativeItem(Tree=partition, Offset="{1;1;1}", WrapPaths=False, WrapItems=False)  # -> ItemA, ItemB
merge_2 = Merge(Data1=relitem_3.ItemA, Data2=relitem_3.ItemB)
box = Box2Pt(PointA=relitem_3.ItemA, PointB=relitem_3.ItemB, Plane=PlaneXY(0, 0, 0))
avr = Average(Input=merge_2)

relitem_4 = RelativeItem(Tree=partition, Offset="{1;0;0}", WrapPaths=False, WrapItems=False)  # -> ItemA, ItemB
ln_3 = Line(StartPoint=relitem_4.ItemA, EndPoint=relitem_4.ItemB)

flatten = FlattenTree(Tree=partition, Path="{0}")
item_2 = ListItem(List=flatten, Index=0, Wrap=True)  # -> Item1, Item
box_2 = Box2Pt(PointA=item_2.Item1, PointB=item_2.Item, Plane=PlaneXY(0, 0, 0))

split = SplitTree(Data=avr, Masks=flatten("{0;?;?}"))  # -> simplify(Positive), Negative
getvalue = GetValue(Module=translate, Point=flatten(split.Positive))

bnd = Bounds(Numbers=getvalue)
dom = ConstructDomain(DomainStart=Slider(2, range=0..3), DomainEnd=floor_count)
remap = RemapNumbers(Value=getvalue, Source=bnd, Target=dom)  # -> Mapped, Clipped
round = Round(Number=remap.Mapped)  # -> graft(Nearest), Floor, Ceiling
unflatten = UnflattenTree(Tree=round.Nearest, Guide=split.Positive)

series_2 = Series(Start=0, Step=1, Count=unflatten)  # -> simplify(Series)
clean = CleanTree(RemoveNulls=True, RemoveInvalid=True, RemoveEmpty=invert(False), Tree=series_2)
tstat = TreeStatistics(Tree=clean)  # -> Paths, Length, Count
branch = TreeBranch(Tree=split.Positive, Path=tstat.Paths, MaintainPaths=True)
tstat_2 = TreeStatistics(Tree=branch)  # -> Paths, Length, Count
lng_3 = ListLength(List=clean)
unflatten_2 = UnflattenTree(Tree=tstat_2.Paths, Guide=branch)
dup = DuplicateData(Data=unflatten_2, Number=lng_3, Order=True)
pshift = ShiftPaths(Data=dup, Offset=-1)
clean_2 = CleanTree(RemoveNulls=True, RemoveInvalid=True, RemoveEmpty=invert(False), Tree=pshift)
tstat_3 = TreeStatistics(Tree=clean_2)  # -> Paths, Length, Count
branch_2 = TreeBranch(Tree=clean, Path=tstat_3.Paths, MaintainPaths=True)  # -> simplify(graft(Branch))
dpath = DeconstructPath(Branch=clean_2)  # -> simplify(Indices)
ins_2 = InsertItems(List=dpath, Item=branch_2, Indices="0", Wrap=True)
path = ConstructPath(Indices=ins_2)
split_2 = SplitTree(Data=box, Masks=flatten(path))  # -> Positive, Negative
split_3 = SplitTree(Data=avr, Masks=flatten(path))  # -> Positive, Negative
reduced_centers = RemoteSender(split_3.Positive)
reduced_cells = RemoteSender(split_2.Positive)

munion = MeshUnion(Meshes=flatten(reduced_cells))
mshedge = MeshEdgesWithTolerance(Mesh=munion, AngleThreshold=45)  # -> InteriorEdges, NakedEdges
previewlw = CustomPreviewLineweights(Geometry=mshedge.InteriorEdges, Shader=ColourSwatch(SwatchColor=RGB(0, 0, 0)), Absolute=False)

reduced_centers_2 = RemoteReceiver(reduced_centers)
relitem_5 = RelativeItem(Tree=reduced_centers_2, Offset="{1;0;0}", WrapPaths=False, WrapItems=False)  # -> ItemA, ItemB
relitem_6 = RelativeItem(Tree=reduced_centers_2, Offset="{0;0;1}", WrapPaths=False, WrapItems=False)  # -> ItemA, ItemB
relitem_7 = RelativeItem(Tree=reduced_centers_2, Offset="{0;1;0}", WrapPaths=False, WrapItems=False)  # -> ItemA, ItemB
ln_4 = Line(StartPoint=relitem_5.ItemA, EndPoint=relitem_5.ItemB)
ln_5 = Line(StartPoint=relitem_6.ItemA, EndPoint=relitem_6.ItemB)
ln_6 = Line(StartPoint=relitem_7.ItemA, EndPoint=relitem_7.ItemB)

suspicious_value_2 = RemoteReceiver(suspicious_value)

relay = Relay([ln_5, ln_6])
previewlw_2 = CustomPreviewLineweights(Geometry=relay, Shader=ColourSwatch(SwatchColor=RGB(255, 0, 0)), Thickness=Slider(6, range=0..10), Absolute=False)
previewlw_3 = CustomPreviewLineweights(Geometry=ln_4, Shader=ColourSwatch(SwatchColor=RGB(0, 17, 255)), Thickness=Slider(6, range=0..10), Absolute=False)

merge_3 = Merge(Data1=ln_4, Data2=ln_6, Data3=ln_5)  # -> flatten(Result)
l_net = NetworkFromLines(Lines=flatten(merge_3))  # -> simplify(PointPointTopology), simplify(ConnectionPointTopology), flatten(Points), flatten(Lines)
connexion_lines = RemoteSender(l_net.Lines)

connexion_indexes = RemoteSender(l_net.ConnectionPointTopology)
adjacency_tree = RemoteSender(l_net.PointPointTopology)
node_points = RemoteSender(l_net.Points)

reduced_cells_2 = RemoteReceiver(reduced_cells)
edges = BrepEdges(Brep=reduced_cells_2)  # -> Naked, Interior, NonManifold
node_points_2 = RemoteReceiver(node_points)
points = PointList(Points=node_points_2, Size=".8")
previewlw_4 = CustomPreviewLineweights(Geometry=edges.Interior, Shader=ColourSwatch(SwatchColor=RGB(196, 196, 196)), Absolute=False)

connexion_lines_2 = RemoteReceiver(connexion_lines)
flip = FlipCurve(Curve=connexion_lines_2)  # -> Curve, Flag
merge_4 = Merge(Data1=flatten(connexion_lines_2), Data2=flatten(flip.Curve))
connexion_lines_bidirectional = RemoteSender(merge_4)

connexion_indexes_2 = RemoteReceiver(connexion_indexes)
tstat_4 = TreeStatistics(Tree=connexion_indexes_2)  # -> Paths, Length, Count
rev = ReverseList(List=connexion_indexes_2)
dpath_2 = DeconstructPath(Branch=tstat_4.Paths)  # -> flatten(Indices)
item_3 = ListItem(List=reverse(dpath_2), Index=0, Wrap=True)
addition = Addition(A=dpath_2, B="1", C=item_3)  # -> graft(Result)
path_2 = ConstructPath(Indices=addition)
dup_2 = DuplicateData(Data=path_2, Number=2, Order=True)
tree = CreateTree(Data=rev, Path=dup_2)
merge_5 = Merge(Data1=simplify(connexion_indexes_2), Data2=simplify(tree))
connexion_indexes_bidirectional = RemoteSender(merge_5)

# ---- group: ordering the center points and celles based on heteroptera point node order
reduced_centers_3 = RemoteReceiver(reduced_centers)
node_points_3 = RemoteReceiver(node_points)
reduced_cells_3 = RemoteReceiver(reduced_cells)
mindex_2 = MemberIndex(Set=flatten(reduced_centers_3), Member=node_points_3)  # -> Index, Count
flatten_2 = FlattenTree(Tree=mindex_2.Index, Path="{0}")
item_4 = ListItem(List=flatten(reduced_cells_3), Index=mindex_2.Index, Wrap=True)
item_5 = ListItem(List=flatten(reduced_centers_3), Index=flatten_2, Wrap=True)
centers_ordered = RemoteSender(item_5)
cells_ordered = RemoteSender(item_4)
ordering_idx = RemoteSender(flatten_2)

# ----
xy_size_3 = RemoteReceiver(xy_size)
multiplication_4 = Multiplication(A=Slider(2, range=0..4), B=xy_size_3)
multiplication_5 = Multiplication(A=Slider(1, range=0..4), B=xy_size_3)
Y = UnitY(Factor=multiplication_4)
Z = UnitZ(Factor=multiplication_5)
addition_2 = Addition(A=Y, B=Z)
crv = Curve(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)
move = Move(Geometry=crv, Motion=addition_2)  # -> Geometry, Transform

dpipeline = DynamicGeometryPipeline(
    LayerFilter="Default",
    TypeFilter="curve",
    NameFilter="*",
    GroupByLayer=False,
    GroupByType=False,
    IncludeHidden=True,
    IncludeLocked=True,
    enableFullPath=True,
    listenToAttributes=True)
circulation_curves = RemoteSender(dpipeline)

reduced_cells_4 = RemoteReceiver(reduced_cells)

circulation_curves_2 = RemoteReceiver(circulation_curves)
node_points_4 = RemoteReceiver(node_points)
xy_size_4 = RemoteReceiver(xy_size)
crv_cp = CurveClosestPoint(Point=graft(node_points_4), Curve=circulation_curves_2)  # -> Point, Parameter, Distance
division_2 = Division(A=xy_size_4, B="2")
smaller = SmallerThan(FirstNumber=crv_cp.Distance, SecondNumber=division_2)  # -> SmallerThan, OrEqualTo
cull = CullPattern(List=crv_cp.Point, CullPattern=smaller.SmallerThan)  # -> simplify(List)
clean_3 = CleanTree(RemoveNulls=True, RemoveInvalid=True, RemoveEmpty=invert(False), Tree=cull)
tstat_5 = TreeStatistics(Tree=clean_3)  # -> Paths, Length, Count
dpath_3 = DeconstructPath(Branch=tstat_5.Paths)  # -> flatten(Indices)
circulation_indices = RemoteSender(dpath_3)

# ---- group: terasses?
north_east_south_west = Panel("""{-1;1;0}
{-1;0;1}
{-1;-1;0}
{-1;0;-1}""")
reduced_centers_4 = RemoteReceiver(reduced_centers)
ordering_idx_2 = RemoteReceiver(ordering_idx)
tstat_6 = TreeStatistics(Tree=simplify(reduced_centers_4))  # -> Paths, Length, Count
python = GhPythonScript(D=north_east_south_west, O="{1;0;0}")  # -> simplify(P), simplify(B); inputs D: list, S: list, O: list
# ---------- python: Python ----------
"""Provides a scripting component.
    Inputs:
        D: Paths to offset
        S: (optional) Path to test for inclusion. If None, paths in D
        O: Offsets
    Output:
        P: New paths"""

__author__ = "Antoine Maes"
__version__ = "2022.05.10"

import Grasshopper.DataTree as ghdt
from ghpythonlib import treehelpers as th

def path_to_list(paths_list):
    list_paths_list = []
    for path in paths_list:
        temp_element = str(path)[1:-1]
        list_paths_list.append(temp_element.split(";"))
        
    return [[int(i) for i in j] for j in list_paths_list]


def offset_paths(list_of_path_as_list, offsets):

    off_nested_list = path_to_list(offsets)

    super_path = []
    for path in list_of_path_as_list:
        for offset in off_nested_list:
            new_path = []
            for int_idx in range(len(offset)):
                new_path.append(path[int_idx] + offset[int_idx])
                if len(new_path) == len(off_nested_list[0]):
                    super_path.append(new_path)
    return super_path


def list_to_paths(paths_as_list):
    paths = []
    for path in paths_as_list:
        paths.append("{" + ";".join([str(i) for i in path]) + "}")
    return paths


def reorder_path_list(list_to_reorder, offset_count):
    ordered = [[] for _ in range(offset_count)]

    for list_idx in range(len(list_to_reorder)):
        ordered[list_idx % offset_count].append(list_to_reorder[list_idx])
        
    return ordered


def bool_inclusion(new_paths, old_paths):
    bool_list = [[] for _ in new_paths]
    for path_list_idx in range(len(new_paths)):
        for path in new_paths[path_list_idx]:
            if path in [str(i) for i in old_paths]:
                bool_list[path_list_idx].append(True)
            else:
                bool_list[path_list_idx].append(False)
    return bool_list


if len(S) > 0:
    D = [str(i) for i in S]
else:
    D = [str(i) for i in D]


list_of_path_list = path_to_list(D)
offseted_path_list = offset_paths(list_of_path_list, O)

one_list_paths = list_to_paths(offseted_path_list)
ordered_list_paths = reorder_path_list(one_list_paths, len(O))

bools = bool_inclusion(ordered_list_paths, D)

B = th.list_to_tree(bools)
P = th.list_to_tree(ordered_list_paths)
# ---------- end python ----------
item_6 = ListItem(List=tstat_6.Paths, Index=ordering_idx_2, Wrap=True)
python_2 = GhPythonScript(D=item_6, O=north_east_south_west)  # -> simplify(P), simplify(B); inputs D: list, S: list, O: list; same code as python
python_3 = GhPythonScript(D=item_6, O=python.P)  # -> simplify(P), simplify(B); inputs D: list, S: list, O: list; same code as python
not = GateNot(A=python_3.B)
and = GateAnd(A=python_2.B, B=not)  # -> simplify(Result)

# ---- group: get general direction of the edge
connexion_lines_bidirectional_2 = RemoteReceiver(connexion_lines_bidirectional)
devec = DeconstructVector(Vector=connexion_lines_bidirectional_2)  # -> XComponent, YComponent, ZComponent
devec_2 = DeconstructVector(Vector=connexion_lines_bidirectional_2)  # -> XComponent, YComponent, ZComponent
devec_3 = DeconstructVector(Vector=connexion_lines_bidirectional_2)  # -> XComponent, YComponent, ZComponent
abs = Absolute(Value=devec.XComponent)
abs_2 = Absolute(Value=devec_2.YComponent)
abs_3 = Absolute(Value=devec_3.ZComponent)
larger = LargerThan(FirstNumber=abs, SecondNumber="0")  # -> LargerThan, OrEqualTo
larger_2 = LargerThan(FirstNumber=abs_2, SecondNumber="0")  # -> LargerThan, OrEqualTo
larger_3 = LargerThan(FirstNumber=abs_3, SecondNumber="0")  # -> LargerThan, OrEqualTo
cull_2 = CullPattern(List=devec.XComponent, CullPattern=larger.LargerThan)
cull_3 = CullPattern(List=devec_2.YComponent, CullPattern=larger_2.LargerThan)
cull_4 = CullPattern(List=devec_3.ZComponent, CullPattern=larger_3.LargerThan)
clean_4 = CleanTree(RemoveNulls=True, RemoveInvalid=True, RemoveEmpty=invert(False), Tree=cull_2)  # -> simplify(Tree)
clean_5 = CleanTree(RemoveNulls=True, RemoveInvalid=True, RemoveEmpty=invert(False), Tree=cull_3)  # -> simplify(Tree)
clean_6 = CleanTree(RemoveNulls=True, RemoveInvalid=True, RemoveEmpty=invert(False), Tree=cull_4)  # -> simplify(Tree)

# ---- group: build tree branch attributes
reduced_centers_5 = RemoteReceiver(reduced_centers)
ordering_idx_3 = RemoteReceiver(ordering_idx)
tstat_7 = TreeStatistics(Tree=reduced_centers_5)  # -> Paths, Length, Count
item_7 = ListItem(List=tstat_7.Paths, Index=ordering_idx_3, Wrap=True)
dpath_4 = DeconstructPath(Branch=item_7)
flip_2 = FlipMatrix(Data=dpath_4)

# ----
connexion_lines_bidirectional_3 = RemoteReceiver(connexion_lines_bidirectional)
eval = EvaluateCurve(Curve=reparameterize(graft(connexion_lines_bidirectional_3)), Parameter=".5")  # -> Point, Tangent, Angle
devec_4 = DeconstructVector(Vector=eval.Tangent)  # -> XComponent, YComponent, simplify(ZComponent)
abs_4 = Absolute(Value=devec_4.ZComponent)
smaller_2 = SmallerThan(FirstNumber=abs_4, SecondNumber=".5")  # -> simplify(SmallerThan), OrEqualTo
larger_4 = LargerThan(FirstNumber=devec_4.ZComponent, SecondNumber="0")  # -> LargerThan, OrEqualTo
smaller_3 = SmallerThan(FirstNumber=devec_4.ZComponent, SecondNumber="0")  # -> SmallerThan, OrEqualTo
att_is_horizontal = RemoteSender(smaller_2.SmallerThan)
attr_goes_down = RemoteSender(smaller_3.SmallerThan)
attr_goes_up = RemoteSender(larger_4.LargerThan)

# ---- group: terasses?
branch_3 = TreeBranch(Tree=and, Path=Slider(1, range=0..3), MaintainPaths=True)
tag = TextTag(Location=reduced_centers_4, Text=graft(branch_3), Colour=ColourSwatch(SwatchColor=RGB(0, 0, 0)))

# ---- group: get general direction of the edge
long = LongestList(ListA=clean_4, ListB="East-West", PaddingMode=2)  # -> ListA, ListB
long_2 = LongestList(ListA=clean_5, ListB="North-South", PaddingMode=2)  # -> ListA, ListB
long_3 = LongestList(ListA=clean_6, ListB="Up-Down", PaddingMode=2)  # -> ListA, ListB
merge_6 = Merge(Data1=long.ListB, Data2=long_2.ListB, Data3=long_3.ListB)  # -> simplify(graft(Result))
attr_direction = RemoteSender(merge_6)

# ----
attr_window_count = RemoteReceiver()
attr_direction_2 = RemoteReceiver(attr_direction)
attr_goes_down_2 = RemoteReceiver(attr_goes_down)
attr_goes_up_2 = RemoteReceiver(attr_goes_up)
att_is_horizontal_2 = RemoteReceiver(att_is_horizontal)
edge_attr_labels = Panel("""goes_up
goes_down
is_horizontal""")
merge_7 = Merge(Data1=simplify(attr_goes_up_2), Data2=attr_goes_down_2, Data3=simplify(att_is_horizontal_2))  # -> simplify(Result)
edge_attributes_values = RemoteSender(merge_7)
edge_attribute_keys = RemoteSender(edge_attr_labels)

node_attr_labels = Panel("""has_window
window_count
has_terrace_North
has_terrace_East
has_terrace_South
has_terrace_West
branch_A
branch_B
branch_C""")
node_attribute_keys = RemoteSender(node_attr_labels)

circulation_indices_2 = RemoteReceiver(circulation_indices)
concat = Concatenate(FragmentA="http://127.0.0.1:5000/", FragmentB="graph_set_circulation")

hops = Hops(
    CacheResultsInMemory=False,
    CacheSolveResults=False,
    RemoteSolveVersion=(0, 1, 0),
    ShowInput_Enabled=False,
    ShowInput_Path=True,
    SynchronousSolve=True)
ratio = Slider(0.3, range=0..1)
ratio_2 = Slider(0.7, range=0..1)
max_targets = Slider(5, range=-1..25)
max_targets_2 = Slider(10, range=-1..25)
concat_2 = Concatenate(FragmentA="http://127.0.0.1:5000/", FragmentB="generation_settings")
concat_3 = Concatenate(FragmentA="http://127.0.0.1:5000/", FragmentB="ranking_settings")
rejson = SerializeJson(_4=ratio, _8=ratio_2, IncludeNullAndEmptyProperties=False)
hops_2 = Hops(
    _Path=concat_2,
    MaxTargets=max_targets,
    MaxPaths=max_targets_2,
    Fill=Toggle(True),
    FastCirculation=Toggle(True),
    CacheResultsInMemory=False,
    CacheSolveResults=False,
    RemoteDefinitionLocation="http://127.0.0.1:5000/generation_settings",
    RemoteSolveVersion=(0, 1, 0),
    ShowInput_Enabled=False,
    ShowInput_Path=True,
    SynchronousSolve=True)
python_4 = GhPythonScript()  # -> out, a
# ---------- python_4: Python ----------
__author__ = "Antoine"
__version__ = "2022.12.06"

def hello(message, message2):
    print("hello " + message + " " + message2)

def question(message):
    print("question " + message)

function_dict = {
    hello:["world", "!"],
    question:["answer"]
}

for key, values in function_dict.items():
    # print(key, "ah")
    # print(function_dict[key], "oh")
    
    key(*values)
# ---------- end python_4 ----------
hops_3 = Hops(
    _Path=concat_3,
    Compacity=Slider(0, range=0..1),
    Circulation=Slider(0.6, range=0..1),
    CacheResultsInMemory=False,
    CacheSolveResults=False,
    RemoteDefinitionLocation="http://127.0.0.1:5000/ranking_settings",
    RemoteSolveVersion=(0, 1, 0),
    ShowInput_Enabled=False,
    ShowInput_Path=True,
    SynchronousSolve=True)
panel = Panel(python_4.out)
concat_4 = Concatenate(FragmentA="http://127.0.0.1:5000/", FragmentB="generate_v3")
panel_2 = Panel(hops_2)
cells_ordered_2 = RemoteReceiver(cells_ordered)
centers_ordered_2 = RemoteReceiver(centers_ordered)
scale_2 = Scale(Geometry=cells_ordered_2, Center=graft(centers_ordered_2), Factor=".9")  # -> Geometry, Transform
desired_proportions = Panel(rejson)
edges_2 = BrepEdges(Brep=scale_2.Geometry)  # -> Naked, Interior, NonManifold

dejson = DeserializeJson(OutputsLocked=False)  # -> Directed, Multigraph, Graph, Nodes, Edges
dejsonkv = DeserializeKeysAndValues(Keys=Slider(4, range=0..9))  # -> Key, Value
dejson_2 = DeserializeJson(JSON=dejson.Edges, OutputsLocked=False)  # -> Goes_up, Goes_down, Is_horizontal, From, To

# ---- group: circulations
circulation_indices_3 = RemoteReceiver(circulation_indices)
cells_ordered_3 = RemoteReceiver(cells_ordered)
item_8 = ListItem(List=flatten(cells_ordered_3), Index=circulation_indices_3, Wrap=True)  # -> simplify(Item)
alpha = AdjustAlpha(Color=ColourSwatch(SwatchColor=RGB(0, 0, 0)), Alpha=Slider(0.6, range=0..1))
preview = CustomPreview(Geometry=item_8, Material=alpha)

# ----
munion_2 = MeshUnion(Meshes=item_8)  # -> graft(Result)
concat_5 = Concatenate(FragmentA="http://127.0.0.1:5000/", FragmentB="explode_graph")
clean_7 = CombineClean(Meshes=munion_2)
panel_3 = Panel("""branch_A
branch_B
branch_C""")
concat_6 = Concatenate(FragmentA="http://127.0.0.1:5000/", FragmentB="read_nodes_attr_value")

reduced_cells_5 = RemoteReceiver(reduced_cells)

# ---- group: I challenge you to find faster than me
debrep = DeconstructBrep(Brep=reduced_cells_5)  # -> reparameterize(Faces), Edges, Vertices

# ----
evalsrf = EvaluateSurface(Surface=debrep.Faces, Point="0.5,0.5,0")  # -> Point, Normal, UDirection, VDirection, Frame
avr_2 = Average(Input=debrep.Vertices)  # -> simplify(ArithmeticMean)
addition_3 = Addition(A=evalsrf.Point, B=evalsrf.Normal)
cp = ClosestPoint(Point=addition_3, Cloud=flatten(avr_2))  # -> ClosestPoint, CPIndex, simplify(Distance)
smaller_4 = SmallerThan(FirstNumber=simplify(cp.Distance), SecondNumber=suspicious_value_2)  # -> SmallerThan, OrEqualTo

dispatch = Dispatch(List=evalsrf.Frame, DispatchPattern=smaller_4.SmallerThan)  # -> graft(ListA), graft(ListB)
dispatch_2 = Dispatch(List=debrep.Faces, DispatchPattern=smaller_4.SmallerThan)  # -> graft(ListA), graft(ListB)

deplane = DeconstructPlane(Plane=dispatch.ListB)  # -> Origin, XAxis, YAxis, ZAxis
devec_5 = DeconstructVector(Vector=deplane.ZAxis)  # -> XComponent, YComponent, ZComponent
abs_5 = Absolute(Value=devec_5.ZComponent)
larger_5 = LargerThan(FirstNumber=abs_5, SecondNumber="0")  # -> LargerThan, OrEqualTo
larger_6 = LargerThan(FirstNumber=devec_5.ZComponent, SecondNumber="0")  # -> LargerThan, OrEqualTo
dispatch_3 = Dispatch(List=dispatch.ListB, DispatchPattern=larger_5.LargerThan)  # -> ListA, ListB
dispatch_4 = Dispatch(List=larger_6.LargerThan, DispatchPattern=larger_5.LargerThan)  # -> ListA, ListB
dispatch_5 = Dispatch(List=dispatch_3.ListA, DispatchPattern=dispatch_4.ListA)  # -> ListA, ListB

deplane_2 = DeconstructPlane(Plane=dispatch.ListA)  # -> Origin, XAxis, YAxis, ZAxis
devec_6 = DeconstructVector(Vector=deplane_2.ZAxis)  # -> XComponent, YComponent, ZComponent
abs_6 = Absolute(Value=devec_6.ZComponent)
larger_7 = LargerThan(FirstNumber=abs_6, SecondNumber="0")  # -> LargerThan, OrEqualTo
dispatch_6 = Dispatch(List=dispatch_2.ListA, DispatchPattern=larger_7.LargerThan)  # -> ListA, ListB

clean_8 = CleanTree(RemoveNulls=True, RemoveInvalid=True, RemoveEmpty=invert(False), Tree=simplify(dispatch_3.ListB))
tstat_8 = TreeStatistics(Tree=clean_8)  # -> Paths, Length, Count
split_4 = SplitTree(Data=simplify(dispatch_2.ListB), Masks=flatten(tstat_8.Paths))  # -> Positive, Negative
outside_walls = RemoteSender(split_4.Positive)

clean_9 = CleanTree(RemoveNulls=True, RemoveInvalid=True, RemoveEmpty=invert(False), Tree=simplify(dispatch_5.ListA))
tstat_9 = TreeStatistics(Tree=clean_9)  # -> Paths, Length, Count
split_5 = SplitTree(Data=simplify(dispatch_2.ListB), Masks=flatten(tstat_9.Paths))  # -> Positive, Negative

clean_10 = CleanTree(RemoveNulls=True, RemoveInvalid=True, RemoveEmpty=invert(False), Tree=simplify(dispatch_5.ListB))
tstat_10 = TreeStatistics(Tree=clean_10)  # -> Paths, Length, Count
split_6 = SplitTree(Data=simplify(dispatch_2.ListB), Masks=flatten(tstat_10.Paths))  # -> Positive, Negative

preview_2 = CustomPreview(Geometry=[split_4.Positive, split_5.Positive, split_6.Positive], Material=ColourSwatch(SwatchColor=RGBA(0, 0, 0, 33)))  # disabled

outside_walls_2 = RemoteReceiver(outside_walls)
pshift_2 = ShiftPaths(Data=outside_walls_2, Offset=-1)

preview_3 = CustomPreview(Geometry=split_4.Positive, Material=ColourSwatch(SwatchColor=RGBA(0, 255, 229, 150)))  # disabled
preview_4 = CustomPreview(Geometry=split_5.Positive, Material=ColourSwatch(SwatchColor=RGBA(255, 0, 119, 150)))  # disabled
preview_5 = CustomPreview(Geometry=split_6.Positive, Material=ColourSwatch(SwatchColor=RGBA(255, 183, 0, 150)))  # disabled
preview_6 = CustomPreview(Geometry=dispatch_6.ListA, Material=ColourSwatch(SwatchColor=RGBA(115, 255, 0, 150)))  # disabled

tstat_11 = TreeStatistics(Tree=pshift_2)  # -> Paths, Length, Count
branch_4 = TreeBranch(Tree=reduced_cells_4, Path=tstat_11.Paths, MaintainPaths=True)
preview_7 = CustomPreview(Geometry=dispatch_6.ListB, Material=ColourSwatch(SwatchColor=RGBA(255, 0, 0, 150)))  # disabled

reduced_cells_6 = RemoteReceiver(reduced_cells)
outside_walls_3 = RemoteReceiver(outside_walls)
pshift_3 = ShiftPaths(Data=outside_walls_3, Offset=-1)
tstat_12 = TreeStatistics(Tree=reduced_cells_6)  # -> Paths, Length, Count
tstat_13 = TreeStatistics(Tree=pshift_3)  # -> Paths, Length, Count
python_5 = GhPythonScript(x=tstat_12.Paths, y=tstat_13.Paths)  # -> a, b; inputs x: list, y: list
# ---------- python_5: Python ----------
__author__ = "Win"
__version__ = "2022.05.03"

# associate the right inputs
if len(x) < len(y):
    smaller = x
    larger = y
else:
    smaller = y
    larger = x

# create the empty lists
a = []
b = []

# append to each lists
for i in larger:
    if i in smaller:
        a.append(i)
    else:
        b.append(i)
# ---------- end python_5 ----------

ordering_idx_4 = RemoteReceiver(ordering_idx)
long_4 = LongestList(ListA=python_5.a, ListB="True", PaddingMode=2)  # -> ListA, ListB
long_5 = LongestList(ListA=python_5.b, ListB="False", PaddingMode=2)  # -> ListA, ListB
tree_2 = CreateTree(Data=long_4.ListB, Path=python_5.a)
tree_3 = CreateTree(Data=long_5.ListB, Path=python_5.b)
merge_8 = Merge(Data1=tree_2, Data2=tree_3)
item_9 = ListItem(List=flatten(merge_8), Index=ordering_idx_4, Wrap=True)  # -> graft(Item)

ordering_idx_5 = RemoteReceiver(ordering_idx)
int = Integer("0")
long_6 = LongestList(ListA=python_5.b, ListB=int, PaddingMode=2)  # -> ListA, ListB
tree_4 = CreateTree(Data=long_6.ListB, Path=python_5.b)
lng_4 = ListLength(List=pshift_3)
merge_9 = Merge(Data1=lng_4, Data2=tree_4)
item_10 = ListItem(List=flatten(merge_9), Index=ordering_idx_5, Wrap=True)  # -> graft(Item)

bang = ExplodeTree(Data=simplify(flip_2))  # -> graft(Branch0), graft(Branch1), graft(Branch2)
bang_2 = ExplodeTree(Data=and)  # -> graft(Branch0), graft(Branch1), graft(Branch2), graft(Branch3)
merge_10 = Merge(
    Data1=simplify(item_9),
    Data2=simplify(item_10),
    Data3=simplify(bang_2.Branch0),
    Data4=simplify(bang_2.Branch1),
    Data5=simplify(bang_2.Branch2),
    Data6=simplify(bang_2.Branch3),
    Data7=simplify(bang.Branch0),
    Data8=simplify(bang.Branch1),
    Data9=simplify(bang.Branch2))  # -> simplify(Result)
node_attribute_values = RemoteSender(merge_10)

node_attribute_values_2 = RemoteReceiver(node_attribute_values)
node_attribute_keys_2 = RemoteReceiver(node_attribute_keys)
node_points_5 = RemoteReceiver(node_points)
concat_7 = Concatenate(FragmentA="http://127.0.0.1:5000/", FragmentB="node_to_graph")
graft = GraftTree(Tree=node_points_5, IncludeEmptyLists=True, IncludeNullItems=True)  # -> simplify(Tree)
hops_4 = Hops(
    _Path=concat_7,
    NodeIndices=graft,
    Attributes=node_attribute_values_2,
    Labels=node_attribute_keys_2,
    CacheResultsInMemory=False,
    CacheSolveResults=False,
    RemoteDefinitionLocation="http://127.0.0.1:5000/node_to_graph",
    RemoteSolveVersion=(0, 1, 0),
    ShowInput_Enabled=False,
    ShowInput_Path=True,
    SynchronousSolve=True)

connexion_indexes_bidirectional_2 = RemoteReceiver(connexion_indexes_bidirectional)
edge_attributes_values_2 = RemoteReceiver(edge_attributes_values)
edge_attribute_keys_2 = RemoteReceiver(edge_attribute_keys)
concat_8 = Concatenate(FragmentA="http://127.0.0.1:5000/", FragmentB="add_edge_graph")
hops_5 = Hops(
    _Path=concat_8,
    Graph=hops_4,
    NodeIndexes=connexion_indexes_bidirectional_2,
    Attributes=edge_attributes_values_2,
    Labels=edge_attribute_keys_2,
    CacheResultsInMemory=False,
    CacheSolveResults=False,
    RemoteDefinitionLocation="http://127.0.0.1:5000/add_edge_graph",
    RemoteSolveVersion=(0, 1, 0),
    ShowInput_Enabled=False,
    ShowInput_Path=True,
    SynchronousSolve=True)

hops_6 = Hops(
    _Path=concat,
    Graph=hops_5,
    Indices=circulation_indices_2,
    CacheResultsInMemory=False,
    CacheSolveResults=False,
    RemoteDefinitionLocation="http://127.0.0.1:5000/graph_set_circulation",
    RemoteSolveVersion=(0, 1, 0),
    ShowInput_Enabled=False,
    ShowInput_Path=True,
    SynchronousSolve=True)

concat_9 = Concatenate(FragmentA="http://127.0.0.1:5000/", FragmentB="read_nodes_attr_value")
hops_7 = Hops(
    _Path=concat_9,
    Graph=hops_6,
    Attributes="CIRCULATION_DISTANCE",
    Index=-1,
    CacheResultsInMemory=False,
    CacheSolveResults=False,
    RemoteDefinitionLocation="http://127.0.0.1:5000/read_nodes_attr_value",
    RemoteSolveVersion=(0, 1, 0),
    ShowInput_Enabled=False,
    ShowInput_Path=True,
    SynchronousSolve=True)  # -> Values, ListPartitioner
partition_2 = PartitionList(List=hops_7.Values, Size=hops_7.ListPartitioner)

panel_4 = Panel("""0
1""")
panel_5 = Panel("""0
2""")
entwine = Entwine(Branch00=panel_4, Branch01=panel_5, FlattenInputs=True)  # -> simplify(Result)
concat_10 = Concatenate(FragmentA="http://127.0.0.1:5000/", FragmentB="read_edges_attr_values")
hops_8 = Hops(
    _Path=concat_10,
    Graph=hops_6,
    Attributes="is_horizontal",
    Edges=-1,
    CacheResultsInMemory=False,
    CacheSolveResults=False,
    RemoteDefinitionLocation="http://127.0.0.1:5000/read_edges_attr_values",
    RemoteSolveVersion=(0, 1, 0),
    ShowInput_Enabled=False,
    ShowInput_Path=True,
    SynchronousSolve=True)  # -> Values, ListPartitioner
partition_3 = PartitionList(List=hops_8.Values, Size=hops_8.ListPartitioner)
flip_3 = FlipMatrix(Data=partition_3)
panel_6 = Panel(flip_3)

panel_7 = Panel("""goes_down
goes_up""")
panel_8 = Panel("""True
True""")
concat_11 = Concatenate(FragmentA="http://127.0.0.1:5000/", FragmentB="remove_edges")
hops_9 = Hops(
    _Path=concat_11,
    Graph=hops_6,
    EdgeAttribute=panel_7,
    EdgeValue=panel_8,
    CacheResultsInMemory=False,
    CacheSolveResults=False,
    RemoteDefinitionLocation="http://127.0.0.1:5000/remove_edges",
    RemoteSolveVersion=(0, 1, 0),
    ShowInput_Enabled=False,
    ShowInput_Path=True,
    SynchronousSolve=True)

bnd_2 = Bounds(Numbers=partition_2)
dedomain = DeconstructDomain(Domain=bnd_2)  # -> Start, End
gradient = Gradient(
    LowerLimit=dedomain.Start,
    UpperLimit=dedomain.End,
    Parameter=partition_2,
    stops=[0: RGB(234, 38, 0), 0.25: RGB(234, 126, 0), 0.5: RGB(254, 244, 84), 0.75: RGB(173, 203, 249), 1: RGB(75, 107, 169)])
hops_10 = Hops(
    _Path=concat_4,
    Graph=hops_6,
    ApartmentProportions=rejson,
    GenerationSettings=hops_2,
    RankingSettings=hops_3,
    FloorCount=Slider(3, range=1..3),
    Iterations=Slider(1, range=1..10),
    CacheResultsInMemory=False,
    CacheSolveResults=False,
    RemoteDefinitionLocation="http://127.0.0.1:5000/generate_v3",
    RemoteSolveVersion=(0, 1, 0),
    ShowInput_Enabled=False,
    ShowInput_Path=True,
    SynchronousSolve=True)  # -> NewGraph, AllRankings, ApartIndexes, ListPartitioner, Proportions
cset = CreateSet(List=hops_10.ListPartitioner)  # -> Set, Map
partition_4 = PartitionList(List=hops_10.ApartIndexes, Size=hops_10.ListPartitioner)
lng_5 = ListLength(List=hops_10.ListPartitioner)
mindex_3 = MemberIndex(Set=hops_10.ListPartitioner, Member=cset.Set)  # -> Index, Count
alpha_2 = AdjustAlpha(Color=gradient, Alpha=Slider(0.55, range=0..1))
lng_6 = ListLength(List=mindex_3.Index)
division_3 = Division(A=lng_6, B=lng_5)
panel_9 = Panel(division_3)
preview_8 = CustomPreview(Geometry=cells_ordered_2, Material=graft(alpha_2))
previewlw_5 = CustomPreviewLineweights(Geometry=edges_2.Interior, Shader=graft(alpha_2), Thickness=Slider(3, range=0..10), Absolute=False)
hops_11 = Hops(
    _Path=concat_5,
    Graph=hops_9,
    CacheResultsInMemory=False,
    CacheSolveResults=False,
    RemoteDefinitionLocation="http://127.0.0.1:5000/explode_graph",
    RemoteSolveVersion=(0, 1, 0),
    ShowInput_Enabled=False,
    ShowInput_Path=True,
    SynchronousSolve=True)  # -> Nodes, Edges, ListPartitioner
partition_5 = PartitionList(List=hops_11.Edges, Size=hops_11.ListPartitioner)
panel_10 = Panel(hops_11.Nodes)
hops_12 = Hops(
    _Path=concat_6,
    Graph=hops_10.NewGraph,
    Attributes=panel_3,
    Index=hops_10.ApartIndexes,
    CacheResultsInMemory=False,
    CacheSolveResults=False,
    RemoteDefinitionLocation="http://127.0.0.1:5000/read_nodes_attr_value",
    RemoteSolveVersion=(0, 1, 0),
    ShowInput_Enabled=False,
    ShowInput_Path=True,
    SynchronousSolve=True)  # -> Values, ListPartitioner
panel_11 = Panel(partition_5)
partition_6 = PartitionList(List=hops_12.Values, Size=hops_12.ListPartitioner)
flip_4 = FlipMatrix(Data=partition_6)
path_3 = ConstructPath(Indices=flip_4)  # -> flatten(Branch)

cells_ordered_4 = RemoteReceiver(cells_ordered)
item_11 = ListItem(List=flatten(cells_ordered_4), Index=partition_4, Wrap=True)  # -> simplify(Item)

mesh = Mesh(item_11)

munion_3 = MeshUnion(Meshes=mesh)
clean_11 = CombineClean(Meshes=munion_3)

entwine_2 = Entwine(Branch00=clean_7, Branch01=clean_11, FlattenInputs=True)  # -> flatten(Result)

# ---- group: visualise different rankings
dejsonkv_2 = DeserializeKeysAndValues(JSON=hops_10.AllRankings)  # -> Key, Value
list = ItemSelector(
    dejsonkv_2.Key,
    {"circulation_rankings", "compacity_rankings", "window_rankings_before", "window_rankings_after", "floors_rankings"}, selected="compacity_rankings")
dejsonkv_3 = DeserializeKeysAndValues(JSON=hops_10.AllRankings, Keys=list)  # -> Key, Value
dejson_3 = DeserializeJson(JSON=dejsonkv_3.Value, OutputsLocked=False)
bnd_3 = Bounds(Numbers=dejson_3)
dedomain_2 = DeconstructDomain(Domain=bnd_3)  # -> Start, End
gradient_2 = Gradient(
    LowerLimit=dedomain_2.Start,
    UpperLimit=dedomain_2.End,
    Parameter=dejson_3,
    stops=[0: RGB(234, 38, 0), 0.25: RGB(234, 126, 0), 0.5: RGB(254, 244, 84), 0.75: RGB(173, 203, 249), 1: RGB(75, 107, 169)])
alpha_3 = AdjustAlpha(Color=gradient_2, Alpha=Slider(0.4, range=0..1))
preview_9 = CustomPreview(Geometry=mesh, Material=graft(alpha_3))

# ----
graft_2 = GraftTree(Tree=entwine_2, IncludeEmptyLists=True, IncludeNullItems=True)  # -> simplify(Tree)

tstat_14 = TreeStatistics(Tree=mesh)  # -> Paths, Length, Count
subtraction = Subtraction(A=tstat_14.Count, B="1")
range_3 = Range(Domain=Domain(0, 1), Steps=subtraction)
gradient_3 = Gradient(
    LowerLimit="0",
    UpperLimit="1",
    Parameter=range_3,
    stops=[0: RGB(243, 57, 0), 0.118: RGB(236, 27, 60), 0.234: RGB(210, 0, 118), 0.336: RGB(103, 0, 120), 0.452: RGB(39, 72, 161), 0.559: RGB(1, 192, 229), 0.67: RGB(18, 178, 90), 0.775: RGB(79, 186, 8), 0.889: RGB(220, 237, 32), 1: RGB(247, 159, 20)])
alpha_4 = AdjustAlpha(Color=gradient_3, Alpha=Slider(0.4, range=0..1))

merge_11 = Merge(Data1=item_8, Data2=mesh)

facen = FaceNormals(Mesh=graft_2)  # -> Centers, Normals
addition_4 = Addition(A=facen.Centers, B=facen.Normals)  # -> graft(Result)
mesh_2 = Mesh(merge_11)
minc = MeshInclusion(Mesh=flatten(mesh_2), Point=addition_4, Strict=False)
ma_2 = MassAddition(Input=minc)  # -> Result, PartialResults
bool = Boolean(ma_2.Result)

tree_5 = CreateTree(Data=flatten(mesh), Path=path_3)

merge_12 = Merge(Data1=Slider(2, range=0..3), Data2=Slider(3, range=0..4), Data3=Slider(3, range=0..9))
path_4 = ConstructPath(Indices=merge_12)
branch_5 = TreeBranch(Tree=tree_5, Path=path_4, MaintainPaths=True)

mshedge_2 = MeshEdgesWithTolerance(Mesh=graft_2, AngleThreshold=45)  # -> InteriorEdges, NakedEdges
previewlw_6 = CustomPreviewLineweights(
    Geometry=mshedge_2.InteriorEdges,
    Shader=ColourSwatch(SwatchColor=RGB(0, 0, 0)),
    Thickness=Slider(10, range=0..10),
    Absolute=False)

tstat_15 = TreeStatistics(Tree=tree_5)  # -> Paths, Length, Count
panel_12 = Panel(tstat_15.Paths)

# ---- group: separate meshes between outside and meshes between aparts
demesh = DeconstructMesh(Mesh=graft_2)  # -> Vertices, Faces, Colours, Normals
unflatten_3 = UnflattenTree(Tree=bool, Guide=demesh.Faces)
cullf = CullFaces(Mesh=graft_2, Pattern=invert(unflatten_3))
cullf_2 = CullFaces(Mesh=graft_2, Pattern=unflatten_3)

# ----
preview_10 = CustomPreview(Geometry=mesh, Material=graft(alpha_4))

clean_12 = CombineClean(Meshes=flatten(cullf))
disjoint = DisjointMesh(Mesh=flatten(clean_12))  # -> graft(Meshes)
demesh_2 = DeconstructMesh(Mesh=disjoint)  # -> Vertices, Faces, Colours, Normals
facen_2 = FaceNormals(Mesh=disjoint)  # -> Centers, Normals
devec_7 = DeconstructVector(Vector=facen_2.Normals)  # -> XComponent, YComponent, ZComponent
abs_7 = Absolute(Value=devec_7.ZComponent)
unweave = Unweave(List=demesh_2.Faces, UnweavePattern=abs_7)  # -> Data0, Data1
clean_13 = CleanTree(RemoveNulls=True, RemoveInvalid=True, RemoveEmpty=False, Tree=unweave.Data0)
clean_14 = CleanTree(RemoveNulls=True, RemoveInvalid=True, RemoveEmpty=False, Tree=unweave.Data1)
swatch = ColourSwatch(SwatchColor=RGB(255, 0, 0))
swatch_2 = ColourSwatch(SwatchColor=RGB(47, 0, 255))
conmesh = ConstructMesh(Vertices=simplify(demesh_2.Vertices), Faces=simplify(clean_13), Colours=swatch_2)
conmesh_2 = ConstructMesh(Vertices=simplify(demesh_2.Vertices), Faces=simplify(clean_14), Colours=swatch)
disjoint_2 = DisjointMesh(Mesh=conmesh)
disjoint_3 = DisjointMesh(Mesh=conmesh_2)

demesh_3 = DeconstructMesh(Mesh=cullf_2)  # -> Vertices, Faces, Colours, Normals
facen_3 = FaceNormals(Mesh=cullf_2)  # -> Centers, Normals
devec_8 = DeconstructVector(Vector=facen_3.Normals)  # -> XComponent, YComponent, ZComponent
addition_5 = Addition(A=devec_8.ZComponent, B="1")
unweave_2 = Unweave(List=demesh_3.Faces, UnweavePattern=addition_5)  # -> Data0, Data1, Data2
clean_15 = CleanTree(RemoveNulls=True, RemoveInvalid=True, RemoveEmpty=False, Tree=unweave_2.Data0)
clean_16 = CleanTree(RemoveNulls=True, RemoveInvalid=True, RemoveEmpty=False, Tree=unweave_2.Data1)
clean_17 = CleanTree(RemoveNulls=True, RemoveInvalid=True, RemoveEmpty=False, Tree=unweave_2.Data2)

# ---- group: me too
conmesh_3 = ConstructMesh(Vertices=simplify(demesh_3.Vertices), Faces=simplify(clean_16), Colours=ColourSwatch(SwatchColor=RGB(176, 206, 255)))

# ----
merge_13 = Merge(Data1=facen_3.Centers, Data2=facen_2.Centers)  # -> flatten(Result)
facen_4 = FaceNormals(Mesh=mesh)  # -> Centers, Normals
demesh_4 = DeconstructMesh(Mesh=mesh)  # -> Vertices, Faces, Colours, Normals
mindex_4 = MemberIndex(Set=facen_4.Centers, Member=merge_13)  # -> Index, Count
trim = TrimTree(Tree=mindex_4.Index, Depth=1)
cull_i = CullIndex(List=demesh_4.Faces, Indices=trim, Wrap=True)
conmesh_4 = ConstructMesh(Vertices=demesh_4.Vertices, Faces=cull_i)  # -> simplify(Mesh)
trim_2 = TrimTree(Tree=conmesh_4, Depth=1)

# ---- group: I might be grumpy, but I should be fine
conmesh_5 = ConstructMesh(Vertices=simplify(demesh_3.Vertices), Faces=simplify(clean_15))
conmesh_6 = ConstructMesh(Vertices=simplify(demesh_3.Vertices), Faces=simplify(clean_17))

# ----
lng_7 = ListLength(List=flatten(clean_7))
series_3 = Series(Start=0, Step=1, Count=lng_7)
path_5 = ConstructPath(Indices=graft(series_3))  # -> flatten(Branch)
split_7 = SplitTree(Data=conmesh_3, Masks=flatten(path_5))  # -> Positive, Negative

facen_5 = FaceNormals(Mesh=graft_2)  # -> flatten(Centers), Normals
clean_18 = CombineClean(Meshes=flatten(conmesh_5))
pdecon = Deconstruct(Point=facen_5.Centers)  # -> XComponent, YComponent, ZComponent
facen_6 = FaceNormals(Mesh=clean_18)  # -> flatten(Centers), Normals
cset_2 = CreateSet(List=pdecon.ZComponent)  # -> Set, Map
demesh_5 = DeconstructMesh(Mesh=clean_18)  # -> Vertices, Faces, Colours, Normals
sort = SortList(Keys=cset_2.Map)  # -> Keys, ValuesA
pdecon_2 = Deconstruct(Point=facen_6.Centers)  # -> XComponent, YComponent, ZComponent
item_12 = ListItem(List=sort.Keys, Index=0, Wrap=True)
mindex_5 = MemberIndex(Set=pdecon_2.ZComponent, Member=item_12)  # -> Index, Count
cull_i_2 = CullIndex(List=demesh_5.Faces, Indices=mindex_5.Index, Wrap=True)
item_13 = ListItem(List=demesh_5.Faces, Index=mindex_5.Index, Wrap=True)
conmesh_7 = ConstructMesh(Vertices=demesh_5.Vertices, Faces=item_13, Colours=ColourSwatch(SwatchColor=RGB(82, 82, 82)))
conmesh_8 = ConstructMesh(Vertices=demesh_5.Vertices, Faces=cull_i_2, Colours=ColourSwatch(SwatchColor=RGB(153, 153, 153)))

clean_19 = CombineClean(Meshes=flatten(clean_7))
clean_20 = CombineClean(Meshes=flatten(disjoint_3))
demesh_6 = DeconstructMesh(Mesh=clean_19)  # -> Vertices, Faces, Colours, Normals
facen_7 = FaceNormals(Mesh=clean_19)  # -> Centers, Normals
facen_8 = FaceNormals(Mesh=clean_20)  # -> Centers, Normals
mindex_6 = MemberIndex(Set=facen_7.Centers, Member=facen_8.Centers)  # -> Index, Count
item_14 = ListItem(List=demesh_6.Faces, Index=flatten(mindex_6.Index), Wrap=True)
item_15 = ListItem(List=facen_7.Normals, Index=flatten(mindex_6.Index), Wrap=True)
devec_9 = DeconstructVector(Vector=item_15)  # -> XComponent, YComponent, ZComponent
larger_8 = LargerThan(FirstNumber=devec_9.ZComponent, SecondNumber="0")  # -> LargerThan, OrEqualTo
dispatch_7 = Dispatch(List=item_14, DispatchPattern=larger_8.LargerThan)  # -> ListA, ListB

clean_21 = CombineClean(Meshes=flatten(disjoint_2))
clean_22 = CombineClean(Meshes=flatten(clean_7))
facen_9 = FaceNormals(Mesh=clean_21)  # -> Centers, Normals
facen_10 = FaceNormals(Mesh=clean_22)  # -> Centers, Normals
demesh_7 = DeconstructMesh(Mesh=clean_21)  # -> Vertices, Faces, Colours, Normals
mindex_7 = MemberIndex(Set=facen_9.Centers, Member=facen_10.Centers)  # -> Index, Count
cull_i_3 = CullIndex(List=demesh_7.Faces, Indices=flatten(mindex_7.Index), Wrap=True)
item_16 = ListItem(List=demesh_7.Faces, Index=flatten(mindex_7.Index), Wrap=True)

clean_23 = CombineClean(Meshes=flatten(conmesh_6))
clean_24 = CombineClean(Meshes=flatten(clean_7))
facen_11 = FaceNormals(Mesh=clean_23)  # -> Centers, Normals
facen_12 = FaceNormals(Mesh=clean_24)  # -> Centers, Normals
demesh_8 = DeconstructMesh(Mesh=clean_23)  # -> Vertices, Faces, Colours, Normals
mindex_8 = MemberIndex(Set=facen_11.Centers, Member=facen_12.Centers)  # -> Index, Count
cull_i_4 = CullIndex(List=demesh_8.Faces, Indices=flatten(mindex_8.Index), Wrap=True)
item_17 = ListItem(List=demesh_8.Faces, Index=flatten(mindex_8.Index), Wrap=True)
swatch_3 = ColourSwatch(SwatchColor=RGB(143, 219, 0))

mcol = MeshColours(Mesh=split_7.Positive, Colours=ColourSwatch(SwatchColor=RGB(102, 120, 148)))
mesh_3 = Mesh(split_7.Negative)

clean_25 = CombineClean(Meshes=flatten(conmesh_6))
disjoint_4 = DisjointMesh(Mesh=clean_25)  # -> graft(Meshes)
medges = MeshEdges(Mesh=disjoint_4)  # -> NakedEdges, InteriorEdges, NonManifoldEdges
number_slider_4 = Slider(0.5, range=0.1..0.8)
join = JoinCurves(Curves=medges.NakedEdges, Preserve=False)
neg = Negative(Value=number_slider_4)
merge_14 = Merge(Data1=neg, Data2=number_slider_4)
offset = OffsetCurve(Curve=join, Distance=merge_14, Corners=1)  # -> simplify(Curve)
trim_3 = TrimTree(Tree=offset, Depth=1)
len = Length(Curve=trim_3)
sort_2 = SortList(Keys=len, ValuesA=trim_3)  # -> Keys, ValuesA
simplify = SimplifyCurve(Curve=join)  # -> Curve, Simplified
item_18 = ListItem(List=sort_2.ValuesA, Index=0, Wrap=True)
explode = Explode(Curve=simplify.Curve, Recursive=True)  # -> Segments, Vertices
explode_2 = Explode(Curve=item_18, Recursive=True)  # -> Segments, Vertices
rulesrf = RuledSurface(CurveA=explode.Segments, CurveB=explode_2.Segments)
Z_2 = UnitZ(Factor=Slider(0.5, range=0.1..1))
extr = Extrude(Base=rulesrf, Direction=Z_2)
preview_11 = CustomPreview(Geometry=extr, Material=swatch_3)

# ---- group: remove faces from inside_common_slabs_TEMP
demesh_9 = DeconstructMesh(Mesh=clean_20)  # -> Vertices, Faces, Colours, Normals
mindex_9 = MemberIndex(Set=facen_8.Centers, Member=facen_7.Centers)  # -> Index, Count
cull_i_5 = CullIndex(List=demesh_9.Faces, Indices=flatten(mindex_9.Index), Wrap=True)

# ---- group: I might be grumpy, but I should be fine
conmesh_9 = ConstructMesh(Vertices=demesh_6.Vertices, Faces=dispatch_7.ListA, Colours=ColourSwatch(SwatchColor=RGB(250, 117, 255)))
conmesh_10 = ConstructMesh(Vertices=demesh_6.Vertices, Faces=dispatch_7.ListB, Colours=ColourSwatch(SwatchColor=RGB(180, 0, 186)))
conmesh_11 = ConstructMesh(Vertices=demesh_9.Vertices, Faces=cull_i_5, Colours=swatch)

conmesh_12 = ConstructMesh(Vertices=demesh_7.Vertices, Faces=item_16, Colours=ColourSwatch(SwatchColor=RGB(255, 144, 0)))
conmesh_13 = ConstructMesh(Vertices=demesh_7.Vertices, Faces=cull_i_3, Colours=swatch_2)

conmesh_14 = ConstructMesh(Vertices=demesh_8.Vertices, Faces=item_17, Colours=ColourSwatch(SwatchColor=RGB(78, 120, 0)))
conmesh_15 = ConstructMesh(Vertices=demesh_8.Vertices, Faces=cull_i_4, Colours=swatch_3)

# ----
clean_26 = CombineClean(Meshes=flatten(conmesh_7))
clean_27 = CombineClean(Meshes=flatten(clean_7))
facen_13 = FaceNormals(Mesh=clean_26)  # -> Centers, Normals
facen_14 = FaceNormals(Mesh=clean_27)  # -> Centers, Normals
demesh_10 = DeconstructMesh(Mesh=clean_26)  # -> Vertices, Faces, Colours, Normals
mindex_10 = MemberIndex(Set=facen_13.Centers, Member=facen_14.Centers)  # -> Index, Count
item_19 = ListItem(List=demesh_10.Faces, Index=flatten(mindex_10.Index), Wrap=True)
cull_i_6 = CullIndex(List=demesh_10.Faces, Indices=flatten(mindex_10.Index), Wrap=True)

clean_28 = CombineClean(Meshes=flatten(conmesh_8))
clean_29 = CombineClean(Meshes=flatten(clean_7))
facen_15 = FaceNormals(Mesh=clean_28)  # -> Centers, Normals
facen_16 = FaceNormals(Mesh=clean_29)  # -> Centers, Normals
demesh_11 = DeconstructMesh(Mesh=clean_28)  # -> Vertices, Faces, Colours, Normals
mindex_11 = MemberIndex(Set=facen_15.Centers, Member=facen_16.Centers)  # -> Index, Count
item_20 = ListItem(List=demesh_11.Faces, Index=flatten(mindex_11.Index), Wrap=True)
cull_i_7 = CullIndex(List=demesh_11.Faces, Indices=flatten(mindex_11.Index), Wrap=True)

# ---- group: I might be grumpy, but I should be fine
conmesh_16 = ConstructMesh(Vertices=demesh_10.Vertices, Faces=item_19, Colours=ColourSwatch(SwatchColor=RGB(0, 0, 0)))
conmesh_17 = ConstructMesh(Vertices=demesh_10.Vertices, Faces=cull_i_6, Colours=ColourSwatch(SwatchColor=RGB(76, 76, 76)))

conmesh_18 = ConstructMesh(Vertices=demesh_11.Vertices, Faces=item_20, Colours=ColourSwatch(SwatchColor=RGB(150, 150, 150)))
conmesh_19 = ConstructMesh(Vertices=demesh_11.Vertices, Faces=cull_i_7, Colours=ColourSwatch(SwatchColor=RGB(222, 222, 222)))

# ---- group: CUBE SEQUENCE !
panel_13 = Panel("cubes_sequence")  # disabled
panel_14 = Panel("all")  # disabled
swatch_4 = ColourSwatch(SwatchColor=RGB(0, 0, 0))  # disabled
swatch_5 = ColourSwatch(SwatchColor=RGB(0, 0, 0))  # disabled

# ----
dpipeline_2 = DynamicGeometryPipeline(
    LayerFilter=panel_13,
    TypeFilter=panel_14,
    NameFilter="*",
    GroupByLayer=False,
    GroupByType=False,
    IncludeHidden=True,
    IncludeLocked=True,
    enableFullPath=False,
    listenToAttributes=True)  # disabled

# ---- group: CUBE SEQUENCE ! (continued)
volume = Volume(Geometry=dpipeline_2, UseTasks=True)  # -> Volume, Centroid; disabled
sort_pt = SortPoints(Points=volume.Centroid)  # -> Points, Indices; disabled
pdecon_3 = Deconstruct(Point=sort_pt.Points)  # -> XComponent, YComponent, ZComponent; disabled
entwine_3 = Entwine(Branch00=pdecon_3.XComponent, Branch01=pdecon_3.YComponent, Branch02=pdecon_3.ZComponent, FlattenInputs=True)  # disabled
cset_3 = CreateSet(List=entwine_3)  # -> Set, Map; disabled
sort_3 = SortList(Keys=cset_3.Set)  # -> Keys, ValuesA; disabled
lng_8 = ListLength(List=cset_3.Set)  # disabled
bang_3 = ExplodeTree(Data=sort_3.Keys)  # -> Branch0, Branch1, Branch2; disabled
series_4 = Series(Start=0, Step=1, Count=lng_8)  # -> simplify(Series); disabled
crossref_2 = CrossReference(ListA=bang_3.Branch0, ListB=bang_3.Branch1, ListC=bang_3.Branch2, CrossMode=1)  # -> ListA, ListB, ListC; disabled
pdecon_4 = Deconstruct(Point=sort_pt.Points)  # -> XComponent, YComponent, ZComponent; disabled
pt_2 = ConstructPoint(XCoordinate=pdecon_4.XComponent, YCoordinate=pdecon_4.YComponent, ZCoordinate=pdecon_4.ZComponent)  # disabled
bnd_4 = Bounds(Numbers=series_4)  # disabled
entwine_4 = Entwine(Branch00=crossref_2.ListA, Branch01=crossref_2.ListB, Branch02=crossref_2.ListC, FlattenInputs=True)  # disabled
pt_3 = ConstructPoint(XCoordinate=crossref_2.ListA, YCoordinate=crossref_2.ListB, ZCoordinate=crossref_2.ListC)  # disabled
bnd_5 = Bounds(Numbers=sort_3.Keys)  # disabled
remap_2 = RemapNumbers(Value=entwine_4, Source=bnd_5, Target=bnd_4)  # -> Mapped, Clipped; disabled
mindex_12 = MemberIndex(Set=pt_3, Member=pt_2)  # -> Index, Count; disabled
flip_5 = FlipMatrix(Data=remap_2.Mapped)  # disabled
path_6 = ConstructPath(Indices=flip_5)  # -> flatten(Branch); disabled
item_21 = ListItem(List=path_6, Index=mindex_12.Index, Wrap=True)  # -> flatten(Item); disabled
tree_6 = CreateTree(Data=pt_2, Path=item_21)  # disabled
tag_2 = TextTag(Location=pt_3, Text=path_6, Colour=swatch_4)  # disabled
tag_3 = TextTag(Location=pt_2, Text=item_21, Colour=swatch_5)  # disabled

number_slider_5 = Slider(0, range=0..4)  # disabled
number_slider_6 = Slider(2, range=0..4)  # disabled
number_slider_7 = Slider(1, range=0..4)  # disabled
panel_15 = Panel("{{{0};{1};{2}}}")  # disabled
format = Format(Format=panel_15, Culture=127, Data0=number_slider_5, Data1=number_slider_6, Data2=number_slider_7)  # disabled
branch_6 = TreeBranch(Tree=tree_6, Path=format, MaintainPaths=True)  # disabled
sph = Sphere(Base=branch_6, Radius=1)  # disabled
preview_12 = CustomPreview(
    Geometry=sph,
    Material={diffuse=RGB(221, 160, 221), emission=RGB(66, 48, 66), shine=0.5, specular=RGB(255, 255, 255), transparency=0})  # disabled

panel_16 = Panel("{1;0;0}")  # disabled
panel_17 = Panel("{0;1;0}")  # disabled
panel_18 = Panel("{0;0;1}")  # disabled
relitem_8 = RelativeItem(Tree=tree_6, Offset=panel_16, WrapPaths=False, WrapItems=False)  # -> ItemA, ItemB; disabled
relitem_9 = RelativeItem(Tree=tree_6, Offset=panel_17, WrapPaths=False, WrapItems=False)  # -> ItemA, ItemB; disabled
relitem_10 = RelativeItem(Tree=tree_6, Offset=panel_18, WrapPaths=False, WrapItems=False)  # -> ItemA, ItemB; disabled
ln_7 = Line(StartPoint=relitem_9.ItemA, EndPoint=relitem_9.ItemB)  # disabled
ln_8 = Line(StartPoint=relitem_8.ItemA, EndPoint=relitem_8.ItemB)  # disabled
ln_9 = Line(StartPoint=relitem_10.ItemA, EndPoint=relitem_10.ItemB)  # disabled

merge_15 = Merge(Data1=ln_8, Data2=ln_7, Data3=ln_9)  # -> flatten(Result); disabled
lng_9 = ListLength(List=merge_15)  # disabled
panel_19 = Panel(lng_9)  # disabled

swatch_6 = ColourSwatch(SwatchColor=RGB(8, 255, 0))  # disabled
number_slider_8 = Slider(12, range=0..40)  # disabled
swatch_7 = ColourSwatch(SwatchColor=RGB(255, 0, 0))  # disabled
swatch_8 = ColourSwatch(SwatchColor=RGB(8, 0, 255))  # disabled
previewlw_7 = CustomPreviewLineweights(Geometry=ln_8, Shader=swatch_7, Thickness=number_slider_8, Absolute=False)  # disabled
previewlw_8 = CustomPreviewLineweights(Geometry=ln_7, Shader=swatch_6, Thickness=number_slider_8, Absolute=False)  # disabled
previewlw_9 = CustomPreviewLineweights(Geometry=ln_9, Shader=swatch_8, Thickness=number_slider_8, Absolute=False)  # disabled

# ----
clean_30 = CombineClean(Meshes=flatten(trim_2))
disjoint_5 = DisjointMesh(Mesh=flatten(clean_30))  # -> graft(Meshes)
demesh_12 = DeconstructMesh(Mesh=disjoint_5)  # -> Vertices, Faces, Colours, Normals
facen_17 = FaceNormals(Mesh=disjoint_5)  # -> Centers, Normals
devec_10 = DeconstructVector(Vector=facen_17.Normals)  # -> XComponent, YComponent, ZComponent
abs_8 = Absolute(Value=devec_10.ZComponent)
unweave_3 = Unweave(List=demesh_12.Faces, UnweavePattern=abs_8)  # -> Data0, Data1
number_slider_9 = Slider(0.16, range=0..1)
alpha_5 = AdjustAlpha(Color=swatch_2, Alpha=number_slider_9)
alpha_6 = AdjustAlpha(Color=swatch, Alpha=number_slider_9)

# ---- group: I might be grumpy, but I should be fine
conmesh_20 = ConstructMesh(Vertices=simplify(demesh_12.Vertices), Faces=simplify(unweave_3.Data0), Colours=alpha_5)
conmesh_21 = ConstructMesh(Vertices=simplify(demesh_12.Vertices), Faces=simplify(unweave_3.Data1), Colours=alpha_6)

# ----
clean_31 = CleanTree(RemoveNulls=True, RemoveInvalid=True, RemoveEmpty=invert(False), Tree=conmesh_21)
