# Grasshopper definition Gh_to_network.gh (Grasshopper 1.0.7)
# plug-ins: Heteroptera, Hops, Human, Tundra, Wombat, eleFront

standard_height = Slider(3, range=2..4)
floor_count = Slider(4, range=0..10)
first_height = Slider(4, range=3..5)
series = Series(Start=standard_height, Step=standard_height, Count=floor_count)
ins = InsertItems(List=series, Item="0", Indices="0", Wrap=True)

yx_grid = Slider(3, range=2..4)
number_slider = Slider(7, range=0..10)
number_slider_2 = Slider(7, range=0..10)
multiplication = Multiplication(A=number_slider_2, B=yx_grid)
multiplication_2 = Multiplication(A=yx_grid, B=number_slider)
range = Range(Domain=multiplication, Steps=number_slider_2)
range_2 = Range(Domain=multiplication_2, Steps=number_slider)

crossref = CrossReference(ListA=range, ListB=range_2, ListC=ins, CrossMode=1)  # -> ListA, ListB, ListC
lng = ListLength(List=range)
pt = ConstructPoint(XCoordinate=crossref.ListA, YCoordinate=crossref.ListB, ZCoordinate=crossref.ListC)
mindex = MemberIndex(Set=crossref.ListC, Member=ins)  # -> Index, Count
item = ListItem(List=pt, Index=mindex.Index, Wrap=True)
partition = PartitionList(List=item, Size=lng)  # -> simplify(graft(Chunks))

# ---- group: Works but very suspicious
merge = Merge(Data1=yx_grid, Data2=standard_height, Data3=standard_height)
ma = MassAddition(Input=merge)  # -> Result, PartialResults
lng_2 = ListLength(List=merge)
division = Division(A=ma.Result, B=lng_2)
sqrt = SquareRoot(Value=division)

# ----
simplexperlin = SimplexPerlin(Seed=1, Quality=2, gradient="tundraGradient")
translate = Translate(Module=simplexperlin, X=Slider(0.468, range=0..1), Y=Slider(1, range=0..1), Z=0, gradient="tundraGradient")
number_slider_3 = Slider(0.05, range=0..1)
scale = Scale(Module=translate, XScale=number_slider_3, YScale=number_slider_3, ZScale=1, gradient="tundraGradient")

relitem = RelativeItem(Tree=partition, Offset="{0;0;1}", WrapPaths=False, WrapItems=False)  # -> ItemA, ItemB
relitem_2 = RelativeItem(Tree=partition, Offset="{0;1;0}", WrapPaths=False, WrapItems=False)  # -> ItemA, ItemB
ln = Line(StartPoint=relitem.ItemA, EndPoint=relitem.ItemB)
ln_2 = Line(StartPoint=relitem_2.ItemA, EndPoint=relitem_2.ItemB)

relitem_3 = RelativeItem(Tree=partition, Offset="{1;0;0}", WrapPaths=False, WrapItems=False)  # -> ItemA, ItemB
ln_3 = Line(StartPoint=relitem_3.ItemA, EndPoint=relitem_3.ItemB)

relitem_4 = RelativeItem(Tree=partition, Offset="{1;1;1}", WrapPaths=False, WrapItems=False)  # -> ItemA, ItemB
merge_2 = Merge(Data1=relitem_4.ItemA, Data2=relitem_4.ItemB)
box = Box2Pt(PointA=relitem_4.ItemA, PointB=relitem_4.ItemB, Plane=PlaneXY(0, 0, 0))
avr = Average(Input=merge_2)

flatten = FlattenTree(Tree=partition, Path="{0}")
item_2 = ListItem(List=flatten, Index=0, Wrap=True)  # -> Item1, Item
box_2 = Box2Pt(PointA=item_2.Item1, PointB=item_2.Item, Plane=PlaneXY(0, 0, 0))

split = SplitTree(Data=avr, Masks=flatten("{0;?;?}"))  # -> simplify(Positive), Negative
getvalue = GetValue(Module=scale, Point=flatten(split.Positive))

subtraction = Subtraction(A=floor_count, B="0")
bnd = Bounds(Numbers=getvalue)
dom = ConstructDomain(DomainStart="0", DomainEnd=subtraction)
remap = RemapNumbers(Value=getvalue, Source=bnd, Target=dom)  # -> Mapped, Clipped
round = Round(Number=remap.Mapped)  # -> graft(Nearest), Floor, Ceiling
unflatten = UnflattenTree(Tree=round.Nearest, Guide=split.Positive)

series_2 = Series(Start=0, Step=1, Count=unflatten)  # -> simplify(Series)
clean = CleanTree(RemoveNulls=True, RemoveInvalid=True, RemoveEmpty=invert(False), Tree=series_2)
tstat = TreeStatistics(Tree=clean)  # -> Paths, Length, Count
branch = TreeBranch(Tree=split.Positive, Path=tstat.Paths, MaintainPaths=True)
tstat_2 = TreeStatistics(Tree=branch)  # -> Paths, Length, Count
lng_3 = ListLength(List=clean)
unflatten_2 = UnflattenTree(Tree=tstat_2.Paths, Guide=branch)
dup = DuplicateData(Data=unflatten_2, Number=lng_3, Order=True)
pshift = ShiftPaths(Data=dup, Offset=-1)
clean_2 = CleanTree(RemoveNulls=True, RemoveInvalid=True, RemoveEmpty=invert(False), Tree=pshift)
tstat_3 = TreeStatistics(Tree=clean_2)  # -> Paths, Length, Count
branch_2 = TreeBranch(Tree=clean, Path=tstat_3.Paths, MaintainPaths=True)  # -> simplify(graft(Branch))
dpath = DeconstructPath(Branch=clean_2)  # -> simplify(Indices)
ins_2 = InsertItems(List=dpath, Item=branch_2, Indices="0", Wrap=True)
path = ConstructPath(Indices=ins_2)
split_2 = SplitTree(Data=box, Masks=flatten(path))  # -> Positive, Negative
split_3 = SplitTree(Data=avr, Masks=flatten(path))  # -> Positive, Negative

box_3 = EvaluateBox(
    Box=box_2,
    UParameter=Slider(0.3346, range=0..1),
    VParameter=Slider(0.787, range=0..1),
    WParameter=Slider(0.0925, range=0..1))  # -> Plane, Point, Include
cp = ClosestPoint(Point=box_3.Point, Cloud=flatten(avr))  # -> ClosestPoint, CPIndex, Distance
tstat_4 = TreeStatistics(Tree=avr)  # -> Paths, Length, Count
item_3 = ListItem(List=simplify(tstat_4.Paths), Index=cp.CPIndex, Wrap=True)

dpath_2 = DeconstructPath(Branch=item_3)  # -> simplify(Indices)
lng_4 = ListLength(List=flatten(dpath_2))
dup_2 = DuplicateData(Data=dpath_2, Number=lng_4, Order=True)
dup_3 = DuplicateData(Data="?", Number=lng_4, Order=True)
series_3 = Series(Start=0, Step=1, Count=lng_4)
partition_2 = PartitionList(List=dup_2, Size=lng_4)
replace = ReplaceItems(List=partition_2, Item=graft(dup_3), Indices=graft(series_3), Wrap=False)
conmask = ConstructPathMask(IndexCharacters=replace)  # -> simplify(Mask)

subtraction_2 = Subtraction(A=Slider(5, range=3..10), B="1")
dom_2 = ConstructDomain(DomainStart=0, DomainEnd=subtraction_2)
range_3 = Range(Domain=dom_2, Steps=subtraction_2)
Z = UnitZ(Factor=range_3)
pt_2 = ConstructPoint(XCoordinate=range_3, YCoordinate=graft(range_3), ZCoordinate=0)  # -> simplify(graft(Point))
move = Move(Geometry=pt_2, Motion=Z)  # -> graft(Geometry), Transform
split_4 = SplitTree(Data=split_3.Positive, Masks=flatten(conmask))  # -> Positive, Negative
split_5 = SplitTree(Data=split_2.Positive, Masks=flatten(conmask))  # -> Positive, Negative
lng_5 = ListLength(List=flatten(move.Geometry))
multiplication_3 = Multiplication(A=lng_5, B=Slider(0.537, range=0..1))

edges = BrepEdges(Brep=split_2.Positive)  # -> Naked, Interior, NonManifold
previewlw = CustomPreviewLineweights(Geometry=edges.Interior, Shader=ColourSwatch(SwatchColor=RGB(0, 0, 0)), Absolute=False)

edges_2 = BrepEdges(Brep=split_5.Positive)  # -> Naked, Interior, NonManifold
reduce = RandomReduce(List=flatten(move.Geometry), Reduction=multiplication_3, Seed=Slider(0, range=0..10))

# ----
# Filter only the attached blocks
tstat_5 = TreeStatistics(Tree=simplify(split_5.Positive))  # -> Paths, Length, Count
txt = Text(tstat_5.Paths)
txt_2 = Text(item_3)
dpath_3 = DeconstructPath(Branch=tstat_5.Paths)
mindex_2 = MemberIndex(Set=txt, Member=txt_2)  # -> Index, Count
flip = FlipMatrix(Data=dpath_3)
python = GhPythonScript(V=flip, I=mindex_2.Index)  # -> out, B; inputs V: list
# ---------- python: Python ----------
__author__ = "Antoine"
__version__ = "2022.02.02"

V_length = len(V)

start_index = I
# ---------- end python ----------
panel = Panel(python.out)
panel_2 = Panel(flip)

pdecon = Deconstruct(Point=reduce)  # -> XComponent, YComponent, ZComponent
previewlw_2 = CustomPreviewLineweights(
    Geometry=edges_2.Interior,
    Shader=ColourSwatch(SwatchColor=RGB(255, 0, 0)),
    Thickness=Slider(10, range=0..10),
    Absolute=False)
merge_3 = Merge(
    Data1=simplify(graft(pdecon.YComponent)),
    Data2=simplify(graft(pdecon.XComponent)),
    Data3=simplify(graft(pdecon.ZComponent)))

# ---- group: I challenge you to find faster than me
debrep = DeconstructBrep(Brep=split_2.Positive)  # -> reparameterize(Faces), Edges, Vertices

# ----
path_2 = ConstructPath(Indices=merge_3)

evalsrf = EvaluateSurface(Surface=debrep.Faces, Point="0.5,0.5,0")  # -> Point, Normal, UDirection, VDirection, Frame
avr_2 = Average(Input=debrep.Vertices)  # -> simplify(ArithmeticMean)
addition = Addition(A=evalsrf.Point, B=evalsrf.Normal)
cp_2 = ClosestPoint(Point=addition, Cloud=flatten(avr_2))  # -> ClosestPoint, CPIndex, simplify(Distance)
smaller = SmallerThan(FirstNumber=simplify(cp_2.Distance), SecondNumber=sqrt)  # -> SmallerThan, OrEqualTo

path_3 = FilePath()
branch_3 = TreeBranch(Tree=move.Geometry, Path=path_2, MaintainPaths=True)
file = ReadFile(File=path_3, PerLineParse=False)

relitem_5 = RelativeItem(Tree=split_3.Positive, Offset="{1;0;0}", WrapPaths=False, WrapItems=False)  # -> ItemA, ItemB
ln_4 = Line(StartPoint=relitem_5.ItemA, EndPoint=relitem_5.ItemB)

relitem_6 = RelativeItem(Tree=split_3.Positive, Offset="{0;0;1}", WrapPaths=False, WrapItems=False)  # -> ItemA, ItemB
relitem_7 = RelativeItem(Tree=split_3.Positive, Offset="{0;1;0}", WrapPaths=False, WrapItems=False)  # -> ItemA, ItemB
ln_5 = Line(StartPoint=relitem_6.ItemA, EndPoint=relitem_6.ItemB)
ln_6 = Line(StartPoint=relitem_7.ItemA, EndPoint=relitem_7.ItemB)

python_2 = GhPythonScript(Code=file)  # -> Out, A
relitem_8 = RelativeItem(Tree=branch_3, Offset="{0;1;0}", WrapPaths=False, WrapItems=False)  # -> ItemA, ItemB
relitem_9 = RelativeItem(Tree=branch_3, Offset="{1;0;0}", WrapPaths=False, WrapItems=False)  # -> ItemA, ItemB
relitem_10 = RelativeItem(Tree=branch_3, Offset="{0;0;1}", WrapPaths=False, WrapItems=False)  # -> ItemA, ItemB
ln_7 = Line(StartPoint=relitem_8.ItemA, EndPoint=relitem_8.ItemB)
ln_8 = Line(StartPoint=relitem_9.ItemA, EndPoint=relitem_9.ItemB)
ln_9 = Line(StartPoint=relitem_10.ItemA, EndPoint=relitem_10.ItemB)

previewlw_3 = CustomPreviewLineweights(Geometry=[ln_5, ln_6], Shader=ColourSwatch(SwatchColor=RGB(255, 0, 0)), Thickness=Slider(6, range=0..10), Absolute=False)
previewlw_4 = CustomPreviewLineweights(Geometry=ln_4, Shader=ColourSwatch(SwatchColor=RGB(0, 17, 255)), Thickness=Slider(6, range=0..10), Absolute=False)

merge_4 = Merge(Data1=ln_4, Data2=ln_6, Data3=ln_5)  # -> flatten(Result)
dispatch = Dispatch(List=evalsrf.Frame, DispatchPattern=smaller.SmallerThan)  # -> graft(ListA), graft(ListB)
dispatch_2 = Dispatch(List=debrep.Faces, DispatchPattern=smaller.SmallerThan)  # -> graft(ListA), graft(ListB)
merge_5 = Merge(Data1=ln_8, Data2=ln_7, Data3=ln_9)  # -> flatten(Result)

deplane = DeconstructPlane(Plane=dispatch.ListB)  # -> Origin, XAxis, YAxis, ZAxis
devec = DeconstructVector(Vector=deplane.ZAxis)  # -> XComponent, YComponent, ZComponent
abs = Absolute(Value=devec.ZComponent)
larger = LargerThan(FirstNumber=abs, SecondNumber="0")  # -> LargerThan, OrEqualTo
larger_2 = LargerThan(FirstNumber=devec.ZComponent, SecondNumber="0")  # -> LargerThan, OrEqualTo
dispatch_3 = Dispatch(List=dispatch.ListB, DispatchPattern=larger.LargerThan)  # -> ListA, ListB
dispatch_4 = Dispatch(List=larger_2.LargerThan, DispatchPattern=larger.LargerThan)  # -> ListA, ListB
dispatch_5 = Dispatch(List=dispatch_3.ListA, DispatchPattern=dispatch_4.ListA)  # -> ListA, ListB

deplane_2 = DeconstructPlane(Plane=dispatch.ListA)  # -> Origin, XAxis, YAxis, ZAxis
devec_2 = DeconstructVector(Vector=deplane_2.ZAxis)  # -> XComponent, YComponent, ZComponent
abs_2 = Absolute(Value=devec_2.ZComponent)
larger_3 = LargerThan(FirstNumber=abs_2, SecondNumber="0")  # -> LargerThan, OrEqualTo
dispatch_6 = Dispatch(List=dispatch_2.ListA, DispatchPattern=larger_3.LargerThan)  # -> ListA, ListB

l_net = NetworkFromLines(Lines=flatten(merge_4))  # -> simplify(PointPointTopology), simplify(ConnectionPointTopology), Points, Lines

pt_3 = Point(flatten(split_3.Positive))
mindex_3 = MemberIndex(Set=pt_3, Member=l_net.Points)  # -> flatten(Index), Count
item_4 = ListItem(List=flatten(split_3.Positive), Index=mindex_3.Index, Wrap=True)

mindex_4 = MemberIndex(Set=flatten(split_3.Positive), Member=l_net.Points)  # -> Index, Count

tstat_6 = TreeStatistics(Tree=l_net.PointPointTopology)  # -> Paths, Length, Count
graft = GraftTree(Tree=l_net.PointPointTopology, IncludeEmptyLists=True, IncludeNullItems=True)  # -> simplify(Tree)
dpath_4 = DeconstructPath(Branch=tstat_6.Paths)
item_5 = ListItem(List=l_net.Points, Index=l_net.PointPointTopology, Wrap=True)
item_6 = ListItem(List=l_net.Points, Index=dpath_4, Wrap=True)
ln_10 = Line(StartPoint=item_5, EndPoint=item_6)  # -> graft(Line)
eval = EvaluateCurve(Curve=reparameterize(ln_10), Parameter=".5")  # -> Point, Tangent, Angle
devec_3 = DeconstructVector(Vector=eval.Tangent)  # -> XComponent, YComponent, ZComponent
abs_3 = Absolute(Value=devec_3.ZComponent)
smaller_2 = SmallerThan(FirstNumber=abs_3, SecondNumber=".5")  # -> simplify(SmallerThan), OrEqualTo

item_7 = ListItem(List=flatten(split_2.Positive), Index=mindex_4.Index, Wrap=True)

tstat_7 = TreeStatistics(Tree=l_net.PointPointTopology)  # -> Paths, Length, Count
dpath_5 = DeconstructPath(Branch=tstat_7.Paths)
item_8 = ListItem(List=l_net.Points, Index=l_net.PointPointTopology, Wrap=True)
item_9 = ListItem(List=l_net.Points, Index=dpath_5, Wrap=True)
ln_11 = Line(StartPoint=item_8, EndPoint=item_9)
eval_2 = EvaluateCurve(Curve=reparameterize(ln_11), Parameter=".5")  # -> Point, Tangent, Angle
devec_4 = DeconstructVector(Vector=eval_2.Tangent)  # -> XComponent, YComponent, ZComponent
abs_4 = Absolute(Value=devec_4.ZComponent)
smaller_3 = SmallerThan(FirstNumber=abs_4, SecondNumber=".5")  # -> simplify(SmallerThan), OrEqualTo

panel_3 = Panel(l_net.PointPointTopology)
points = PointList(Points=l_net.Points, Size=".8")

# ---- group: get general direction of the edge
devec_5 = DeconstructVector(Vector=eval.Tangent)  # -> XComponent, YComponent, ZComponent
devec_6 = DeconstructVector(Vector=eval.Tangent)  # -> XComponent, YComponent, ZComponent
devec_7 = DeconstructVector(Vector=eval.Tangent)  # -> XComponent, YComponent, ZComponent
abs_5 = Absolute(Value=devec_5.XComponent)
abs_6 = Absolute(Value=devec_6.YComponent)
abs_7 = Absolute(Value=devec_7.ZComponent)
larger_4 = LargerThan(FirstNumber=abs_5, SecondNumber="0")  # -> LargerThan, OrEqualTo
larger_5 = LargerThan(FirstNumber=abs_6, SecondNumber="0")  # -> LargerThan, OrEqualTo
larger_6 = LargerThan(FirstNumber=abs_7, SecondNumber="0")  # -> LargerThan, OrEqualTo
cull = CullPattern(List=devec_5.XComponent, CullPattern=larger_4.LargerThan)
cull_2 = CullPattern(List=devec_6.YComponent, CullPattern=larger_5.LargerThan)
cull_3 = CullPattern(List=devec_7.ZComponent, CullPattern=larger_6.LargerThan)
clean_3 = CleanTree(RemoveNulls=True, RemoveInvalid=True, RemoveEmpty=invert(False), Tree=cull)  # -> simplify(Tree)
clean_4 = CleanTree(RemoveNulls=True, RemoveInvalid=True, RemoveEmpty=invert(False), Tree=cull_2)  # -> simplify(Tree)
clean_5 = CleanTree(RemoveNulls=True, RemoveInvalid=True, RemoveEmpty=invert(False), Tree=cull_3)  # -> simplify(Tree)

# ----
clean_6 = CleanTree(RemoveNulls=True, RemoveInvalid=True, RemoveEmpty=invert(False), Tree=simplify(dispatch_3.ListB))
tstat_8 = TreeStatistics(Tree=clean_6)  # -> Paths, Length, Count
split_6 = SplitTree(Data=simplify(dispatch_2.ListB), Masks=flatten(tstat_8.Paths))  # -> Positive, Negative

pshift_2 = ShiftPaths(Data=split_6.Positive, Offset=-1)
tstat_9 = TreeStatistics(Tree=split_2.Positive)  # -> Paths, Length, Count
tstat_10 = TreeStatistics(Tree=pshift_2)  # -> Paths, Length, Count
python_3 = GhPythonScript(x=tstat_9.Paths, y=tstat_10.Paths)  # -> a, b; inputs x: list, y: list
# ---------- python_3: Python ----------
__author__ = "Win"
__version__ = "2022.05.03"

# associate the right inputs
if len(x) < len(y):
    smaller = x
    larger = y
else:
    smaller = y
    larger = x

# create the empty lists
a = []
b = []

# append to each lists
for i in larger:
    if i in smaller:
        a.append(i)
    else:
        b.append(i)
# ---------- end python_3 ----------
branch_4 = TreeBranch(Tree=split_2.Positive, Path=python_3.b, MaintainPaths=True)
long = LongestList(ListA=python_3.a, ListB="True", PaddingMode=2)  # -> ListA, ListB
long_2 = LongestList(ListA=python_3.b, ListB="False", PaddingMode=2)  # -> ListA, ListB
tree = CreateTree(Data=long.ListB, Path=python_3.a)
tree_2 = CreateTree(Data=long_2.ListB, Path=python_3.b)
merge_6 = Merge(Data1=tree, Data2=tree_2)
item_10 = ListItem(List=flatten(merge_6), Index=mindex_3.Index, Wrap=True)  # -> graft(Item)

lng_6 = ListLength(List=pshift_2)
long_3 = LongestList(ListA=python_3.b, ListB="0", PaddingMode=2)  # -> ListA, ListB
tree_3 = CreateTree(Data=long_3.ListB, Path=python_3.b)
merge_7 = Merge(Data1=lng_6, Data2=tree_3)
item_11 = ListItem(List=flatten(merge_7), Index=mindex_3.Index, Wrap=True)  # -> graft(Item)

clean_7 = CleanTree(RemoveNulls=True, RemoveInvalid=True, RemoveEmpty=invert(False), Tree=simplify(dispatch_5.ListA))
tstat_11 = TreeStatistics(Tree=clean_7)  # -> Paths, Length, Count
split_7 = SplitTree(Data=simplify(dispatch_2.ListB), Masks=flatten(tstat_11.Paths))  # -> Positive, Negative

clean_8 = CleanTree(RemoveNulls=True, RemoveInvalid=True, RemoveEmpty=invert(False), Tree=simplify(dispatch_5.ListB))
tstat_12 = TreeStatistics(Tree=clean_8)  # -> Paths, Length, Count
split_8 = SplitTree(Data=simplify(dispatch_2.ListB), Masks=flatten(tstat_12.Paths))  # -> Positive, Negative

concat = Concatenate(FragmentA="http://127.0.0.1:5000/", FragmentB="ajd_to_net")
hops = Hops(
    CacheResultsInMemory=False,
    CacheSolveResults=False,
    RemoteSolveVersion=(0, 1, 0),
    ShowInput_Enabled=False,
    ShowInput_Path=True,
    SynchronousSolve=True)
long_4 = LongestList(ListA=clean_3, ListB="East-West", PaddingMode=2)  # -> ListA, ListB
long_5 = LongestList(ListA=clean_4, ListB="North-South", PaddingMode=2)  # -> ListA, ListB
long_6 = LongestList(ListA=clean_5, ListB="Up-Down", PaddingMode=2)  # -> ListA, ListB

preview = CustomPreview(Geometry=split_6.Positive, Material=ColourSwatch(SwatchColor=RGBA(0, 255, 229, 150)))  # disabled
preview_2 = CustomPreview(Geometry=dispatch_6.ListA, Material=ColourSwatch(SwatchColor=RGBA(115, 255, 0, 150)))  # disabled
preview_3 = CustomPreview(Geometry=split_7.Positive, Material=ColourSwatch(SwatchColor=RGBA(255, 0, 119, 150)))  # disabled
preview_4 = CustomPreview(Geometry=split_8.Positive, Material=ColourSwatch(SwatchColor=RGBA(255, 183, 0, 150)))  # disabled

hops_2 = Hops(
    _Path=concat,
    Adjacency=l_net.PointPointTopology,
    Type=smaller_3.SmallerThan,
    WriteGmlFile=False,
    CacheResultsInMemory=False,
    CacheSolveResults=False,
    RemoteDefinitionLocation="http://127.0.0.1:5000/ajd_to_net",
    RemoteSolveVersion=(0, 1, 0),
    ShowInput_Enabled=False,
    ShowInput_Path=True,
    SynchronousSolve=True)

# ---- group: get general direction of the edge
merge_8 = Merge(Data1=long_4.ListB, Data2=long_5.ListB, Data3=long_6.ListB)

# ----
crv = Curve([<curve referenced from the Rhino model> x3])
concat_2 = Concatenate(FragmentA="http://127.0.0.1:5000/", FragmentB="path_index")
preview_5 = CustomPreview(Geometry=[split_6.Positive, split_7.Positive, split_8.Positive], Material=ColourSwatch(SwatchColor=RGBA(0, 0, 0, 33)))
preview_6 = CustomPreview(Geometry=dispatch_6.ListB, Material=ColourSwatch(SwatchColor=RGBA(255, 0, 0, 150)))  # disabled

graft_2 = GraftTree(Tree=l_net.PointPointTopology, IncludeEmptyLists=True, IncludeNullItems=True)  # -> simplify(Tree)
graft_3 = GraftTree(Tree=l_net.Points, IncludeEmptyLists=True, IncludeNullItems=True)  # -> simplify(Tree)

hops_3 = Hops(
    _Path=concat_2,
    Graph=hops_2,
    Source=Slider(40, range=0..173),
    Target=Slider(55, range=0..193),
    MaxPaths=Slider(-1, range=-1..15000),
    CacheResultsInMemory=False,
    CacheSolveResults=False,
    RemoteDefinitionLocation="http://127.0.0.1:5000/path_index",
    RemoteSolveVersion=(0, 1, 0),
    ShowInput_Enabled=False,
    ShowInput_Path=True,
    SynchronousSolve=True)  # -> SingleShortestPathsIndexes, AllPathsIndexes, ListPartitioner

panel_4 = Panel("""is_horizontal
direction""")
merge_9 = Merge(Data1=simplify(smaller_2.SmallerThan), Data2=simplify(merge_8))  # -> simplify(Result)

crv_2 = Curve(<curve referenced from the Rhino model>)
crv_cp = CurveClosestPoint(Point=graft(item_4), Curve=crv)  # -> Point, Parameter, Distance
division_2 = Division(A=yx_grid, B="2")
smaller_4 = SmallerThan(FirstNumber=crv_cp.Distance, SecondNumber=division_2)  # -> SmallerThan, OrEqualTo
cull_4 = CullPattern(List=crv_cp.Point, CullPattern=smaller_4.SmallerThan)  # -> simplify(List)
clean_9 = CleanTree(RemoveNulls=True, RemoveInvalid=True, RemoveEmpty=invert(False), Tree=cull_4)
tstat_13 = TreeStatistics(Tree=clean_9)  # -> Paths, Length, Count
dpath_6 = DeconstructPath(Branch=tstat_13.Paths)  # -> flatten(Indices)

pshift_3 = ShiftPaths(Data=split_6.Positive, Offset=-1)
hops_4 = Hops(
    CacheResultsInMemory=False,
    CacheSolveResults=False,
    RemoteSolveVersion=(0, 1, 0),
    ShowInput_Enabled=False,
    ShowInput_Path=True,
    SynchronousSolve=True)
tstat_14 = TreeStatistics(Tree=pshift_3)  # -> Paths, Length, Count
branch_5 = TreeBranch(Tree=split_2.Positive, Path=tstat_14.Paths, MaintainPaths=True)
panel_5 = Panel(graft_2)
panel_6 = Panel(merge_9)
panel_7 = Panel("""has_window
window_count
has_terrace_North
has_terrace_East
has_terrace_South
has_terrace_West
x_position
y_position
z_position""")
concat_3 = Concatenate(FragmentA="http://127.0.0.1:5000/", FragmentB="node_to_graph")
hops_5 = Hops(
    CacheResultsInMemory=False,
    CacheSolveResults=False,
    RemoteSolveVersion=(0, 1, 0),
    ShowInput_Enabled=False,
    ShowInput_Path=True,
    SynchronousSolve=True)
panel_8 = Panel("""has_window
window_count
has_terrace_North
z_position""")
concat_4 = Concatenate(FragmentA="http://127.0.0.1:5000/", FragmentB="read_node")
series_4 = Series(Start=0, Step=1, Count=10)
circulation_indexes = Panel("""10
11""")
concat_5 = Concatenate(FragmentA="http://127.0.0.1:5000/", FragmentB="add_edge_graph")
hops_6 = Hops(
    CacheResultsInMemory=False,
    CacheSolveResults=False,
    RemoteSolveVersion=(0, 1, 0),
    ShowInput_Enabled=False,
    ShowInput_Path=True,
    SynchronousSolve=True)
panel_9 = Panel("26")
circulation_indexes_2 = Panel(dpath_6)
all_apartments = Slider(0, range=0..1)
partition_3 = PartitionList(List=hops_3.AllPathsIndexes, Size=hops_3.ListPartitioner)  # -> simplify(Chunks)
concat_6 = Concatenate(FragmentA="http://127.0.0.1:5000/", FragmentB="many_apartments")

number_slider_4 = Slider(0.47, range=0..1)
number_slider_5 = Slider(89, range=0..200)
concat_7 = Concatenate(FragmentA="http://127.0.0.1:5000/", FragmentB="apartment_builder")

hops_7 = Hops(
    CacheResultsInMemory=False,
    CacheSolveResults=False,
    RemoteSolveVersion=(0, 1, 0),
    ShowInput_Enabled=False,
    ShowInput_Path=True,
    SynchronousSolve=True)
hops_8 = Hops(
    CacheResultsInMemory=False,
    CacheSolveResults=False,
    RemoteSolveVersion=(0, 1, 0),
    ShowInput_Enabled=False,
    ShowInput_Path=True,
    SynchronousSolve=True)
item_12 = ListItem(List=flatten(item_7), Index=partition_3, Wrap=True)
item_13 = ListItem(List=l_net.Points, Index=partition_3, Wrap=True)
pline = PolyLine(Vertices=item_13, Closed=False)  # -> simplify(Polyline)
hops_9 = Hops(
    CacheResultsInMemory=False,
    CacheSolveResults=False,
    RemoteSolveVersion=(0, 1, 0),
    ShowInput_Enabled=False,
    ShowInput_Path=True,
    SynchronousSolve=True)
hops_10 = Hops(
    CacheResultsInMemory=False,
    CacheSolveResults=False,
    RemoteSolveVersion=(0, 1, 0),
    ShowInput_Enabled=False,
    ShowInput_Path=True,
    SynchronousSolve=True)
concat_8 = Concatenate(FragmentA="http://127.0.0.1:5000/", FragmentB="remove_edges")
concat_9 = Concatenate(FragmentA="http://127.0.0.1:5000/", FragmentB="one_apartment")
lng_7 = ListLength()
avr_3 = Average()

tstat_15 = TreeStatistics(Tree=pline)  # -> Paths, Length, Count
subtraction_3 = Subtraction(A=tstat_15.Count, B="1")
max = Maximum(A=subtraction_3, B="1")
range_4 = Range(Domain=Domain(0, 1), Steps=max)  # -> graft(Range)
gradient = Gradient(
    LowerLimit=0,
    UpperLimit=1,
    Parameter=simplify(range_4),
    stops=[0: RGB(243, 57, 0), 0.118: RGB(236, 27, 60), 0.234: RGB(210, 0, 118), 0.336: RGB(103, 0, 120), 0.452: RGB(39, 72, 161), 0.559: RGB(1, 192, 229), 0.67: RGB(18, 178, 90), 0.775: RGB(79, 186, 8), 0.889: RGB(220, 237, 32), 1: RGB(247, 159, 20)])

panel_10 = Panel(lng_7)
rec = DataRecorder(avr_3, DataLimit=-10, RecordData=True)
hops_11 = Hops(
    CacheResultsInMemory=False,
    CacheSolveResults=False,
    RemoteSolveVersion=(0, 1, 0),
    ShowInput_Enabled=False,
    ShowInput_Path=True,
    SynchronousSolve=True)
avr_4 = Average(Input=rec)
num = Number(3.95510479)
num_2 = Number(avr_4)
panel_11 = Panel(num)
panel_12 = Panel(num_2)
number_slider_6 = Slider(6, range=0..212)
concat_10 = Concatenate(FragmentA="http://127.0.0.1:5000/", FragmentB="graph_attributes")
number_slider_7 = Slider(0, range=0..2043)
concat_11 = Concatenate(FragmentA="http://127.0.0.1:5000/", FragmentB="test")
pt_4 = ConstructPoint(XCoordinate=0, YCoordinate=0, ZCoordinate=0)
concat_12 = Concatenate(FragmentA="http://127.0.0.1:5000/", FragmentB="path_index")
hops_12 = Hops(
    CacheResultsInMemory=False,
    CacheSolveResults=False,
    RemoteSolveVersion=(0, 1, 0),
    ShowInput_Enabled=False,
    ShowInput_Path=True,
    SynchronousSolve=True)
number_slider_8 = Slider(10, range=0..10)
branch_6 = TreeBranch(Tree=item_12, Path=number_slider_6, MaintainPaths=True)
branch_7 = TreeBranch(Tree=gradient, Path=number_slider_6, MaintainPaths=True)
branch_8 = TreeBranch(Tree=pline, Path=number_slider_6, MaintainPaths=True)
branch_9 = TreeBranch(Tree=gradient, Path=number_slider_6, MaintainPaths=True)
hops_13 = Hops(
    CacheResultsInMemory=False,
    CacheSolveResults=False,
    RemoteSolveVersion=(0, 1, 0),
    ShowInput_Enabled=False,
    ShowInput_Path=True,
    SynchronousSolve=True)
concat_13 = Concatenate(FragmentA="http://127.0.0.1:5000/", FragmentB="evaluate_apartments")
edges_3 = BrepEdges(Brep=branch_6)  # -> Naked, Interior, NonManifold
previewlw_5 = CustomPreviewLineweights(Geometry=branch_8, Shader=branch_9, Thickness=number_slider_8, Absolute=False)
previewlw_6 = CustomPreviewLineweights(Geometry=pline, Shader=gradient, Thickness=number_slider_8, Absolute=False)
number_slider_9 = Slider(2, range=0..10)
previewlw_7 = CustomPreviewLineweights(Geometry=edges_3.Interior, Shader=ColourSwatch(SwatchColor=RGB(255, 255, 255)), Absolute=False)
number_slider_10 = Slider(0.3, range=0..1)
partition_4 = PartitionList(Size=[3, 2])  # -> simplify(Chunks)
preview_7 = CustomPreview(Geometry=branch_6, Material=branch_7)
item_14 = ListItem(List=flatten(item_7), Index=circulation_indexes_2, Wrap=True)
alpha = AdjustAlpha(Color=ColourSwatch(SwatchColor=RGB(110, 110, 110)), Alpha=number_slider_10)
preview_8 = CustomPreview(Geometry=item_14, Material=alpha)
number_slider_11 = Slider(3, range=0..12)
galapagos = Galapagos(fitness=avr_5, gene=[number_slider_4, number_slider_5])

# ---- group: terasses?
north_east_south_west = Panel("""{-1;1;0}
{-1;0;1}
{-1;-1;0}
{-1;0;-1}""")
tstat_16 = TreeStatistics(Tree=simplify(split_3.Positive))  # -> Paths, Length, Count
python_4 = GhPythonScript(D=north_east_south_west, O="{1;0;0}")  # -> simplify(P), simplify(B); inputs D: list, S: list, O: list
# ---------- python_4: Python ----------
"""Provides a scripting component.
    Inputs:
        D: Paths to offset
        S: (optional) Path to test for inclusion. If None, paths in D
        O: Offsets
    Output:
        P: New paths"""

__author__ = "Antoine Maes"
__version__ = "2022.05.10"

import Grasshopper.DataTree as ghdt
from ghpythonlib import treehelpers as th

def path_to_list(paths_list):
    list_paths_list = []
    for path in paths_list:
        temp_element = str(path)[1:-1]
        list_paths_list.append(temp_element.split(";"))
        
    return [[int(i) for i in j] for j in list_paths_list]


def offset_paths(list_of_path_as_list, offsets):

    off_nested_list = path_to_list(offsets)

    super_path = []
    for path in list_of_path_as_list:
        for offset in off_nested_list:
            new_path = []
            for int_idx in range(len(offset)):
                new_path.append(path[int_idx] + offset[int_idx])
                if len(new_path) == len(off_nested_list[0]):
                    super_path.append(new_path)
    return super_path


def list_to_paths(paths_as_list):
    paths = []
    for path in paths_as_list:
        paths.append("{" + ";".join([str(i) for i in path]) + "}")
    return paths


def reorder_path_list(list_to_reorder, offset_count):
    ordered = [[] for _ in range(offset_count)]

    for list_idx in range(len(list_to_reorder)):
        ordered[list_idx % offset_count].append(list_to_reorder[list_idx])
        
    return ordered


def bool_inclusion(new_paths, old_paths):
    bool_list = [[] for _ in new_paths]
    for path_list_idx in range(len(new_paths)):
        for path in new_paths[path_list_idx]:
            if path in [str(i) for i in old_paths]:
                bool_list[path_list_idx].append(True)
            else:
                bool_list[path_list_idx].append(False)
    return bool_list


if len(S) > 0:
    D = [str(i) for i in S]
else:
    D = [str(i) for i in D]


list_of_path_list = path_to_list(D)
offseted_path_list = offset_paths(list_of_path_list, O)

one_list_paths = list_to_paths(offseted_path_list)
ordered_list_paths = reorder_path_list(one_list_paths, len(O))

bools = bool_inclusion(ordered_list_paths, D)

B = th.list_to_tree(bools)
P = th.list_to_tree(ordered_list_paths)
# ---------- end python_4 ----------

# ----
item_15 = ListItem(List=tstat_16.Paths, Index=mindex_3.Index, Wrap=True)

# ---- group: terasses? (continued)
python_5 = GhPythonScript(D=item_15, O=north_east_south_west)  # -> simplify(P), simplify(B); inputs D: list, S: list, O: list; same code as python_4
python_6 = GhPythonScript(D=item_15, O=python_4.P)  # -> simplify(P), simplify(B); inputs D: list, S: list, O: list; same code as python_4
not = GateNot(A=python_6.B)
and = GateAnd(A=python_5.B, B=not)  # -> simplify(Result)

# ----
panel_13 = Panel(and)

branch_10 = TreeBranch(Tree=and, Path=Slider(1, range=0..3), MaintainPaths=True)
tag = TextTag(Location=split_3.Positive, Text=graft(branch_10), Colour=ColourSwatch(SwatchColor=RGB(0, 0, 0)))

pdecon_2 = Deconstruct(Point=flatten(l_net.Points))  # -> graft(XComponent), graft(YComponent), graft(ZComponent)
bang = ExplodeTree(Data=and)  # -> graft(Branch0), graft(Branch1), graft(Branch2), graft(Branch3)
merge_10 = Merge(
    Data1=simplify(item_10),
    Data2=simplify(item_11),
    Data3=simplify(bang.Branch0),
    Data4=simplify(bang.Branch1),
    Data5=simplify(bang.Branch2),
    Data6=simplify(bang.Branch3),
    Data7=simplify(pdecon_2.XComponent),
    Data8=simplify(pdecon_2.YComponent),
    Data9=simplify(pdecon_2.ZComponent))  # -> simplify(Result)

flatten_2 = FlattenTree(Tree=pdecon_2.ZComponent, Path="{0}")
panel_14 = Panel(flatten_2)
hops_14 = Hops(
    _Path=concat_3,
    NodeIndexes=graft_3,
    Attributes=merge_10,
    Labels=panel_7,
    CacheResultsInMemory=False,
    CacheSolveResults=False,
    RemoteDefinitionLocation="http://127.0.0.1:5000/node_to_graph",
    RemoteSolveVersion=(0, 1, 0),
    ShowInput_Enabled=False,
    ShowInput_Path=True,
    SynchronousSolve=True)
panel_15 = Panel(hops_14)
hops_15 = Hops(
    _Path=concat_4,
    Graph=hops_14,
    Attributes=panel_8,
    Index=-1,
    CacheResultsInMemory=False,
    CacheSolveResults=False,
    RemoteDefinitionLocation="http://127.0.0.1:5000/read_node",
    RemoteSolveVersion=(0, 1, 0),
    ShowInput_Enabled=False,
    ShowInput_Path=True,
    SynchronousSolve=True)  # -> Values, ListPartitioner
partition_5 = PartitionList(List=hops_15.Values, Size=hops_15.ListPartitioner)  # -> simplify(Chunks)
flip_2 = FlipMatrix(Data=partition_5)
hops_16 = Hops(
    _Path=concat_5,
    Graph=hops_14,
    NodeIndexes=graft_2,
    Attributes=merge_9,
    Labels=panel_4,
    CacheResultsInMemory=False,
    CacheSolveResults=False,
    RemoteDefinitionLocation="http://127.0.0.1:5000/add_edge_graph",
    RemoteSolveVersion=(0, 1, 0),
    ShowInput_Enabled=False,
    ShowInput_Path=True,
    SynchronousSolve=True)
panel_16 = Panel(flip_2)

concat_14 = Concatenate(FragmentA="http://127.0.0.1:5000/", FragmentB="random_apartment")
hops_17 = Hops(
    _Path=concat_14,
    Graph=hops_16,
    Start=Slider(30, range=0..55),
    Length=Slider(7, range=0..12),
    Compacity=Slider(0.74, range=0..1),
    Targets=Slider(1, range=0..1),
    Filter=Toggle(True),
    CacheResultsInMemory=False,
    CacheSolveResults=False,
    RemoteDefinitionLocation="http://127.0.0.1:5000/random_apartment",
    RemoteSolveVersion=(0, 1, 0),
    ShowInput_Enabled=False,
    ShowInput_Path=True,
    SynchronousSolve=True)  # -> Message, ApartIndexes, ListPartitioner

concat_15 = Concatenate(FragmentA="http://127.0.0.1:5000/", FragmentB="random_apartment_AB")
hops_18 = Hops(
    _Path=concat_15,
    Graph=hops_16,
    Start=Slider(9, range=0..55),
    Target=Slider(24, range=0..55),
    Length=Slider(6, range=0..10),
    Filter=Toggle(False),
    CacheResultsInMemory=False,
    CacheSolveResults=False,
    RemoteDefinitionLocation="http://127.0.0.1:5000/random_apartment_AB",
    RemoteSolveVersion=(0, 1, 0),
    ShowInput_Enabled=False,
    ShowInput_Path=True,
    SynchronousSolve=True)  # -> ApartIndexes, ListPartitioner

hops_19 = Hops(
    _Path=concat_6,
    Graph=hops_16,
    CirculationIndexes=circulation_indexes,
    Length=Slider(5, range=0..12),
    Compacity=Slider(0.59, range=0..1),
    Seed=Slider(9, range=0..10),
    Filter=Toggle(True),
    CacheResultsInMemory=False,
    CacheSolveResults=False,
    RemoteDefinitionLocation="http://127.0.0.1:5000/many_apartments",
    RemoteSolveVersion=(0, 1, 0),
    ShowInput_Enabled=False,
    ShowInput_Path=True,
    SynchronousSolve=True)  # -> Message, ApartIndexes, ListPartitioner

hops_20 = Hops(
    _Path=concat_8,
    Graph=hops_16,
    EdgeAttribute="is_horizontal",
    EdgeValue="False",
    CacheResultsInMemory=False,
    CacheSolveResults=False,
    RemoteDefinitionLocation="http://127.0.0.1:5000/remove_edges",
    RemoteSolveVersion=(0, 1, 0),
    ShowInput_Enabled=False,
    ShowInput_Path=True,
    SynchronousSolve=True)

hops_21 = Hops(
    _Path=concat_7,
    Graph=hops_16,
    CirculationIndexes=circulation_indexes_2,
    MaxLength=Slider(4, range=2..10),
    MinLength=Slider(3, range=2..10),
    Compacity=number_slider_4,
    Seed=number_slider_5,
    CacheResultsInMemory=False,
    CacheSolveResults=False,
    RemoteDefinitionLocation="http://127.0.0.1:5000/apartment_builder",
    RemoteSolveVersion=(0, 1, 0),
    ShowInput_Enabled=False,
    ShowInput_Path=True,
    SynchronousSolve=True)  # -> NewGraph, ApartIndexes, ListPartitioner
partition_6 = PartitionList(List=hops_17.ApartIndexes, Size=hops_17.ListPartitioner)  # -> simplify(Chunks)

number_slider_12 = Slider(13, range=0..55)
panel_17 = Panel()
hops_22 = Hops(
    _Path=concat_9,
    Graph=hops_16,
    Index=number_slider_12,
    Length=Slider(4, range=1..10),
    Attributes=panel_17,
    CacheResultsInMemory=False,
    CacheSolveResults=False,
    RemoteDefinitionLocation="http://127.0.0.1:5000/one_apartment",
    RemoteSolveVersion=(0, 1, 0),
    ShowInput_Enabled=False,
    ShowInput_Path=True,
    SynchronousSolve=True)  # -> FurthestReachableIndexes, AllReachableIndexes, Values

tstat_17 = TreeStatistics(Tree=partition_6)  # -> Paths, Length, Count
partition_7 = PartitionList(List=hops_21.ApartIndexes, Size=hops_21.ListPartitioner)  # -> simplify(Chunks)
cset = CreateSet(List=hops_21.ListPartitioner)  # -> Set, Map
subtraction_4 = Subtraction(A=tstat_17.Count, B="1")
panel_18 = Panel(cset.Set)
multiplication_4 = Multiplication(A=subtraction_4, B=all_apartments)
panel_19 = Panel(hops_21.NewGraph)
item_16 = ListItem(List=tstat_17.Paths, Index=multiplication_4, Wrap=True)
lng_8 = ListLength(List=flatten(hops_22.FurthestReachableIndexes))
branch_11 = TreeBranch(Tree=partition_6, Path=item_16, MaintainPaths=True)
subtraction_5 = Subtraction(A=lng_8, B="1")

# ---- group: Furthest reachable blocs for apart length
item_17 = ListItem(List=flatten(item_7), Index=hops_22.FurthestReachableIndexes, Wrap=True)

# ----
multiplication_5 = Multiplication(A=subtraction_5, B=Slider(0.9043, range=0..1))
item_18 = ListItem(List=hops_22.FurthestReachableIndexes, Index=multiplication_5, Wrap=True)
item_19 = ListItem(List=flatten(item_7), Index=branch_11, Wrap=True)

hops_23 = Hops(
    _Path=concat_12,
    Graph=hops_16,
    Source=item_18,
    Target=number_slider_12,
    MaxPaths=Slider(-1, range=-1..15000),
    CacheResultsInMemory=False,
    CacheSolveResults=False,
    RemoteDefinitionLocation="http://127.0.0.1:5000/path_index",
    RemoteSolveVersion=(0, 1, 0),
    ShowInput_Enabled=False,
    ShowInput_Path=True,
    SynchronousSolve=True)  # -> SingleShortestPathsIndexes, AllPathsIndexes, ListPartitioner

item_20 = ListItem(List=flatten(item_7), Index=partition_7, Wrap=True)
lng_9 = ListLength(List=item_20)
lng_10 = ListLength(List=item_19)
hops_24 = Hops(
    _Path=concat_10,
    Graph=hops_16,
    CacheResultsInMemory=False,
    CacheSolveResults=False,
    RemoteDefinitionLocation="http://127.0.0.1:5000/graph_attributes",
    RemoteSolveVersion=(0, 1, 0),
    ShowInput_Enabled=False,
    ShowInput_Path=True,
    SynchronousSolve=True)  # -> NodeAttributeList, EdgeAttributeList
lng_11 = ListLength(List=flatten(lng_9))
subtraction_6 = Subtraction(A=lng_10, B="1")
item_21 = ListItem(List=hops_24.NodeAttributeList, Index=Slider(1, range=0..8), Wrap=True)
panel_20 = Panel(item_21)
subtraction_7 = Subtraction(A=lng_11, B="1")
range_5 = Range(Domain=Domain(0, 1), Steps=subtraction_6)
edges_4 = BrepEdges(Brep=item_19)  # -> Naked, Interior, NonManifold
range_6 = Range(Domain=Domain(0, 1), Steps=subtraction_7)
hops_25 = Hops(
    _Path=concat_13,
    Graph=hops_16,
    ApartmentsIndexes=partition_7,
    Attribute=item_21,
    CacheResultsInMemory=False,
    CacheSolveResults=False,
    RemoteDefinitionLocation="http://127.0.0.1:5000/evaluate_apartments",
    RemoteSolveVersion=(0, 1, 0),
    ShowInput_Enabled=False,
    ShowInput_Path=True,
    SynchronousSolve=True)  # -> Values, ValueListPartitioner
hsl = ColourHSL(Alpha=Slider(0.6, range=0..1), Hue=ColourSwatch(SwatchColor=RGB(255, 0, 0)), Saturation=1, Luminance=range_5)
edges_5 = BrepEdges(Brep=item_20)  # -> Naked, Interior, NonManifold
gradient_2 = Gradient(
    LowerLimit=0,
    UpperLimit=1,
    Parameter=range_6,
    stops=[0: RGB(243, 57, 0), 0.114: RGB(236, 27, 60), 0.221: RGB(210, 0, 118), 0.336: RGB(103, 0, 120), 0.447: RGB(39, 72, 161), 0.555: RGB(1, 192, 229), 0.668: RGB(18, 178, 90), 0.781: RGB(79, 186, 8), 0.888: RGB(220, 237, 32), 1: RGB(247, 159, 20)])
previewlw_8 = CustomPreviewLineweights(
    Geometry=edges_4.Interior,
    Shader=ColourSwatch(SwatchColor=RGB(255, 255, 255)),
    Thickness=Slider(2, range=0..10),
    Absolute=False)
preview_9 = CustomPreview(Geometry=item_19, Material=hsl)
panel_21 = Panel(partition_7)
partition_8 = PartitionList(List=hops_25.Values, Size=hops_25.ValueListPartitioner)  # -> simplify(Chunks)
partition_9 = PartitionList(List=hops_23.AllPathsIndexes, Size=hops_23.ListPartitioner)  # -> simplify(Chunks)
previewlw_9 = CustomPreviewLineweights(
    Geometry=edges_5.Interior,
    Shader=ColourSwatch(SwatchColor=RGB(255, 255, 255)),
    Thickness=number_slider_9,
    Absolute=False)
alpha_2 = AdjustAlpha(Color=gradient_2, Alpha=number_slider_10)
item_22 = ListItem(List=flatten(item_7), Index=partition_9, Wrap=True)
item_23 = ListItem(List=l_net.Points, Index=partition_9, Wrap=True)
num_3 = Number(partition_8)
preview_10 = CustomPreview(Geometry=item_20, Material=graft(alpha_2))
previewlw_10 = CustomPreviewLineweights(Geometry=edges_5.Interior, Shader=graft(alpha_2), Thickness=number_slider_9, Absolute=False)
pline_2 = PolyLine(Vertices=item_23, Closed=False)  # -> simplify(Polyline)
ma_2 = MassAddition(Input=num_3)  # -> Result, PartialResults
panel_22 = Panel(partition_8)
bnd_2 = Bounds(Numbers=flatten(ma_2.Result))
panel_23 = Panel(ma_2.Result)

tstat_18 = TreeStatistics(Tree=pline_2)  # -> Paths, Length, Count
subtraction_8 = Subtraction(A=tstat_18.Count, B="1")
max_2 = Maximum(A=subtraction_8, B="1")
range_7 = Range(Domain=Domain(0, 1), Steps=max_2)  # -> graft(Range)
gradient_3 = Gradient(
    LowerLimit=0,
    UpperLimit=1,
    Parameter=simplify(range_7),
    stops=[0: RGB(243, 57, 0), 0.118: RGB(236, 27, 60), 0.234: RGB(210, 0, 118), 0.336: RGB(103, 0, 120), 0.452: RGB(39, 72, 161), 0.559: RGB(1, 192, 229), 0.67: RGB(18, 178, 90), 0.775: RGB(79, 186, 8), 0.889: RGB(220, 237, 32), 1: RGB(247, 159, 20)])

remap_2 = RemapNumbers(Value=ma_2.Result, Source=bnd_2, Target=Domain(0, 1))  # -> Mapped, Clipped
item_24 = ListItem(List=flatten(l_net.Points), Index=partition_7, Wrap=True)
item_25 = ListItem(List=flatten(item_7), Index=partition_7, Wrap=True)
gradient_4 = Gradient(
    LowerLimit=0,
    UpperLimit=1,
    Parameter=remap_2.Mapped,
    stops=[0: RGB(234, 38, 0), 0.25: RGB(234, 126, 0), 0.5: RGB(254, 244, 84), 0.75: RGB(173, 203, 249), 1: RGB(75, 107, 169)])
concat_16 = Concatenate(FragmentA="average", FragmentB=item_21, JoinSeparator=" ")
scale_2 = Scale(Geometry=item_25, Center=item_24, Factor=".9")  # -> Geometry, Transform
edges_6 = BrepEdges(Brep=scale_2.Geometry)  # -> Naked, Interior, NonManifold
alpha_3 = AdjustAlpha(Color=gradient_4, Alpha=Slider(0.5, range=0..1))
pshift_4 = ShiftPaths(Data=edges_6.Interior, Offset=-1)
previewlw_11 = CustomPreviewLineweights(Geometry=pshift_4, Shader=graft(alpha_2), Thickness=Slider(8, range=0..10), Absolute=False)
preview_11 = CustomPreview(Geometry=scale_2.Geometry, Material=alpha_3)
avr_5 = Average(Input=flatten(ma_2.Result))
concat_17 = Concatenate(FragmentA=concat_16, FragmentB=avr_5, JoinSeparator=": ")

merge_11 = Merge(Data1=flatten(item_21), Data2=flatten(bnd_2), Data3=flatten(concat_17))
pt_5 = Point(Point(-5.870514314, 1.331740401, 0))
neg = Negative(Value=Slider(1.5, range=1..2))
lng_12 = ListLength(List=merge_11)
series_5 = Series(Start=0, Step=neg, Count=lng_12)
Z_2 = UnitZ(Factor=series_5)
move_2 = Move(Geometry=pt_5, Motion=Z_2)  # -> Geometry, Transform
tag_2 = TextTag(Location=move_2.Geometry, Text=merge_11)

branch_12 = TreeBranch(Tree=item_22, Path=number_slider_11, MaintainPaths=True)
branch_13 = TreeBranch(Tree=gradient_3, Path=number_slider_11, MaintainPaths=True)
edges_7 = BrepEdges(Brep=branch_12)  # -> Naked, Interior, NonManifold
preview_12 = CustomPreview(Geometry=branch_12, Material=branch_13)
previewlw_12 = CustomPreviewLineweights(Geometry=pline_2, Shader=gradient_3, Thickness=Slider(10, range=0..10), Absolute=False)
previewlw_13 = CustomPreviewLineweights(Geometry=edges_7.Interior, Shader=ColourSwatch(SwatchColor=RGB(255, 255, 255)), Absolute=False)
